# Grasshopper definition 001_OpenModelParams.gh (Grasshopper 1.0.7)
# Copyright: Arup
# plug-ins: GSA, sof_gh_sofistik_rhino

panel = Panel("C:\Users\Kristjan.Nielsen\Desktop\GSA-Grasshoppe\Cantilever model.gwb")
io = IO(
    SofistikDocumentProperties_VersionMajor="2020",
    SofistikDocumentProperties_VersionMinor="8",
    SofistikDocumentProperties_VersionName="Rhino-Interface")
open = OpenModel(FilenameAndPath=panel, File="C:\Users\Kristjan.Nielsen\Desktop\GSA-Grasshoppe\Cantilever model.gwb")
bool6 = CreateBool6(x=False, xx=False, y=False, yy=False, z=False, zz=False)
offset = CreateOffset(OffsetX1=0, OffsetX2=0, OffsetY=0, OffsetZ=0)
gsa = GSAModel(open)
getanalysis = GetModelAnalysis(GSAModel=gsa)  # -> AnalysisTasks, AnalysisCaseNames, LoadCaseCombinationID, AnalysisCaseDescription
getgeo = GetModelGeometry(GSAModel=gsa, NodeFilterList="All", ElementFilterList="All", MemberFilterList="All", Mode=0)  # -> Nodes, _1DElements, _2DElements, _3DElements, _1DMembers, _2DMembers, _3DMembers
getprops = GetModelProperties(GSAModel=gsa)  # -> Sections, _2DProperties, Springs
getloads = GetModelLoads(GSAModel=gsa)  # -> GravityLoads, NodeLoads, BeamLoads, FaceLoads, GridPointLoads, GridLineLoads, GridAreaLoads, GridPlaneSurfaces
panel_2 = Panel(getanalysis.AnalysisTasks)
panel_3 = Panel(getanalysis.AnalysisCaseNames)
pb = Section(getprops.Sections)
pa = _2DProperty(getprops._2DProperties)
ps = Spring(getprops.Springs)
b6 = Bool6(bool6)
of = Offset(offset)
ld = Load([getloads.GravityLoads, getloads.NodeLoads, getloads.BeamLoads, getloads.FaceLoads, getloads.GridPointLoads, getloads.GridLineLoads, getloads.GridAreaLoads])
gps = GridPlaneSurface(getloads.GridPlaneSurfaces)
panel_4 = Panel(getanalysis.LoadCaseCombinationID)
no = Node(getgeo.Nodes)
e1d = _1DElement(getgeo._1DElements)
e2d = _2DElement(getgeo._2DElements)
e3d = _3DElement(getgeo._3DElements)
m1d = _1DMember(getgeo._1DMembers)
m2d = _2DMember(getgeo._2DMembers)
m3d = _3DMember(getgeo._3DMembers)
panel_5 = Panel(getanalysis.AnalysisCaseDescription)
