# Grasshopper definition 101_CreatePA-PB.gh (Grasshopper 1.0.7)
# Copyright: Arup
# plug-ins: GSA, sof_gh_sofistik_rhino

io = IO(
    SofistikDocumentProperties_VersionMajor="2020",
    SofistikDocumentProperties_VersionMinor="8",
    SofistikDocumentProperties_VersionName="Rhino-Interface")
crv = Curve(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)
profile = CreateProfile(
    Search="heb",
    Mode=0,
    catalogueIndex=3,
    catalogueProfileName="All",
    catalogueTypeIndex=-1,
    catalogueTypeName="All",
    inclSS=False,
    isB2B=False,
    isElliptical=False,
    isGeneral=False,
    isHollow=False,
    isTapered=False,
    loadlistid=1,
    loadselectid=2,
    profilesContents0="All",
    profilesContents1="IPE IPE80",
    profilesContents10="IPE IPE160",
    profilesContents100="HE HE220.A",
    profilesContents101="HE HE180.B",
    profilesContents102="HE HE120.M",
    profilesContents103="HE HE260.AA",
    profilesContents104="HE HE.DILx200",
    profilesContents105="HE HE240.A",
    profilesContents106="HE HE280.AA",
    profilesContents107="HE HE200.B",
    profilesContents108="HE HE140.M",
    profilesContents109="HE HE.DILx220",
    profilesContents11="IPE IPE.Rx160",
    profilesContents110="HE HE260.A",
    profilesContents111="HE HE300.AA",
    profilesContents112="HE HE220.B"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)
profile_2 = CreateProfile(
    Boundary=crv,
    Mode=7,
    catalogueIndex=3,
    catalogueProfileName="All",
    catalogueTypeIndex=-1,
    catalogueTypeName="All",
    inclSS=False,
    isB2B=False,
    isElliptical=False,
    isGeneral=False,
    isHollow=False,
    isTapered=False,
    loadlistid=0,
    loadselectid=2,
    profilesContents0="All",
    profilesContents1="IPE IPE80",
    profilesContents10="IPE IPE160",
    profilesContents100="HE HE220.A",
    profilesContents101="HE HE180.B",
    profilesContents102="HE HE120.M",
    profilesContents103="HE HE260.AA",
    profilesContents104="HE HE.DILx200",
    profilesContents105="HE HE240.A",
    profilesContents106="HE HE280.AA",
    profilesContents107="HE HE200.B",
    profilesContents108="HE HE140.M",
    profilesContents109="HE HE.DILx220",
    profilesContents11="IPE IPE.Rx160",
    profilesContents110="HE HE260.A",
    profilesContents111="HE HE300.AA",
    profilesContents112="HE HE220.B"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)
item = ListItem(List=profile, Index=0, Wrap=True)
profile_3 = CreateProfile(
    DepthMm=Slider(19, range=0..100),
    WidthMm=Slider(7.2, range=0..10),
    WebTHKMm=Slider(3, range=0..10),
    FlangeTHKMm=Slider(1.5, range=0..10),
    Mode=1,
    catalogueIndex=3,
    catalogueProfileName="All",
    catalogueTypeIndex=-1,
    catalogueTypeName="All",
    inclSS=False,
    isB2B=False,
    isElliptical=False,
    isGeneral=False,
    isHollow=True,
    isTapered=False,
    loadlistid=-1,
    loadselectid=-1,
    profilesContents0="All",
    profilesContents1="IPE IPE80",
    profilesContents10="IPE IPE160",
    profilesContents100="HE HE220.A",
    profilesContents101="HE HE180.B",
    profilesContents102="HE HE120.M",
    profilesContents103="HE HE260.AA",
    profilesContents104="HE HE.DILx200",
    profilesContents105="HE HE240.A",
    profilesContents106="HE HE280.AA",
    profilesContents107="HE HE200.B",
    profilesContents108="HE HE140.M",
    profilesContents109="HE HE.DILx220",
    profilesContents11="IPE IPE.Rx160",
    profilesContents110="HE HE260.A",
    profilesContents111="HE HE300.AA",
    profilesContents112="HE HE220.B"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)
section = CreateSection(Profile="STD R 850 300")
section_2 = CreateSection(Profile=profile_2)
section_3 = CreateSection(Profile=item)
panel = Panel(profile_3)
sectprop = SectionProperties(Section=section)  # -> Area, MomentOfInertiaYY, MomentOfInertiaZZ, MomentOfInertiaYZ, TorsionConstant, ShearAreaFactorInY, ShearAreaFactorInZ, SurfaceALength, VolumeLength
pb = Section(section_3)
sectprop_2 = SectionProperties(Section=profile_3)  # -> Area, MomentOfInertiaYY, MomentOfInertiaZZ, MomentOfInertiaYZ, TorsionConstant, ShearAreaFactorInY, ShearAreaFactorInZ, SurfaceALength, VolumeLength
analyse = AnalyseModel(GSAProperties=section_2)
panel_2 = Panel(sectprop.Area)
panel_3 = Panel([sectprop_2.Area, sectprop_2.MomentOfInertiaYY, sectprop_2.MomentOfInertiaZZ, sectprop_2.MomentOfInertiaYZ])
prop2d = Create2DProperty(Material=0, Mode=3)
savegsa = SaveModel(GSAModel=analyse)
pa = _2DProperty(prop2d)
