# Grasshopper definition 102_CreateBool6-Offset.gh (Grasshopper 1.0.7)
# Copyright: Arup
# plug-ins: GSA

bool6 = CreateBool6(x=True, xx=False, y=True, yy=False, z=False, zz=True)
offset = CreateOffset(
    OffsetX1=Slider(-1.5, range=-1.5..15),
    OffsetX2=Slider(0.8, range=-1.5..15),
    OffsetY=Slider(-1.5, range=-1.5..15),
    OffsetZ=Slider(-1.5, range=-1.5..15))
b6 = Bool6(bool6)
of = Offset(offset)
panel = Panel(b6)
bool6edit = EditBool6(Bool6=b6, XX=Toggle(True))  # -> Bool6, X, Y, Z, XX, YY, ZZ
offsetedit = EditOffset(Offset=of, OffsetZ=Slider(4, range=0..10))  # -> Offset, OffsetX1, OffsetX2, OffsetY, OffsetZ
panel_2 = Panel(of)
panel_3 = Panel([bool6edit.X, bool6edit.Y, bool6edit.Z, bool6edit.XX, bool6edit.YY, bool6edit.ZZ])
panel_4 = Panel([offsetedit.OffsetX1, offsetedit.OffsetX2, offsetedit.OffsetY, offsetedit.OffsetZ])
b6_2 = Bool6(bool6edit.Bool6)
of_2 = Offset(offsetedit.Offset)
