# Grasshopper definition 201_GerberBeam.gh (Grasshopper 1.0.7)
# Copyright: Arup
# plug-ins: GSA

number_slider = Slider(0.195, range=0..0.499)
profile = CreateProfile(
    Mode=0,
    catalogueIndex=3,
    catalogueProfileName="All",
    catalogueTypeIndex=27,
    catalogueTypeName="All",
    inclSS=False,
    isB2B=False,
    isElliptical=False,
    isGeneral=False,
    isHollow=False,
    isTapered=False,
    loadlistid=3,
    loadselectid=75,
    profilesContents0="HE HE400.B",
    sectionNamesContents0="All",
    sectionNamesContents1="HE HE100.AA",
    sectionNamesContents10="HE HE.DILx120",
    sectionNamesContents100="HE HE340.M",
    sectionNamesContents101="HE HE360.M",
    sectionNamesContents102="HE HE900.A",
    sectionNamesContents103="HE HE400.M",
    sectionNamesContents104="HE HE800.B",
    sectionNamesContents105="HE HE450.M",
    sectionNamesContents106="HE HE500.M",
    sectionNamesContents107="HE HE1000.A",
    sectionNamesContents108="HE HE550.M",
    sectionNamesContents109="HE HE600.M",
    sectionNamesContents11="HE HE120.B",
    sectionNamesContents110="HE HE900.B",
    sectionNamesContents111="HE HE650.M"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)
pt = ConstructPoint(XCoordinate=0, YCoordinate=0, ZCoordinate=0)
pt_2 = ConstructPoint(XCoordinate=0, YCoordinate=Slider(15, range=0..100), ZCoordinate=0)
material = CreateMaterial(AnalysisProperty=0, Grade=1, Mode=1)
subtraction = Subtraction(A="1", B=number_slider)
ln = Line(StartPoint=pt, EndPoint=pt_2)
section = CreateSection(Profile=profile, Material=material)
shatter = Shatter(Curve=ln, Parameters=[number_slider, subtraction])
eval = EvaluateCurve(Curve=ln, Parameter=[number_slider, subtraction])  # -> Point, Tangent, Angle
open = OpenModel(
    FilenameAndPath="C:\Users\Kristjan.Nielsen\Desktop\BaseModel.gwb",
    File="C:\Users\Kristjan.Nielsen\Desktop\BaseModel.gwb")
neg = Negative(Value=Slider(37, range=0..100))
beamload = CreateBeamLoad(LoadCase=1, ElementList="all", Axis=0, Direction="z", Projected=False, LoadKNM=neg, Mode=1)
support = CreateSupport(Point=pt, Plane=PlaneXY(0, 0, 0), x=True, xx=False, y=True, yy=True, z=True, zz=False)
support_2 = CreateSupport(Point=[eval.Point, pt_2], Plane=PlaneXY(0, 0, 0), x=True, xx=False, y=True, yy=False, z=True, zz=False)
elem1d = Create1DElement(Line=shatter, Section=section)
analyse = AnalyseModel(GSAModelS=open, GSAGeometry=flatten([support_2, elem1d, support]), GSALoad=beamload, Analyse=True, ReMesh=True)
elem1dresults = _1DElementResults(
    GSAModel=analyse,
    LoadCase=1,
    ElementFilterList="All",
    NoPositions=10,
    Scale=10,
    Display=3,
    Mode=0,
    noDec=0,
    slider=True,
    val=100,
    valMax=1000,
    valMin=0)  # -> Translation, Rotation, Line, Co, Colours, Values
