# Grasshopper definition 201_SimpleCantileverElem1D.gh (Grasshopper 1.0.7)
# Copyright: Arup
# plug-ins: GSA, sof_gh_sofistik_rhino

io = IO(
    SofistikDocumentProperties_VersionMajor="2020",
    SofistikDocumentProperties_VersionMinor="8",
    SofistikDocumentProperties_VersionName="Rhino-Interface")
unit = EditGSAUnits(SectionLengthUnit="ft")
profile = CreateProfile(
    DepthIn=Slider(15, range=0..100),
    WidthIn=Slider(15, range=0..100),
    Mode=1,
    catalogueIndex=-1,
    catalogueProfileName="All",
    catalogueTypeIndex=-1,
    catalogueTypeName="All",
    inclSS=False,
    isB2B=False,
    isElliptical=False,
    isGeneral=False,
    isHollow=False,
    isTapered=False,
    loadlistid=0,
    loadselectid=1,
    profilesContents0="All",
    profilesContents1="BSI-IPE IPEAA80",
    profilesContents10="BSI-IPE IPE120",
    profilesContents100="BSI-HE HE300AA",
    profilesContents1000="E-W E-W920x420x365",
    profilesContents10000="EN-CRHS RHS150x100x12.5",
    profilesContents10001="EN-CRHS RHS200x100x10",
    profilesContents10002="EN-CRHS RHS200x120x10",
    profilesContents10003="EN-CRHS RHS250x150x8.0",
    profilesContents10004="EN-CRHS RHS260x140x8.0",
    profilesContents10005="EN-CRHS RHS300x100x8.0",
    profilesContents10006="EN-CRHS RHS300x200x6.3",
    profilesContents10007="EN-CRHS RHS350x150x6.3",
    profilesContents10008="EN-CRHS RHS200x150x10.0",
    profilesContents10009="EN-CRHS RHS250x100x10",
    profilesContents1001="E-W E-W1100x300x369",
    profilesContents10010="EN-CRHS RHS200x100x12.5"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)
pt = ConstructPoint(XCoordinate=Slider(0, range=0..10), YCoordinate=Slider(2, range=0..10), ZCoordinate=Slider(0, range=0..10))
pt_2 = ConstructPoint(XCoordinate=Slider(4, range=0..10), YCoordinate=Slider(5, range=0..10), ZCoordinate=Slider(0, range=0..10))
material = CreateMaterial(AnalysisProperty=0, Grade=1, Mode=2)
ln = Line(StartPoint=pt, EndPoint=pt_2)
section = CreateSection(Profile=profile, Material=material)
prop2d = Create2DProperty(ThicknessFt=Slider(15, range=0..100), Mode=3)
support = CreateSupport(Point=pt, Plane=PlaneXY(0, 0, 0), x=True, xx=True, y=True, yy=True, z=True, zz=True)
elem1d = Create1DElement(Line=ln, Section=section)
brep = Brep(<brep referenced from the Rhino model>)
analyse = AnalyseModel(GSAGeometry=[elem1d, support], Analyse=False, ReMesh=False)
panel = Panel("C:\Users\Kristjan.Nielsen\source\repos\GhSA\Documentation\GettingStartedGuide\GhFiles\test.gwb")
mem2d = Create2DMember(Brep=brep, _2DProperty=prop2d, MeshSize=0)
save = SaveModel(
    GSAModel=analyse,
    Save=False,
    FileAndPath=panel,
    File="C:\Users\Kristjan.Nielsen\source\repos\GhSA\Documentation\GettingStartedGuide\GhFiles\test.gwb")
