# Grasshopper definition 202_ResiprocalMem1D.gh (Grasshopper 1.0.7)
# Copyright: Arup
# plug-ins: GSA, sof_gh_sofistik_rhino

io = IO(
    SofistikDocumentProperties_VersionMajor="2020",
    SofistikDocumentProperties_VersionMinor="8",
    SofistikDocumentProperties_VersionName="Rhino-Interface")
polygon = Polygon(Plane=PlaneXY(0, 0, 0), Radius=Slider(2, range=0..10), Segments=Slider(5, range=0..10), FilletRadius=0)  # -> Polygon, Length
explode = Explode(Curve=polygon.Polygon, Recursive=True)  # -> Segments, Vertices
ext = ExtendCurve(Curve=explode.Segments, Type=0, Start="0", End=Slider(4, range=0..10))
end = EndPoints(Curve=ext)  # -> Start, End
support = CreateSupport(Point=end.End, Plane=PlaneXY(0, 0, 0), x=True, xx=False, y=True, yy=False, z=True, zz=False)
mem1d = Create1DMember(
    Curve=ext,
    x1=False,
    x2=False,
    xx1=False,
    xx2=False,
    y1=False,
    y2=False,
    yy1=False,
    yy2=False,
    z1=False,
    z2=False,
    zz1=False,
    zz2=False)
elemfrommem = ElementsFromMembers(_1DMembers=mem1d)  # -> Nodes, _1DElements, _2DElements, _3DElements, GSAModel
asyncanalyse = AsyncAnalyseModel(GSAGeometry=[mem1d, support])
savegsa = SaveModel(GSAModel=asyncanalyse)
getgeo = GetModelGeometry(GSAModel=asyncanalyse, NodeFilterList="All", ElementFilterList="All", MemberFilterList="All", Mode=0)  # -> Nodes, _1DElements, _2DElements, _3DElements, _1DMembers, _2DMembers, _3DMembers
e1d = _1DElement(elemfrommem._1DElements)
e1d_2 = _1DElement(getgeo._1DElements)
item = ListItem(List=e1d_2, Index=Slider(6, range=0..10), Wrap=True)
