# Grasshopper definition 203_EditMem1D-2D-MeshSize.gh (Grasshopper 1.0.7)
# Copyright: Arup
# plug-ins: GSA, sof_gh_sofistik_rhino

io = IO(
    SofistikDocumentProperties_VersionMajor="2020",
    SofistikDocumentProperties_VersionMinor="8",
    SofistikDocumentProperties_VersionName="Rhino-Interface")
pt = ConstructPoint(XCoordinate=Slider(0, range=0..10), YCoordinate=Slider(0, range=0..10), ZCoordinate=Slider(0, range=0..10))
pt_2 = ConstructPoint(XCoordinate=Slider(4, range=0..10), YCoordinate=Slider(5.4, range=0..10), ZCoordinate=Slider(0, range=0..10))
pt_3 = ConstructPoint(XCoordinate=Slider(5.4, range=0..10), YCoordinate=Slider(0, range=0..10), ZCoordinate=Slider(0, range=0..10))
pt_4 = ConstructPoint(XCoordinate=Slider(0, range=0..10), YCoordinate=Slider(3.8, range=0..10), ZCoordinate=Slider(0, range=0..10))
pt_5 = ConstructPoint(XCoordinate=Slider(0.595, range=0..1), YCoordinate=Slider(0.204, range=0..1), ZCoordinate=0)
pt_6 = ConstructPoint(XCoordinate=Slider(0.475, range=0..1), YCoordinate=Slider(0.447, range=0..1), ZCoordinate=0)
pt_7 = ConstructPoint(XCoordinate=Slider(0.102, range=0..1), YCoordinate=Slider(0.324, range=0..1), ZCoordinate=0)
pt_8 = ConstructPoint(XCoordinate=Slider(0.742, range=0..1), YCoordinate=Slider(0.848, range=0..1), ZCoordinate=0)
srf4pt = _4PointSurface(CornerA=pt, CornerB=pt_3, CornerC=pt_2, CornerD=pt_4)
evalsrf = EvaluateSurface(Surface=reparameterize(srf4pt), Point=pt_5)  # -> Point, Normal, UDirection, VDirection, Frame
evalsrf_2 = EvaluateSurface(Surface=reparameterize(srf4pt), Point=[pt_7, pt_6, pt_8])  # -> Point, Normal, UDirection, VDirection, Frame
edges = BrepEdges(Brep=srf4pt)  # -> Naked, Interior, NonManifold
item = ListItem(List=evalsrf_2.Point, Index=0, Wrap=True)  # -> Item, Item1, Item2
m1d = _1DMember(edges.Naked)
vec = VectorXYZ(XComponent=Slider(0.7, range=0..10), YComponent=Slider(2.5, range=0..10), ZComponent=0)  # -> Vector, Length
arc = Arc3Pt(PointA=item.Item, PointB=item.Item1, PointC=item.Item2)  # -> Arc, Plane, Radius
item_2 = ListItem(List=m1d, Index=0, Wrap=True)
move = Move(Geometry=item_2, Motion=vec.Vector)  # -> Geometry, Transform
mem2d = Create2DMember(Brep=srf4pt, InclPoints=evalsrf.Point, InclCurves=arc.Arc, MeshSize=Slider(1.8, range=0.1..5))
mem1dedit = Edit1DMember(_1DMember=[item_2, move.Geometry], MeshSize=Slider(0.3, range=0.1..1.1), MeshWithOthers=True)  # -> _1DMember, Member1dNumber, Curve, Section, MemberGroup, MemberType, _1DElementType, Offset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
elemfrommem = ElementsFromMembers(_1DMembers=mem1dedit._1DMember, _2DMembers=mem2d)  # -> Nodes, _1DElements, _2DElements, _3DElements, GSAModel
end = EndPoints(Curve=elemfrommem._1DElements)  # -> Start, End
