# Grasshopper definition 204_Mem1Ds-Colours.gh (Grasshopper 1.0.7)
# Copyright: Arup
# plug-ins: GSA, sof_gh_sofistik_rhino

io = IO(
    SofistikDocumentProperties_VersionMajor="2020",
    SofistikDocumentProperties_VersionMinor="8",
    SofistikDocumentProperties_VersionName="Rhino-Interface")
ellipse = Ellipse(Plane=PlaneXY(0, 0, 0), Radius1=Slider(66, range=0..100), Radius2=Slider(84, range=0..100))  # -> Ellipse, Focus1, Focus2
Z = UnitZ(Factor=Slider(30, range=-100..100))
Z_2 = UnitZ(Factor=Slider(0, range=-100..100))
ellipse_2 = Ellipse(Plane=PlaneXY(0, 0, 0), Radius1=Slider(23, range=0..100), Radius2=Slider(33, range=0..100))  # -> Ellipse, Focus1, Focus2
cp = ControlPoints(Curve=ellipse_2.Ellipse)  # -> Points, Weights, Knots
cp_2 = ControlPoints(Curve=ellipse.Ellipse)  # -> Points, Weights, Knots
dispatch = Dispatch(List=cp.Points, DispatchPattern=[True, False])  # -> ListA, ListB
dispatch_2 = Dispatch(List=cp_2.Points, DispatchPattern=[True, False])  # -> ListA, ListB
shift = ShiftList(List=reverse(dispatch.ListA), Shift=1, Wrap=False)  # -> reverse(List)
shift_2 = ShiftList(List=reverse(dispatch_2.ListA), Shift=1, Wrap=False)  # -> reverse(List)
move = Move(Geometry=dispatch.ListB, Motion=Z_2)  # -> Geometry, Transform
move_2 = Move(Geometry=dispatch_2.ListB, Motion=Z)  # -> Geometry, Transform
int = Integer(Slider(100, range=0..100))
weave = Weave(Pattern=[0, 1], Stream0=shift, Stream1=move.Geometry, NullGaps=False)
weave_2 = Weave(Pattern=[0, 1], Stream0=shift_2, Stream1=move_2.Geometry, NullGaps=False)
one_over_x = OneOverX(Value=int)
nurbs = NurbsCurve(Vertices=weave, Degree=3, Periodic=Toggle(True))  # -> Curve, Length, Domain
nurbs_2 = NurbsCurve(Vertices=weave_2, Degree=3, Periodic=Toggle(True))  # -> Curve, Length, Domain
series = Series(Start=0, Step=one_over_x, Count=int)
eval = EvaluateCurve(Curve=reparameterize(nurbs_2.Curve), Parameter=series)  # -> Point, Tangent, Angle
eval_2 = EvaluateCurve(Curve=reparameterize(nurbs.Curve), Parameter=series)  # -> Point, Tangent, Angle
ln = Line(StartPoint=eval.Point, EndPoint=eval_2.Point)
len = Length(Curve=ln)
sort = SortList(Keys=len)  # -> Keys, ValuesA
item = ListItem(List=sort.Keys, Index=0, Wrap=True)  # -> Item1, Item
gradient = Gradient(
    LowerLimit=item.Item,
    UpperLimit=item.Item1,
    Parameter=len,
    stops=[0: RGB(175, 238, 238), 0.598: RGB(221, 160, 221), 1: RGB(128, 0, 128)])
m1d = _1DMember(ln)
mem1dedit = Edit1DMember(_1DMember=m1d, MeshWithOthers=True, Member1dColour=gradient)  # -> _1DMember, Member1dNumber, Curve, Section, MemberGroup, MemberType, _1DElementType, Offset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
analyse = AnalyseModel(GSAGeometry=mem1dedit._1DMember)
getgeo = GetModelGeometry(GSAModel=analyse, NodeFilterList="All", ElementFilterList="All", MemberFilterList="All", Mode=0)  # -> Nodes, _1DElements, _2DElements, _3DElements, _1DMembers, _2DMembers, _3DMembers
panel = Panel("C:\Users\Kristjan.Nielsen\source\repos\GhSA\Documentation\GettingStartedGuide\GhFiles\ColourMem1Ds.gwb")
m1d_2 = _1DMember(getgeo._1DMembers)
savegsa = SaveModel(GSAModel=analyse, FileAndPath=panel)
