# Grasshopper definition 204_Mem1Ds-GhTransform.gh (Grasshopper 1.0.7)
# Copyright: Arup
# plug-ins: GSA, sof_gh_sofistik_rhino

io = IO(
    SofistikDocumentProperties_VersionMajor="2020",
    SofistikDocumentProperties_VersionMinor="8",
    SofistikDocumentProperties_VersionName="Rhino-Interface")
profile = CreateProfile(
    DepthMm=Slider(60, range=0..100),
    WidthMm=Slider(40, range=0..100),
    Mode=1,
    catalogueIndex=-1,
    catalogueProfileName="All",
    catalogueTypeIndex=-1,
    catalogueTypeName="All",
    inclSS=False,
    isB2B=False,
    isElliptical=False,
    isGeneral=False,
    isHollow=False,
    isTapered=False,
    loadlistid=0,
    loadselectid=1,
    profilesContents0="All",
    profilesContents1="BSI-IPE IPEAA80",
    profilesContents10="BSI-IPE IPE120",
    profilesContents100="BSI-HE HE300AA",
    profilesContents1000="E-W E-W920x420x365",
    profilesContents10000="EN-CRHS RHS150x100x12.5",
    profilesContents10001="EN-CRHS RHS200x100x10",
    profilesContents10002="EN-CRHS RHS200x120x10",
    profilesContents10003="EN-CRHS RHS250x150x8.0",
    profilesContents10004="EN-CRHS RHS260x140x8.0",
    profilesContents10005="EN-CRHS RHS300x100x8.0",
    profilesContents10006="EN-CRHS RHS300x200x6.3",
    profilesContents10007="EN-CRHS RHS350x150x6.3",
    profilesContents10008="EN-CRHS RHS200x150x10.0",
    profilesContents10009="EN-CRHS RHS250x100x10",
    profilesContents1001="E-W E-W1100x300x369",
    profilesContents10010="EN-CRHS RHS200x100x12.5"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)
profile_2 = CreateProfile(
    DepthMm=Slider(50, range=0..100),
    WidthMm=Slider(30, range=0..100),
    Mode=1,
    catalogueIndex=-1,
    catalogueProfileName="All",
    catalogueTypeIndex=-1,
    catalogueTypeName="All",
    inclSS=False,
    isB2B=False,
    isElliptical=False,
    isGeneral=False,
    isHollow=False,
    isTapered=False,
    loadlistid=0,
    loadselectid=1,
    profilesContents0="All",
    profilesContents1="BSI-IPE IPEAA80",
    profilesContents10="BSI-IPE IPE120",
    profilesContents100="BSI-HE HE300AA",
    profilesContents1000="E-W E-W920x420x365",
    profilesContents10000="EN-CRHS RHS150x100x12.5",
    profilesContents10001="EN-CRHS RHS200x100x10",
    profilesContents10002="EN-CRHS RHS200x120x10",
    profilesContents10003="EN-CRHS RHS250x150x8.0",
    profilesContents10004="EN-CRHS RHS260x140x8.0",
    profilesContents10005="EN-CRHS RHS300x100x8.0",
    profilesContents10006="EN-CRHS RHS300x200x6.3",
    profilesContents10007="EN-CRHS RHS350x150x6.3",
    profilesContents10008="EN-CRHS RHS200x150x10.0",
    profilesContents10009="EN-CRHS RHS250x100x10",
    profilesContents1001="E-W E-W1100x300x369",
    profilesContents10010="EN-CRHS RHS200x100x12.5"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)
profile_3 = CreateProfile(
    DepthMm=Slider(40, range=0..100),
    WidthMm=Slider(25, range=0..100),
    Mode=1,
    catalogueIndex=-1,
    catalogueProfileName="All",
    catalogueTypeIndex=-1,
    catalogueTypeName="All",
    inclSS=False,
    isB2B=False,
    isElliptical=False,
    isGeneral=False,
    isHollow=False,
    isTapered=False,
    loadlistid=0,
    loadselectid=1,
    profilesContents0="All",
    profilesContents1="BSI-IPE IPEAA80",
    profilesContents10="BSI-IPE IPE120",
    profilesContents100="BSI-HE HE300AA",
    profilesContents1000="E-W E-W920x420x365",
    profilesContents10000="EN-CRHS RHS150x100x12.5",
    profilesContents10001="EN-CRHS RHS200x100x10",
    profilesContents10002="EN-CRHS RHS200x120x10",
    profilesContents10003="EN-CRHS RHS250x150x8.0",
    profilesContents10004="EN-CRHS RHS260x140x8.0",
    profilesContents10005="EN-CRHS RHS300x100x8.0",
    profilesContents10006="EN-CRHS RHS300x200x6.3",
    profilesContents10007="EN-CRHS RHS350x150x6.3",
    profilesContents10008="EN-CRHS RHS200x150x10.0",
    profilesContents10009="EN-CRHS RHS250x100x10",
    profilesContents1001="E-W E-W1100x300x369",
    profilesContents10010="EN-CRHS RHS200x100x12.5"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)
rectangle = Rectangle(Plane=PlaneXY(0, 0, 0), XSize=Slider(12.15, range=0..15), YSize=Slider(8.1, range=0..15), Radius=0)  # -> Rectangle, Length
section = CreateSection(Profile=profile_2)
section_2 = CreateSection(Profile=profile)
section_3 = CreateSection(Profile=profile_3)
explode = Explode(Curve=rectangle.Rectangle, Recursive=True)  # -> Segments, Vertices
dispatch = Dispatch(List=explode.Segments, DispatchPattern=[True, False])  # -> ListA, ListB
item = ListItem(List=reverse(dispatch.ListB), Index=0, Wrap=True)
mem1d = Create1DMember(
    Curve=dispatch.ListA,
    Section=section_2,
    x1=False,
    x2=False,
    xx1=False,
    xx2=False,
    y1=False,
    y2=False,
    yy1=False,
    yy2=False,
    z1=False,
    z2=False,
    zz1=False,
    zz2=False)
mem1d_2 = Create1DMember(
    Curve=item,
    Section=section,
    x1=False,
    x2=False,
    xx1=False,
    xx2=False,
    y1=False,
    y2=False,
    yy1=False,
    yy2=False,
    z1=False,
    z2=False,
    zz1=False,
    zz2=False)
Z = UnitZ(Factor=Slider(4.8, range=0..10))
move = Move(Geometry=mem1d, Motion=Z)  # -> Geometry, Transform
move_2 = Move(Geometry=mem1d_2, Motion=Z)  # -> Geometry, Transform
X = UnitX(Factor=Slider(4.05, range=0..15))
end = EndPoints(Curve=mem1d)  # -> Start, End
end_2 = EndPoints(Curve=move.Geometry)  # -> Start, End
ln = Line(StartPoint=[end.Start, end.End], EndPoint=[end_2.Start, end_2.End])
arrlinear = LinearArray(Geometry=move_2.Geometry, Direction=X, Count=Slider(4, range=0..15))  # -> Geometry, Transform
mem1d_3 = Create1DMember(
    Curve=ln,
    Section=section_3,
    x1=False,
    x2=False,
    xx1=False,
    xx2=False,
    y1=False,
    y2=False,
    yy1=False,
    yy2=False,
    z1=False,
    z2=False,
    zz1=False,
    zz2=False)
m1d = _1DMember([mem1d_3, arrlinear.Geometry, move.Geometry])

# ---- group: Use normal move component with GsaGH
move_3 = Move(Geometry=m1d, Motion=Z)  # -> Geometry, Transform

# ----
analyse = AnalyseModel(GSAGeometry=flatten([m1d, move_3.Geometry]))
savegsa = SaveModel(GSAModel=analyse)
