# Grasshopper definition 205_3dElemsFromMems.gh (Grasshopper 1.0.7)
# Copyright: Arup
# plug-ins: GSA

number_slider = Slider(2, range=0..10)
pt = ConstructPoint(XCoordinate=0, YCoordinate=0, ZCoordinate=0)
pt_2 = ConstructPoint(XCoordinate=number_slider, YCoordinate=number_slider, ZCoordinate=number_slider)
vec = VectorXYZ(XComponent=Slider(1, range=0..10), YComponent=Slider(1, range=0..10), ZComponent=Slider(1, range=0..10))  # -> Vector, Length
box = Box2Pt(PointA=pt, PointB=pt_2, Plane=PlaneXY(0, 0, 0))
move = Move(Geometry=box, Motion=vec.Vector)  # -> Geometry, Transform
sunion = SolidUnion(Breps=[box, move.Geometry])
mem3d = Create3DMember(Solid=sunion, MeshSize=Slider(0.33, range=0..1))
elemfrommem = ElementsFromMembers(_3DMembers=mem3d)  # -> Nodes, _1DElements, _2DElements, _3DElements, GSAModel
