# Grasshopper definition 299_Prob+Geo-relationship.gh (Grasshopper 1.0.7)
# Copyright: Arup
# plug-ins: GSA, sof_gh_sofistik_rhino

panel = Panel("C:\Users\Kristjan.Nielsen\Desktop\GSA-Grasshoppe\Cantilever model.gwb")
pt = ConstructPoint(XCoordinate=0, YCoordinate=0, ZCoordinate=0)
pt_2 = ConstructPoint(XCoordinate=0, YCoordinate=Slider(9.8, range=0..10), ZCoordinate=0)
io = IO(
    SofistikDocumentProperties_VersionMajor="2020",
    SofistikDocumentProperties_VersionMinor="8",
    SofistikDocumentProperties_VersionName="Rhino-Interface")
ln = Line(StartPoint=pt, EndPoint=pt_2)
ln_2 = Line(StartPoint=pt, EndPoint=pt_2)
panel_2 = Panel("99")
mplane = MeshPlane(Boundary={Plane=PlaneXY(0, 0, 0), Size=Domain2(u=-10..10, v=-10..10)}, WidthCount=10, HeightCount=10)  # -> Mesh, Area
rectangle = Rectangle(Plane=PlaneXY(0, 0, 0), XSize=Domain(-1, 1), YSize=Domain(-2, 2), Radius=0)  # -> Rectangle, Length
opengsa = OpenModel(FilenameAndPath=panel, Guid=panel)
material = CreateMaterial(AnalysisProperty=0, Grade=1, Mode=2)
material_2 = CreateMaterial(AnalysisProperty=0, Grade=1, Mode=1)
gsa = GSAModel(opengsa)
pt_3 = ConstructPoint(XCoordinate=0, YCoordinate=0, ZCoordinate=0)
pt_4 = ConstructPoint(XCoordinate=0, YCoordinate=Slider(9.8, range=0..10), ZCoordinate=0)
pt_5 = ConstructPoint(XCoordinate=0, YCoordinate=0, ZCoordinate=0)
pt_6 = ConstructPoint(XCoordinate=0, YCoordinate=Slider(9.8, range=0..10), ZCoordinate=0)
section = CreateSection(Profile="STD I 1000 500 15 25", Material=material_2)
section_2 = CreateSection(Profile="STD I 1000 500 15 25", Material=material)
mesh = Mesh(mplane.Mesh)
brep = Brep(rectangle.Rectangle)
crv = Curve(ln_2)
line = Line(ln)
getgeo = GetModelGeometry(GSAModel=gsa, NodeFilterList="All", ElementFilterList="All", MemberFilterList="All", Mode=0)  # -> Nodes, _1DElements, _2DElements, _3DElements, _1DMembers, _2DMembers, _3DMembers
prop2d = Create2DProperty(Thickness_m=Slider(0.5, range=0..1), Mode=3)
section_3 = CreateSection(Profile="STD I 1000 500 15 25")
ln_3 = Line(StartPoint=pt_3, EndPoint=pt_4)
ln_4 = Line(StartPoint=pt_5, EndPoint=pt_6)
int = Integer(getgeo._1DElements)
int_2 = Integer(getgeo._2DMembers)
int_3 = Integer(getgeo._1DMembers)
sectionedit = EditSection(Section=section_2, SectionNumber="42")  # -> Section, SectionNumber, SectionProfile, Material, SectionPool, SectionName, SectionColour
panel_3 = Panel("1")
pb = Section(section_3)
pa = _2DProperty(prop2d)
elem1d = Create1DElement(Line=ln_3, Section=section)
m1d = _1DMember(getgeo._1DMembers)
m2d = _2DMember(getgeo._2DMembers)
elem1d_2 = Create1DElement(Line=ln_4, Section="42")
mem1dedit = Edit1DMember(_1DMember=m1d, MeshWithOthers=True)  # -> _1DMember, Member1dNumber, Curve, Section, MemberGroup, MemberType, _1DElementType, Offset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
mem2d = Create2DMember(Brep=brep, _2DProperty=pa, MeshSize=0)
mem1d = Create1DMember(
    Curve=crv,
    Section=pb,
    x1=False,
    x2=False,
    xx1=False,
    xx2=False,
    y1=False,
    y2=False,
    yy1=False,
    yy2=False,
    z1=False,
    z2=False,
    zz1=False,
    zz2=False)
elem2d = Create2DElement(Mesh=mesh, _2DProperty=pa)
elem1d_3 = Create1DElement(Line=line, Section=pb)
mem2dedit = Edit2DMember(_2DMember=m2d, MeshWithOthers=True)  # -> _2DMember, MemberNumber, Brep, InclPoints, InclCurves, _2DProperty, MemberGroup, MemberType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
analyse = AnalyseModel(GSAProperties=sectionedit.Section, GSAGeometry=elem1d_2)
analyse_2 = AnalyseModel(GSAGeometry=elem1d)
sectionedit_2 = EditSection(Section=mem1dedit.Section)  # -> Section, SectionNumber, SectionProfile, Material, SectionPool, SectionName, SectionColour
e2d = _2DElement(elem2d)
e1d = _1DElement(elem1d_3)
m1d_2 = _1DMember(mem1d)
m2d_2 = _2DMember(mem2d)
prop2dedit = Edit2DProperty(_2DProperty=mem2dedit._2DProperty)  # -> _2DProperty, Prop2dNumber, Material, Thickness, Axis, Prop2dName, Prop2dColour, Type
getgeo_2 = GetModelGeometry(GSAModel=analyse, NodeFilterList="All", ElementFilterList="All", MemberFilterList="All", Mode=0)  # -> Nodes, _1DElements, _2DElements, _3DElements, _1DMembers, _2DMembers, _3DMembers
getprops = GetModelProperties(GSAModel=analyse)  # -> Sections, _2DProperties, Springs
panel_4 = Panel(sectionedit_2.SectionName)
getgeo_3 = GetModelGeometry(GSAModel=analyse_2, NodeFilterList="All", ElementFilterList="All", MemberFilterList="All", Mode=0)  # -> Nodes, _1DElements, _2DElements, _3DElements, _1DMembers, _2DMembers, _3DMembers
panel_5 = Panel(prop2dedit.Material)
int_4 = Integer(mem1dedit.Section)
sectprop = SectionProperties(Section=sectionedit_2.Section)  # -> Area, MomentOfInertiaYY, MomentOfInertiaZZ, MomentOfInertiaYZ, TorsionConstant, ShearAreaFactorInY, ShearAreaFactorInZ, SurfaceALength, VolumeLength
elem2dedit = Edit2DElement(_2DElement=e2d)  # -> _2DElement, Number, AnalysisMesh, _2DProperty, Group, ElementType, Offset, Name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
elem1dedit = Edit1DElement(_1DElement=e1d)  # -> _1DElement, Number, Line, Section, Group, Type, Offset, StartRelease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
int_5 = Integer(mem2dedit._2DProperty)
elem1dedit_2 = Edit1DElement(_1DElement=getgeo_2._1DElements)  # -> _1DElement, Number, Line, Section, Group, Type, Offset, StartRelease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
panel_6 = Panel(sectprop.Area)
panel_7 = Panel(sectionedit_2.Material)
elem1dedit_3 = Edit1DElement(_1DElement=getgeo_3._1DElements)  # -> _1DElement, Number, Line, Section, Group, Type, Offset, StartRelease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
panel_8 = Panel(prop2dedit.Thickness)
mem2dedit_2 = Edit2DMember(_2DMember=m2d_2, MeshWithOthers=True)  # -> _2DMember, MemberNumber, Brep, InclPoints, InclCurves, _2DProperty, MemberGroup, MemberType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
mem1dedit_2 = Edit1DMember(_1DMember=m1d_2, MeshWithOthers=True)  # -> _1DMember, Member1dNumber, Curve, Section, MemberGroup, MemberType, _1DElementType, Offset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
panel_9 = Panel(int_5)
panel_10 = Panel(elem1dedit_2.Section)
sectionedit_3 = EditSection(Section=elem1dedit_2.Section)  # -> Section, SectionNumber, SectionProfile, Material, SectionPool, SectionName, SectionColour
panel_11 = Panel(int_4)
int_6 = Integer(elem1dedit_3.Section)
panel_12 = Panel(elem1dedit_3.Section)
elemfrommem = ElementsFromMembers(_2DMembers=m2d_2)  # -> Nodes, _1DElements, _2DElements, _3DElements, GSAModel
pa_2 = _2DProperty(elem2dedit._2DProperty)
pa_3 = _2DProperty(mem2dedit_2._2DProperty)
panel_13 = Panel(int_6)
pb_2 = Section(elem1dedit.Section)
pb_3 = Section(mem1dedit_2.Section)
materialedit = EditMaterial(Material=sectionedit_3.Material)  # -> Material, AnalysisProperty, MaterialType, MaterialGrade
panel_14 = Panel(pb_2)
panel_15 = Panel(pb_3)
panel_16 = Panel(pa_2)
panel_17 = Panel(pa_3)
elem2dedit_2 = Edit2DElement(_2DElement=elemfrommem._2DElements)  # -> _2DElement, Number, AnalysisMesh, _2DProperty, Group, ElementType, Offset, Name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
int_7 = Integer(elem2dedit_2._2DProperty)
panel_18 = Panel(elem2dedit_2._2DProperty)
panel_19 = Panel(int_7)
