# Grasshopper definition 301_GridAreaLoad_Wind.gh (Grasshopper 1.0.7)
# plug-ins: GSA, TT Toolbox
# This script is used for ...

# ----
# Geometry
# Zone load vectors
# Zone names
# Current wind direction name
brep = Brep(Tree({2;0}: [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], {2;1}: [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], {2;2}: [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], {2;3}: [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], {2;4}: [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], {2;5}: [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], {2;6}: [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], {2;7}: [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], {2;8}: [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]))
vec = Vector(Tree({2;0}: [Vector(0, -1.0824, 0), Vector(0, 1.0824, 0)], {2;1}: [Vector(0, -0.7216, 0), Vector(0, 0.7216, 0)], {2;2}: [Vector(0, -0.451, 0), Vector(0, 0.451, 0)], {2;3}: [Vector(0.61336, 0, 0)], {2;4}: [Vector(0.38335, 0, 0)], {2;5}: [Vector(0, 0, 1.0824), Vector(0, 0, 1.0824)], {2;6}: [Vector(0, 0, 0.7216)], {2;7}: [Vector(0, 0, 0.6314)], {2;8}: [Vector(0, 0, 0.1804)]))
txt = Text("Wind direction +X")
txt_2 = Text(Tree({2;0}: ["A'", "A"], {2;1}: ["B'", "B"], {2;2}: ["C'", "C"], {2;3}: ["D"], {2;4}: ["E"], {2;5}: ["F", "F"], {2;6}: ["G"], {2;7}: ["H"], {2;8}: ["I"]))

python = GhPythonScript(x=flatten(vec))  # -> out, a, b; inputs x: list
# ---------- python: Python ----------
import rhinoscriptsyntax as rs

a = []
b = []

for i in x:
    if i[0] != 0:
        a.append(i[0])
        b.append("x")
    
    if i[1] != 0:
        a.append(i[1])
        b.append("y")
    
    if i[2] != 0:
        a.append(i[2])
        b.append("z")
# ---------- end python ----------
match = MatchTreeStructure(DataList=flatten(python.a), TreeMask=vec)
match_2 = MatchTreeStructure(DataList=flatten(python.b), TreeMask=vec)
concat = Concatenate(FragmentA=txt, FragmentB=" - Zone", FragmentA_2=txt_2)
areaload = CreateGridAreaLoad(LoadCase=1, Brep=brep, Direction=match_2, Axis=0, Projected=False, LoadName=concat, ValueKNM²=match)  # -> flatten(GridAreaLoad)
brep_2 = Brep(flatten(brep))
item = ListItem(List=brep_2, Index=Slider(11, range=0..13), Wrap=True)
analyse = AnalyseModel(GSALoad=areaload)
panel = Panel("C:\Users\Kristjan.Nielsen\source\repos\GhSA\Documentation\GettingStartedGuide\GhFiles\GridArea_WindLoad.gwb")
getloads = GetModelLoads(GSAModel=analyse)  # -> GravityLoads, NodeLoads, BeamLoads, FaceLoads, GridPointLoads, GridLineLoads, GridAreaLoads, GridPlaneSurfaces
pln = Plane(getloads.GridPlaneSurfaces)
savegsa = SaveModel(GSAModel=analyse, FileAndPath=panel)
