# Grasshopper definition 401_Analysis_SimpleCantilever.gh (Grasshopper 1.0.7)
# plug-ins: GSA, sof_gh_sofistik_rhino

panel = Panel("C:\Users\Kristjan.Nielsen\Desktop\GSA-Grasshoppe\BaseModel.gwb")
io = IO(
    SofistikDocumentProperties_VersionMajor="2020",
    SofistikDocumentProperties_VersionMinor="8",
    SofistikDocumentProperties_VersionName="Rhino-Interface")
profile = CreateProfile(
    Mode=0,
    catalogueIndex=3,
    catalogueProfileName="All",
    catalogueTypeIndex=27,
    catalogueTypeName="All",
    inclSS=False,
    isB2B=False,
    isElliptical=False,
    isGeneral=False,
    isHollow=False,
    isTapered=False,
    loadlistid=3,
    loadselectid=21,
    profilesContents0="HE HE200.A",
    sectionNamesContents0="All",
    sectionNamesContents1="HE HE100.AA",
    sectionNamesContents10="HE HE.DILx120",
    sectionNamesContents100="HE HE340.M",
    sectionNamesContents101="HE HE360.M",
    sectionNamesContents102="HE HE900.A",
    sectionNamesContents103="HE HE400.M",
    sectionNamesContents104="HE HE800.B",
    sectionNamesContents105="HE HE450.M",
    sectionNamesContents106="HE HE500.M",
    sectionNamesContents107="HE HE1000.A",
    sectionNamesContents108="HE HE550.M",
    sectionNamesContents109="HE HE600.M",
    sectionNamesContents11="HE HE120.B",
    sectionNamesContents110="HE HE900.B",
    sectionNamesContents111="HE HE650.M"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)
open = OpenModel(FilenameAndPath=panel, File="C:\Users\Kristjan.Nielsen\Desktop\GSA-Grasshoppe\BaseModel.gwb")
pt = ConstructPoint(XCoordinate=0, YCoordinate=0, ZCoordinate=0)
pt_2 = ConstructPoint(XCoordinate=0, YCoordinate=Slider(6, range=0..100), ZCoordinate=0)
material = CreateMaterial(AnalysisProperty=0, Grade=1, Mode=1)
ln = Line(StartPoint=pt, EndPoint=pt_2)
section = CreateSection(Profile=profile, Material=material)
support = CreateSupport(Point=pt, Plane=PlaneXY(0, 0, 0), x=True, xx=True, y=True, yy=True, z=True, zz=True)
mem1d = Create1DMember(
    Curve=ln,
    Section=section,
    x1=False,
    x2=False,
    xx1=False,
    xx2=False,
    y1=False,
    y2=False,
    yy1=False,
    yy2=False,
    z1=False,
    z2=False,
    zz1=False,
    zz2=False)
gravityload = CreateGravityLoad(LoadCase=1, ElementList="All", GravityFactor=Vector(0, 0, -1))
analyse = AnalyseModel(ModelS=open, GSAGeometry=flatten([support, mem1d]), GSALoad=gravityload, Analyse=True, ReMesh=True)
elem1dresults = _1DElementResults(
    GSAModel=analyse,
    LoadCase=1,
    ElementFilterList="All",
    NoPositions=10,
    Scale=10,
    Display=3,
    Mode=0,
    noDec=0,
    slider=True,
    val=100,
    valMax=100,
    valMin=0)  # -> Translation, Rotation, Line, Co, Colours, Values
noderesult = NodeResults(
    GSAModel=analyse,
    LoadCase=1,
    NodeFilterList="All",
    Scalar=10,
    Display=3,
    Mode=1,
    noDec=0,
    slider=False,
    val=0,
    valMax=100,
    valMin=0)  # -> Force, Moment, Point, Co, Colours, Values
legend = Legend(Colour=elem1dresults.Colours, Tags=elem1dresults.Values, LegendType=1)
legend_2 = Legend(Colour=noderesult.Colours, Tags=noderesult.Values, LegendType=1)
vlen = VectorLength(Vector=noderesult.Force)
sort = SortList(Keys=vlen, ValuesA=noderesult.Point)  # -> Keys, ValuesA
item = ListItem(List=reverse(sort.ValuesA), Index=0, Wrap=True)
item_2 = ListItem(List=reverse(sort.Keys), Index=0, Wrap=True)
tag = TextTag(Location=item, Text=item_2, Colour=ColourSwatch(SwatchColor=RGB(0, 0, 0)))
