# Grasshopper definition 402_Analysis_Surface.gh (Grasshopper 1.0.7)
# Copyright: Arup
# plug-ins: GSA, sof_gh_sofistik_rhino

panel = Panel("C:\Users\Kristjan.Nielsen\Desktop\GSA-Grasshoppe\BaseModel.gwb")
io = IO(
    SofistikDocumentProperties_VersionMajor="2020",
    SofistikDocumentProperties_VersionMinor="8",
    SofistikDocumentProperties_VersionName="Rhino-Interface")
open = OpenModel(FilenameAndPath=panel, File="C:\Users\Kristjan.Nielsen\Desktop\GSA-Grasshoppe\BaseModel.gwb")
pt = ConstructPoint(XCoordinate=Slider(-4.6, range=-5..5), YCoordinate=Slider(2.1, range=-5..5), ZCoordinate=0)
pt_2 = ConstructPoint(XCoordinate=Slider(1.8, range=-5..5), YCoordinate=Slider(3.5, range=-5..5), ZCoordinate=0)
pt_3 = ConstructPoint(XCoordinate=Slider(1.2, range=-5..5), YCoordinate=Slider(-4.2, range=-5..5), ZCoordinate=0)
pt_4 = ConstructPoint(XCoordinate=Slider(-5, range=-5..5), YCoordinate=Slider(-5, range=-5..5), ZCoordinate=0)
srf4pt = _4PointSurface(CornerA=pt_4, CornerB=pt, CornerC=pt_2, CornerD=pt_3)
pt_5 = Point([pt_4, pt, pt_2, pt_3])
prop2d = Create2DProperty(Thickness_m=Slider(0.7, range=0..1), Mode=3)
support = CreateSupport(Point=pt_5, Plane=PlaneXY(0, 0, 0), x=True, xx=False, y=True, yy=False, z=True, zz=True)
mem2d = Create2DMember(Brep=srf4pt, MeshSize=Slider(0.5, range=0..1))
prop2dedit = Edit2DProperty(_2DProperty=prop2d, Prop2dNumber="1")  # -> _2DProperty, Prop2dNumber, Material, Thickness, Axis, Prop2dName, Prop2dColour, Type
gsa = GSAModel(open)
gravityload = CreateGravityLoad(LoadCase=1, ElementList="All", GravityFactor=Vector(0, 0, -1))
faceload = CreateFaceLoad(LoadCase=1, ElementList="all", Axis=-1, Direction="z", Projected=False, ValueKNM²=Slider(5, range=0..10), Mode=0)
analyse = AnalyseModel(ModelS=gsa, GSAProperties=prop2dedit._2DProperty, GSAGeometry=[mem2d, support], GSALoad=[gravityload, faceload])
series = Series(Start=0, Step="0.1", Count=10)
gradient = Gradient(
    LowerLimit="0",
    UpperLimit="1",
    Parameter=series,
    stops=[0: RGB(0, 98, 0), 0.25: RGB(81, 175, 17), 0.5: RGB(159, 198, 146), 0.75: RGB(170, 235, 41), 1: RGB(221, 255, 53)])
elem2dresults = _2DElementResults(GSAModel=analyse, LoadCase=1, ElementFilterList="All", Display=3, Mode=0, flayer=0)  # -> Translation, Rotation, Mesh, Colours, Values
noderesult = NodeResults(GSAModel=analyse, LoadCase=1, NodeFilterList="All", Scalar=10, Display=2, Mode=1)  # -> Force, Moment, Point, Co, Colours, Values
cluster = Cluster(C=elem2dresults.Mesh)
devec = DeconstructVector(Vector=elem2dresults.Translation)  # -> XComponent, YComponent, ZComponent
legend = Legend(Colour=elem2dresults.Colours, Tags=elem2dresults.Values, Rectangle=cluster, LegendType=1)
panel_2 = Panel(devec.XComponent)
panel_3 = Panel(devec.YComponent)
panel_4 = Panel(devec.ZComponent)
shift = ShiftList(List=devec.ZComponent, Shift=1, Wrap=False)  # -> flatten(List)
series_2 = Series(Start=0, Step="-0.1", Count="21")
mjoin = MeshJoin(Meshes=elem2dresults.Mesh)
iso = MeshIsoLines(mesh=mjoin, values=shift, niso=series_2)  # -> isolines, text_plane, text
crv = Curve(iso.isolines)
tag = TextTag3D(Location=iso.text_plane, Text=iso.text, Size=Slider(0.2, range=0..1), Justification=7)

# ==== cluster MeshIsoLines: Creates Isolines on a xy-planar mesh from input values
io = IO(
    SofistikDocumentProperties_VersionMajor="2020",
    SofistikDocumentProperties_VersionMinor="8",
    SofistikDocumentProperties_VersionName="Rhino-Interface")
niso = ClusterInput()  # Number of isolines (single number input) or list of values for where to create isolines (list input)
values = ClusterInput()  # Result values; must either match number of verticies or number of faces
mesh = ClusterInput()  # Input Mesh
num = Number(niso)
mesh_2 = Mesh(mesh)
num_2 = Number(values)
demesh = DeconstructMesh(Mesh=mesh_2)  # -> Vertices, Faces, Colours, Normals
lng = ListLength(List=num)
lng_2 = ListLength(List=demesh.Vertices)
lng_3 = ListLength(List=num_2)
larger = LargerThan(FirstNumber=lng, SecondNumber="1")  # -> LargerThan, OrEqualTo
weld = WeldMesh(Mesh=mesh_2, Angle=3.141592654)
equals = Equality(FirstNumber=lng_2, SecondNumber=lng_3)  # -> Equality, Inequality
c_script = CSharpScript(m=weld, v=num_2)  # -> out, A; inputs m: Mesh, v: list of Double
# ---------- c_script: C# ----------
    List<double> vals = new List<double>();
    for (int i = 0; i < m.TopologyVertices.Count; i++)
    {
      int[] faces = m.TopologyVertices.ConnectedFaces(i);
      double val = 0;
      for (int j = 0; j < faces.Length; j++)
      {
        val += v[faces[j]];
      }
      val = val / faces.Length;
      vals.Add(val);
    }
    A = vals;
# ---------- end c_script ----------
p_n_c = PickNChoose(Pattern=equals.Equality, Stream0=graft(c_script.A), Stream1=graft(num_2))
p_n_c_2 = PickNChoose(Pattern=equals.Equality, Stream0=weld, Stream1=mesh_2)
addition = Addition(A=num, B=1)
pshift = ShiftPaths(Data=p_n_c, Offset=-1)
sort = SortList(Keys=pshift)  # -> Keys, ValuesA
item = ListItem(List=sort.Keys, Index=0, Wrap=True)  # -> Item1, Item
min = Minimum(A=item.Item1, B=item.Item)
max = Maximum(A=item.Item1, B=item.Item)
subtraction = Subtraction(A=item.Item1, B=item.Item)
subtraction_2 = Subtraction(A=item.Item, B=item.Item1)
larger_2 = LargerThan(FirstNumber=max, SecondNumber=0)  # -> LargerThan, OrEqualTo
p_n_c_3 = PickNChoose(Pattern=larger_2.LargerThan, Stream0=subtraction_2, Stream1=subtraction)
division = Division(A=p_n_c_3, B=num)
series = Series(Start=0, Step=division, Count=addition)  # -> flatten(Series)
p_n_c_4 = PickNChoose(Pattern=larger.LargerThan, Stream0=graft(series), Stream1=graft(num))
demesh_2 = DeconstructMesh(Mesh=p_n_c_2)  # -> Vertices, Faces, Colours, Normals
pshift_2 = ShiftPaths(Data=p_n_c_4, Offset=-1)
area = Area(Geometry=p_n_c_2)  # -> Area, Centroid
Z = UnitZ(Factor=pshift)
num_3 = Number(pshift_2)
move = Move(Geometry=demesh_2.Vertices, Motion=Z)  # -> Geometry, Transform
xy = XYPlane(Origin=area.Centroid)
Z_2 = UnitZ(Factor=num_3)
conmesh = ConstructMesh(Vertices=move.Geometry, Faces=demesh_2.Faces)
move_2 = Move(Geometry=xy, Motion=Z_2)  # -> Geometry, Transform
sec = MeshPlane(Mesh=conmesh, Plane=move_2.Geometry)
project = Project(Geometry=sec, Plane=xy)  # -> Geometry, Transform
graft = GraftTree(Tree=num_3, IncludeEmptyLists=True, IncludeNullItems=True)
eval = EvaluateCurve(Curve=reparameterize(project.Geometry), Parameter="0.5")  # -> Point, Tangent, Angle
devec = DeconstructVector(Vector=eval.Tangent)  # -> XComponent, YComponent, ZComponent
rev = Reverse(Vector=eval.Tangent)
larger_3 = LargerThan(FirstNumber=devec.XComponent, SecondNumber=0)  # -> LargerThan, OrEqualTo
p_n_c_5 = PickNChoose(Pattern=larger_3.LargerThan, Stream0=rev, Stream1=eval.Tangent)
pl = ConstructPlane(Origin=eval.Point, XAxis=p_n_c_5, YAxis=Vector(0, 1, 0))
crv = Curve(simplify(project.Geometry))
pln = Plane(simplify(pl))
num_4 = Number(simplify(graft))
isolines = ClusterOutput(crv)  # Isolines
text_plane = ClusterOutput(pln)  # Plane for creating text tag at each isoline
text = ClusterOutput(num_4)  # Text tag for each isoline

# ==== cluster Cluster
io = IO(
    SofistikDocumentProperties_VersionMajor="2020",
    SofistikDocumentProperties_VersionMinor="8",
    SofistikDocumentProperties_VersionName="Rhino-Interface")
C = ClusterInput()
bbox = BoundingBox(Content=C, Plane=PlaneXY(0, 0, 0), UnionBox=True)  # -> Box, Box_2
Y = UnitY(Factor="-1")
box_corners = BoxCorners(Box=bbox.Box)  # -> CornerA, CornerB, CornerC, CornerD, CornerE, CornerF, CornerG, CornerH
move = Move(Geometry=box_corners.CornerA, Motion=Y)  # -> Geometry, Transform
rectangle = Rectangle(Plane=move.Geometry, XSize="-1", YSize="-2", Radius=0)  # -> Rectangle, Length
R = ClusterOutput(rectangle.Rectangle)
