# Grasshopper definition 402b_Analysis_Surface_FaceLoad-by-GroupNumber.gh (Grasshopper 1.0.7)
# Copyright: Arup
# plug-ins: GSA, sof_gh_sofistik_rhino

panel = Panel("C:\Users\Kristjan.Nielsen\Desktop\GSA-Grasshoppe\BaseModel.gwb")
io = IO(
    SofistikDocumentProperties_VersionMajor="2020",
    SofistikDocumentProperties_VersionMinor="8",
    SofistikDocumentProperties_VersionName="Rhino-Interface")
open = OpenModel(FilenameAndPath=panel, File="C:\Users\Kristjan.Nielsen\Desktop\GSA-Grasshoppe\BaseModel.gwb")
pt = ConstructPoint(XCoordinate=Slider(-5, range=-5..5), YCoordinate=Slider(3.9, range=-5..5), ZCoordinate=0)
pt_2 = ConstructPoint(XCoordinate=Slider(0, range=-5..5), YCoordinate=Slider(-0.3, range=-5..5), ZCoordinate=0)
pt_3 = ConstructPoint(XCoordinate=Slider(2.8, range=-5..5), YCoordinate=Slider(-5, range=-5..5), ZCoordinate=0)
pt_4 = ConstructPoint(XCoordinate=Slider(-5, range=-5..5), YCoordinate=Slider(-5, range=-5..5), ZCoordinate=0)
material = CreateMaterial(AnalysisProperty=0, Grade=1, Mode=2)
srf4pt = _4PointSurface(CornerA=pt_2, CornerB=pt_3, CornerC=pt_4)
pt_5 = Point([pt_4, pt, pt_2, pt_3])
srf4pt_2 = _4PointSurface(CornerA=pt_4, CornerB=pt, CornerC=pt_2)
prop2d = Create2DProperty(Material=material, ThicknessMm=Slider(270, range=0..1000), Mode=3)
support = CreateSupport(Point=pt_5, Plane=PlaneXY(0, 0, 0), x=True, xx=False, y=True, yy=False, z=True, zz=False)
panel_2 = Panel("""G101
G102""")
mem2d = Create2DMember(Brep=[srf4pt_2, srf4pt], _2DProperty=prop2d, MeshSize=[Slider(0.5, range=0..1), Slider(0.1, range=0..1)])
gsa = GSAModel(open)
faceload = CreateFaceLoad(
    LoadCase=1,
    ElementList=panel_2,
    Axis=-1,
    Direction="z",
    Projected=False,
    ValueKNM²=[Slider(1, range=0..10), Slider(37, range=0..80)],
    Mode=0)
panel_3 = Panel("""101
102""")
mem2dedit = Edit2DMember(_2DMember=mem2d, Member2dGroup=panel_3, MeshWithOthers=True)  # -> _2DMember, MemberNumber, Brep, InclPoints, InclCurves, _2DProperty, MemberGroup, MemberType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
analyse = AnalyseModel(ModelS=gsa, GSAGeometry=[support, mem2dedit._2DMember], GSALoad=faceload)
elem2dresults = _2DElementResults(
    GSAModel=analyse,
    LoadCase=1,
    ElementFilterList="All",
    Display=3,
    Mode=0,
    flayer=0,
    noDec=0,
    slider=True,
    val=50,
    valMax=100,
    valMin=0)  # -> Translation, Rotation, Mesh, Colours, Values
save = SaveModel(
    GSAModel=analyse,
    Save=False,
    FileAndPath="C:\Users\Kristjan.Nielsen\Desktop\test7.gwb",
    File="C:\Users\Kristjan.Nielsen\Desktop\test7.gwb")
cluster = Cluster(C=elem2dresults.Mesh)
devec = DeconstructVector(Vector=elem2dresults.Translation)  # -> XComponent, YComponent, ZComponent
legend = Legend(Colour=elem2dresults.Colours, Tags=elem2dresults.Values, Rectangle=cluster, LegendType=1)
panel_4 = Panel(devec.XComponent)
panel_5 = Panel(devec.YComponent)
panel_6 = Panel(devec.ZComponent)

# ==== cluster Cluster
io = IO(
    SofistikDocumentProperties_VersionMajor="2020",
    SofistikDocumentProperties_VersionMinor="8",
    SofistikDocumentProperties_VersionName="Rhino-Interface")
C = ClusterInput()
bbox = BoundingBox(Content=C, Plane=PlaneXY(0, 0, 0), UnionBox=True)  # -> Box, Box_2
project = Project(Geometry=bbox.Box, Plane=PlaneXY(0, 0, 0))  # -> Geometry, Transform
Y = UnitY(Factor="-1")
box_corners = BoxCorners(Box=project.Geometry)  # -> CornerA, CornerB, CornerC, CornerD, CornerE, CornerF, CornerG, CornerH
move = Move(Geometry=box_corners.CornerA, Motion=Y)  # -> Geometry, Transform
rectangle = Rectangle(Plane=move.Geometry, XSize="-1", YSize="-2", Radius=0)  # -> Rectangle, Length
R = ClusterOutput(rectangle.Rectangle)
