# Grasshopper definition 403_Analysis_Surface_Optimisation.gh (Grasshopper 1.0.7)
# Copyright: Arup
# plug-ins: GSA, sof_gh_sofistik_rhino

panel = Panel("C:\Users\Kristjan.Nielsen\Desktop\GSA-Grasshoppe\BaseModel.gwb")
io = IO(
    SofistikDocumentProperties_VersionMajor="2020",
    SofistikDocumentProperties_VersionMinor="8",
    SofistikDocumentProperties_VersionName="Rhino-Interface")
number_slider = Slider(0.471, range=0..1)
number_slider_2 = Slider(0.531, range=0..1)
open = OpenModel(FilenameAndPath=panel, File="C:\Users\Kristjan.Nielsen\Desktop\GSA-Grasshoppe\BaseModel.gwb")
number_slider_3 = Slider(1, range=0..1)
pt = ConstructPoint(XCoordinate=0, YCoordinate=Slider(21, range=0..100), ZCoordinate=0)
pt_2 = ConstructPoint(XCoordinate=Slider(26, range=0..100), YCoordinate=Slider(24, range=0..100), ZCoordinate=0)
pt_3 = ConstructPoint(XCoordinate=0, YCoordinate=0, ZCoordinate=0)
pt_4 = ConstructPoint(XCoordinate=Slider(31, range=0..100), YCoordinate=Slider(1, range=0..100), ZCoordinate=0)
pt_5 = ConstructPoint(XCoordinate=number_slider, YCoordinate=number_slider_2, ZCoordinate=0)
srf4pt = _4PointSurface(CornerA=pt_3, CornerB=pt, CornerC=pt_2, CornerD=pt_4)
prop2d = Create2DProperty(Thickness_m=number_slider_3, Mode=3)
evalsrf = EvaluateSurface(Surface=reparameterize(srf4pt), Point=pt_5)  # -> Point, Normal, UDirection, VDirection, Frame
prop2dedit = Edit2DProperty(_2DProperty=prop2d, Prop2dNumber="1")  # -> _2DProperty, Prop2dNumber, Material, Thickness, Axis, Prop2dName, Prop2dColour, Type
gravityload = CreateGravityLoad(LoadCase=1, ElementList="All", GravityFactor=Vector(0, 0, -1))
support = CreateSupport(Point=evalsrf.Point, Plane=PlaneXY(0, 0, 0), x=False, xx=False, y=False, yy=False, z=True, zz=False)
support_2 = CreateSupport(Point=[pt_3, pt, pt_2, pt_4], Plane=PlaneXY(0, 0, 0), x=True, xx=False, y=True, yy=False, z=True, zz=False)
mem2d = Create2DMember(Brep=srf4pt, InclPoints=evalsrf.Point, MeshSize=0)
analyse = AnalyseModel(ModelS=open, GSAProperties=prop2dedit._2DProperty, GSAGeometry=[support_2, mem2d, support], GSALoad=gravityload)
elem2dresults = _2DElementResults(GSAModel=analyse, LoadCase=1, ElementFilterList="All", Display=3, Mode=0, flayer=0)  # -> Translation, Rotation, Mesh, Colours, Values
vlen = VectorLength(Vector=flatten(elem2dresults.Translation))
cluster = Cluster(C=elem2dresults.Mesh)
shift = ShiftList(List=elem2dresults.Translation, Shift=1, Wrap=False)
sort = SortList(Keys=vlen)  # -> Keys, ValuesA
legend = Legend(Colour=elem2dresults.Colours, Tags=elem2dresults.Values, Rectangle=cluster, LegendType=1)
vlen_2 = VectorLength(Vector=flatten(shift))
item = ListItem(List=reverse(sort.Keys), Index=0, Wrap=True)
galapagos = Galapagos(fitness=item, gene=[number_slider, number_slider_2, number_slider_3])
mjoin = MeshJoin(Meshes=elem2dresults.Mesh)
iso = MeshIsoLines(mesh=mjoin, values=vlen_2, niso="10")  # -> isolines, text_plane, text
swatch = ColourSwatch(SwatchColor=RGB(0, 0, 0))
tag = TextTag3D(Location=iso.text_plane, Text=iso.text, Size=Slider(0.2, range=0..1), Colour=swatch, Justification=7)
preview = CustomPreview(Geometry=iso.isolines, Material=swatch)

# ==== cluster MeshIsoLines: Creates Isolines on a xy-planar mesh from input values
io = IO(
    SofistikDocumentProperties_VersionMajor="2020",
    SofistikDocumentProperties_VersionMinor="8",
    SofistikDocumentProperties_VersionName="Rhino-Interface")
niso = ClusterInput()  # Number of isolines (single number input) or list of values for where to create isolines (list input)
values = ClusterInput()  # Result values; must either match number of verticies or number of faces
mesh = ClusterInput()  # Input Mesh
num = Number(niso)
mesh_2 = Mesh(mesh)
num_2 = Number(values)
demesh = DeconstructMesh(Mesh=mesh_2)  # -> Vertices, Faces, Colours, Normals
lng = ListLength(List=num)
lng_2 = ListLength(List=demesh.Vertices)
lng_3 = ListLength(List=num_2)
larger = LargerThan(FirstNumber=lng, SecondNumber="1")  # -> LargerThan, OrEqualTo
weld = WeldMesh(Mesh=mesh_2, Angle=3.141592654)
equals = Equality(FirstNumber=lng_2, SecondNumber=lng_3)  # -> Equality, Inequality
c_script = CSharpScript(m=weld, v=num_2)  # -> out, A; inputs m: Mesh, v: list of Double
# ---------- c_script: C# ----------
    List<double> vals = new List<double>();
    for (int i = 0; i < m.TopologyVertices.Count; i++)
    {
      int[] faces = m.TopologyVertices.ConnectedFaces(i);
      double val = 0;
      for (int j = 0; j < faces.Length; j++)
      {
        val += v[faces[j]];
      }
      val = val / faces.Length;
      vals.Add(val);
    }
    A = vals;
# ---------- end c_script ----------
p_n_c = PickNChoose(Pattern=equals.Equality, Stream0=graft(c_script.A), Stream1=graft(num_2))
p_n_c_2 = PickNChoose(Pattern=equals.Equality, Stream0=weld, Stream1=mesh_2)
addition = Addition(A=num, B=1)
pshift = ShiftPaths(Data=p_n_c, Offset=-1)
sort = SortList(Keys=pshift)  # -> Keys, ValuesA
item = ListItem(List=sort.Keys, Index=0, Wrap=True)  # -> Item1, Item
min = Minimum(A=item.Item1, B=item.Item)
max = Maximum(A=item.Item1, B=item.Item)
subtraction = Subtraction(A=item.Item1, B=item.Item)
subtraction_2 = Subtraction(A=item.Item, B=item.Item1)
larger_2 = LargerThan(FirstNumber=max, SecondNumber=0)  # -> LargerThan, OrEqualTo
p_n_c_3 = PickNChoose(Pattern=larger_2.LargerThan, Stream0=subtraction_2, Stream1=subtraction)
division = Division(A=p_n_c_3, B=num)
series = Series(Start=0, Step=division, Count=addition)  # -> flatten(Series)
p_n_c_4 = PickNChoose(Pattern=larger.LargerThan, Stream0=graft(series), Stream1=graft(num))
demesh_2 = DeconstructMesh(Mesh=p_n_c_2)  # -> Vertices, Faces, Colours, Normals
pshift_2 = ShiftPaths(Data=p_n_c_4, Offset=-1)
area = Area(Geometry=p_n_c_2)  # -> Area, Centroid
Z = UnitZ(Factor=pshift)
num_3 = Number(pshift_2)
move = Move(Geometry=demesh_2.Vertices, Motion=Z)  # -> Geometry, Transform
xy = XYPlane(Origin=area.Centroid)
Z_2 = UnitZ(Factor=num_3)
conmesh = ConstructMesh(Vertices=move.Geometry, Faces=demesh_2.Faces)
move_2 = Move(Geometry=xy, Motion=Z_2)  # -> Geometry, Transform
sec = MeshPlane(Mesh=conmesh, Plane=move_2.Geometry)
project = Project(Geometry=sec, Plane=xy)  # -> Geometry, Transform
graft = GraftTree(Tree=num_3, IncludeEmptyLists=True, IncludeNullItems=True)
eval = EvaluateCurve(Curve=reparameterize(project.Geometry), Parameter="0.5")  # -> Point, Tangent, Angle
devec = DeconstructVector(Vector=eval.Tangent)  # -> XComponent, YComponent, ZComponent
rev = Reverse(Vector=eval.Tangent)
larger_3 = LargerThan(FirstNumber=devec.XComponent, SecondNumber=0)  # -> LargerThan, OrEqualTo
p_n_c_5 = PickNChoose(Pattern=larger_3.LargerThan, Stream0=rev, Stream1=eval.Tangent)
pl = ConstructPlane(Origin=eval.Point, XAxis=p_n_c_5, YAxis=Vector(0, 1, 0))
crv = Curve(simplify(project.Geometry))
pln = Plane(simplify(pl))
num_4 = Number(simplify(graft))
isolines = ClusterOutput(crv)  # Isolines
text_plane = ClusterOutput(pln)  # Plane for creating text tag at each isoline
text = ClusterOutput(num_4)  # Text tag for each isoline

# ==== cluster Cluster
io = IO(
    SofistikDocumentProperties_VersionMajor="2020",
    SofistikDocumentProperties_VersionMinor="8",
    SofistikDocumentProperties_VersionName="Rhino-Interface")
C = ClusterInput()
bbox = BoundingBox(Content=C, Plane=PlaneXY(0, 0, 0), UnionBox=True)  # -> Box, Box_2
Y = UnitY(Factor="-1")
box_corners = BoxCorners(Box=bbox.Box)  # -> CornerA, CornerB, CornerC, CornerD, CornerE, CornerF, CornerG, CornerH
move = Move(Geometry=box_corners.CornerA, Motion=Y)  # -> Geometry, Transform
rectangle = Rectangle(Plane=move.Geometry, XSize="-1", YSize="-2", Radius=0)  # -> Rectangle, Length
R = ClusterOutput(rectangle.Rectangle)
