# Grasshopper definition 404_Analysis_Surface_Update-PA-Thickness.gh (Grasshopper 1.0.7)
# Copyright: Arup
# plug-ins: sof_gh_sofistik_rhino, GSA

io = IO(
    SofistikDocumentProperties_VersionMajor="2020",
    SofistikDocumentProperties_VersionMinor="8",
    SofistikDocumentProperties_VersionName="Rhino-Interface")
panel = Panel("C:\Users\Kristjan.Nielsen\Desktop\GSA-Grasshoppe\BaseModel.gwb")
rectangle = Rectangle(Plane=PlaneXY(0, 0, 0), XSize=Slider(8.1, range=5..15), YSize=Slider(12, range=5..15), Radius=0)  # -> Rectangle, Length
open = OpenModel(FilenameAndPath=panel, File="C:\Users\Kristjan.Nielsen\Desktop\GSA-Grasshoppe\BaseModel.gwb")
explode = Explode(Curve=rectangle.Rectangle, Recursive=True)  # -> Segments, Vertices
area = Area(Geometry=rectangle.Rectangle)  # -> Area, Centroid

# ---- group: Create initial Member2D
material = CreateMaterial(AnalysisProperty=0, Grade=1, Mode=2)
prop2d = Create2DProperty(Material=material, ThicknessMm="300", Mode=3)
mem2d = Create2DMember(Brep=rectangle.Rectangle, InclPoints=area.Centroid, _2DProperty=prop2d, MeshSize=Slider(1, range=0..1))

# ----
support = CreateSupport(Point=[explode.Vertices, area.Centroid], Plane=PlaneXY(0, 0, 0), x=True, xx=False, y=True, yy=False, z=True, zz=False)  # -> flatten(Node)
mem2dedit = Edit2DMember(_2DMember=mem2d, Member2dGroup="99", MeshWithOthers=True)  # -> _2DMember, MemberNumber, Brep, InclPoints, InclCurves, _2DProperty, MemberGroup, MemberType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
faceload = CreateFaceLoad(LoadCase=1, ElementList="G99", Axis=-1, Direction="z", Projected=False, ValueKNM²="-15", Mode=0)
analyse = AnalyseModel(ModelS=open, GSAGeometry=flatten([support, mem2dedit._2DMember]), GSALoad=faceload, Analyse=True, ReMesh=True)
unit = EditGSAUnits(SectionLengthUnit="mm")
elem2dresults = _2DElementResults(
    GSAModel=analyse,
    LoadCase=1,
    ElementFilterList="All",
    Display=5,
    Mode=1,
    flayer=0,
    noDec=0,
    slider=False,
    val=0,
    valMax=100,
    valMin=0)  # -> Force, Moment, Mesh, Colours, Values
devec = DeconstructVector(Vector=elem2dresults.Moment)  # -> XComponent, YComponent, ZComponent

# ---- group: Extract analysed geometry
getgeo = GetModelGeometry(GSAModel=analyse, NodeFilterList="All", ElementFilterList="All", MemberFilterList="All", Mode=0)  # -> Nodes, _1DElements, _2DElements, _3DElements, _1DMembers, _2DMembers, _3DMembers

# ---- group: First item is centre value
item = ListItem(List=devec.XComponent, Index=0, Wrap=True)
item_2 = ListItem(List=devec.YComponent, Index=0, Wrap=True)

# ----
facen = FaceNormals(Mesh=elem2dresults.Mesh)  # -> Centers, Normals

# ---- group: Pythagoran value of xx and yy
sqr = Square(Value=item)
sqr_2 = Square(Value=item_2)
addition = Addition(A=sqr, B=sqr_2)
sqrt = SquareRoot(Value=addition)  # -> flatten(Result)

# ---- group: Remap stress result values to new thickness
minthk = Slider(200, range=1..1000)
maxthk = Slider(1000, range=1..1000)
bnd = Bounds(Numbers=sqrt)
bnd_2 = Bounds(Numbers=[minthk, maxthk])
remap = RemapNumbers(Value=sqrt, Source=bnd, Target=bnd_2)  # -> Mapped, Clipped

# ---- group: Edit2dElem to extract internal Prop2ds (PA)
elem2dedit = Edit2DElement(_2DElement=getgeo._2DElements)  # -> _2DElement, Number, AnalysisMesh, _2DProperty, Group, ElementType, Offset, Name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

# ---- group: If ID>0 then this will be set in the model, so one must in this case give a unique ID for each PA in list
panel_2 = Panel("1")

# ---- group: Set new ID to 0 for all new props to be appended
panel_3 = Panel("0")

# ---- group: Edit Prop2d with new Thickness
prop2dedit = Edit2DProperty(_2DProperty=elem2dedit._2DProperty, Prop2dNumber=panel_3, Thickness=remap.Mapped)  # -> _2DProperty, Prop2dNumber, Material, Thickness, Axis, Prop2dName, Prop2dColour, Type

# ----
tag = TextTag(Location=flatten(facen.Centers), Text=sqrt)
split = TextSplit(Text=prop2dedit.Thickness, Separators="(")
item_3 = ListItem(List=split, Index=0, Wrap=True)  # -> flatten(Item)

# ---- group: Create an offset of half thickness
division = Division(A=item_3, B=2000)
neg = Negative(Value=division)

# ----
globalresult = GlobalResults(GSAModel=analyse, LoadCase=1)  # -> TotalForceLoads, TotalMomentLoads, TotalForceReactions, TotalMomentReactions, EffectiveMass, EffectiveInertia, Mode, Modal, Frequency, LoadFactor

# ---- group: Use EditElem2d again to set the updated PAs
elem2dedit_2 = Edit2DElement(_2DElement=elem2dedit._2DElement, _2DProperty=prop2dedit._2DProperty, Offset=neg)  # -> _2DElement, Number, AnalysisMesh, _2DProperty, Group, ElementType, Offset, Name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

# ----
analyse_2 = AnalyseModel(GSAGeometry=elem2dedit_2._2DElement, Analyse=True, ReMesh=True)
panel_4 = Panel("C:\Users\Kristjan.Nielsen\source\repos\GhSA\Documentation\GettingStartedGuide\GhFiles\test.gwb")
save = SaveModel(
    GSAModel=analyse_2,
    Save=False,
    FileAndPath=panel_4,
    File="C:\Users\Kristjan.Nielsen\source\repos\GhSA\Documentation\GettingStartedGuide\GhFiles\test.gwb")
