# Grasshopper definition 405_Analysis_CombinedModel.gh (Grasshopper 1.0.7)
# Copyright: Arup
# plug-ins: GSA, sof_gh_sofistik_rhino

io = IO(
    SofistikDocumentProperties_VersionMajor="2020",
    SofistikDocumentProperties_VersionMinor="8",
    SofistikDocumentProperties_VersionName="Rhino-Interface")

# ---- group: Parametric Geometry
z1 = Slider(4.5, range=0..10)
z2 = Slider(3.6, range=0..10)
rectangle = Rectangle(Plane=PlaneXY(0, 0, 0), XSize=Slider(6.5, range=0..10), YSize=Slider(7.7, range=0..10), Radius=0)  # -> Rectangle, Length
Z = UnitZ(Factor=z1)
explode = Explode(Curve=rectangle.Rectangle, Recursive=True)  # -> Segments, Vertices
shift = ShiftList(List=explode.Vertices, Shift=1, Wrap=False)
move = Move(Geometry=rectangle.Rectangle, Motion=Z)  # -> Geometry, Transform
# Lookup steel profiles
offset_l = OffsetCurveLoose(Curve=move.Geometry, Distance=1)
line = LineSDL(Start=shift, Direction=Vector(0, 0, 1), Length=z1)

# ---- group: Build Properties
profile = CreateProfile(
    Mode=0,
    catalogueIndex=3,
    catalogueProfileName="All",
    catalogueTypeIndex=26,
    catalogueTypeName="All",
    inclSS=False,
    isB2B=False,
    isElliptical=False,
    isGeneral=False,
    isHollow=False,
    isTapered=False,
    loadlistid=3,
    loadselectid=39,
    profilesContents0="IPE IPE360",
    sectionNamesContents0="All",
    sectionNamesContents1="IPE IPE80",
    sectionNamesContents10="IPE IPE160",
    sectionNamesContents11="IPE IPE.Rx160",
    sectionNamesContents12="IPE IPE.Ax200",
    sectionNamesContents13="IPE IPE180",
    sectionNamesContents14="IPE IPE.Ox180",
    sectionNamesContents15="IPE IPE.Rx180",
    sectionNamesContents16="IPE IPE.Ax220",
    sectionNamesContents17="IPE IPE200",
    sectionNamesContents18="IPE IPE.Ox200",
    sectionNamesContents19="IPE IPE.Ax240",
    sectionNamesContents2="IPE IPE100",
    sectionNamesContents20="IPE IPE220",
    sectionNamesContents21="IPE IPE.Rx200",
    sectionNamesContents22="IPE IPE.Ox220"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)
# Materials
material = CreateMaterial(AnalysisProperty=0, Grade=1, Mode=2)
number_slider = Slider(0.5, range=0..1)
material_2 = CreateMaterial(AnalysisProperty=0, Grade=1, Mode=1)
# 2D Property
prop2d = Create2DProperty(Material=material, ThicknessMm=Slider(200, range=0..1000), Mode=3)
# Section
section = CreateSection(Profile=profile, Material=material_2)

# ---- group: Open existing GSA models
panel = Panel("C:\Users\Kristjan.Nielsen\Desktop\GSA-Grasshoppe\BaseModel.gwb")
open = OpenModel(FilenameAndPath=panel, File="C:\Users\Kristjan.Nielsen\Desktop\GSA-Grasshoppe\BaseModel.gwb")

# ---- group: Create GSA geometry objects
# Node/Support
mem1d = Create1DMember(
    Curve=line,
    Section=section,
    x1=False,
    x2=False,
    xx1=False,
    xx2=False,
    y1=False,
    y2=False,
    yy1=False,
    yy2=False,
    z1=False,
    z2=False,
    zz1=False,
    zz2=False)
support = CreateSupport(Point=shift, Plane=PlaneXY(0, 0, 0), x=True, xx=True, y=True, yy=True, z=True, zz=True)
# 2D Members
mem2d = Create2DMember(Brep=offset_l, _2DProperty=prop2d, MeshSize=number_slider)

# ----
Z_2 = UnitZ(Factor=z1)
Z_3 = UnitZ(Factor=z2)
# 1D Members
division = Division(A=z2, B=z1)

# ---- group: Create Loads
# Gravity
# Face load
faceload = CreateFaceLoad(LoadCase=1, ElementList="PA1", Axis=-1, Direction="z", Projected=False, ValueKNM²=Slider(-8, range=-10..0), Mode=0)
gravityload = CreateGravityLoad(LoadCase=1, ElementList="All", GravityFactor=Vector(0, 0, -1))

# ---- group: Transform GSA objects on the fly
scale_nu = ScaleNU(Geometry=mem1d, Plane=PlaneXY(0, 0, 0), ScaleX=1, ScaleY=1, ScaleZ=division)  # -> Geometry, Transform
move_2 = Move(Geometry=mem2d, Motion=Z_3)  # -> Geometry, Transform
# Move
# Scale
move_3 = Move(Geometry=scale_nu.Geometry, Motion=Z_2)  # -> Geometry, Transform

# ----
gsa = GSAModel(open)
no = Node(support)
m1d = _1DMember([mem1d, move_3.Geometry])
m2d = _2DMember([move_2.Geometry, mem2d])

# ---- group: Analysis
# Assemble
# Remeshing
# Analysis
analyse = AnalyseModel(GSAModelS=gsa, GSAGeometry=flatten([no, m1d, m2d]), GSALoad=[gravityload, faceload], Analyse=True, ReMesh=True)

# ---- group: Display results
# Node results -> Reactions
# 1D Results -> Deflections
noderesult = NodeResults(
    GSAModel=analyse,
    LoadCase=1,
    NodeFilterList="All",
    Scalar=10,
    Display=3,
    Mode=1,
    noDec=0,
    slider=False,
    val=0,
    valMax=1000,
    valMin=0)  # -> Force, Moment, Point, Co, Colours, Values
elem1dresults = _1DElementResults(
    GSAModel=analyse,
    LoadCase=1,
    ElementFilterList="All",
    NoPositions=10,
    Scale=10,
    Display=3,
    Mode=0,
    noDec=0,
    slider=True,
    val=100,
    valMax=1000,
    valMin=0)  # -> Translation, Rotation, Line, Co, Colours, Values
# 2D Results -> Stress plot
elem2dresults = _2DElementResults(
    GSAModel=analyse,
    LoadCase=1,
    ElementFilterList="All",
    Display=1,
    Mode=3,
    flayer=-1,
    noDec=0,
    slider=False,
    val=0,
    valMax=100,
    valMin=0)  # -> ProjectedStressVector, ProjectedShearStressVector, Mesh, Colours, Values
