# Grasshopper definition 999_GrasshopperScriptingBoilerPlates.gh (Grasshopper 1.0.7)
# Copyright: Arup
# plug-ins: GSA

pt = ConstructPoint(XCoordinate=0, YCoordinate=0, ZCoordinate=0)
pt_2 = ConstructPoint(XCoordinate=0, YCoordinate="15", ZCoordinate=0)
ln = Line(StartPoint=pt, EndPoint=pt_2)
m1d = _1DMember(ln)
analyse = AnalyseModel(GSAGeometry=m1d)
vb = GhSAVBScript(
    x=analyse,
    y="myScriptedModel",
    Reference=["C:\Program Files\Oasys\GSA 10.1\GsaAPI.dll", "C:\Users\Kristjan.Nielsen\source\repos\GhSA\GSA.gha"])  # -> out, A, B, C
# ---------- vb: VB usings ----------
Imports GhSA.Parameters
Imports GhSA.Util
Imports GsaAPI
# ---------- vb: VB ----------
    ' Throw a warining if input parameter x is not set
    If x Is Nothing Then
      Me.Component.AddRuntimeMessage(GH_RuntimeMessageLevel.Warning, "Input parameter x failed to collect data")
      Return
    End If

    ' Create a New empty GSA-Grasshopper model
    Dim model As GsaModel = New GsaModel()
    ' Set the input to this model
    model = TryCast(x, GsaModel)

    ' Set the filename in the GsaModel (this is not otherwise exposed)
    model.FileName = y
    ' Output the FileName from the model
    A = model.FileName

    ' Access the GsaAPI model through model.Model
    ' For instance, Take out the nodes from the model like this
    B = model.Model.Nodes()

    ' The namespace of the GSA-Grasshopper plugin is called 'GhSA'
    ' The Namespace For the GsaAPI.dll Is 'GsaAPI'

    ' The GhSA Namespace contains a lot Of useful conversion functions
    ' That you can use. Here's an example of converting nodes:
    C = GhSA.Util.Gsa.FromGSA.GetNodes(B, model.Model)
# ---------- end vb ----------
ghsa_c_script = GhSACSharpScript(
    x=analyse,
    y="myScriptedModel",
    Reference=["C:\Program Files\Oasys\GSA 10.1\GsaAPI.dll", "C:\Users\Kristjan.Nielsen\source\repos\GhSA\GSA.gha"])  # -> out, A, B, C
# ---------- ghsa_c_script: C# usings ----------
using GhSA.Parameters;
using GsaAPI;
# ---------- ghsa_c_script: C# ----------
    // throw a warining if input parameter x is not set
    if (x == null) {
      this.Component.AddRuntimeMessage(GH_RuntimeMessageLevel.Warning,
        "Input parameter x failed to collect data");
      return;}

    // create a new empty GSA-Grasshopper model
    GsaModel model = new GsaModel();
    // set the input to this model
    model = x as GsaModel;

    // set the filename in the GsaModel (this is not otherwise exposed)
    model.FileName = (string) y;
    // output the FileName from the model
    A = model.FileName;
    // access the GsaAPI model through model.Model
    // for instance, take out the nodes from the model like this
    B = model.Model.Nodes();

    // the namespace of the GSA-Grasshopper plugin is called 'GhSA'
    // the namespace for the GsaAPI.dll is 'GsaAPI'

    // the GhSA namespace contains a lot of useful conversion functions
    // that you can use. Here's an example of converting nodes:
    System.Collections.Generic.IReadOnlyDictionary<int, GsaAPI.Node> nodes = model.Model.Nodes();
    C = GhSA.Util.Gsa.FromGSA.GetNodes(nodes, model.Model);
# ---------- end ghsa_c_script ----------
python = GhSAPythonScript(x=analyse, y="myScriptedModel")  # -> out, a, b, c
# ---------- python: Python ----------
__author__ = "Kristjan.Nielsen"
__version__ = "2021.02.12"

import rhinoscriptsyntax as rs

#### / setup / ####
import clr

# Get the plugin GUID
from System import Guid
gsaguid = Guid("a3b08c32-f7de-4b00-b415-f8b466f05e9f")

# Find the plugin in the component server from GUID
import Grasshopper
gsaplugin = Grasshopper.Instances.ComponentServer.FindAssembly(gsaguid)
# Get the plugin file location and add that as a reference
gsaplugin_dir = gsaplugin.Location
clr.AddReferenceToFileAndPath(gsaplugin_dir)
import GhSA
from GhSA import Util

# Using the plugin to find the file location for GsaAPI
from os import path
gsaapi_dir = GhSA.Util.Gsa.InstallationFolderPath.GetPath
clr.AddReferenceToFileAndPath(path.join(gsaapi_dir, "GsaAPI.dll"))

#### / setup / ####

# the namespace of the GSA-Grasshopper plugin is called 'GhSA'
# the namespace for the GsaAPI.dll is 'GsaAPI'

# set the input x to be a GSA-Grasshopper model:
model = x

# set the input y to be the FileName in the model:
model.FileName = y

# set the a output to be the FileName from the model
a = model.FileName

# access the GsaAPI model through model.Model
# for instance, take out the nodes from the model like this
b = model.Model.Nodes()

# the GhSA namespace contains a lot of useful conversion functions
# that you can use. Here's an example of converting nodes:
c = Util.Gsa.FromGSA.GetNodes(b, model.Model)
# ---------- end python ----------
filename = Panel(vb.A)
filename_2 = Panel(ghsa_c_script.A)
filename_3 = Panel(python.a)
gsaapi_nodes = Panel(vb.B)
gsaapi_nodes_2 = Panel(ghsa_c_script.B)
gsaapi_nodes_3 = Panel(python.b)
gsa_grasshopper_nodes = Panel(vb.C)
gsa_grasshopper_nodes_2 = Panel(ghsa_c_script.C)
gsa_grasshopper_nodes_3 = Panel(python.c)
