# Grasshopper definition MembersFromGeometry.gh (Grasshopper 1.0.7)
# Copyright: Arup
# plug-ins: sof_gh_sofistik_rhino, GSA

io = IO(
    SofistikDocumentProperties_VersionMajor="2020",
    SofistikDocumentProperties_VersionMinor="8",
    SofistikDocumentProperties_VersionName="Rhino-Interface")
pipeline = GeometryPipeline(
    GroupByLayer=False,
    GroupByType=False,
    IncludeHidden=True,
    IncludeLocked=True,
    LayerFilter="*",
    NameFilter="*",
    SublayerFiltering=True,
    TypeFilter=1)
pipeline_2 = GeometryPipeline(
    GroupByLayer=False,
    GroupByType=False,
    IncludeHidden=True,
    IncludeLocked=True,
    LayerFilter="*",
    NameFilter="*",
    SublayerFiltering=True,
    TypeFilter=4)
pipeline_3 = GeometryPipeline(
    GroupByLayer=False,
    GroupByType=False,
    IncludeHidden=True,
    IncludeLocked=True,
    LayerFilter="*",
    NameFilter="*",
    SublayerFiltering=True,
    TypeFilter=1073741848)
mem2d = Create2DMember(Brep=pipeline_3, InclPoints=pipeline, MeshSize=Slider(1, range=0.25..10))
m1d = _1DMember(pipeline_2)
elemfrommem = ElementsFromMembers(_1DMembers=m1d, _2DMembers=mem2d)  # -> _1DElements, _2DElements, _3DElements
