# Grasshopper definition AssembleModel.gh (Grasshopper 1.0.7)
# Copyright: Arup
# plug-ins: GSA

vec = VectorXYZ(XComponent=Slider(4, range=0..10), YComponent=Slider(3, range=0..10), ZComponent=0)  # -> Vector, Length
pt = ConstructPoint(XCoordinate=0, YCoordinate=0, ZCoordinate="-10")
pt_2 = ConstructPoint(XCoordinate="10", YCoordinate=0, ZCoordinate="-10")
pt_3 = ConstructPoint(XCoordinate=0, YCoordinate="10", ZCoordinate="-10")
pt_4 = ConstructPoint(XCoordinate="10", YCoordinate="10", ZCoordinate="-10")
pt_5 = ConstructPoint(XCoordinate=0, YCoordinate=0, ZCoordinate=0)
ln = Line(StartPoint=pt_5, EndPoint=pt)
pt_6 = ConstructPoint(XCoordinate="10", YCoordinate=0, ZCoordinate=0)
ln_2 = Line(StartPoint=pt_6, EndPoint=pt_2)
pt_7 = ConstructPoint(XCoordinate=0, YCoordinate="10", ZCoordinate=0)
ln_3 = Line(StartPoint=pt_7, EndPoint=pt_3)
pt_8 = ConstructPoint(XCoordinate="10", YCoordinate="10", ZCoordinate=0)
ln_4 = Line(StartPoint=pt_8, EndPoint=pt_4)
srf4pt = _4PointSurface(CornerA=pt_5, CornerB=pt_6, CornerC=pt_8, CornerD=pt_7)
srf4pt_2 = _4PointSurface(CornerA=pt_5, CornerB=pt_6, CornerC=pt_2, CornerD=pt)
srf4pt_3 = _4PointSurface(CornerA=pt_6, CornerB=pt_8, CornerC=pt_4, CornerD=pt_2)
ln_5 = Line(StartPoint=pt_5, EndPoint=pt_7)
move = Move(Geometry=pt_5, Motion=vec.Vector)  # -> Geometry, Transform
xy = XYPlane(Origin=Point(0, 0, 0))
xz = XZPlane(Origin=Point(0, 0, 0))
yz = YZPlane(Origin=Point(0, 0, 0))
gridplane = CreateGridPlane(Plane=xy, Type="General")
gridplane_2 = CreateGridPlane(Plane=xz, Type="General")
gridplane_3 = CreateGridPlane(Plane=yz, GridElevationInModelUnits="-10", Type="General")
profile = CreateProfile(
    Depth_mm="400",
    Width_mm="400",
    catalogueIndex=-1,
    inclSS=False,
    lengthUnit="Millimeter",
    mode="Other",
    Profile_type="Rectangle",
    Measure="mm",
    typeIndex=-1)
loadcase = CreateLoadCase(CaseID="3", Name="Wind", Type="Wind")
loadcase_2 = CreateLoadCase(CaseID="2", Name="Dead", Type="Dead")
createlist = CreateList(Index=0, Definition="12123", Type="Node")
loadcase_3 = CreateLoadCase(CaseID="1", Name="Dead", Type="Dead")
mat = CreateMaterial(Material_type="Concrete", Design_Code="EC2-1-1", Grade="C30/37")
creategridline = CreateGridLine(Curve=ln_5, Label="A")
gridsurface = CreateGridSurface(GridPlane=gridplane, GridSurfaceID=0, ToleranceInModelUnits="1m", Type="2D")
gridsurface_2 = CreateGridSurface(GridPlane=gridplane_3, GridSurfaceID=0, Type="2D")
gridsurface_3 = CreateGridSurface(GridPlane=gridplane_2, GridSurfaceID=0, Type="2D")
section = CreateSection(Profile=profile, Material=mat, Basic_Offset="Centroid")
prop2d = Create2DProperty(Thickness_mm="200", Material=mat, Type="Shell", Unit="mm")
crv = Curve(ln_5)
pt_9 = Point(move.Geometry)
gridsurface_4 = CreateGridSurface(GridSurfaceID=0, Type="2D")
mem2d = Create2DMember(
    Brep=srf4pt_3,
    Property2D=prop2d,
    MeshSizeInModelUnits=Slider(1, range=0..1),
    InternalOffset=True,
    Preview3dSection=False,
    Mesh_mode="Quad dominant")
mem2d_2 = Create2DMember(
    Brep=srf4pt_2,
    Property2D=prop2d,
    MeshSizeInModelUnits=Slider(0.6, range=0..1),
    InternalOffset=True,
    Preview3dSection=False,
    Mesh_mode="Quad dominant")
mem1d = Create1DMember(
    Curve=crv,
    Property=section,
    Preview3dSection=False,
    x1=False,
    x2=False,
    xx1=False,
    xx2=False,
    y1=False,
    y2=False,
    yy1=False,
    yy2=False,
    z1=False,
    z2=False,
    zz1=False,
    zz2=False)
support = CreateSupport(Point=[pt, pt_2, pt_4, pt_7], Plane=PlaneXY(0, 0, 0), x=True, xx=False, y=True, yy=False, z=True, zz=False)
mem2d_3 = Create2DMember(
    Brep=srf4pt,
    InclPoints=pt_9,
    InclCurves=mem1d,
    Property2D=prop2d,
    MeshSizeInModelUnits=Slider(1, range=0..1),
    InternalOffset=True,
    Preview3dSection=False,
    Mesh_mode="Quad dominant")
beamload = CreateBeamLoad(
    LoadCase=loadcase_3,
    Loadable1DObjects=mem1d,
    Axis=0,
    Direction="z",
    Projected=False,
    Value_kN_m="-1",
    Type="Uniform",
    Unit="kN/m")
beamthermalload = CreateBeamThermalLoad(LoadCase=loadcase_3, Loadable1DObjects=mem1d, Value_C="2", Type="Uniform", Unit="°C")
mem2dedit = Edit2DMember(Member2D=mem2d_3, InternalOffset="false", Preview3dSection=False)  # -> Member2D, MemberNumber, Brep, InclPoints, InclCurves, _2DProperty, MemberGroup, MemberType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
faceload = CreateFaceLoad(
    LoadCase=loadcase_2,
    Loadable2DObjects=mem2dedit.Member2D,
    Axis=-1,
    Direction="z",
    Projected=False,
    Value_kN_m²="-3",
    Type="Uniform",
    Unit="kN/m²")
faceload_2 = CreateFaceThermalLoad(LoadCase=loadcase_2, Loadable2DObjects=mem2dedit.Member2D, Value_C="4", Type="Uniform", Unit="°C")
mem2dedit_2 = Edit2DMember(Member2D=mem2d_2, InternalOffset="false", Preview3dSection=False)  # -> Member2D, MemberNumber, Brep, InclPoints, InclCurves, _2DProperty, MemberGroup, MemberType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
areaload = CreateGridAreaLoad(
    LoadCase=loadcase,
    Brep=mem2dedit_2.Member2D,
    GridPlaneSurface=gridsurface_3,
    Direction="y",
    Axis=0,
    Projected=False,
    Value_kN_m²="9",
    ExpansionChanged=True,
    Mode=0,
    Unit="kN/m²")

lineload = CreateGridLineLoad(
    LoadCase=loadcase_3,
    PolyLine=mem1d,
    GridPlaneSurface=gridsurface_4,
    Direction="z",
    Axis=0,
    Projected=False,
    ValueStart_kN_m="-6",
    ValueEnd_kN_m="-6",
    ExpansionChanged=False,
    Mode=0,
    Unit="kN/m")

mem2dedit_3 = Edit2DMember(Member2D=mem2d, InternalOffset="false", Preview3dSection=False)  # -> Member2D, MemberNumber, Brep, InclPoints, InclCurves, _2DProperty, MemberGroup, MemberType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

areaload_2 = CreateGridAreaLoad(
    LoadCase=loadcase,
    Brep=mem2dedit_3.Member2D,
    GridPlaneSurface=gridsurface_2,
    Direction="x",
    Axis=0,
    Projected=False,
    Value_kN_m²="10",
    ExpansionChanged=True,
    Mode=0,
    Unit="kN/m²")

gravityload = CreateGravityLoad(LoadCase=loadcase_3, LoadableObjects=mem1d, GravityFactor=Vector(0, 0, -1))
areaload_3 = CreateGridAreaLoad(
    LoadCase=loadcase_2,
    Brep=mem2dedit.Member2D,
    Direction="z",
    Axis=0,
    Projected=False,
    Value_kN_m²="7",
    ExpansionChanged=True,
    Mode=2,
    Unit="kN/m²")
areaload_4 = CreateGridAreaLoad(
    LoadCase=loadcase_2,
    Brep=mem2dedit.Member2D,
    GridPlaneSurface=gridsurface,
    Direction="z",
    Axis=0,
    Projected=False,
    Value_kN_m²="-8",
    ExpansionChanged=True,
    Mode=0,
    Unit="kN/m²")

pt_10 = Point(move.Geometry)
pointload = CreateGridPointLoad(LoadCase=loadcase_3, Point=pt_10, Direction="z", Axis=0, Value_kN="-8", ExpansionChanged=True, Mode=2, Unit="kN")

ld = Load(areaload)
nodeload = CreateNodeLoad(LoadCase=loadcase_3, NodeList=move.Geometry, Direction="z", Value_kN="-5", Type="NodeForce", Unit="kN")
ld_2 = Load([faceload, faceload_2, areaload_3, areaload_4])
σa = CreateAnalysisCase(Name="L1 + L2 + L3", Description="L1 + L2 + L3")
ld_3 = Load([nodeload, beamload, gravityload, beamthermalload, lineload, pointload])
ld_4 = Load([ld_2, ld, ld_3])
m1d = Member1D(mem1d)
no = Node(support)
m2d = Member2D([mem2dedit.Member2D, mem2dedit_3.Member2D, mem2dedit_2.Member2D])
σt = CreateAnalysisTask(AnalysisCases=σa, Solver="Static")
panel = Panel("false")
analyse = AnalyseModel(
    ModelSAndLists=[createlist, creategridline],
    GSAGeometryIn_m=[m2d, no, m1d],
    Load=ld_4,
    AnalysisTasksCombinations=σt,
    Analyse=True,
    ReMesh=True,
    Tolerance=0.01,
    Unit="m")  # -> Model, Errors, Warnings, Remarks, Log
panel_2 = Panel(analyse.Errors)
selres = SelectResult(GSAModel=analyse.Model, Type="AnalysisCase", Case_ID="A1")
loaddiagram = LoadDiagrams(
    GSAModel=analyse.Model,
    Annotation=Toggle(True),
    SignificantDigits=3,
    force="kN",
    length="mm",
    model="m",
    Case_ID="L1",
    Load_Type="All")  # -> DiagramLines, Annotations
getgeo = GetModelGeometry(GSAModel=analyse.Model, Mode=1, Unit="m")  # -> NodesIn_m, _1DElementsIn_m, _2DElementsIn_m, _3DElementsIn_m, _1DMembersIn_m, _2DMembersIn_m, _3DMembersIn_m
deformedpreview3d = PreviewDeformed3DSections(Result=selres, noDec=0, val=236, valMax=1000, valMin=0)  # -> Mesh, Outlines
null = NullItem(Item=flatten([deformedpreview3d.Mesh, deformedpreview3d.Outlines, loaddiagram.Annotations, loaddiagram.DiagramLines]))  # -> NullFlags, InvalidFlags, Description
ma = MassAddition(Input=null.NullFlags)  # -> Result, PartialResults
equals = Equality(FirstNumber=ma.Result, SecondNumber="0")  # -> Equality, Inequality

# ---- group: Assemble
bool = Boolean(equals.Equality)

# ----
panel_3 = Panel(bool)
