# Grasshopper definition ContourEnvelopes.gh (Grasshopper 1.0.7)
# Copyright: Arup
# plug-ins: GSA

pt = ConstructPoint(XCoordinate=0, YCoordinate="9", ZCoordinate=0)
pt_2 = ConstructPoint(XCoordinate=0, YCoordinate=0, ZCoordinate=0)
panel = Panel("""0.35
0.7""")
ln = Line(StartPoint=pt_2, EndPoint=pt)

# ---- group: 1d member
mat = CreateMaterial(Material_type="Steel", Design_Code="EN 1993-1-1:2005", Grade="S235")
profile = CreateProfile(
    catalogueIndex=3,
    lengthUnit="Centimeter",
    mode="Catalogue",
    Profile_type="Catalogue",
    Catalogue="Europrofile",
    Type="EP HE beams",
    Profile="HE HE320.B",
    typeIndex=27)
section = CreateSection(Profile=profile, Material=mat, Basic_Offset="Top")
mem1d = Create1DMember(
    Curve=ln,
    Property=section,
    Preview3dSection=True,
    x1=False,
    x2=False,
    xx1=False,
    xx2=False,
    y1=False,
    y2=False,
    yy1=False,
    yy2=False,
    z1=False,
    z2=False,
    zz1=False,
    zz2=False)

# ----
eval = EvaluateCurve(Curve=ln, Parameter=panel)  # -> Point, Tangent, Angle
X = UnitX(Factor="6")
move = Move(Geometry=eval.Point, Motion=X)  # -> reverse(Geometry), Transform
pline = PolyLine(Vertices=[eval.Point, move.Geometry], Closed=Toggle(True))
pt_3 = ConstructPoint(XCoordinate="0.3", YCoordinate="0.5", ZCoordinate=0)
pt_4 = ConstructPoint(XCoordinate="0.5", YCoordinate="0.3", ZCoordinate=0)
pt_5 = ConstructPoint(XCoordinate="0.3", YCoordinate="0.3", ZCoordinate=0)
pt_6 = ConstructPoint(XCoordinate="0.5", YCoordinate="0.5", ZCoordinate=0)
support = CreateSupport(Point=[move.Geometry, pt_2, pt], Plane=PlaneXY(0, 0, 0), x=True, xx=False, y=True, yy=False, z=True, zz=False)
evalsrf = EvaluateSurface(Surface=reparameterize(pline), Point=[pt_5, pt_3, pt_6, pt_4])  # -> Point, Normal, UDirection, VDirection, Frame

# ---- group: 2d member
mat_2 = CreateMaterial(Material_type="Concrete", Design_Code="EC2-1-1", Grade="C30/37")
prop2d = Create2DProperty(Thickness_cm="28cm", Material=mat_2, Type="Shell", Unit="cm")
mem2d = Create2DMember(
    Brep=pline,
    InclPoints=evalsrf.Point,
    Property2D=prop2d,
    InternalOffset=True,
    Preview3dSection=False,
    Mesh_mode="Quad dominant")

# ---- group: 3d member
item = ListItem(List=evalsrf.Point, Index=0, Wrap=True)  # -> Item, Item1, Item2
Z = UnitZ(Factor=1)
move_2 = Move(Geometry=item.Item2, Motion=Z)  # -> Geometry, Transform
mat_3 = CreateMaterial(Material_type="Glass", Grade="Soda-lime")
box = Box2Pt(PointA=item.Item, PointB=move_2.Geometry, Plane=PlaneXY(0, 0, 0))
mem3d = Create3DMember(Solid=box, Property3D=mat_3)

# ---- group: Loads
beamload = CreateBeamLoad(
    LoadCase="2",
    Loadable1DObjects=mem1d,
    Axis=0,
    Direction="z",
    Projected=False,
    Value_kN_m="-15",
    Type="Uniform",
    Unit="kN/m")
faceload = CreateFaceLoad(
    LoadCase="3",
    Loadable2DObjects=mem2d,
    Axis=-1,
    Direction="z",
    Projected=False,
    Value_kN_m²="-5",
    Type="Uniform",
    Unit="kN/m²")
gravityload = CreateGravityLoad(GravityFactor=Vector(0, 0, -1))

# ---- group: Combinations
createcombination = CreateCombinationCase(ID="5", Name="MinEnvelope", Description="(-1C3 or C3)")
createcombination_2 = CreateCombinationCase(ID="6", Name="MinEnvelope2", Description="(-1.5A1 or -1.2A1)")
createcombination_3 = CreateCombinationCase(ID="4", Name="MaxEnvelope", Description="(C3 or -1C3)")
createcombination_4 = CreateCombinationCase(ID="1", Name="BeamLoad", Description="(1 or 1.35)A1 + (0 or 1.5)A2")
createcombination_5 = CreateCombinationCase(ID="2", Name="FaceLoad", Description="(1 or 1.35)A1 + (0 or 1.5)A3")
createcombination_6 = CreateCombinationCase(ID="3", Name="Combo", Description="C1 to C2")

# ----
analyse = AnalyseModel(
    GSAGeometryIn_m=[support, mem1d, mem2d, mem3d],
    Load=[gravityload, beamload, faceload],
    AnalysisTasksCombinations=[createcombination_4, createcombination_5, createcombination_6, createcombination_3, createcombination, createcombination_2],
    Analyse=True,
    ReMesh=True,
    Tolerance=0.01,
    Unit="m")  # -> Model, Errors, Warnings, Remarks, Logs
selres = SelectResult(GSAModel=analyse.Model, Type="Combination", Case_ID="C3", Permutation="All")
nodecontour = ContourNodeResults(
    Result=selres,
    Scalar=10,
    Display=3,
    Mode=0,
    envelope="Maximum",
    force="kN",
    legend=True,
    legendScale=1,
    length="mm",
    moment="kN·m",
    noDec=0,
    Result_Type="Displacement",
    Component="Resolved |U|",
    slider=True,
    val=250,
    valMax=1000,
    valMin=0)  # -> P, Colours, Values_mm
contour3d = Contour3DResults(
    Result=selres,
    Display=3,
    Mode=0,
    envelope="Maximum",
    legend=True,
    legendScale=1,
    length="mm",
    noDec=0,
    Result_Type="Displacement",
    Component="Resolved |U|",
    slider=True,
    stress="MPa",
    val=250,
    valMax=1000,
    valMin=0)  # -> NgonMesh, Colours, Values_mm
contour1d = Contour1DResults(
    Result=selres,
    IntermediatePoints=10,
    Scale=10,
    Display=3,
    Mode=0,
    energy="MJ",
    envelope="Maximum",
    force="kN",
    legend=True,
    legendScale=1,
    length="mm",
    moment="kN·m",
    noDec=0,
    Result_Type="Displacement",
    Component="Resolved |U|",
    slider=True,
    stress="MPa",
    val=250,
    valMax=1000,
    valMin=0)  # -> L, Colours, Values_mm
contour2d = Contour2DResults(
    Result=selres,
    Display=3,
    Mode=0,
    envelope="Maximum",
    flayer=0,
    force="kN/m",
    legend=True,
    legendScale=1,
    length="mm",
    model="m",
    moment="kN",
    noDec=0,
    Result_Type="Displacement",
    Component="Resolved |U|",
    slider=True,
    stress="MPa",
    val=250,
    valMax=1000,
    valMin=0)  # -> M, Colours, Values_mm
nodecontour_2 = ContourNodeResults(
    Result=selres,
    Scalar=10,
    Display=3,
    Mode=0,
    envelope="Minimum",
    force="kN",
    legend=True,
    legendScale=1,
    length="mm",
    moment="kN·m",
    noDec=0,
    Result_Type="Displacement",
    Component="Resolved |U|",
    slider=True,
    val=250,
    valMax=1000,
    valMin=0)  # -> P, Colours, Values_mm
contour3d_2 = Contour3DResults(
    Result=selres,
    Display=3,
    Mode=0,
    envelope="Minimum",
    legend=True,
    legendScale=1,
    length="mm",
    noDec=0,
    Result_Type="Displacement",
    Component="Resolved |U|",
    slider=True,
    stress="MPa",
    val=250,
    valMax=1000,
    valMin=0)  # -> NgonMesh, Colours, Values_mm
contour1d_2 = Contour1DResults(
    Result=selres,
    IntermediatePoints=10,
    Scale=10,
    Display=3,
    Mode=0,
    energy="MJ",
    envelope="Minimum",
    force="kN",
    legend=True,
    legendScale=1,
    length="mm",
    moment="kN·m",
    noDec=0,
    Result_Type="Displacement",
    Component="Resolved |U|",
    slider=True,
    stress="MPa",
    val=250,
    valMax=1000,
    valMin=0)  # -> L, Colours, Values_mm
contour2d_2 = Contour2DResults(
    Result=selres,
    Display=3,
    Mode=0,
    envelope="Minimum",
    flayer=0,
    force="kN/m",
    legend=True,
    legendScale=1,
    length="mm",
    model="m",
    moment="kN",
    noDec=0,
    Result_Type="Displacement",
    Component="Resolved |U|",
    slider=True,
    stress="MPa",
    val=250,
    valMax=1000,
    valMin=0)  # -> M, Colours, Values_mm

# ---- group: Assert max and min are not equal
ptresinfo = PointResultInfo(P=nodecontour.P)  # -> Point, R
ptresinfo_2 = PointResultInfo(P=nodecontour_2.P)  # -> Point, R
meshresinfo = MeshResultInfo(M=contour2d.M)  # -> Mesh, Vertices, R
meshresinfo_2 = MeshResultInfo(M=contour2d_2.M)  # -> Mesh, Vertices, R
meshresinfo_3 = MeshResultInfo(M=contour3d.NgonMesh)  # -> Mesh, Vertices, R
meshresinfo_4 = MeshResultInfo(M=contour3d_2.NgonMesh)  # -> Mesh, Vertices, R
lnresinfo = LineResultInfo(L=contour1d.L)  # -> Line, R1, R2
lnresinfo_2 = LineResultInfo(L=contour1d_2.L)  # -> Line, R1, R2
num = Number(ptresinfo_2.R)
num_2 = Number(ptresinfo.R)
num_3 = Number(meshresinfo_2.R)
num_4 = Number(meshresinfo.R)
num_5 = Number(meshresinfo_4.R)
num_6 = Number(meshresinfo_3.R)
num_7 = Number([lnresinfo_2.R1, lnresinfo_2.R2])
num_8 = Number([lnresinfo.R1, lnresinfo.R2])
equals = Equality(FirstNumber=num_2, SecondNumber="0")  # -> Equality, Inequality
equals_2 = Equality(FirstNumber=num_4, SecondNumber="0")  # -> Equality, Inequality
equals_3 = Equality(FirstNumber=num_6, SecondNumber="0")  # -> Equality, Inequality
equals_4 = Equality(FirstNumber=num_8, SecondNumber="0")  # -> Equality, Inequality
cull = CullPattern(List=num_2, CullPattern=equals.Inequality)
cull_2 = CullPattern(List=num, CullPattern=equals.Inequality)
cull_3 = CullPattern(List=num_4, CullPattern=equals_2.Inequality)
cull_4 = CullPattern(List=num_3, CullPattern=equals_2.Inequality)
cull_5 = CullPattern(List=num_6, CullPattern=equals_3.Inequality)
cull_6 = CullPattern(List=num_5, CullPattern=equals_3.Inequality)
cull_7 = CullPattern(List=num_8, CullPattern=equals_4.Inequality)
cull_8 = CullPattern(List=num_7, CullPattern=equals_4.Inequality)
equals_5 = Equality(FirstNumber=cull, SecondNumber=cull_2)  # -> Equality, Inequality
equals_6 = Equality(FirstNumber=cull_3, SecondNumber=cull_4)  # -> Equality, Inequality
equals_7 = Equality(FirstNumber=cull_5, SecondNumber=cull_6)  # -> Equality, Inequality
equals_8 = Equality(FirstNumber=cull_7, SecondNumber=cull_8)  # -> Equality, Inequality
ma = MassAddition(Input=flatten(equals_8.Equality))  # -> Result, PartialResults
ma_2 = MassAddition(Input=equals_5.Equality)  # -> Result, PartialResults
ma_3 = MassAddition(Input=equals_6.Equality)  # -> Result, PartialResults
ma_4 = MassAddition(Input=equals_7.Equality)  # -> Result, PartialResults

# ---- group: CustomGradient
subtraction = Subtraction(A="5", B=1)
subtraction_2 = Subtraction(A="7.5", B="0")
division = Division(A=subtraction_2, B=subtraction)
series = Series(Start="0", Step=division, Count="5")
gradient = Gradient(LowerLimit="0", UpperLimit="7.5", Parameter=series, stops=[0: RGB(0, 128, 0), 0.5: RGB(255, 255, 0), 1: RGB(255, 0, 0)])
dom = ConstructDomain(DomainStart="0", DomainEnd="7.5")

# ---- group: Custom +/- permutations
merge = Merge(Data1="1", Data2="9")
getres = GetResult(GSAModel=analyse.Model, T="C", Case="6")
getres_2 = GetResult(GSAModel=analyse.Model, T="C", Case="5", Permutation=merge)
getres_3 = GetResult(GSAModel=analyse.Model, T="C", Case="4", Permutation=merge)

# ---- group: 3dResults
int = Integer(ma_4.Result)

# ---- group: 2dResults
int_2 = Integer(ma_3.Result)

# ---- group: NodeResults
int_3 = Integer(ma_2.Result)

# ---- group: 1dResults
int_4 = Integer(ma.Result)

# ----
nodecontour_3 = ContourNodeResults(
    Result=getres_3,
    NodeFilterList="7 8 26 27 42 45 56 57",
    Colour=gradient,
    MinMaxDomain=dom,
    Scalar=10,
    Display=3,
    Mode=0,
    envelope="Maximum",
    force="kN",
    legend=True,
    legendScale=1,
    length="mm",
    moment="kN·m",
    noDec=0,
    Result_Type="Displacement",
    Component="Resolved |U|",
    slider=True,
    val=250,
    valMax=1000,
    valMin=0)  # -> P, Colours, Values_mm
nodecontour_4 = ContourNodeResults(
    Result=getres_2,
    NodeFilterList="7 8 26 27 42 45 56 57",
    Colour=gradient,
    MinMaxDomain=dom,
    Scalar=10,
    Display=3,
    Mode=0,
    envelope="Minimum",
    force="kN",
    legend=True,
    legendScale=1,
    length="mm",
    moment="kN·m",
    noDec=0,
    Result_Type="Displacement",
    Component="Resolved |U|",
    slider=True,
    val=250,
    valMax=1000,
    valMin=0)  # -> P, Colours, Values_mm
contour1d_3 = Contour1DResults(
    Result=getres_3,
    IntermediatePoints="4",
    Colour=gradient,
    MinMaxDomain=dom,
    Scale=10,
    Display=3,
    Mode=0,
    energy="MJ",
    envelope="Maximum",
    force="kN",
    legend=True,
    legendScale=1,
    length="mm",
    moment="kN·m",
    noDec=0,
    Result_Type="Displacement",
    Component="Resolved |U|",
    slider=True,
    stress="MPa",
    val=250,
    valMax=1000,
    valMin=0)  # -> L, Colours, Values_mm
contour2d_3 = Contour2DResults(
    Result=getres_3,
    ElementMemberFilterList="16 18",
    Colour=gradient,
    MinMaxDomain=dom,
    Display=3,
    Mode=0,
    envelope="Maximum",
    flayer=0,
    force="kN/m",
    legend=True,
    legendScale=1,
    length="mm",
    model="m",
    moment="kN",
    noDec=0,
    Result_Type="Displacement",
    Component="Resolved |U|",
    slider=True,
    stress="MPa",
    val=250,
    valMax=1000,
    valMin=0)  # -> M, Colours, Values_mm
contour3d_3 = Contour3DResults(
    Result=getres_3,
    Colour=gradient,
    MinMaxDomain=dom,
    Display=3,
    Mode=0,
    envelope="Maximum",
    legend=True,
    legendScale=1,
    length="mm",
    noDec=0,
    Result_Type="Displacement",
    Component="Resolved |U|",
    slider=True,
    stress="MPa",
    val=250,
    valMax=1000,
    valMin=0)  # -> NgonMesh, Colours, Values_mm
contour1d_4 = Contour1DResults(
    Result=getres_2,
    IntermediatePoints="4",
    Colour=gradient,
    MinMaxDomain=dom,
    Scale=10,
    Display=3,
    Mode=0,
    energy="MJ",
    envelope="Minimum",
    force="kN",
    legend=True,
    legendScale=1,
    length="mm",
    moment="kN·m",
    noDec=0,
    Result_Type="Displacement",
    Component="Resolved |U|",
    slider=True,
    stress="MPa",
    val=250,
    valMax=1000,
    valMin=0)  # -> L, Colours, Values_mm
contour2d_4 = Contour2DResults(
    Result=getres_2,
    ElementMemberFilterList="16 18",
    Colour=gradient,
    MinMaxDomain=dom,
    Display=3,
    Mode=0,
    envelope="Minimum",
    flayer=0,
    force="kN/m",
    legend=True,
    legendScale=1,
    length="mm",
    model="m",
    moment="kN",
    noDec=0,
    Result_Type="Displacement",
    Component="Resolved |U|",
    slider=True,
    stress="MPa",
    val=250,
    valMax=1000,
    valMin=0)  # -> M, Colours, Values_mm
contour3d_4 = Contour3DResults(
    Result=getres_2,
    Colour=gradient,
    MinMaxDomain=dom,
    Display=3,
    Mode=0,
    envelope="Minimum",
    legend=True,
    legendScale=1,
    length="mm",
    noDec=0,
    Result_Type="Displacement",
    Component="Resolved |U|",
    slider=True,
    stress="MPa",
    val=250,
    valMax=1000,
    valMin=0)  # -> NgonMesh, Colours, Values_mm
nodecontour_5 = ContourNodeResults(
    Result=getres,
    NodeFilterList="7 8 26 27 42 45 56 57",
    Colour=gradient,
    MinMaxDomain=dom,
    Scalar=10,
    Display=3,
    Mode=0,
    envelope="Minimum",
    force="kN",
    legend=True,
    legendScale=1,
    length="mm",
    moment="kN·m",
    noDec=0,
    Result_Type="Displacement",
    Component="Resolved |U|",
    slider=True,
    val=250,
    valMax=1000,
    valMin=0)  # -> P, Colours, Values_mm
contour1d_5 = Contour1DResults(
    Result=getres,
    IntermediatePoints="4",
    Colour=gradient,
    MinMaxDomain=dom,
    Scale=10,
    Display=3,
    Mode=0,
    energy="MJ",
    envelope="Minimum",
    force="kN",
    legend=True,
    legendScale=1,
    length="mm",
    moment="kN·m",
    noDec=0,
    Result_Type="Displacement",
    Component="Resolved |U|",
    slider=True,
    stress="MPa",
    val=250,
    valMax=1000,
    valMin=0)  # -> L, Colours, Values_mm
contour2d_5 = Contour2DResults(
    Result=getres,
    ElementMemberFilterList="16 18",
    Colour=gradient,
    MinMaxDomain=dom,
    Display=3,
    Mode=0,
    envelope="Minimum",
    flayer=0,
    force="kN/m",
    legend=True,
    legendScale=1,
    length="mm",
    model="m",
    moment="kN",
    noDec=0,
    Result_Type="Displacement",
    Component="Resolved |U|",
    slider=True,
    stress="MPa",
    val=250,
    valMax=1000,
    valMin=0)  # -> M, Colours, Values_mm
contour3d_5 = Contour3DResults(
    Result=getres,
    Colour=gradient,
    MinMaxDomain=dom,
    Display=3,
    Mode=0,
    envelope="Minimum",
    legend=True,
    legendScale=1,
    length="mm",
    noDec=0,
    Result_Type="Displacement",
    Component="Resolved |U|",
    slider=True,
    stress="MPa",
    val=250,
    valMax=1000,
    valMin=0)  # -> NgonMesh, Colours, Values_mm
lnresinfo_3 = LineResultInfo(L=contour1d_3.L)  # -> Line, R1, R2
lnresinfo_4 = LineResultInfo(L=contour1d_4.L)  # -> Line, R1, R2
ptresinfo_3 = PointResultInfo(P=nodecontour_3.P)  # -> Point, R
ptresinfo_4 = PointResultInfo(P=nodecontour_4.P)  # -> Point, R
lnresinfo_5 = LineResultInfo(L=contour1d_5.L)  # -> Line, R1, R2
meshresinfo_5 = MeshResultInfo(M=contour3d_3.NgonMesh)  # -> Mesh, Vertices, R
ptresinfo_5 = PointResultInfo(P=nodecontour_5.P)  # -> Point, R
meshresinfo_6 = MeshResultInfo(M=contour2d_3.M)  # -> Mesh, Vertices, R
meshresinfo_7 = MeshResultInfo(M=contour3d_4.NgonMesh)  # -> Mesh, Vertices, R
meshresinfo_8 = MeshResultInfo(M=contour2d_4.M)  # -> Mesh, Vertices, R
meshresinfo_9 = MeshResultInfo(M=contour3d_5.NgonMesh)  # -> Mesh, Vertices, R
meshresinfo_10 = MeshResultInfo(M=contour2d_5.M)  # -> Mesh, Vertices, R
item_2 = ListItem(List=lnresinfo_3.R1, Index="3", Wrap=True)  # -> flatten(Item)
item_3 = ListItem(List=lnresinfo_4.R1, Index="3", Wrap=True)  # -> flatten(Item)
item_4 = ListItem(List=lnresinfo_5.R1, Index="3", Wrap=True)  # -> flatten(Item)

# ---- group: MinElem3ds
num_9 = Number(meshresinfo_7.R)

# ---- group: MaxElem2ds
num_10 = Number(meshresinfo_6.R)

# ---- group: Min2Elem3ds
num_11 = Number(meshresinfo_9.R)

# ---- group: MinElem2ds
num_12 = Number(meshresinfo_8.R)

# ---- group: MaxElem3ds
num_13 = Number(meshresinfo_5.R)

# ---- group: Min2Elem2ds
num_14 = Number(meshresinfo_10.R)

# ---- group: MaxNodes
num_15 = Number(ptresinfo_3.R)

# ---- group: MinNodes
num_16 = Number(ptresinfo_4.R)

# ---- group: Min2Nodes
num_17 = Number(ptresinfo_5.R)

# ---- group: MaxElem1ds
num_18 = Number(item_2)

# ---- group: MinElem1ds
num_19 = Number(item_3)

# ---- group: Min2Elem1ds
num_20 = Number(item_4)
