# Grasshopper definition CreateEdit2dPropElemAndMem.gh (Grasshopper 1.0.7)
# Copyright: Arup
# plug-ins: GSA

size = Slider(3, range=0..100)
rectangle = Rectangle(Plane=PlaneXY(0, 0, 0), XSize="4", YSize="4", Radius=0)  # -> Rectangle, Length
pt = ConstructPoint(XCoordinate=0, YCoordinate=0, ZCoordinate="4")
pt_2 = ConstructPoint(XCoordinate=size, YCoordinate=0, ZCoordinate="4")
pt_3 = ConstructPoint(XCoordinate=size, YCoordinate=size, ZCoordinate="4")
pt_4 = ConstructPoint(XCoordinate=0, YCoordinate=size, ZCoordinate="4")
material = CustomMaterial(
    ElasticModulus_MPa="18000",
    PoissonsRatio="0.3",
    Density_kg_m³="2400",
    Material_Type="Concrete",
    Stress_Unit="MPa",
    Density_Unit="kg/m³",
    Temperature_Unit="°C")
material_2 = CustomMaterial(
    ElasticModulus_MPa="8000",
    PoissonsRatio="0.15",
    Density_kg_m³="750",
    Material_Type="Timber",
    Stress_Unit="MPa",
    Density_Unit="kg/m³",
    Temperature_Unit="°C")
mplane = MeshPlane(Boundary=rectangle.Rectangle, WidthCount="4", HeightCount="4")  # -> Mesh, Area
sqr = Square(Value="4")
division = Division(A=sqr, B=2)
series = Series(Start=0, Step=1, Count=sqr)
srf4pt = _4PointSurface(CornerA=pt, CornerB=pt_2, CornerC=pt_3, CornerD=pt_4)
prop2d = Create2DProperty(Thickness_cm="40", Material=material, Type="Shell", Unit="cm")
elem2d = Create2DElement(Mesh=mplane.Mesh)
offset = CreateOffset(OffsetZ_m="-0.15", Measure="m")
series_2 = Series(Start="4", Step=1, Count=sqr)
offset_2 = CreateOffset(OffsetZ_m=series_2, Measure="m")
concat = Concatenate(FragmentA="multiName", FragmentB=series)
series_3 = Series(Start="5", Step=1, Count=sqr)
toggle = BooleanToggle(True)
dup = DuplicateData(Data=Toggle(False), Number=division, Order=True)
dup_2 = DuplicateData(Data=Toggle(True), Number=division, Order=True)
mem2d = Create2DMember(Brep=srf4pt, Prop2D=prop2d, InternalOffset=False)
prop2dedit = Edit2DProperty(
    Prop2D=prop2d,
    Prop2dNumber="6",
    Material=material_2,
    Thickness_cm="50",
    LengthUnit="Centimeter",
    ReferenceEdge=0,
    SupportType=0)  # -> Prop2D, Prop2dNumber, Material, Thickness_cm, Axis, SupportType, ReferenceEdge, Prop2dName, Prop2dColour, Type
area = Area(Geometry=srf4pt)  # -> Area, Centroid
no = Node(pt)
weave = Weave(Pattern=[0, 1], Stream0=dup, Stream1=dup_2, NullGaps=False)
elem2dedit = Edit2DElement(
    Element2D=elem2d,
    Element2dNumber=series_3,
    Element2dGroup="4",
    Offset=offset,
    OrientationAngle=degrees("90"),
    Element2dName="singleName",
    DummyElement=toggle)  # -> Element2D, Number, AnalysisMesh, _2DProperty, Group, ElementType, Offset, OrientationAngle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
elem2dedit_2 = Edit2DElement(
    Element2D=elem2d,
    Element2dGroup=series_2,
    Offset=offset_2,
    OrientationAngle=degrees(series_2),
    Element2dName=concat,
    DummyElement=weave)  # -> Element2D, Number, AnalysisMesh, _2DProperty, Group, ElementType, Offset, OrientationAngle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
mem2dedit = Edit2DMember(Member2D=mem2d, MemberType="Wall", _2DElementType="Rigid Diaphragm")  # -> Member2D, MemberNumber, Brep, InclPoints, InclCurves, _2DProperty, MemberGroup, MemberType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
mem2dedit_2 = Edit2DMember(
    Member2D=mem2d,
    Member2dNumber="9",
    InclPoints=area.Centroid,
    _2DProperty=prop2dedit.Prop2D,
    Member2dGroup="4",
    _2DElementType="1")  # -> Member2D, MemberNumber, Brep, InclPoints, InclCurves, _2DProperty, MemberGroup, MemberType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
deg = Degrees(Radians=elem2dedit_2.OrientationAngle)
demesh = DeconstructMesh(Mesh=elem2dedit.AnalysisMesh)  # -> Vertices, Faces, Colours, Normals
deg_2 = Degrees(Radians=elem2dedit.OrientationAngle)
dcon = DeleteConsecutive(Set=elem2dedit.Name, Wrap=False)  # -> Set, Count
elemfrommem = ElementsFromMembers(Nodes_m=no, _2DMembers_m=mem2dedit.Member2D, Tolerance=0.01, Unit="m")  # -> Nodes, _1DElements, _2DElements, _3DElements, GSAModel
elemfrommem_2 = ElementsFromMembers(_2DMembers_m=mem2dedit_2.Member2D, Tolerance=0.01, Unit="m")  # -> Nodes, _1DElements, _2DElements, _3DElements, GSAModel
dcon_2 = DeleteConsecutive(Set=elem2dedit.DummyElement, Wrap=False)  # -> Set, Count
tmatch = MatchText(Text=elem2dedit_2.Name, Pattern=concat, Case=True)
round = Round(Number=deg)  # -> Nearest, Floor, Ceiling
lng = ListLength(List=elem2dedit.DummyElement)
dcon_3 = DeleteConsecutive(Set=deg_2, Wrap=False)  # -> Set, Count
lng_2 = ListLength(List=elem2dedit_2.DummyElement)
lng_3 = ListLength(List=demesh.Faces)
lng_4 = ListLength(List=elem2dedit.OrientationAngle)
lng_5 = ListLength(List=elem2dedit.Name)
lng_6 = ListLength(List=elem2dedit_2.OrientationAngle)
lng_7 = ListLength(List=dcon.Set)
lng_8 = ListLength(List=elem2dedit_2.Name)
lng_9 = ListLength(List=elem2dedit_2.Group)
lng_10 = ListLength(List=elemfrommem.Nodes)
equals = Equality(FirstNumber=elem2dedit.Number, SecondNumber=series_3)  # -> Equality, Inequality
equals_2 = Equality(FirstNumber=sqr, SecondNumber=lng_3)  # -> Equality, Inequality
equals_3 = Equality(FirstNumber=sqr, SecondNumber=lng)  # -> Equality, Inequality
equals_4 = Equality(FirstNumber=toggle, SecondNumber=dcon_2.Set)  # -> Equality, Inequality
equals_5 = Equality(FirstNumber=sqr, SecondNumber=lng_2)  # -> Equality, Inequality
equals_6 = Equality(FirstNumber=weave, SecondNumber=elem2dedit_2.DummyElement)  # -> Equality, Inequality
equals_7 = Equality(FirstNumber=sqr, SecondNumber=lng_4)  # -> Equality, Inequality
equals_8 = Equality(FirstNumber="90", SecondNumber=dcon_3.Set)  # -> Equality, Inequality
equals_9 = Equality(FirstNumber=lng_7, SecondNumber="1")  # -> Equality, Inequality
equals_10 = Equality(FirstNumber=sqr, SecondNumber=lng_5)  # -> Equality, Inequality
equals_11 = Equality(FirstNumber=sqr, SecondNumber=lng_6)  # -> Equality, Inequality
equals_12 = Equality(FirstNumber=series_2, SecondNumber=round.Nearest)  # -> Equality, Inequality
equals_13 = Equality(FirstNumber=sqr, SecondNumber=lng_8)  # -> Equality, Inequality
equals_14 = Equality(FirstNumber=sqr, SecondNumber=lng_9)  # -> Equality, Inequality
equals_15 = Equality(FirstNumber=series_2, SecondNumber=elem2dedit_2.Group)  # -> Equality, Inequality
not = GateNot(A=tmatch)

# ---- group: DiaphragmNodeCount
int = Integer(lng_10)

# ----
elem2dedit_3 = Edit2DElement(Element2D=elemfrommem_2._2DElements)  # -> Element2D, Number, AnalysisMesh, _2DProperty, Group, ElementType, Offset, OrientationAngle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
chars = Characters(Text=elem2dedit_3.ElementType)  # -> Result, Unicode
lng_11 = ListLength(List=elem2dedit_3.Number)
int_2 = Integer(elem2dedit_3.ParentMembers)
int_3 = Integer(elem2dedit_3._2DProperty)
int_4 = Integer(elem2dedit_3.Group)
item = ListItem(List=reverse(chars.Result), Index=0, Wrap=True)  # -> flatten(Item)
dcon_4 = DeleteConsecutive(Set=int_2, Wrap=False)  # -> Set, Count
dcon_5 = DeleteConsecutive(Set=int_4, Wrap=False)  # -> Set, Count
dcon_6 = DeleteConsecutive(Set=int_3, Wrap=False)  # -> Set, Count
sort = SortList(Keys=elem2dedit_3.Number)  # -> Keys, ValuesA
series_4 = Series(Start="1", Step=1, Count=lng_11)
equals_16 = Equality(FirstNumber="9", SecondNumber=dcon_4.Set)  # -> Equality, Inequality
equals_17 = Equality(FirstNumber="4", SecondNumber=dcon_5.Set)  # -> Equality, Inequality
equals_18 = Equality(FirstNumber="6", SecondNumber=dcon_6.Set)  # -> Equality, Inequality
ma = MassAddition(Input=flatten([equals.Inequality, equals_2.Inequality, equals_7.Inequality, equals_8.Inequality, equals_10.Inequality, equals_9.Inequality, equals_3.Inequality, equals_4.Inequality, equals_14.Inequality, equals_15.Inequality, equals_11.Inequality, equals_12.Inequality, equals_13.Inequality, not, equals_5.Inequality, equals_6.Inequality]))  # -> Result, PartialResults
equals_19 = Equality(FirstNumber=item, SecondNumber="6")  # -> Equality, Inequality
equals_20 = Equality(FirstNumber=item, SecondNumber="8")  # -> Equality, Inequality
equals_21 = Equality(FirstNumber=series_4, SecondNumber=sort.Keys)  # -> Equality, Inequality
or = GateOr(A=equals_19.Equality, B=equals_20.Equality)

# ---- group: EditElem2dSet
int_5 = Integer(ma.Result)

# ----
not_2 = GateNot(A=or)
ma_2 = MassAddition(Input=flatten([equals_18.Inequality, equals_17.Inequality, not_2, equals_16.Inequality, equals_21.Inequality]))  # -> Result, PartialResults

# ---- group: EditElem2dInfo
int_6 = Integer(ma_2.Result)
