# Grasshopper definition CreateEdit3dPropElemAndMem.gh (Grasshopper 1.0.7)
# Copyright: Arup
# plug-ins: GSA

size = Slider(3, range=0..100)
movefact = Slider(0.5, range=0.1..0.9)
pt = ConstructPoint(XCoordinate=0, YCoordinate=0, ZCoordinate=0)
pt_2 = ConstructPoint(XCoordinate=size, YCoordinate=size, ZCoordinate=size)
multiplication = Multiplication(A=size, B=movefact)
vec = VectorXYZ(XComponent=multiplication, YComponent=multiplication, ZComponent=multiplication)  # -> Vector, Length
box = Box2Pt(PointA=pt, PointB=pt_2, Plane=PlaneXY(0, 0, 0))
material = CreateCustomMaterial(
    ElasticModulus_MPa="8000",
    PoissonsRatio="0.15",
    Density_kg_m³="750",
    Material_Type="Timber",
    Stress_Unit="MPa",
    Density_Unit="kg/m³",
    Temperature_Unit="°C")
material_2 = CreateCustomMaterial(
    ElasticModulus_MPa="18000",
    PoissonsRatio="0.3",
    Density_kg_m³="2400",
    Material_Type="Timber",
    Stress_Unit="MPa",
    Density_Unit="kg/m³",
    Temperature_Unit="°C")
move = Move(Geometry=box, Motion=vec.Vector)  # -> Geometry, Transform
sunion = SolidUnion(Breps=[box, move.Geometry])
prop3d = Create3DProperty(Material=material_2)
mem3d = Create3DMember(Solid=sunion)
mem3dedit = Edit3DMember(
    Member3D=mem3d,
    Member3dNumber="6",
    _3DProperty=prop3d,
    MeshSizeInModelUnits="0.78",
    MeshWithOthers=Toggle(False),
    Member3dName="Member",
    Member3dGroup="99",
    Member3dColour=ColourSwatch(SwatchColor=RGB(0, 115, 255)),
    DummyMember=Toggle(True))  # -> Member3D, MemberNumber, SolidMesh, _3DProperty, MeshSizeInModelUnits, MeshWithOthers, MemberName, MemberGroup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
prop3dedit = Edit3DProperty(
    Prop3D=prop3d,
    Prop3dNumber="4",
    Material=material,
    Axis="1",
    Prop3dName="Timber",
    Prop3dColour=ColourSwatch(SwatchColor=RGB(255, 242, 0)))  # -> Prop3D, Prop2dNumber, Material, Axis, Prop3dName, Prop3dColour
model = CreateModel(GSAGeometryIn_m=mem3dedit.Member3D, ReMesh=True, Tolerance=0.01, Unit="m")
getgeo = GetModelGeometry(GSAModel=model, Mode=1, Unit="m")  # -> NodesIn_m, _1DElementsIn_m, _2DElementsIn_m, _3DElementsIn_m, _1DMembersIn_m, _2DMembersIn_m, _3DMembersIn_m
mem3dedit_2 = Edit3DMember(Member3D=getgeo._3DMembersIn_m)  # -> Member3D, MemberNumber, SolidMesh, _3DProperty, MeshSizeInModelUnits, MeshWithOthers, MemberName, MemberGroup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
prop3dedit_2 = Edit3DProperty(Prop3D=mem3dedit_2._3DProperty)  # -> Prop3D, Prop2dNumber, Material, Axis, Prop3dName, Prop3dColour
prop3dedit_3 = Edit3DProperty(Prop3D=prop3d)  # -> Prop3D, Prop2dNumber, Material, Axis, Prop3dName, Prop3dColour
elem3dedit = Edit3DElement(Element3D=getgeo._3DElementsIn_m, _3DProperty=prop3dedit.Prop3D)  # -> Element3D, Number, AnalysisMesh, _3DProperty, Group, ElementType, Name, Colour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
lng = ListLength(List=mem3dedit_2.SolidMesh)

# ---- group: ExpectedError
elem3dedit_2 = Edit3DElement(Element3D=elem3dedit.Element3D, Number="1")  # -> Element3D, Number, AnalysisMesh, _3DProperty, Group, ElementType, Name, Colour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

# ----
matprop = MaterialProperties(
    Material=prop3dedit_2.Material,
    DensityUnit="KilogramPerCubicMeter",
    StressUnit="Megapascal",
    TemperatureUnit="DegreeCelsius")  # -> ElasticModulus_MPa, PoissonsRatio, Density_kg_m³, ThermalExpansion_C_¹
dcon = DeleteConsecutive(Set=elem3dedit.ParentMembers, Wrap=False)  # -> Set, Count
matprop_2 = MaterialProperties(
    Material=prop3dedit_3.Material,
    DensityUnit="KilogramPerCubicMeter",
    StressUnit="Megapascal",
    TemperatureUnit="DegreeCelsius")  # -> ElasticModulus_MPa, PoissonsRatio, Density_kg_m³, ThermalExpansion_C_¹
prop3dedit_4 = Edit3DProperty(Prop3D=elem3dedit._3DProperty)  # -> Prop3D, Prop2dNumber, Material, Axis, Prop3dName, Prop3dColour
dcon_2 = DeleteConsecutive(Set=elem3dedit.Group, Wrap=False)  # -> Set, Count
lng_2 = ListLength(List=elem3dedit.Number)
division = Division(A=lng_2, B=2)
series = Series(Start=0, Step=1, Count=lng_2)
concat = Concatenate(FragmentA="multiName", FragmentB=series)
dup = DuplicateData(Data="2", Number=lng_2, Order=True)
dup_2 = DuplicateData(Data=Toggle(False), Number=division, Order=True)
dup_3 = DuplicateData(Data=ColourSwatch(SwatchColor=RGB(255, 255, 255)), Number=lng_2, Order=True)
dup_4 = DuplicateData(Data=Toggle(True), Number=division, Order=True)
weave = Weave(Pattern=[0, 1], Stream0=dup_2, Stream1=dup_4, NullGaps=False)
series_2 = Series(Start=0, Step="2", Count=lng_2)
elem3dedit_3 = Edit3DElement(
    Element3D=elem3dedit.Element3D,
    Number=series_2,
    Element3dGroup="2",
    Element3dName="singleName",
    Element3dColour=ColourSwatch(SwatchColor=RGB(255, 255, 255)),
    DummyElement=Toggle(True))  # -> Element3D, Number, AnalysisMesh, _3DProperty, Group, ElementType, Name, Colour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
elem3dedit_4 = Edit3DElement(Element3D=elem3dedit.Element3D, Element3dGroup=dup, Element3dName=concat, Element3dColour=dup_3, DummyElement=weave)  # -> Element3D, Number, AnalysisMesh, _3DProperty, Group, ElementType, Name, Colour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
lng_3 = ListLength(List=elem3dedit.AnalysisMesh)

# ---- group: MemId
int = Integer(mem3dedit_2.MemberNumber)

# ---- group: MemCount
int_2 = Integer(lng)

# ---- group: MemName
txt = Text(mem3dedit_2.MemberName)

# ----
matprop_3 = MaterialProperties(
    Material=prop3dedit.Material,
    DensityUnit="KilogramPerCubicMeter",
    StressUnit="Megapascal",
    TemperatureUnit="DegreeCelsius")  # -> ElasticModulus_MPa, PoissonsRatio, Density_kg_m³, ThermalExpansion_C_¹
null = NullItem(Item=elem3dedit_2.Element3D)  # -> NullFlags, InvalidFlags, Description
equals = Equality(FirstNumber=dcon.Set, SecondNumber="6")  # -> Equality, Inequality
tmatch = MatchText(Text=elem3dedit_4.Name, Pattern=concat, Case=True)
dcon_3 = DeleteConsecutive(Set=elem3dedit_3.Group, Wrap=False)  # -> Set, Count
lng_4 = ListLength(List=series_2)
lng_5 = ListLength(List=elem3dedit_3.Group)
lng_6 = ListLength(List=elem3dedit_3.ElementType)
dcon_4 = DeleteConsecutive(Set=elem3dedit_3.Name, Wrap=False)  # -> Set, Count
dcon_5 = DeleteConsecutive(Set=elem3dedit_3.Colour, Wrap=False)  # -> Set, Count
lng_7 = ListLength(List=elem3dedit_3.Name)
lng_8 = ListLength(List=elem3dedit_3.Colour)
dcon_6 = DeleteConsecutive(Set=elem3dedit_3.DummyElement, Wrap=False)  # -> Set, Count
lng_9 = ListLength(List=elem3dedit_3.DummyElement)
dcon_7 = DeleteConsecutive(Set=elem3dedit_4.Group, Wrap=False)  # -> Set, Count
lng_10 = ListLength(List=series_2)
lng_11 = ListLength(List=elem3dedit_4.Group)
dcon_8 = DeleteConsecutive(Set=elem3dedit_4.Colour, Wrap=False)  # -> Set, Count
lng_12 = ListLength(List=elem3dedit_4.Name)
lng_13 = ListLength(List=elem3dedit_4.Colour)
lng_14 = ListLength(List=elem3dedit_4.DummyElement)
not = GateNot(A=null.NullFlags)
matprop_4 = MaterialProperties(
    Material=prop3dedit_4.Material,
    DensityUnit="KilogramPerCubicMeter",
    StressUnit="Megapascal",
    TemperatureUnit="DegreeCelsius")  # -> ElasticModulus_MPa, PoissonsRatio, Density_kg_m³, ThermalExpansion_C_¹
num = Number(matprop.ElasticModulus_MPa)
num_2 = Number(matprop.PoissonsRatio)
num_3 = Number(matprop.Density_kg_m³)
num_4 = Number(matprop.ThermalExpansion_C_¹)
int_3 = Integer(prop3dedit_4.Prop2dNumber)
num_5 = Number(matprop_3.ElasticModulus_MPa)
num_6 = Number(matprop_3.PoissonsRatio)
num_7 = Number(matprop_3.Density_kg_m³)
num_8 = Number(matprop_3.ThermalExpansion_C_¹)
lng_15 = ListLength(List=dcon_3.Set)
equals_2 = Equality(FirstNumber=lng_4, SecondNumber=lng_6)  # -> Equality, Inequality
equals_3 = Equality(FirstNumber=lng_4, SecondNumber=lng_5)  # -> Equality, Inequality
lng_16 = ListLength(List=dcon_4.Set)
lng_17 = ListLength(List=dcon_5.Set)
lng_18 = ListLength(List=dcon_6.Set)
equals_4 = Equality(FirstNumber=lng_4, SecondNumber=lng_7)  # -> Equality, Inequality
equals_5 = Equality(FirstNumber=lng_4, SecondNumber=lng_8)  # -> Equality, Inequality
lng_19 = ListLength(List=dcon_7.Set)
equals_6 = Equality(FirstNumber=lng_4, SecondNumber=lng_9)  # -> Equality, Inequality
equals_7 = Equality(FirstNumber=lng_10, SecondNumber=lng_11)  # -> Equality, Inequality
lng_20 = ListLength(List=dcon_8.Set)
equals_8 = Equality(FirstNumber=lng_10, SecondNumber=lng_12)  # -> Equality, Inequality
equals_9 = Equality(FirstNumber=lng_10, SecondNumber=lng_13)  # -> Equality, Inequality
equals_10 = Equality(FirstNumber=lng_10, SecondNumber=lng_14)  # -> Equality, Inequality

# ---- group: MeshCount
int_4 = Integer(lng_3)

# ---- group: ElemGrp
int_5 = Integer(dcon_2.Set)

# ----
not_2 = GateNot(A=tmatch)
equals_11 = Equality(FirstNumber=elem3dedit_4.DummyElement, SecondNumber=weave)  # -> Equality, Inequality

# ---- group: ElemMaterial
txt_2 = Text(prop3dedit_4.Prop3dName)

# ----
equals_12 = Equality(FirstNumber=elem3dedit_3.Number, SecondNumber=series_2)  # -> Equality, Inequality

# ---- group: zero if all are true
equals_13 = Equality(FirstNumber=mem3dedit_2.MeshSizeInModelUnits, SecondNumber=mem3dedit.MeshSizeInModelUnits)  # -> Equality, Inequality
equals_14 = Equality(FirstNumber=mem3dedit_2.MeshWithOthers, SecondNumber=mem3dedit.MeshWithOthers)  # -> Equality, Inequality
equals_15 = Equality(FirstNumber=mem3dedit_2.MemberGroup, SecondNumber=mem3dedit.MemberGroup)  # -> Equality, Inequality
equals_16 = Equality(FirstNumber=mem3dedit_2.DummyMember, SecondNumber=mem3dedit.DummyMember)  # -> Equality, Inequality
equals_17 = Equality(FirstNumber=num, SecondNumber=matprop_2.ElasticModulus_MPa)  # -> Equality, Inequality
equals_18 = Equality(FirstNumber=num_4, SecondNumber=matprop_2.ThermalExpansion_C_¹)  # -> Equality, Inequality
equals_19 = Equality(FirstNumber=num_2, SecondNumber=matprop_2.PoissonsRatio)  # -> Equality, Inequality
equals_20 = Equality(FirstNumber=num_3, SecondNumber=matprop_2.Density_kg_m³)  # -> Equality, Inequality
equals_21 = Equality(FirstNumber=prop3dedit_2.Axis, SecondNumber=prop3dedit_3.Axis)  # -> Equality, Inequality
ma = MassAddition(Input=flatten([equals_17.Inequality, equals_19.Inequality, equals_20.Inequality, equals_18.Inequality, equals_21.Inequality, equals_13.Inequality, equals_14.Inequality, equals_15.Inequality, equals_16.Inequality]))  # -> Result, PartialResults

# ----
equals_22 = Equality(FirstNumber=lng_15, SecondNumber="1")  # -> Equality, Inequality
equals_23 = Equality(FirstNumber=lng_16, SecondNumber="1")  # -> Equality, Inequality
equals_24 = Equality(FirstNumber=lng_17, SecondNumber="1")  # -> Equality, Inequality
equals_25 = Equality(FirstNumber=lng_18, SecondNumber="1")  # -> Equality, Inequality
equals_26 = Equality(FirstNumber=lng_19, SecondNumber="1")  # -> Equality, Inequality
num_9 = Number(matprop_4.ElasticModulus_MPa)
num_10 = Number(matprop_4.PoissonsRatio)
equals_27 = Equality(FirstNumber=lng_20, SecondNumber="1")  # -> Equality, Inequality
num_11 = Number(matprop_4.Density_kg_m³)
num_12 = Number(matprop_4.ThermalExpansion_C_¹)
ma_2 = MassAddition(Input=flatten([equals_3.Inequality, equals_22.Inequality, equals_2.Inequality, equals_4.Inequality, equals_23.Inequality, equals_12.Inequality, equals_5.Inequality, equals_24.Inequality, equals_6.Inequality, equals_25.Inequality]))  # -> Result, PartialResults
ma_3 = MassAddition(Input=flatten([equals_7.Inequality, equals_26.Inequality, equals_8.Inequality, equals_12.Inequality, equals_9.Inequality, equals_27.Inequality, equals_10.Inequality, equals_11.Inequality, not_2]))  # -> Result, PartialResults

# ---- group: zero if all are true
equals_28 = Equality(FirstNumber=int_3, SecondNumber=prop3dedit.Prop2dNumber)  # -> Equality, Inequality
equals_29 = Equality(FirstNumber=num_9, SecondNumber=num_5)  # -> Equality, Inequality
equals_30 = Equality(FirstNumber=num_12, SecondNumber=num_8)  # -> Equality, Inequality
equals_31 = Equality(FirstNumber=num_10, SecondNumber=num_6)  # -> Equality, Inequality
equals_32 = Equality(FirstNumber=num_11, SecondNumber=num_7)  # -> Equality, Inequality
equals_33 = Equality(FirstNumber=prop3dedit_4.Axis, SecondNumber=prop3dedit.Axis)  # -> Equality, Inequality
ma_4 = MassAddition(Input=flatten([equals_28.Inequality, equals_29.Inequality, equals_31.Inequality, equals_32.Inequality, equals_30.Inequality, equals_33.Inequality, ma_2.Result, not, equals.Inequality, ma_3.Result]))  # -> Result, PartialResults

# ---- group: EditMemTest
int_6 = Integer(ma.Result)

# ----
panel = Panel(int_6)

# ---- group: EditElemTest
int_7 = Integer(ma_4.Result)

# ----
panel_2 = Panel(int_7)
