# Grasshopper definition CreateEditMem3d.gh (Grasshopper 1.0.7)
# Copyright: Arup
# plug-ins: GSA

pt = ConstructPoint(XCoordinate="4", YCoordinate="4", ZCoordinate="4")
pt_2 = ConstructPoint(XCoordinate=0, YCoordinate=0, ZCoordinate=0)
box = Box2Pt(PointA=pt_2, PointB=pt, Plane=PlaneXY(0, 0, 0))
mesh = Mesh(box)
geo = Geometry([pt_2, box, mesh])

# ---- group: CreateMember3d
mem3d = Create3DMember(Solid=geo)

# ---- group: EditMember3d
mem3dedit = Edit3DMember(Solid=geo)  # -> Member3D, MemberNumber, SolidMesh, _3DProperty, MeshSizeInModelUnits, MeshWithOthers, MemberName, MemberGroup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

# ----
mesh_2 = Mesh(mem3dedit.SolidMesh)
m3d = Member3D(mem3d)
