# Grasshopper definition CreateGridSurface.gh (Grasshopper 1.0.7)
# plug-ins: GSA

xy = XYPlane(Origin=Point(0, 0, 0))
gridplane = CreateGridPlane(Plane=xy, GridPlaneID="42", GridElevation_ft=Slider(10, range=0..1000), Name="test", Type="General", Unit="ft")

# ---- group: gps
gridsurface = CreateGridSurface(
    GridPlane=gridplane,
    GridSurfaceID="42",
    ElementList="All",
    Name="test",
    Tolerance_mm=Slider(99, range=0..1000),
    SpanDirection="0.5",
    Type="1D, One-way span",
    Unit="mm")
