# Grasshopper definition CreateLoads.gh (Grasshopper 1.0.7)
# Copyright: Arup
# plug-ins: GSA

profile = CreateProfile(
    catalogueIndex=2,
    inclSS=False,
    lengthUnit="Centimeter",
    mode="Catalogue",
    Profile_type="Catalogue",
    Catalogue="British",
    Type="Parallel flange I sections(IPE) - EN10365:2017",
    Profile="BSI-IPE IPE100",
    typeIndex=248)
pt = ConstructPoint(XCoordinate=0, YCoordinate=0, ZCoordinate=0)
pt_2 = ConstructPoint(XCoordinate="1", YCoordinate=0, ZCoordinate=0)
sph = Sphere(Base=PlaneXY(0, 0, 0), Radius=1)
xy = XYPlane(Origin=Point(0, 0, 0))
ln = Line(StartPoint=pt, EndPoint=pt_2)
xy_2 = XYPlane(Origin=Point(0, 0, 0))
mem3d = Create3DMember(Solid=sph)
editpv = Edit3DProperty()  # -> Property3D, Prop2dNumber, Material, Axis, Prop3dName, Prop3dColour
mem2d = Create2DMember(Brep=xy, InternalOffset=True, Preview3dSection=False, Mesh_mode="Quad dominant")
prop2d = Create2DProperty(Thickness_cm="777", Type="Shell", Unit="cm")
createlist = CreateList(Index="1", Name="Elements", Definition="all", Type="Element")
createlist_2 = CreateList(Index="1", Name="Members", Definition="all", Type="Member")
section = CreateSection(Profile=profile, Basic_Offset="Centroid")
elem2d = Create2DElement(Mesh=xy, Preview3dSection=False)
mem1d = Create1DMember(
    Curve=ln,
    Preview3dSection=False,
    x1=False,
    x2=False,
    xx1=False,
    xx2=False,
    y1=False,
    y2=False,
    yy1=False,
    yy2=False,
    z1=False,
    z2=False,
    zz1=False,
    zz2=False)
mat = CreateMaterial(Material_type="Concrete", Design_Code="EC2-1-1", Grade="C30/37")
elem1d = Create1DElement(Line=ln, Preview3dSection=False)
gridplane = CreateGridPlane(Plane=xy_2, Type="General")
gridplane_2 = CreateGridPlane(Plane=xy_2, Type="Storey")
gridsurface = CreateGridSurface(GridPlane=[gridplane_2, xy_2], GridSurfaceID=0, SpanDirection=0, Type="1D, One-way span")
gridsurface_2 = CreateGridSurface(GridPlane=[gridplane, xy_2], GridSurfaceID=0, Type="1D, Two-way span")
gridsurface_3 = CreateGridSurface(
    GridPlane=[gridplane, xy_2],
    GridSurfaceID=0,
    LoadableObjects=[createlist, createlist_2, elem1d, mem1d, mat, section, elem2d, mem2d, prop2d, mem3d, editpv.Property3D],
    SpanDirection=0,
    Type="1D, One-way span")
gridsurface_4 = CreateGridSurface(GridPlane=[gridplane, xy_2], GridSurfaceID=0, Type="2D")
gridsurface_5 = CreateGridSurface(GridPlane=[gridplane_2, xy_2], GridSurfaceID=0, Type="1D, Two-way span")
gridsurface_6 = CreateGridSurface(GridPlane=[gridplane_2, xy_2], GridSurfaceID=0, Type="2D")
loadcase = CreateLoadCase(CaseID="7", Name="Name", Type="LiveRoof")
pt_3 = Point(pt_2)
line = Line(ln)
pt_4 = Point(pt_2)
panel = Panel("9")
lcinfo = LoadCaseInfo(LoadCase=loadcase)  # -> CaseID, Name, Type
areaload = CreateGridAreaLoad(
    LoadCase="7",
    GridPlaneSurface=[gridsurface_3, xy_2, "7", gridsurface_2, gridsurface_4, gridsurface_5, gridsurface_6, gridsurface],
    Direction="z",
    Axis=0,
    Projected=False,
    Value_kN_m²="7",
    ExpansionChanged=False,
    Mode=0,
    Unit="kN/m²")
faceload = CreateFaceThermalLoad(
    LoadCase="4",
    Loadable2DObjects=[createlist, createlist_2, elem1d, mem1d, mat, section, elem2d, mem2d, prop2d],
    Value_C="4",
    Type="Uniform",
    Unit="°C")
nodeload = CreateNodeLoad(LoadCase="6", NodeList=pt_3, Direction="z", Value_kN="6", Type="NodeForce", Unit="kN")
faceload_2 = CreateFaceLoad(
    LoadCase="3",
    Loadable2DObjects=[createlist, createlist_2, elem1d, mem1d, mat, section],
    Axis=-1,
    Direction="z",
    Projected=False,
    Value_kN_m²="3",
    Type="Uniform",
    Unit="kN/m²")
pointload = CreateGridPointLoad(
    LoadCase="9",
    Point=pt_4,
    GridPlaneSurface=[xy_2, gridsurface_3, gridsurface_2, gridsurface_4, gridsurface, gridsurface_5, gridsurface_6],
    Direction="z",
    Axis=0,
    Value_kN="9",
    ExpansionChanged=False,
    Mode=0,
    Unit="kN")
beamload = CreateBeamLoad(
    LoadCase="1",
    Loadable1DObjects=[createlist, createlist_2, elem1d, mem1d, mat, section],
    Axis=0,
    Direction="z",
    Projected=False,
    Value_kN_m="1",
    Type="Uniform",
    Unit="kN/m")
beamthermalload = CreateBeamThermalLoad(
    LoadCase="2",
    Loadable1DObjects=[createlist, createlist_2, elem1d, mem1d, mat, section],
    Value_C="2",
    Type="Uniform",
    Unit="°C")
gravityload = CreateGravityLoad(
    LoadCase="5",
    LoadableObjects=[createlist, createlist_2, elem1d, mem1d, mat, section, mem3d, editpv.Property3D],
    GravityFactor=Vector(0, 0, -1))
lineload = CreateGridLineLoad(
    LoadCase="8",
    PolyLine=line,
    GridPlaneSurface=["8", gridsurface_3, gridsurface_2, gridsurface_4, gridsurface, gridsurface_5, gridsurface_6, xy_2],
    Direction="z",
    Axis=0,
    Projected=False,
    ValueStart_kN_m="8",
    ValueEnd_kN_m="8",
    ExpansionChanged=False,
    Mode=0,
    Unit="kN/m")
int = Integer(lcinfo.CaseID)
txt = Text(lcinfo.Name)
txt_2 = Text(lcinfo.Type)
panel_2 = Panel(int)
panel_3 = Panel(txt)
panel_4 = Panel(txt_2)
loadprop = LoadProperties(Load=beamthermalload, Force_Unit="kN", Length_Unit="m")  # -> LoadCase, Name, Definition, Axis, Direction, Projected, LoadValueOrFactorX_forceUnitAbbreviation_kN_forcePerLengthUnit_kN_m_forcePerAreaUnit_kN_m², LoadValueOrFactorY_forceUnitAbbreviation_kN_forcePerLengthUnit_kN_m_forcePerAreaUnit_kN_m²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
loadprop_2 = LoadProperties(Load=faceload_2, Force_Unit="kN", Length_Unit="m")  # -> LoadCase, Name, Definition, Axis, Direction, Projected, LoadValueOrFactorX_forceUnitAbbreviation_kN_forcePerLengthUnit_kN_m_forcePerAreaUnit_kN_m², LoadValueOrFactorY_forceUnitAbbreviation_kN_forcePerLengthUnit_kN_m_forcePerAreaUnit_kN_m²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
loadprop_3 = LoadProperties(Load=beamload, Force_Unit="kN", Length_Unit="m")  # -> LoadCase, Name, Definition, Axis, Direction, Projected, LoadValueOrFactorX_forceUnitAbbreviation_kN_forcePerLengthUnit_kN_m_forcePerAreaUnit_kN_m², LoadValueOrFactorY_forceUnitAbbreviation_kN_forcePerLengthUnit_kN_m_forcePerAreaUnit_kN_m²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
loadprop_4 = LoadProperties(Load=faceload, Force_Unit="kN", Length_Unit="m")  # -> LoadCase, Name, Definition, Axis, Direction, Projected, LoadValueOrFactorX_forceUnitAbbreviation_kN_forcePerLengthUnit_kN_m_forcePerAreaUnit_kN_m², LoadValueOrFactorY_forceUnitAbbreviation_kN_forcePerLengthUnit_kN_m_forcePerAreaUnit_kN_m²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
loadprop_5 = LoadProperties(Load=gravityload, Force_Unit="kN", Length_Unit="m")  # -> LoadCase, Name, Definition, Axis, Direction, Projected, LoadValueOrFactorX_forceUnitAbbreviation_kN_forcePerLengthUnit_kN_m_forcePerAreaUnit_kN_m², LoadValueOrFactorY_forceUnitAbbreviation_kN_forcePerLengthUnit_kN_m_forcePerAreaUnit_kN_m²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
loadprop_6 = LoadProperties(Load=nodeload, Force_Unit="kN", Length_Unit="m")  # -> LoadCase, Name, Definition, Axis, Direction, Projected, LoadValueOrFactorX_forceUnitAbbreviation_kN_forcePerLengthUnit_kN_m_forcePerAreaUnit_kN_m², LoadValueOrFactorY_forceUnitAbbreviation_kN_forcePerLengthUnit_kN_m_forcePerAreaUnit_kN_m²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
loadprop_7 = LoadProperties(Load=areaload, Force_Unit="kN", Length_Unit="m")  # -> LoadCase, Name, Definition, Axis, Direction, Projected, LoadValueOrFactorX_forceUnitAbbreviation_kN_forcePerLengthUnit_kN_m_forcePerAreaUnit_kN_m², LoadValueOrFactorY_forceUnitAbbreviation_kN_forcePerLengthUnit_kN_m_forcePerAreaUnit_kN_m²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
loadprop_8 = LoadProperties(Load=pointload, Force_Unit="kN", Length_Unit="m")  # -> LoadCase, Name, Definition, Axis, Direction, Projected, LoadValueOrFactorX_forceUnitAbbreviation_kN_forcePerLengthUnit_kN_m_forcePerAreaUnit_kN_m², LoadValueOrFactorY_forceUnitAbbreviation_kN_forcePerLengthUnit_kN_m_forcePerAreaUnit_kN_m²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
loadprop_9 = LoadProperties(Load=lineload, Force_Unit="kN", Length_Unit="m")  # -> LoadCase, Name, Definition, Axis, Direction, Projected, LoadValueOrFactorX_forceUnitAbbreviation_kN_forcePerLengthUnit_kN_m_forcePerAreaUnit_kN_m², LoadValueOrFactorY_forceUnitAbbreviation_kN_forcePerLengthUnit_kN_m_forcePerAreaUnit_kN_m²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
int_2 = Integer(loadprop.LoadCase)
txt_3 = Text(loadprop.LoadValueOrFactorX_forceUnitAbbreviation_kN_forcePerLengthUnit_kN_m_forcePerAreaUnit_kN_m²)
int_3 = Integer(loadprop_2.LoadCase)
txt_4 = Text(loadprop_2.LoadValueOrFactorX_forceUnitAbbreviation_kN_forcePerLengthUnit_kN_m_forcePerAreaUnit_kN_m²)
txt_5 = Text(loadprop_3.LoadValueOrFactorX_forceUnitAbbreviation_kN_forcePerLengthUnit_kN_m_forcePerAreaUnit_kN_m²)
int_4 = Integer(loadprop_3.LoadCase)
txt_6 = Text(loadprop_4.LoadValueOrFactorX_forceUnitAbbreviation_kN_forcePerLengthUnit_kN_m_forcePerAreaUnit_kN_m²)
int_5 = Integer(loadprop_4.LoadCase)
txt_7 = Text(loadprop_5.LoadValueOrFactorZ_forceUnitAbbreviation_kN_forcePerLengthUnit_kN_m_forcePerAreaUnit_kN_m²)
int_6 = Integer(loadprop_5.LoadCase)
txt_8 = Text(loadprop_6.LoadValueOrFactorX_forceUnitAbbreviation_kN_forcePerLengthUnit_kN_m_forcePerAreaUnit_kN_m²)
int_7 = Integer(loadprop_6.LoadCase)
txt_9 = Text(loadprop_7.LoadValueOrFactorX_forceUnitAbbreviation_kN_forcePerLengthUnit_kN_m_forcePerAreaUnit_kN_m²)
int_8 = Integer(loadprop_7.LoadCase)
txt_10 = Text(loadprop_8.LoadValueOrFactorX_forceUnitAbbreviation_kN_forcePerLengthUnit_kN_m_forcePerAreaUnit_kN_m²)
txt_11 = Text(loadprop_9.LoadValueOrFactorX_forceUnitAbbreviation_kN_forcePerLengthUnit_kN_m_forcePerAreaUnit_kN_m²)
int_9 = Integer(loadprop_8.LoadCase)
int_10 = Integer(loadprop_9.LoadCase)
panel_5 = Panel(int_2)
panel_6 = Panel(int_3)
panel_7 = Panel(txt_3)
panel_8 = Panel(txt_4)
panel_9 = Panel(int_4)
panel_10 = Panel(txt_5)
panel_11 = Panel(int_5)
panel_12 = Panel(txt_6)
panel_13 = Panel(int_6)
panel_14 = Panel(txt_7)
panel_15 = Panel(int_7)
panel_16 = Panel(txt_8)
panel_17 = Panel(int_8)
panel_18 = Panel(txt_9)
panel_19 = Panel(int_9)
panel_20 = Panel(txt_10)
panel_21 = Panel(int_10)
panel_22 = Panel(txt_11)
num = Number(loadprop.LoadValueOrFactorX_forceUnitAbbreviation_kN_forcePerLengthUnit_kN_m_forcePerAreaUnit_kN_m²)
num_2 = Number(loadprop_2.LoadValueOrFactorX_forceUnitAbbreviation_kN_forcePerLengthUnit_kN_m_forcePerAreaUnit_kN_m²)
num_3 = Number(loadprop_3.LoadValueOrFactorX_forceUnitAbbreviation_kN_forcePerLengthUnit_kN_m_forcePerAreaUnit_kN_m²)
num_4 = Number(loadprop_4.LoadValueOrFactorX_forceUnitAbbreviation_kN_forcePerLengthUnit_kN_m_forcePerAreaUnit_kN_m²)
num_5 = Number(loadprop_5.LoadValueOrFactorX_forceUnitAbbreviation_kN_forcePerLengthUnit_kN_m_forcePerAreaUnit_kN_m²)
num_6 = Number(loadprop_6.LoadValueOrFactorX_forceUnitAbbreviation_kN_forcePerLengthUnit_kN_m_forcePerAreaUnit_kN_m²)
num_7 = Number(loadprop_5.LoadValueOrFactorY_forceUnitAbbreviation_kN_forcePerLengthUnit_kN_m_forcePerAreaUnit_kN_m²)
num_8 = Number(loadprop_7.LoadValueOrFactorX_forceUnitAbbreviation_kN_forcePerLengthUnit_kN_m_forcePerAreaUnit_kN_m²)
num_9 = Number(loadprop_5.LoadValueOrFactorZ_forceUnitAbbreviation_kN_forcePerLengthUnit_kN_m_forcePerAreaUnit_kN_m²)
num_10 = Number(loadprop_9.LoadValueOrFactorY_forceUnitAbbreviation_kN_forcePerLengthUnit_kN_m_forcePerAreaUnit_kN_m²)
num_11 = Number(loadprop_8.LoadValueOrFactorX_forceUnitAbbreviation_kN_forcePerLengthUnit_kN_m_forcePerAreaUnit_kN_m²)
num_12 = Number(loadprop_9.LoadValueOrFactorX_forceUnitAbbreviation_kN_forcePerLengthUnit_kN_m_forcePerAreaUnit_kN_m²)
equals = Equality(FirstNumber="2", SecondNumber=int_2)  # -> Equality, Inequality
equals_2 = Equality(FirstNumber="3", SecondNumber=int_3)  # -> Equality, Inequality
equals_3 = Equality(FirstNumber="1", SecondNumber=int_4)  # -> Equality, Inequality
equals_4 = Equality(FirstNumber=num, SecondNumber="2")  # -> Equality, Inequality
equals_5 = Equality(FirstNumber=num_2, SecondNumber="3")  # -> Equality, Inequality
equals_6 = Equality(FirstNumber=num_3, SecondNumber="1")  # -> Equality, Inequality
equals_7 = Equality(FirstNumber="4", SecondNumber=int_5)  # -> Equality, Inequality
equals_8 = Equality(FirstNumber="5", SecondNumber=int_6)  # -> Equality, Inequality
equals_9 = Equality(FirstNumber=num_4, SecondNumber="4")  # -> Equality, Inequality
equals_10 = Equality(FirstNumber=num_5, SecondNumber="0")  # -> Equality, Inequality
equals_11 = Equality(FirstNumber="6", SecondNumber=int_7)  # -> Equality, Inequality
equals_12 = Equality(FirstNumber=num_7, SecondNumber="0")  # -> Equality, Inequality
equals_13 = Equality(FirstNumber="7", SecondNumber=int_8)  # -> Equality, Inequality
equals_14 = Equality(FirstNumber=num_6, SecondNumber="6")  # -> Equality, Inequality
equals_15 = Equality(FirstNumber=num_9, SecondNumber="-1")  # -> Equality, Inequality
equals_16 = Equality(FirstNumber=num_8, SecondNumber="7")  # -> Equality, Inequality
equals_17 = Equality(FirstNumber="9", SecondNumber=int_9)  # -> Equality, Inequality
equals_18 = Equality(FirstNumber="8", SecondNumber=int_10)  # -> Equality, Inequality
equals_19 = Equality(FirstNumber=num_11, SecondNumber="9")  # -> Equality, Inequality
equals_20 = Equality(FirstNumber=num_10, SecondNumber="8")  # -> Equality, Inequality
equals_21 = Equality(FirstNumber=num_12, SecondNumber="8")  # -> Equality, Inequality
ma = MassAddition(Input=equals.Inequality)  # -> Result, PartialResults
ma_2 = MassAddition(Input=equals_2.Inequality)  # -> Result, PartialResults
ma_3 = MassAddition(Input=equals_3.Inequality)  # -> Result, PartialResults
ma_4 = MassAddition(Input=equals_4.Inequality)  # -> Result, PartialResults
ma_5 = MassAddition(Input=equals_5.Inequality)  # -> Result, PartialResults
ma_6 = MassAddition(Input=equals_6.Inequality)  # -> Result, PartialResults
ma_7 = MassAddition(Input=equals_7.Inequality)  # -> Result, PartialResults
ma_8 = MassAddition(Input=equals_8.Inequality)  # -> Result, PartialResults
ma_9 = MassAddition(Input=equals_9.Inequality)  # -> Result, PartialResults
ma_10 = MassAddition(Input=[equals_10.Inequality, equals_12.Inequality, equals_15.Inequality])  # -> Result, PartialResults
ma_11 = MassAddition(Input=equals_11.Inequality)  # -> Result, PartialResults
ma_12 = MassAddition(Input=equals_13.Inequality)  # -> Result, PartialResults
ma_13 = MassAddition(Input=equals_14.Inequality)  # -> Result, PartialResults
ma_14 = MassAddition(Input=equals_16.Inequality)  # -> Result, PartialResults
ma_15 = MassAddition(Input=equals_17.Inequality)  # -> Result, PartialResults
ma_16 = MassAddition(Input=equals_18.Inequality)  # -> Result, PartialResults
ma_17 = MassAddition(Input=equals_19.Inequality)  # -> Result, PartialResults
ma_18 = MassAddition(Input=[equals_21.Inequality, equals_20.Inequality])  # -> Result, PartialResults
equals_22 = Equality(FirstNumber=ma.Result, SecondNumber="0")  # -> Equality, Inequality
equals_23 = Equality(FirstNumber=ma_2.Result, SecondNumber="0")  # -> Equality, Inequality
equals_24 = Equality(FirstNumber=ma_3.Result, SecondNumber="0")  # -> Equality, Inequality
equals_25 = Equality(FirstNumber=ma_4.Result, SecondNumber="0")  # -> Equality, Inequality
equals_26 = Equality(FirstNumber=ma_5.Result, SecondNumber="0")  # -> Equality, Inequality
equals_27 = Equality(FirstNumber=ma_6.Result, SecondNumber="0")  # -> Equality, Inequality
equals_28 = Equality(FirstNumber=ma_7.Result, SecondNumber="0")  # -> Equality, Inequality
equals_29 = Equality(FirstNumber=ma_8.Result, SecondNumber="0")  # -> Equality, Inequality
equals_30 = Equality(FirstNumber=ma_9.Result, SecondNumber="0")  # -> Equality, Inequality
equals_31 = Equality(FirstNumber=ma_10.Result, SecondNumber="0")  # -> Equality, Inequality
equals_32 = Equality(FirstNumber=ma_11.Result, SecondNumber="0")  # -> Equality, Inequality
equals_33 = Equality(FirstNumber=ma_12.Result, SecondNumber="0")  # -> Equality, Inequality
equals_34 = Equality(FirstNumber=ma_13.Result, SecondNumber="0")  # -> Equality, Inequality
equals_35 = Equality(FirstNumber=ma_14.Result, SecondNumber="0")  # -> Equality, Inequality
equals_36 = Equality(FirstNumber=ma_15.Result, SecondNumber="0")  # -> Equality, Inequality
equals_37 = Equality(FirstNumber=ma_16.Result, SecondNumber="0")  # -> Equality, Inequality
equals_38 = Equality(FirstNumber=ma_17.Result, SecondNumber="0")  # -> Equality, Inequality
equals_39 = Equality(FirstNumber=ma_18.Result, SecondNumber="0")  # -> Equality, Inequality
ma_19 = MassAddition(Input=[equals_22.Inequality, equals_25.Inequality])  # -> Result, PartialResults
ma_20 = MassAddition(Input=[equals_23.Inequality, equals_26.Inequality])  # -> Result, PartialResults
ma_21 = MassAddition(Input=[equals_24.Inequality, equals_27.Inequality])  # -> Result, PartialResults
ma_22 = MassAddition(Input=[equals_28.Inequality, equals_30.Inequality])  # -> Result, PartialResults
ma_23 = MassAddition(Input=[equals_29.Inequality, equals_31.Inequality])  # -> Result, PartialResults
ma_24 = MassAddition(Input=[equals_32.Inequality, equals_34.Inequality])  # -> Result, PartialResults
ma_25 = MassAddition(Input=[equals_33.Inequality, equals_35.Inequality])  # -> Result, PartialResults
ma_26 = MassAddition(Input=[equals_36.Inequality, equals_38.Inequality])  # -> Result, PartialResults
ma_27 = MassAddition(Input=[equals_37.Inequality, equals_39.Inequality])  # -> Result, PartialResults
equals_40 = Equality(FirstNumber=ma_19.Result, SecondNumber="0")  # -> Equality, Inequality
equals_41 = Equality(FirstNumber=ma_20.Result, SecondNumber="0")  # -> Equality, Inequality
equals_42 = Equality(FirstNumber=ma_21.Result, SecondNumber="0")  # -> Equality, Inequality
equals_43 = Equality(FirstNumber=ma_22.Result, SecondNumber="0")  # -> Equality, Inequality
equals_44 = Equality(FirstNumber=ma_23.Result, SecondNumber="0")  # -> Equality, Inequality
equals_45 = Equality(FirstNumber=ma_24.Result, SecondNumber="0")  # -> Equality, Inequality
equals_46 = Equality(FirstNumber=ma_25.Result, SecondNumber="0")  # -> Equality, Inequality
equals_47 = Equality(FirstNumber=ma_26.Result, SecondNumber="0")  # -> Equality, Inequality
equals_48 = Equality(FirstNumber=ma_27.Result, SecondNumber="0")  # -> Equality, Inequality

# ---- group: BeamThermalLoad
bool = Boolean(equals_40.Equality)

# ---- group: FaceLoad
bool_2 = Boolean(equals_41.Equality)

# ---- group: BeamLoad
bool_3 = Boolean(equals_42.Equality)

# ---- group: FaceThermalLoad
bool_4 = Boolean(equals_43.Equality)

# ---- group: GravityLoad
bool_5 = Boolean(equals_44.Equality)

# ---- group: NodeLoad
bool_6 = Boolean(equals_45.Equality)

# ---- group: GridAreaLoad
bool_7 = Boolean(equals_46.Equality)

# ---- group: GridPointLoad
bool_8 = Boolean(equals_47.Equality)

# ---- group: GridLineLoad
bool_9 = Boolean(equals_48.Equality)

# ----
panel_23 = Panel(bool)
panel_24 = Panel(bool_2)
panel_25 = Panel(bool_3)
panel_26 = Panel(bool_4)
panel_27 = Panel(bool_5)
panel_28 = Panel(bool_6)
panel_29 = Panel(bool_7)
panel_30 = Panel(bool_8)
panel_31 = Panel(bool_9)
