# Grasshopper definition CreateModelWithReferenceIDs.gh (Grasshopper 1.0.7)
# Copyright: Arup
# plug-ins: GSA

profile = CreateProfile(
    catalogueIndex=3,
    inclSS=False,
    lengthUnit="Centimeter",
    mode="Catalogue",
    Profile_type="Catalogue",
    Catalogue="Europrofile",
    Type="EP HE beams",
    Profile="HE HE240.A",
    typeIndex=27)
profile_2 = CreateProfile(
    catalogueIndex=3,
    inclSS=False,
    lengthUnit="Centimeter",
    mode="Catalogue",
    Profile_type="Catalogue",
    Catalogue="Europrofile",
    Type="EP HE beams",
    Profile="HE HE260.B",
    typeIndex=27)
material = CustomMaterial(
    AnalysisPropertyNumber="2",
    ElasticModulus_MPa="200000",
    PoissonsRatio="0.3",
    Density_kg_m³="7850",
    Material_Type="Timber",
    Stress_Unit="MPa",
    Density_Unit="kg/m³",
    Temperature_Unit="°C")
material_2 = CustomMaterial(
    AnalysisPropertyNumber="1",
    ElasticModulus_MPa="18000",
    PoissonsRatio="0.3",
    Density_kg_m³="2500",
    Material_Type="Timber",
    Stress_Unit="MPa",
    Density_Unit="kg/m³",
    Temperature_Unit="°C")
profile_3 = CreateProfile(
    NumberOfInputs=0,
    catalogueIndex=3,
    inclSS=False,
    lengthUnit="Centimeter",
    mode="Catalogue",
    Profile_type="Catalogue",
    Catalogue="Europrofile",
    Type="EP HE beams",
    Profile="HE HE240.A",
    typeIndex=27)
profile_4 = CreateProfile(
    NumberOfInputs=0,
    catalogueIndex=3,
    inclSS=False,
    lengthUnit="Centimeter",
    mode="Catalogue",
    Profile_type="Catalogue",
    Catalogue="Europrofile",
    Type="EP HE beams",
    Profile="HE HE260.B",
    typeIndex=27)
sectionedit = EditSection(Section=profile, SectionNumber="1", Material=material)  # -> Section, SectionNumber, SectionProfile, Material, BasicOffset, AddOffsetY_cm, AddOffsetZ_cm, SectionModifier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
sectionedit_2 = EditSection(Section=profile_2, SectionNumber="2", Material=material)  # -> Section, SectionNumber, SectionProfile, Material, BasicOffset, AddOffsetY_cm, AddOffsetZ_cm, SectionModifier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
prop2dedit = Edit2DProperty(Prop2dNumber="3", Material=material_2, Thickness_cm="25", LengthUnit="Centimeter", ReferenceEdge=0, SupportType=0)  # -> Prop2D, Prop2dNumber, Prop2dName, Prop2dColour, Axis, Type, Material, Thickness_cm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
rectangle = Rectangle(Plane=PlaneXY(0, 0, 0), XSize="8.4", YSize="10", Radius=0)  # -> Rectangle, Length
explode = Explode(Curve=rectangle.Rectangle, Recursive=True)  # -> Segments, Vertices
boundary = BoundarySurfaces(Edges=rectangle.Rectangle)
dispatch = Dispatch(List=explode.Segments, DispatchPattern=[True, False])  # -> ListA, ListB
mem2d = Create2DMember(Brep=boundary, Prop2D="3", InternalOffset=False, Preview3dSection=False)
mem1d = Create1DMember(
    Curve=dispatch.ListB,
    Section="2",
    Preview3dSection=False,
    x1=False,
    x2=False,
    xx1=False,
    xx2=False,
    y1=False,
    y2=False,
    yy1=False,
    yy2=False,
    z1=False,
    z2=False,
    zz1=False,
    zz2=False)
mem1d_2 = Create1DMember(
    Curve=dispatch.ListA,
    Section="1",
    Preview3dSection=False,
    x1=False,
    x2=False,
    xx1=False,
    xx2=False,
    y1=False,
    y2=False,
    yy1=False,
    yy2=False,
    z1=False,
    z2=False,
    zz1=False,
    zz2=False)
model = CreateModel(
    Properties=flatten([sectionedit.Section, sectionedit_2.Section, prop2dedit.Prop2D]),
    GSAGeometryIn_m=flatten([mem1d_2, mem1d, mem2d]),
    ReMesh=True,
    Tolerance=0.05,
    Unit="m")
getgeo = GetModelGeometry(GSAModel=model, NodeFilterList="All", ElementFilterList="All", MemberFilterList="All", Mode=1, Unit="m")  # -> Nodes_m, _1DElements_m, _2DElements_m, _3DElements_m, _1DMembers_m, _2DMembers_m, _3DMembers_m
model_2 = CreateModel(GSAGeometryIn_m=[getgeo._1DElements_m, getgeo._2DElements_m], ReMesh=False, Tolerance=0.05, Unit="m")
getgeo_2 = GetModelGeometry(GSAModel=model_2, NodeFilterList="All", ElementFilterList="All", MemberFilterList="All", Mode=1, Unit="m")  # -> Nodes_m, _1DElements_m, _2DElements_m, _3DElements_m, _1DMembers_m, _2DMembers_m, _3DMembers_m
elem1dedit = Edit1DElement(Element1D=getgeo_2._1DElements_m, Preview3dSection=False)  # -> Element1D, Number, Line, Section, Group, Type, Offset, StartRelease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
elem2dedit = Edit2DElement(Element2D=getgeo_2._2DElements_m, Preview3dSection=False)  # -> Element2D, Number, AnalysisMesh, _2DProperty, Group, ElementType, Offset, OrientationAngle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
prop2dedit_2 = Edit2DProperty(PA=elem2dedit._2DProperty, LengthUnit="Centimeter", ReferenceEdge=0, SupportType=0)  # -> PA, ID, Na, Co, Ax, Ty, Mat, Th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
sectionedit_3 = EditSection(Section=elem1dedit.Section)  # -> Section, SectionNumber, SectionProfile, Material, BasicOffset, AddOffsetY_cm, AddOffsetZ_cm, SectionModifier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
dcon = DeleteConsecutive(Set=prop2dedit_2.ID, Wrap=False)  # -> Set, Count
dcon_2 = DeleteConsecutive(Set=sectionedit_3.SectionNumber, Wrap=False)  # -> Set, Count
fsim = FindSimilarMember(Data=dcon.Set, Set=prop2dedit_2.ID)  # -> Hit, Index
fsim_2 = FindSimilarMember(Data=dcon_2.Set, Set=sectionedit_3.SectionNumber)  # -> Hit, Index
item = ListItem(List=prop2dedit_2.Th, Index=fsim.Index, Wrap=True)
item_2 = ListItem(List=sectionedit_3.SectionProfile, Index=fsim_2.Index, Wrap=True)
item_3 = ListItem(List=sectionedit_3.Material, Index=fsim_2.Index, Wrap=True)
item_4 = ListItem(List=prop2dedit_2.Mat, Index=fsim.Index, Wrap=True)
matprop = MaterialProperties(Material=item_3, DensityUnit="KilogramPerCubicMeter", StressUnit="Megapascal", TemperatureUnit="DegreeCelsius")  # -> ElasticModulus_MPa, PoissonsRatio, Density_kg_m³, ThermalExpansion_C_¹
matprop_2 = MaterialProperties(Material=item_4, DensityUnit="KilogramPerCubicMeter", StressUnit="Megapascal", TemperatureUnit="DegreeCelsius")  # -> ElasticModulus_MPa, PoissonsRatio, Density_kg_m³, ThermalExpansion_C_¹

# ---- group: Profiles
txt = Text(item_2)

# ---- group: SteelE
num = Number(matprop.ElasticModulus_MPa)

# ---- group: ConcreteE
num_2 = Number(matprop_2.ElasticModulus_MPa)

# ---- group: Thickness
num_3 = Number(item)

# ----
panel = Panel(txt)
panel_2 = Panel(num)
panel_3 = Panel(num_3)
panel_4 = Panel(num_2)
