# Grasshopper definition CreateSpringProperties.gh (Grasshopper 1.0.7)
# Copyright: Arup
# plug-ins: GSA

spring = CreateSpringProperty(
    Name="name6",
    SpringCurveX="6",
    SpringCurveY="6",
    SpringCurveZ="6",
    SpringCurveXx="6",
    SpringCurveYy="6",
    SpringCurveZz="6",
    DampingRatio="0.6",
    Type="General",
    Stiffness_Unit="kN/m",
    Rotational_Stiffness_Unit="N·m/rad")
spring_2 = CreateSpringProperty(
    Name="name6",
    StiffnessX_kN_m="6.6",
    StiffnessY_kN_m="6.6",
    StiffnessZ_kN_m="6.6",
    StiffnessXx_N_m_rad="6.6",
    StiffnessYy_N_m_rad="6.6",
    StiffnessZz_N_m_rad="6.6",
    DampingRatio="0.6",
    Type="General",
    Stiffness_Unit="kN/m",
    Rotational_Stiffness_Unit="N·m/rad")
spring_3 = CreateSpringProperty(Name="name10", StiffnessXx_N_m_rad="10", DampingRatio="1.0", Type="Torsional", Rotational_Stiffness_Unit="N·m/rad")
spring_4 = CreateSpringProperty(Name="name1", Stiffness_kN_m="1.1", DampingRatio="0.1", Type="Axial", Stiffness_Unit="kN/m")
spring_5 = CreateSpringProperty(Name="name2", Stiffness_kN_m="2.2", DampingRatio="0.2", Type="Compression-only", Stiffness_Unit="kN/m")
spring_6 = CreateSpringProperty(Name="name3", DampingRatio="0.3", Type="Connector")
spring_7 = CreateSpringProperty(
    Name="name4",
    StiffnessX_kN_m="4.4",
    StiffnessY_kN_m="4.4",
    StiffnessZ_kN_m="4.4",
    CoeffOfFriction_kN_m="0.4",
    DampingRatio="0.4",
    Type="Friction",
    Stiffness_Unit="kN/m")
spring_8 = CreateSpringProperty(Name="name5", Stiffness_kN_m="5.5", DampingRatio="0.5", Type="Gap", Stiffness_Unit="kN/m")
spring_9 = CreateSpringProperty(
    Name="name7",
    Stiffness_kN_m="7.7",
    LockupVe_mm="7.7",
    LockupVe_mm_2="7.7",
    DampingRatio="0.7",
    Type="Lockup",
    Stiffness_Unit="kN/m",
    Length_Unit="mm")
spring_10 = CreateSpringProperty(Name="name8", SpringMatrix="8", DampingRatio="0.8", Type="Matrix")
spring_11 = CreateSpringProperty(Name="name9", Stiffness_kN_m="9", DampingRatio="0.9", Type="Tension-only", Stiffness_Unit="kN/m")
getsp = GetSpringProperty(
    SpringProperty=spring_4,
    LengthUnit="Meter",
    RotationalStiffnessUnit="NewtonMeterPerRadian",
    StiffnessUnit="KilonewtonPerMeter")  # -> Name, SpringCurveX, StiffnessX_N_m, SpringCurveY, StiffnessY_N_m, SpringCurveZ, StiffnessZ_N_m, SpringCurveXx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
getsp_2 = GetSpringProperty(
    SpringProperty=spring_7,
    LengthUnit="Meter",
    RotationalStiffnessUnit="NewtonMeterPerRadian",
    StiffnessUnit="KilonewtonPerMeter")  # -> Name, SpringCurveX, StiffnessX_N_m, SpringCurveY, StiffnessY_N_m, SpringCurveZ, StiffnessZ_N_m, SpringCurveXx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
getsp_3 = GetSpringProperty(
    SpringProperty=spring,
    LengthUnit="Meter",
    RotationalStiffnessUnit="NewtonMeterPerRadian",
    StiffnessUnit="KilonewtonPerMeter")  # -> Name, SpringCurveX, StiffnessX_N_m, SpringCurveY, StiffnessY_N_m, SpringCurveZ, StiffnessZ_N_m, SpringCurveXx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
getsp_4 = GetSpringProperty(
    SpringProperty=spring_10,
    LengthUnit="Millimeter",
    RotationalStiffnessUnit="NewtonMeterPerRadian",
    StiffnessUnit="KilonewtonPerMeter")  # -> Name, SpringCurveX, StiffnessX_N_m, SpringCurveY, StiffnessY_N_m, SpringCurveZ, StiffnessZ_N_m, SpringCurveXx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
getsp_5 = GetSpringProperty(
    SpringProperty=spring_2,
    LengthUnit="Meter",
    RotationalStiffnessUnit="NewtonMeterPerRadian",
    StiffnessUnit="KilonewtonPerMeter")  # -> Name, SpringCurveX, StiffnessX_N_m, SpringCurveY, StiffnessY_N_m, SpringCurveZ, StiffnessZ_N_m, SpringCurveXx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
panel = Panel([getsp.Name, getsp.SpringCurveX, getsp.StiffnessX_N_m, getsp.SpringCurveY, getsp.StiffnessY_N_m, getsp.SpringCurveZ, getsp.StiffnessZ_N_m, getsp.SpringCurveXx, getsp.StiffnessXx_N_m_rad, getsp.SpringCurveYy, getsp.StiffnessYy_N_m_rad, getsp.SpringCurveZz, getsp.StiffnessZz_N_m_rad, getsp.SpringMatrix, getsp.LockupVe_m, getsp.LockupVe_m_2, getsp.CoeffOfFriction_N_m, getsp.DampingRatio])
panel_2 = Panel([getsp_4.Name, getsp_4.SpringCurveX, getsp_4.StiffnessX_N_m, getsp_4.SpringCurveY, getsp_4.StiffnessY_N_m, getsp_4.SpringCurveZ, getsp_4.StiffnessZ_N_m, getsp_4.SpringCurveXx, getsp_4.StiffnessXx_N_m_rad, getsp_4.SpringCurveYy, getsp_4.StiffnessYy_N_m_rad, getsp_4.SpringCurveZz, getsp_4.StiffnessZz_N_m_rad, getsp_4.SpringMatrix, getsp_4.LockupVe_m, getsp_4.LockupVe_m_2, getsp_4.CoeffOfFriction_N_m, getsp_4.DampingRatio])
panel_3 = Panel([getsp_2.Name, getsp_2.SpringCurveX, getsp_2.StiffnessX_N_m, getsp_2.SpringCurveY, getsp_2.StiffnessY_N_m, getsp_2.SpringCurveZ, getsp_2.StiffnessZ_N_m, getsp_2.SpringCurveXx, getsp_2.StiffnessXx_N_m_rad, getsp_2.SpringCurveYy, getsp_2.StiffnessYy_N_m_rad, getsp_2.SpringCurveZz, getsp_2.StiffnessZz_N_m_rad, getsp_2.SpringMatrix, getsp_2.LockupVe_m, getsp_2.LockupVe_m_2, getsp_2.CoeffOfFriction_N_m, getsp_2.DampingRatio])
panel_4 = Panel([getsp_5.Name, getsp_5.SpringCurveX, getsp_5.StiffnessX_N_m, getsp_5.SpringCurveY, getsp_5.StiffnessY_N_m, getsp_5.SpringCurveZ, getsp_5.StiffnessZ_N_m, getsp_5.SpringCurveXx, getsp_5.StiffnessXx_N_m_rad, getsp_5.SpringCurveYy, getsp_5.StiffnessYy_N_m_rad, getsp_5.SpringCurveZz, getsp_5.StiffnessZz_N_m_rad, getsp_5.SpringMatrix, getsp_5.LockupVe_m, getsp_5.LockupVe_m_2, getsp_5.CoeffOfFriction_N_m, getsp_5.DampingRatio])
panel_5 = Panel([getsp_3.Name, getsp_3.SpringCurveX, getsp_3.StiffnessX_N_m, getsp_3.SpringCurveY, getsp_3.StiffnessY_N_m, getsp_3.SpringCurveZ, getsp_3.StiffnessZ_N_m, getsp_3.SpringCurveXx, getsp_3.StiffnessXx_N_m_rad, getsp_3.SpringCurveYy, getsp_3.StiffnessYy_N_m_rad, getsp_3.SpringCurveZz, getsp_3.StiffnessZz_N_m_rad, getsp_3.SpringMatrix, getsp_3.LockupVe_m, getsp_3.LockupVe_m_2, getsp_3.CoeffOfFriction_N_m, getsp_3.DampingRatio])
getsp_6 = GetSpringProperty(
    SpringProperty=spring_3,
    LengthUnit="Millimeter",
    RotationalStiffnessUnit="NewtonMeterPerRadian",
    StiffnessUnit="KilonewtonPerMeter")  # -> Name, SpringCurveX, StiffnessX_N_m, SpringCurveY, StiffnessY_N_m, SpringCurveZ, StiffnessZ_N_m, SpringCurveXx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
getsp_7 = GetSpringProperty(
    SpringProperty=spring_9,
    LengthUnit="Meter",
    RotationalStiffnessUnit="NewtonMeterPerRadian",
    StiffnessUnit="KilonewtonPerMeter")  # -> Name, SpringCurveX, StiffnessX_N_m, SpringCurveY, StiffnessY_N_m, SpringCurveZ, StiffnessZ_N_m, SpringCurveXx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
getsp_8 = GetSpringProperty(
    SpringProperty=spring_8,
    LengthUnit="Meter",
    RotationalStiffnessUnit="NewtonMeterPerRadian",
    StiffnessUnit="KilonewtonPerMeter")  # -> Name, SpringCurveX, StiffnessX_N_m, SpringCurveY, StiffnessY_N_m, SpringCurveZ, StiffnessZ_N_m, SpringCurveXx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
getsp_9 = GetSpringProperty(
    SpringProperty=spring_5,
    LengthUnit="Meter",
    RotationalStiffnessUnit="NewtonMeterPerRadian",
    StiffnessUnit="KilonewtonPerMeter")  # -> Name, SpringCurveX, StiffnessX_N_m, SpringCurveY, StiffnessY_N_m, SpringCurveZ, StiffnessZ_N_m, SpringCurveXx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
panel_6 = Panel([getsp_6.Name, getsp_6.SpringCurveX, getsp_6.StiffnessX_N_m, getsp_6.SpringCurveY, getsp_6.StiffnessY_N_m, getsp_6.SpringCurveZ, getsp_6.StiffnessZ_N_m, getsp_6.SpringCurveXx, getsp_6.StiffnessXx_N_m_rad, getsp_6.SpringCurveYy, getsp_6.StiffnessYy_N_m_rad, getsp_6.SpringCurveZz, getsp_6.StiffnessZz_N_m_rad, getsp_6.SpringMatrix, getsp_6.LockupVe_m, getsp_6.LockupVe_m_2, getsp_6.CoeffOfFriction_N_m, getsp_6.DampingRatio])
panel_7 = Panel([getsp_7.Name, getsp_7.SpringCurveX, getsp_7.StiffnessX_N_m, getsp_7.SpringCurveY, getsp_7.StiffnessY_N_m, getsp_7.SpringCurveZ, getsp_7.StiffnessZ_N_m, getsp_7.SpringCurveXx, getsp_7.StiffnessXx_N_m_rad, getsp_7.SpringCurveYy, getsp_7.StiffnessYy_N_m_rad, getsp_7.SpringCurveZz, getsp_7.StiffnessZz_N_m_rad, getsp_7.SpringMatrix, getsp_7.LockupVe_m, getsp_7.LockupVe_m_2, getsp_7.CoeffOfFriction_N_m, getsp_7.DampingRatio])
panel_8 = Panel([getsp_8.Name, getsp_8.SpringCurveX, getsp_8.StiffnessX_N_m, getsp_8.SpringCurveY, getsp_8.StiffnessY_N_m, getsp_8.SpringCurveZ, getsp_8.StiffnessZ_N_m, getsp_8.SpringCurveXx, getsp_8.StiffnessXx_N_m_rad, getsp_8.SpringCurveYy, getsp_8.StiffnessYy_N_m_rad, getsp_8.SpringCurveZz, getsp_8.StiffnessZz_N_m_rad, getsp_8.SpringMatrix, getsp_8.LockupVe_m, getsp_8.LockupVe_m_2, getsp_8.CoeffOfFriction_N_m, getsp_8.DampingRatio])
panel_9 = Panel([getsp_9.Name, getsp_9.SpringCurveX, getsp_9.StiffnessX_N_m, getsp_9.SpringCurveY, getsp_9.StiffnessY_N_m, getsp_9.SpringCurveZ, getsp_9.StiffnessZ_N_m, getsp_9.SpringCurveXx, getsp_9.StiffnessXx_N_m_rad, getsp_9.SpringCurveYy, getsp_9.StiffnessYy_N_m_rad, getsp_9.SpringCurveZz, getsp_9.StiffnessZz_N_m_rad, getsp_9.SpringMatrix, getsp_9.LockupVe_m, getsp_9.LockupVe_m_2, getsp_9.CoeffOfFriction_N_m, getsp_9.DampingRatio])
getsp_10 = GetSpringProperty(
    SpringProperty=spring_11,
    LengthUnit="Millimeter",
    RotationalStiffnessUnit="NewtonMeterPerRadian",
    StiffnessUnit="KilonewtonPerMeter")  # -> Name, SpringCurveX, StiffnessX_N_m, SpringCurveY, StiffnessY_N_m, SpringCurveZ, StiffnessZ_N_m, SpringCurveXx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
getsp_11 = GetSpringProperty(
    SpringProperty=spring_6,
    LengthUnit="Meter",
    RotationalStiffnessUnit="NewtonMeterPerRadian",
    StiffnessUnit="KilonewtonPerMeter")  # -> Name, SpringCurveX, StiffnessX_N_m, SpringCurveY, StiffnessY_N_m, SpringCurveZ, StiffnessZ_N_m, SpringCurveXx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
model = CreateModel(
    Properties=[spring_4, spring_5, spring_6, spring_7, spring_8, spring, spring_2, spring_9, spring_10, spring_11, spring_3],
    ReMesh=True,
    Tolerance=10,
    Unit="mm")
panel_10 = Panel([getsp_10.Name, getsp_10.SpringCurveX, getsp_10.StiffnessX_N_m, getsp_10.SpringCurveY, getsp_10.StiffnessY_N_m, getsp_10.SpringCurveZ, getsp_10.StiffnessZ_N_m, getsp_10.SpringCurveXx, getsp_10.StiffnessXx_N_m_rad, getsp_10.SpringCurveYy, getsp_10.StiffnessYy_N_m_rad, getsp_10.SpringCurveZz, getsp_10.StiffnessZz_N_m_rad, getsp_10.SpringMatrix, getsp_10.LockupVe_m, getsp_10.LockupVe_m_2, getsp_10.CoeffOfFriction_N_m, getsp_10.DampingRatio])
panel_11 = Panel([getsp_11.Name, getsp_11.SpringCurveX, getsp_11.StiffnessX_N_m, getsp_11.SpringCurveY, getsp_11.StiffnessY_N_m, getsp_11.SpringCurveZ, getsp_11.StiffnessZ_N_m, getsp_11.SpringCurveXx, getsp_11.StiffnessXx_N_m_rad, getsp_11.SpringCurveYy, getsp_11.StiffnessYy_N_m_rad, getsp_11.SpringCurveZz, getsp_11.StiffnessZz_N_m_rad, getsp_11.SpringMatrix, getsp_11.LockupVe_m, getsp_11.LockupVe_m_2, getsp_11.CoeffOfFriction_N_m, getsp_11.DampingRatio])
getprops = GetModelProperties(GSAModel=model)  # -> Sections, _2DProperties, _3DProperties, SpringProperties
pt = ConstructPoint(XCoordinate=0, YCoordinate=0, ZCoordinate=0)
pt_2 = ConstructPoint(XCoordinate="10", YCoordinate=0, ZCoordinate=0)
ln = Line(StartPoint=pt, EndPoint=pt_2)
mem1d = Create1DMember(
    Curve=ln,
    Preview3dSection=False,
    x1=False,
    x2=False,
    xx1=False,
    xx2=False,
    y1=False,
    y2=False,
    yy1=False,
    yy2=False,
    z1=False,
    z2=False,
    zz1=False,
    zz2=False)
elem1d = Create1DElement(Line=ln, Preview3dSection=False)
mem1d_2 = Create1DMember(
    Curve=ln,
    Property=getprops.SpringProperties,
    Preview3dSection=False,
    x1=False,
    x2=False,
    xx1=False,
    xx2=False,
    y1=False,
    y2=False,
    yy1=False,
    yy2=False,
    z1=False,
    z2=False,
    zz1=False,
    zz2=False)
mem1dedit = Edit1DMember(Member1D=mem1d, Section=getprops.SpringProperties, _1DElementType="spring", Preview3dSection=False)  # -> Member1D, Member1dNumber, Curve, Section, MemberGroup, MemberType, _1DElementType, Offset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
elem1d_2 = Create1DElement(Line=ln, Property=getprops.SpringProperties, Preview3dSection=False)
elem1dedit = Edit1DElement(Element1D=elem1d, Section=getprops.SpringProperties, Type="spring", Preview3dSection=False)  # -> Element1D, Number, Line, Section, Group, Type, Offset, StartRelease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
model_2 = CreateModel(GSAGeometryIn_m=[mem1dedit.Member1D, elem1dedit.Element1D, elem1d_2, mem1d_2], ReMesh=True, Tolerance=0.01, Unit="m")
getprops_2 = GetModelProperties(GSAModel=model_2)  # -> Sections, _2DProperties, _3DProperties, SpringProperties
getgeo = GetModelGeometry(GSAModel=model_2, Mode=1, Unit="m")  # -> NodesIn_m, _1DElementsIn_m, _2DElementsIn_m, _3DElementsIn_m, _1DMembersIn_m, _2DMembersIn_m, _3DMembersIn_m
getsp_12 = GetSpringProperty(
    SpringProperty=graft(getprops_2.SpringProperties),
    LengthUnit="Meter",
    RotationalStiffnessUnit="NewtonMeterPerRadian",
    StiffnessUnit="KilonewtonPerMeter")  # -> Name, SpringCurveX, StiffnessX_N_m, SpringCurveY, StiffnessY_N_m, SpringCurveZ, StiffnessZ_N_m, SpringCurveXx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
panel_12 = Panel([getsp_12.Name, getsp_12.SpringCurveX, getsp_12.StiffnessX_N_m, getsp_12.SpringCurveY, getsp_12.StiffnessY_N_m, getsp_12.SpringCurveZ, getsp_12.StiffnessZ_N_m, getsp_12.SpringCurveXx, getsp_12.StiffnessXx_N_m_rad, getsp_12.SpringCurveYy, getsp_12.StiffnessYy_N_m_rad, getsp_12.SpringCurveZz, getsp_12.StiffnessZz_N_m_rad, getsp_12.SpringMatrix, getsp_12.LockupVe_m, getsp_12.LockupVe_m_2, getsp_12.CoeffOfFriction_N_m, getsp_12.DampingRatio])
txt = Text(flatten(panel_12))
txt_2 = Text([panel, panel_9, panel_11, panel_3, panel_8, panel_5, panel_4, panel_7, panel_2, panel_10, panel_6])
tmatch = MatchText(Text=txt, Pattern=txt_2, Case=True)
nullrep = ReplaceNulls(Items=tmatch, Replacements="True")  # -> Items, Count
bool = Boolean(nullrep.Items)
not = GateNot(A=bool)
ma = MassAddition(Input=not)  # -> Result, PartialResults
equals = Equality(FirstNumber=ma.Result, SecondNumber="0")  # -> Equality, Inequality

# ---- group: RoundTrip
bool_2 = Boolean(equals.Equality)
