# Grasshopper definition Display1d.gh (Grasshopper 1.0.7)
# Copyright: Arup
# plug-ins: GSA

panel = Panel("https://github.com/arup-group/GSA-Grasshopper/raw/main/GsaGHTests/TestHelpers/Steel_Design_Simple.gwb")
c_script = CSharpScript(x=panel)  # -> A; inputs x: String
# ---------- c_script: C# usings ----------
using System.Linq;
# ---------- c_script: C# ----------
    string filePath = System.IO.Path.GetTempPath();
    string fileName = x.Split('/').Last();
    //create webclient and download example file:
    System.Net.WebClient webClient = new System.Net.WebClient();
    webClient.DownloadFile(
      x,
      filePath + fileName);

    A = filePath + fileName;
# ---------- end c_script ----------
open = OpenModel(FilenameAndPath=c_script)
getgeo = GetModelGeometry(GSAModel=open, Mode=1, Unit="m")  # -> NodesIn_m, _1DElementsIn_m, _2DElementsIn_m, _3DElementsIn_m, _1DMembersIn_m, _2DMembersIn_m, _3DMembersIn_m
move = Move(Geometry=getgeo._1DMembersIn_m, Motion=Vector(0, 0, 10))  # -> Geometry, Transform
geo = Geometry([getgeo._1DElementsIn_m, getgeo._1DMembersIn_m])
geo_2 = Geometry([getgeo._1DElementsIn_m, getgeo._1DMembersIn_m])
getres = GetResult(GSAModel=open, T="A", Case=1)
getres_2 = GetResult(GSAModel=open, T="A", Case=1)
getres_3 = GetResult(GSAModel=open, T="A", Case=1)
col = Colour(flatten([ColourSwatch(SwatchColor=RGB(255, 255, 255)), ColourSwatch(SwatchColor=RGB(0, 0, 255)), ColourSwatch(SwatchColor=RGB(255, 0, 255)), ColourSwatch(SwatchColor=RGB(0, 255, 255))]))
dom = ConstructDomain(DomainStart="-100", DomainEnd="100")
move_2 = Move(Geometry=getgeo._1DElementsIn_m, Motion=Vector(0, 0, 10))  # -> Geometry, Transform
move_3 = Move(Geometry=move.Geometry, Motion=Vector(0, 0, 10))  # -> Geometry, Transform
move_4 = Move(Geometry=geo, Motion=Vector(0, 0, 10))  # -> Geometry, Transform
move_5 = Move(Geometry=move_4.Geometry, Motion=Vector(0, 0, 10))  # -> Geometry, Transform
contour1d = Contour1DResults(
    Result=getres,
    IntermediatePoints=10,
    Colour=flatten(col),
    MinMaxDomain=dom,
    Scale=10,
    Display=3,
    Mode=0,
    energy="MJ",
    force="kN",
    legend=True,
    legendScale=1,
    length="mm",
    model="m",
    moment="kN·m",
    noDec=0,
    Result_Type="Displacement",
    Component="Resolved |U|",
    slider=True,
    val=230,
    valMax=1000,
    valMin=0)  # -> L, Colours, Values_mm
nodecontour = ContourNodeResults(
    Result=getres,
    Colour=col,
    MinMaxDomain=dom,
    Scalar=10,
    Display=0,
    Mode=2,
    force="kN",
    legend=True,
    legendScale=1,
    length="mm",
    model="m",
    moment="kN·m",
    noDec=0,
    Result_Type="Footfall",
    Component="Resonant",
    slider=False,
    val=0,
    valMax=1000,
    valMin=0)  # -> P, Colours, Values_
contour1d_2 = Contour1DResults(
    Result=getres,
    IntermediatePoints=10,
    Colour=flatten(col),
    MinMaxDomain=dom,
    Scale=10,
    Display=0,
    Mode=3,
    energy="MJ",
    force="kN",
    legend=True,
    legendScale=1,
    length="mm",
    model="m",
    moment="kN·m",
    noDec=0,
    Result_Type="Footfall",
    Component="Resonant",
    slider=False,
    val=0,
    valMax=1000,
    valMin=0)  # -> L, Colours, LegendValues_
nodecontour_2 = ContourNodeResults(
    Result=getres,
    Colour=col,
    MinMaxDomain=dom,
    Scalar=10,
    Display=3,
    Mode=1,
    force="kN",
    legend=True,
    legendScale=1,
    length="mm",
    model="m",
    moment="kN·m",
    noDec=0,
    Result_Type="Reaction",
    Component="Resolved |F|",
    slider=False,
    val=0,
    valMax=1000,
    valMin=0)  # -> P, Colours, Values_kN
contour1d_3 = Contour1DResults(
    Result=getres,
    IntermediatePoints=10,
    Colour=flatten(col),
    MinMaxDomain=dom,
    Scale=10,
    Display=7,
    Mode=0,
    energy="MJ",
    force="kN",
    legend=True,
    legendScale=1,
    length="mm",
    model="m",
    moment="kN·m",
    noDec=0,
    Result_Type="Displacement",
    Component="Resolved |R|",
    slider=False,
    val=230,
    valMax=1000,
    valMin=0)  # -> L, Colours, Values_rad
contour1d_4 = Contour1DResults(
    Result=getres,
    IntermediatePoints=10,
    Colour=flatten(col),
    MinMaxDomain=dom,
    Scale=10,
    Display=0,
    Mode=2,
    energy="MJ",
    force="kN",
    legend=True,
    legendScale=1,
    length="mm",
    model="m",
    moment="kN·m",
    noDec=0,
    Result_Type="Strain Energy",
    Component="Intermediate Pts",
    slider=False,
    val=0,
    valMax=1000,
    valMin=0)  # -> L, Colours, LegendValues_MJ
contour1d_5 = Contour1DResults(
    Result=getres,
    IntermediatePoints=10,
    Colour=flatten(col),
    MinMaxDomain=dom,
    Scale=10,
    Display=0,
    Mode=1,
    energy="MJ",
    force="kN",
    legend=True,
    legendScale=1,
    length="mm",
    model="m",
    moment="kN·m",
    noDec=0,
    Result_Type="Force",
    Component="Axial Force Fx",
    slider=False,
    val=0,
    valMax=1000,
    valMin=0)  # -> L, Colours, LegendValues_kN
nodecontour_3 = ContourNodeResults(
    Result=getres,
    Colour=col,
    MinMaxDomain=dom,
    Scalar=10,
    Display=3,
    Mode=0,
    force="kN",
    legend=True,
    legendScale=1,
    length="mm",
    model="m",
    moment="kN·m",
    noDec=0,
    Result_Type="Displacement",
    Component="Resolved |U|",
    slider=True,
    val=250,
    valMax=1000,
    valMin=0)  # -> P, Colours, Values_mm
resultdiagram = ResultDiagrams(
    Result=getres_2,
    Annotation=False,
    SignificantDigits=3,
    force="kN",
    length="mm",
    model="m",
    moment="kN·m",
    Type="Force",
    Diagram="Moment Myy",
    stress="MPa")  # -> DiagramLines, Annotations
reactionforce = ReactionForceDiagrams(
    Result=getres_2,
    Annotation=False,
    SignificantDigits=3,
    Display=3,
    force="kN",
    length="mm",
    model="m",
    moment="kN·m",
    Component="Resolved |F|")  # -> DiagramLines, Annotations
loaddiagram = LoadDiagrams(GSAModel=open, Annotation=False, SignificantDigits=3, force="kN", length="mm", model="m", Case_ID="L1", Load_Type="All")  # -> DiagramLines, Annotations
deformedpreview3d = PreviewDeformed3DSections(Result=getres_3, ElementMemberFilterList="1", noDec=0, val=250, valMax=1000, valMin=0)  # -> Mesh, Outlines
preview3d = Preview3DSections(ElementMember1D2D=move_3.Geometry, Unit="m")  # -> AnalysisLayerMesh, AnalysisLayerOutlines, DesignLayerMesh, DesignLayerOutlines
preview3d_2 = Preview3DSections(ElementMember1D2D=move_2.Geometry, Unit="m")  # -> AnalysisLayerMesh, AnalysisLayerOutlines, DesignLayerMesh, DesignLayerOutlines
annotate_detailed = AnnotateDetailed(
    ElementMember=move_5.Geometry,
    Size="1",
    Colour=ColourSwatch(SwatchColor=RGB(255, 255, 255)),
    id=True,
    material=True,
    name=True,
    property=True,
    Type="TextTag 3D",
    text3d=True)  # -> Annotations, Position, Text
annotate_detailed_2 = AnnotateDetailed(
    ElementMember=move_4.Geometry,
    Size="1",
    Colour=ColourSwatch(SwatchColor=RGB(255, 255, 255)),
    id=True,
    material=True,
    name=True,
    property=True,
    Type="Regular Dot",
    text3d=False)  # -> Annotations, Position, Text
an = Annotate(
    NodeElementMemberLoadResultDiagram=[getgeo.NodesIn_m, getgeo._1DElementsIn_m, getgeo._1DMembersIn_m],
    Colour=ColourSwatch(SwatchColor=RGB(255, 255, 255)))  # -> Annotations, Position, Text
nodecontour_4 = ContourNodeResults(
    Result=getres,
    Colour=col,
    MinMaxDomain=dom,
    Scalar=10,
    Display=0,
    Mode=2,
    force="kN",
    legend=True,
    legendScale=1,
    length="mm",
    model="m",
    moment="kN·m",
    noDec=0,
    Result_Type="Footfall",
    Component="Transient",
    slider=False,
    val=0,
    valMax=1000,
    valMin=0)  # -> P, Colours, Values_
nodecontour_5 = ContourNodeResults(
    Result=getres,
    Colour=col,
    MinMaxDomain=dom,
    Scalar=10,
    Display=7,
    Mode=1,
    force="kN",
    legend=True,
    legendScale=1,
    length="mm",
    model="m",
    moment="kN·m",
    noDec=0,
    Result_Type="Reaction",
    Component="Resolved |M|",
    slider=False,
    val=0,
    valMax=1000,
    valMin=0)  # -> P, Colours, Values_kN_m
nodecontour_6 = ContourNodeResults(
    Result=getres,
    Colour=col,
    MinMaxDomain=dom,
    Scalar=10,
    Display=7,
    Mode=0,
    force="kN",
    legend=True,
    legendScale=1,
    length="mm",
    model="m",
    moment="kN·m",
    noDec=0,
    Result_Type="Displacement",
    Component="Resolved |R|",
    slider=True,
    val=250,
    valMax=1000,
    valMin=0)  # -> P, Colours, Values_rad
contour1d_6 = Contour1DResults(
    Result=getres,
    IntermediatePoints=10,
    Colour=flatten(col),
    MinMaxDomain=dom,
    Scale=10,
    Display=1,
    Mode=2,
    energy="MJ",
    force="kN",
    legend=True,
    legendScale=1,
    length="mm",
    model="m",
    moment="kN·m",
    noDec=0,
    Result_Type="Strain Energy",
    Component="Average",
    slider=False,
    val=0,
    valMax=1000,
    valMin=0)  # -> L, Colours, LegendValues_MJ
contour1d_7 = Contour1DResults(
    Result=getres,
    IntermediatePoints=10,
    Colour=flatten(col),
    MinMaxDomain=dom,
    Scale=10,
    Display=1,
    Mode=1,
    energy="MJ",
    force="kN",
    legend=True,
    legendScale=1,
    length="mm",
    model="m",
    moment="kN·m",
    noDec=0,
    Result_Type="Force",
    Component="Shear Force Fy",
    slider=False,
    val=0,
    valMax=1000,
    valMin=0)  # -> L, Colours, LegendValues_kN
contour1d_8 = Contour1DResults(
    Result=getres,
    IntermediatePoints=10,
    Colour=flatten(col),
    MinMaxDomain=dom,
    Scale=10,
    Display=0,
    Mode=3,
    energy="MJ",
    force="kN",
    legend=True,
    legendScale=1,
    length="mm",
    model="m",
    moment="kN·m",
    noDec=0,
    Result_Type="Footfall",
    Component="Transient",
    slider=False,
    val=0,
    valMax=1000,
    valMin=0)  # -> L, Colours, LegendValues_
an_2 = Annotate(NodeElementMemberLoadResultDiagram=[an.Annotations, annotate_detailed_2.Annotations, annotate_detailed.Annotations, loaddiagram.Annotations, reactionforce.Annotations, resultdiagram.Annotations, contour1d.L])  # -> Annotations, Position, Text
contour1d_9 = Contour1DResults(
    Result=getres,
    IntermediatePoints=10,
    Colour=flatten(col),
    MinMaxDomain=dom,
    Scale=10,
    Display=2,
    Mode=1,
    energy="MJ",
    force="kN",
    legend=True,
    legendScale=1,
    length="mm",
    model="m",
    moment="kN·m",
    noDec=0,
    Result_Type="Force",
    Component="Shear Force Fz",
    slider=False,
    val=0,
    valMax=1000,
    valMin=0)  # -> L, Colours, LegendValues_kN
null = NullItem(Item=[loaddiagram.DiagramLines, loaddiagram.Annotations, reactionforce.DiagramLines, reactionforce.Annotations, resultdiagram.DiagramLines, resultdiagram.Annotations])  # -> flatten(NullFlags), InvalidFlags, Description
null_2 = NullItem(Item=[preview3d_2.AnalysisLayerMesh, preview3d_2.AnalysisLayerOutlines, preview3d.DesignLayerMesh, preview3d.DesignLayerOutlines, deformedpreview3d.Mesh, deformedpreview3d.Outlines])  # -> flatten(NullFlags), InvalidFlags, Description
null_3 = NullItem(Item=[an.Annotations, an.Position, an.Text, annotate_detailed_2.Annotations, annotate_detailed_2.Position, annotate_detailed.Annotations, annotate_detailed.Position, annotate_detailed.Text, an_2.Annotations])  # -> NullFlags, InvalidFlags, Description
contour1d_10 = Contour1DResults(
    Result=getres,
    IntermediatePoints=10,
    Colour=flatten(col),
    MinMaxDomain=dom,
    Scale=10,
    Display=3,
    Mode=1,
    energy="MJ",
    force="kN",
    legend=True,
    legendScale=1,
    length="mm",
    model="m",
    moment="kN·m",
    noDec=0,
    Result_Type="Force",
    Component="Res. Shear |Fyz|",
    slider=False,
    val=0,
    valMax=1000,
    valMin=0)  # -> L, Colours, LegendValues_kN
ma = MassAddition(Input=null.NullFlags)  # -> Result, PartialResults
ma_2 = MassAddition(Input=null_2.NullFlags)  # -> Result, PartialResults
contour1d_11 = Contour1DResults(
    Result=getres,
    IntermediatePoints=10,
    Colour=flatten(col),
    MinMaxDomain=dom,
    Scale=10,
    Display=4,
    Mode=1,
    energy="MJ",
    force="kN",
    legend=True,
    legendScale=1,
    length="mm",
    model="m",
    moment="kN·m",
    noDec=0,
    Result_Type="Force",
    Component="Torsion Mxx",
    slider=False,
    val=0,
    valMax=1000,
    valMin=0)  # -> L, Colours, LegendValues_kN_m
ma_3 = MassAddition(Input=null_3.NullFlags)  # -> Result, PartialResults
contour1d_12 = Contour1DResults(
    Result=getres,
    IntermediatePoints=10,
    Colour=flatten(col),
    MinMaxDomain=dom,
    Scale=10,
    Display=5,
    Mode=1,
    energy="MJ",
    force="kN",
    legend=True,
    legendScale=1,
    length="mm",
    model="m",
    moment="kN·m",
    noDec=0,
    Result_Type="Force",
    Component="Moment Myy",
    slider=False,
    val=0,
    valMax=1000,
    valMin=0)  # -> L, Colours, LegendValues_kN_m
equals = Equality(FirstNumber=ma.Result, SecondNumber="0")  # -> Equality, Inequality
equals_2 = Equality(FirstNumber=ma_2.Result, SecondNumber="0")  # -> Equality, Inequality
equals_3 = Equality(FirstNumber=ma_3.Result, SecondNumber="0")  # -> Equality, Inequality
contour1d_13 = Contour1DResults(
    Result=getres,
    IntermediatePoints=10,
    Colour=flatten(col),
    MinMaxDomain=dom,
    Scale=10,
    Display=6,
    Mode=1,
    energy="MJ",
    force="kN",
    legend=True,
    legendScale=1,
    length="mm",
    model="m",
    moment="kN·m",
    noDec=0,
    Result_Type="Force",
    Component="Moment Mzz",
    slider=False,
    val=0,
    valMax=1000,
    valMin=0)  # -> L, Colours, LegendValues_kN_m

# ---- group: Diagrams
bool = Boolean(equals.Equality)

# ---- group: Preview
bool_2 = Boolean(equals_2.Equality)

# ---- group: Annotate
bool_3 = Boolean(equals_3.Equality)

# ----
contour1d_14 = Contour1DResults(
    Result=getres,
    IntermediatePoints=10,
    Colour=flatten(col),
    MinMaxDomain=dom,
    Scale=10,
    Display=7,
    Mode=1,
    energy="MJ",
    force="kN",
    legend=True,
    legendScale=1,
    length="mm",
    model="m",
    moment="kN·m",
    noDec=0,
    Result_Type="Force",
    Component="Res. Moment |Myz|",
    slider=False,
    val=0,
    valMax=1000,
    valMin=0)  # -> L, Colours, LegendValues_kN_m
lnresinfo = LineResultInfo(L=[contour1d.L, contour1d_3.L, contour1d_5.L, contour1d_7.L, contour1d_9.L, contour1d_10.L, contour1d_11.L, contour1d_12.L, contour1d_13.L, contour1d_14.L, contour1d_4.L, contour1d_6.L, contour1d_2.L, contour1d_8.L])  # -> Line, R1, R2
null_4 = NullItem(Item=[contour1d.L, contour1d.Colours, contour1d.Values_mm, nodecontour_3.Colours, nodecontour_3.Values_mm, lnresinfo.Line, lnresinfo.R1, lnresinfo.R2, contour1d_3.L, contour1d_3.Colours, contour1d_3.Values_rad, contour1d_5.L, contour1d_5.Colours, contour1d_5.LegendValues_kN, contour1d_7.L, contour1d_7.Colours, contour1d_7.LegendValues_kN, contour1d_9.L, contour1d_9.Colours, contour1d_9.LegendValues_kN, contour1d_10.L, contour1d_10.Colours, contour1d_10.LegendValues_kN, contour1d_11.L, contour1d_11.Colours, contour1d_11.LegendValues_kN_m, contour1d_12.L, contour1d_12.Colours, contour1d_12.LegendValues_kN_m, contour1d_13.L, contour1d_13.Colours, contour1d_13.LegendValues_kN_m, contour1d_14.L, contour1d_14.Colours, contour1d_14.LegendValues_kN_m, contour1d_4.L, contour1d_4.Colours, contour1d_4.LegendValues_MJ, contour1d_6.L, contour1d_6.Colours, contour1d_6.LegendValues_MJ, contour1d_2.L, contour1d_2.Colours, contour1d_2.LegendValues_, contour1d_8.L, contour1d_8.Colours, contour1d_8.LegendValues_, nodecontour_3.P, nodecontour_6.P, nodecontour_6.Colours, nodecontour_6.Values_rad, nodecontour_2.P, nodecontour_2.Colours, nodecontour_2.Values_kN, nodecontour_5.P, nodecontour_5.Colours, nodecontour_5.Values_kN_m, nodecontour.P, nodecontour.Colours, nodecontour.Values_, nodecontour_4.P, nodecontour_4.Colours, nodecontour_4.Values_])  # -> flatten(NullFlags), InvalidFlags, Description
ma_4 = MassAddition(Input=null_4.NullFlags)  # -> Result, PartialResults
equals_4 = Equality(FirstNumber=ma_4.Result, SecondNumber="0")  # -> Equality, Inequality

# ---- group: Results
bool_4 = Boolean(equals_4.Equality)

# ----
panel_2 = Panel(bool)
panel_3 = Panel(bool_2)
panel_4 = Panel(bool_4)
panel_5 = Panel(bool_3)
