# Grasshopper definition Display2d.gh (Grasshopper 1.0.7)
# Copyright: Arup
# plug-ins: GSA

panel = Panel("https://github.com/arup-group/GSA-Grasshopper/raw/main/GsaGHTests/TestHelpers/Element2d_Simple.gwb")
c_script = CSharpScript(x=panel)  # -> A; inputs x: String
# ---------- c_script: C# usings ----------
using System.Linq;
# ---------- c_script: C# ----------
    string filePath = System.IO.Path.GetTempPath();
    string fileName = x.Split('/').Last();
    //create webclient and download example file:
    System.Net.WebClient webClient = new System.Net.WebClient();
    webClient.DownloadFile(
      x,
      filePath + fileName);

    A = filePath + fileName;
# ---------- end c_script ----------
open = OpenModel(FilenameAndPath=c_script)
analyse_model = AnalyseModel(ModelSAndLists=open, Analyse=True, ReMesh=False, Tolerance=0.01, Unit="m")  # -> Model, Errors, Warnings, Remarks, Logs
getgeo = GetModelGeometry(GSAModel=analyse_model.Model, Mode=1, Unit="m")  # -> NodesIn_m, _1DElementsIn_m, _2DElementsIn_m, _3DElementsIn_m, _1DMembersIn_m, _2DMembersIn_m, _3DMembersIn_m
move = Move(Geometry=getgeo._2DMembersIn_m, Motion=Vector(0, 0, 10))  # -> Geometry, Transform
geo = Geometry([getgeo._2DMembersIn_m, getgeo._2DElementsIn_m])
getres = GetResult(GSAModel=analyse_model.Model, T="A", Case=1)
getres_2 = GetResult(GSAModel=analyse_model.Model, T="A", Case=1)
getres_3 = GetResult(GSAModel=analyse_model.Model, T="A", Case=1)
col = Colour(flatten([ColourSwatch(SwatchColor=RGB(255, 255, 255)), ColourSwatch(SwatchColor=RGB(0, 0, 255)), ColourSwatch(SwatchColor=RGB(255, 0, 255)), ColourSwatch(SwatchColor=RGB(0, 255, 255))]))
dom = ConstructDomain(DomainStart="-100", DomainEnd="100")
move_2 = Move(Geometry=geo, Motion=Vector(0, 0, 10))  # -> Geometry, Transform
move_3 = Move(Geometry=getgeo._2DElementsIn_m, Motion=Vector(0, 0, 10))  # -> Geometry, Transform
move_4 = Move(Geometry=move.Geometry, Motion=Vector(0, 0, 10))  # -> Geometry, Transform
move_5 = Move(Geometry=move_2.Geometry, Motion=Vector(0, 0, 10))  # -> Geometry, Transform
reactionforce = ReactionForceDiagrams(
    Result=getres,
    Annotation="true",
    SignificantDigits="2",
    Colour=ColourSwatch(SwatchColor=RGB(255, 255, 255)),
    Display=3,
    force="kN",
    length="mm",
    model="m",
    moment="kN·m",
    Component="Resolved |F|")  # -> DiagramLines, Annotations
loaddiagram = LoadDiagrams(
    GSAModel=analyse_model.Model,
    Annotation=False,
    SignificantDigits=3,
    force="kN",
    length="mm",
    model="m",
    Case_ID="L1",
    Load_Type="All")  # -> DiagramLines, Annotations
contour2d = Contour2DResults(
    Result=getres_2,
    Colour=col,
    MinMaxDomain=dom,
    Display=3,
    Mode=0,
    envelope="Absolute",
    flayer=0,
    force="kN/m",
    legend=True,
    legendHeight=110,
    legendScale=1,
    legendWidth=120,
    length="mm",
    model="m",
    moment="kN",
    noDec=0,
    Result_Type="Displacement",
    Component="Resolved |U|",
    slider=True,
    stress="MPa",
    val=250,
    valMax=1000,
    valMin=0)  # -> M, Colours, Values_mm
contour2d_2 = Contour2DResults(
    Result=getres_2,
    Colour=col,
    MinMaxDomain=dom,
    Display=1,
    Mode=0,
    envelope="Absolute",
    flayer=0,
    force="kN/m",
    legend=True,
    legendHeight=110,
    legendScale=1,
    legendWidth=120,
    length="mm",
    model="m",
    moment="kN",
    noDec=0,
    Result_Type="Displacement",
    Component="Translation Uy",
    slider=True,
    stress="MPa",
    val=250,
    valMax=1000,
    valMin=0)  # -> M, Colours, Values_mm
deformedpreview3d = PreviewDeformed3DSections(Result=getres_3, ElementMemberFilterList="all", noDec=0, val=250, valMax=1000, valMin=0)  # -> Mesh, Outlines
contour2d_3 = Contour2DResults(
    Result=getres_2,
    Colour=col,
    MinMaxDomain=dom,
    Display=0,
    Mode=0,
    envelope="Absolute",
    flayer=0,
    force="kN/m",
    legend=True,
    legendHeight=110,
    legendScale=1,
    legendWidth=120,
    length="mm",
    model="m",
    moment="kN",
    noDec=0,
    Result_Type="Displacement",
    Component="Translation Ux",
    slider=True,
    stress="MPa",
    val=250,
    valMax=1000,
    valMin=0)  # -> M, Colours, Values_mm
contour2d_4 = Contour2DResults(
    Result=getres_2,
    Colour=col,
    MinMaxDomain=dom,
    Display=0,
    Mode=1,
    envelope="Absolute",
    flayer=0,
    force="kN/m",
    legend=True,
    legendHeight=110,
    legendScale=1,
    legendWidth=120,
    length="mm",
    model="m",
    moment="kN",
    noDec=0,
    Result_Type="Force",
    Component="Force Nx",
    slider=False,
    stress="MPa",
    val=0,
    valMax=1000,
    valMin=0)  # -> M, Colours, LegendValues_kN_m_m
nodecontour = ContourNodeResults(
    Result=getres_2,
    Colour=col,
    MinMaxDomain=dom,
    Scalar=10,
    Display=3,
    Mode=0,
    envelope="Absolute",
    force="kN",
    legend=True,
    legendHeight=110,
    legendScale=1,
    legendWidth=120,
    length="mm",
    moment="kN·m",
    noDec=0,
    Result_Type="Displacement",
    Component="Resolved |U|",
    slider=True,
    val=250,
    valMax=1000,
    valMin=0)  # -> P, Colours, Values_mm
preview3d = Preview3DSections(ElementMember1D2D=move_4.Geometry, Unit="m")  # -> AnalysisLayerMesh, AnalysisLayerOutlines, DesignLayerMesh, DesignLayerOutlines
nodecontour_2 = ContourNodeResults(
    Result=getres_2,
    Colour=col,
    MinMaxDomain=dom,
    Scalar=10,
    Display=3,
    Mode=1,
    envelope="Absolute",
    force="kN",
    legend=True,
    legendHeight=110,
    legendScale=1,
    legendWidth=120,
    length="mm",
    moment="kN·m",
    noDec=0,
    Result_Type="Reaction",
    Component="Resolved |F|",
    slider=False,
    val=0,
    valMax=1000,
    valMin=0)  # -> P, Colours, Values_kN
preview3d_2 = Preview3DSections(ElementMember1D2D=move_3.Geometry, Unit="m")  # -> AnalysisLayerMesh, AnalysisLayerOutlines, DesignLayerMesh, DesignLayerOutlines
annotate_detailed = AnnotateDetailed(
    ElementMember=move_5.Geometry,
    Size="0.1",
    Colour=ColourSwatch(SwatchColor=RGB(255, 255, 255)),
    id=True,
    material=True,
    name=True,
    property=True,
    Type="TextTag 3D",
    text3d=True)  # -> Annotations, Position, Text
annotate_detailed_2 = AnnotateDetailed(
    ElementMember=move_2.Geometry,
    Size="1",
    Colour=ColourSwatch(SwatchColor=RGB(255, 255, 255)),
    id=True,
    material=True,
    name=True,
    property=True,
    Type="Regular Dot",
    text3d=False)  # -> Annotations, Position, Text
an = Annotate(NodeElementMemberLoadResultDiagram=getgeo._2DElementsIn_m, Colour=ColourSwatch(SwatchColor=RGB(255, 255, 255)))  # -> Annotations, Position, Text
contour2d_5 = Contour2DResults(
    Result=getres_2,
    Colour=col,
    MinMaxDomain=dom,
    Display=2,
    Mode=0,
    envelope="Absolute",
    flayer=0,
    force="kN/m",
    legend=True,
    legendHeight=110,
    legendScale=1,
    legendWidth=120,
    length="mm",
    model="m",
    moment="kN",
    noDec=0,
    Result_Type="Displacement",
    Component="Translation Uz",
    slider=True,
    stress="MPa",
    val=250,
    valMax=1000,
    valMin=0)  # -> M, Colours, Values_mm
contour2d_6 = Contour2DResults(
    Result=getres_2,
    Colour=col,
    MinMaxDomain=dom,
    Display=1,
    Mode=1,
    envelope="Absolute",
    flayer=0,
    force="kN/m",
    legend=True,
    legendHeight=110,
    legendScale=1,
    legendWidth=120,
    length="mm",
    model="m",
    moment="kN",
    noDec=0,
    Result_Type="Force",
    Component="Force Ny",
    slider=False,
    stress="MPa",
    val=0,
    valMax=1000,
    valMin=0)  # -> M, Colours, LegendValues_kN_m_m
nodecontour_3 = ContourNodeResults(
    Result=getres_2,
    Colour=col,
    MinMaxDomain=dom,
    Scalar=10,
    Display=7,
    Mode=0,
    envelope="Absolute",
    force="kN",
    legend=True,
    legendHeight=110,
    legendScale=1,
    legendWidth=120,
    length="mm",
    moment="kN·m",
    noDec=0,
    Result_Type="Displacement",
    Component="Resolved |R|",
    slider=True,
    val=250,
    valMax=1000,
    valMin=0)  # -> P, Colours, Values_rad
nodecontour_4 = ContourNodeResults(
    Result=getres_2,
    Colour=col,
    MinMaxDomain=dom,
    Scalar=10,
    Display=7,
    Mode=1,
    envelope="Absolute",
    force="kN",
    legend=True,
    legendHeight=110,
    legendScale=1,
    legendWidth=120,
    length="mm",
    moment="kN·m",
    noDec=0,
    Result_Type="Reaction",
    Component="Resolved |M|",
    slider=False,
    val=0,
    valMax=1000,
    valMin=0)  # -> P, Colours, Values_kN_m
contour2d_7 = Contour2DResults(
    Result=getres_2,
    Colour=col,
    MinMaxDomain=dom,
    Display=2,
    Mode=1,
    envelope="Absolute",
    flayer=0,
    force="kN/m",
    legend=True,
    legendHeight=110,
    legendScale=1,
    legendWidth=120,
    length="mm",
    model="m",
    moment="kN",
    noDec=0,
    Result_Type="Force",
    Component="Force Nxy",
    slider=False,
    stress="MPa",
    val=0,
    valMax=1000,
    valMin=0)  # -> M, Colours, LegendValues_kN_m_m
null = NullItem(Item=[loaddiagram.DiagramLines, loaddiagram.Annotations, reactionforce.DiagramLines, reactionforce.Annotations])  # -> flatten(NullFlags), InvalidFlags, Description
null_2 = NullItem(Item=[preview3d_2.AnalysisLayerMesh, preview3d_2.AnalysisLayerOutlines, preview3d.DesignLayerMesh, preview3d.DesignLayerOutlines, deformedpreview3d.Mesh, deformedpreview3d.Outlines])  # -> flatten(NullFlags), InvalidFlags, Description
null_3 = NullItem(Item=[an.Annotations, an.Position, an.Text, annotate_detailed_2.Annotations, annotate_detailed_2.Position, annotate_detailed.Annotations, annotate_detailed.Position, annotate_detailed.Text])  # -> NullFlags, InvalidFlags, Description
contour2d_8 = Contour2DResults(
    Result=getres_2,
    Colour=col,
    MinMaxDomain=dom,
    Display=0,
    Mode=1,
    envelope="Absolute",
    flayer=0,
    force="kN/m",
    legend=True,
    legendHeight=110,
    legendScale=1,
    legendWidth=120,
    length="mm",
    model="m",
    moment="kN",
    noDec=0,
    Result_Type="Force",
    Component="Shear Qx",
    slider=False,
    stress="MPa",
    val=0,
    valMax=1000,
    valMin=0)  # -> M, Colours, LegendValues_kN_m_m
contour2d_9 = Contour2DResults(
    Result=getres_2,
    Colour=col,
    MinMaxDomain=dom,
    Display=1,
    Mode=1,
    envelope="Absolute",
    flayer=0,
    force="kN/m",
    legend=True,
    legendHeight=110,
    legendScale=1,
    legendWidth=120,
    length="mm",
    model="m",
    moment="kN",
    noDec=0,
    Result_Type="Force",
    Component="Shear Qy",
    slider=False,
    stress="MPa",
    val=0,
    valMax=1000,
    valMin=0)  # -> M, Colours, LegendValues_kN_m_m
ma = MassAddition(Input=null.NullFlags)  # -> Result, PartialResults
ma_2 = MassAddition(Input=null_2.NullFlags)  # -> Result, PartialResults
ma_3 = MassAddition(Input=null_3.NullFlags)  # -> Result, PartialResults
contour2d_10 = Contour2DResults(
    Result=getres_2,
    Colour=col,
    MinMaxDomain=dom,
    Display=4,
    Mode=1,
    envelope="Absolute",
    flayer=0,
    force="kN/m",
    legend=True,
    legendHeight=110,
    legendScale=1,
    legendWidth=120,
    length="mm",
    model="m",
    moment="kN",
    noDec=0,
    Result_Type="Force",
    Component="Moment Mx",
    slider=False,
    stress="MPa",
    val=0,
    valMax=1000,
    valMin=0)  # -> M, Colours, LegendValues_kN_m_m
equals = Equality(FirstNumber=ma.Result, SecondNumber="0")  # -> Equality, Inequality
equals_2 = Equality(FirstNumber=ma_2.Result, SecondNumber="0")  # -> Equality, Inequality
equals_3 = Equality(FirstNumber=ma_3.Result, SecondNumber="0")  # -> Equality, Inequality
contour2d_11 = Contour2DResults(
    Result=getres_2,
    Colour=col,
    MinMaxDomain=dom,
    Display=5,
    Mode=1,
    envelope="Absolute",
    flayer=0,
    force="kN/m",
    legend=True,
    legendHeight=110,
    legendScale=1,
    legendWidth=120,
    length="mm",
    model="m",
    moment="kN",
    noDec=0,
    Result_Type="Force",
    Component="Moment My",
    slider=False,
    stress="MPa",
    val=0,
    valMax=1000,
    valMin=0)  # -> M, Colours, LegendValues_kN_m_m

# ---- group: Preview
bool = Boolean(equals_2.Equality)

# ---- group: Diagrams
bool_2 = Boolean(equals.Equality)

# ---- group: Annotate
bool_3 = Boolean(equals_3.Equality)

# ----
contour2d_12 = Contour2DResults(
    Result=getres_2,
    Colour=col,
    MinMaxDomain=dom,
    Display=6,
    Mode=1,
    envelope="Absolute",
    flayer=0,
    force="kN/m",
    legend=True,
    legendHeight=110,
    legendScale=1,
    legendWidth=120,
    length="mm",
    model="m",
    moment="kN",
    noDec=0,
    Result_Type="Force",
    Component="Moment Mxy",
    slider=False,
    stress="MPa",
    val=0,
    valMax=1000,
    valMin=0)  # -> M, Colours, LegendValues_kN_m_m
panel_2 = Panel(bool)
panel_3 = Panel(bool_2)
contour2d_13 = Contour2DResults(
    Result=getres_2,
    Colour=col,
    MinMaxDomain=dom,
    Display=3,
    Mode=1,
    envelope="Absolute",
    flayer=0,
    force="kN/m",
    legend=True,
    legendHeight=110,
    legendScale=1,
    legendWidth=120,
    length="mm",
    model="m",
    moment="kN",
    noDec=0,
    Result_Type="Force",
    Component="Wood-Armer M*x",
    slider=False,
    stress="MPa",
    val=0,
    valMax=1000,
    valMin=0)  # -> M, Colours, LegendValues_kN_m_m
panel_4 = Panel(bool_3)
contour2d_14 = Contour2DResults(
    Result=getres_2,
    Colour=col,
    MinMaxDomain=dom,
    Display=7,
    Mode=1,
    envelope="Absolute",
    flayer=0,
    force="kN/m",
    legend=True,
    legendHeight=110,
    legendScale=1,
    legendWidth=120,
    length="mm",
    model="m",
    moment="kN",
    noDec=0,
    Result_Type="Force",
    Component="Wood-Armer M*y",
    slider=False,
    stress="MPa",
    val=0,
    valMax=1000,
    valMin=0)  # -> M, Colours, LegendValues_kN_m_m
meshresinfo = MeshResultInfo(M=[contour2d.M, contour2d_3.M, contour2d_2.M, contour2d_5.M, contour2d_4.M, contour2d_6.M, contour2d_7.M, contour2d_8.M, contour2d_9.M, contour2d_10.M, contour2d_11.M, contour2d_12.M, contour2d_13.M, contour2d_14.M])  # -> Mesh, Vertices, R
null_4 = NullItem(Item=[nodecontour.Colours, nodecontour.Values_mm, contour2d.M, contour2d.Colours, contour2d.Values_mm, meshresinfo.Mesh, meshresinfo.Vertices, meshresinfo.R, contour2d_3.M, contour2d_3.Colours, contour2d_3.Values_mm, contour2d_2.M, contour2d_2.Colours, contour2d_2.Values_mm, contour2d_5.M, contour2d_5.Colours, contour2d_5.Values_mm, contour2d_4.M, contour2d_4.Colours, contour2d_4.LegendValues_kN_m_m, contour2d_6.M, contour2d_6.Colours, contour2d_6.LegendValues_kN_m_m, contour2d_7.M, contour2d_7.Colours, contour2d_7.LegendValues_kN_m_m, contour2d_8.M, contour2d_8.Colours, contour2d_8.LegendValues_kN_m_m, contour2d_9.M, contour2d_9.Colours, contour2d_9.LegendValues_kN_m_m, contour2d_10.M, contour2d_10.Colours, contour2d_10.LegendValues_kN_m_m, contour2d_11.M, contour2d_11.Colours, contour2d_11.LegendValues_kN_m_m, contour2d_12.M, contour2d_12.Colours, contour2d_12.LegendValues_kN_m_m, contour2d_13.M, nodecontour_3.P, nodecontour_3.Colours, nodecontour_3.Values_rad, nodecontour_2.P, nodecontour_2.Colours, nodecontour_2.Values_kN, nodecontour_4.P, nodecontour_4.Colours, nodecontour_4.Values_kN_m])  # -> flatten(NullFlags), InvalidFlags, Description
ma_4 = MassAddition(Input=null_4.NullFlags)  # -> Result, PartialResults
equals_4 = Equality(FirstNumber=ma_4.Result, SecondNumber="0")  # -> Equality, Inequality

# ---- group: Results
bool_4 = Boolean(equals_4.Equality)

# ----
panel_5 = Panel(bool_4)
