# Grasshopper definition Display3d.gh (Grasshopper 1.0.7)
# Copyright: Arup
# plug-ins: GSA

panel = Panel("C:\Users\tilman.reinhardt\git\GSA-Grasshopper\GsaGHTests\TestHelpers\Steel_Design_Simple.gwb")
panel_2 = Panel("C:\Users\tilman.reinhardt\git\GSA-Grasshopper\GsaGHTests\TestHelpers\Element2d_Simple.gwb")
panel_3 = Panel("C:\Users\tilman.reinhardt\git\GSA-Grasshopper\GsaGHTests\TestHelpers\Element3d_Simple.gwb")
open = OpenModel(FilenameAndPath=panel_3)
getgeo = GetModelGeometry(GSAModel=open, Mode=1, Unit="m")  # -> NodesIn_m, _1DElementsIn_m, _2DElementsIn_m, _3DElementsIn_m, _1DMembersIn_m, _2DMembersIn_m, _3DMembersIn_m
move = Move(Geometry=getgeo._3DElementsIn_m, Motion="{0,0,30}")  # -> Geometry, Transform; disabled
geo = Geometry(getgeo._3DElementsIn_m)  # disabled
getres = GetResult(GSAModel=open, T="A", Case=1)  # disabled
getres_2 = GetResult(GSAModel=open, T="A", Case=1)
getres_3 = GetResult(GSAModel=open, T="A", Case=1)  # disabled
move_2 = Move(Geometry=geo, Motion=Vector(0, 0, 10))  # -> Geometry, Transform; disabled
move_3 = Move(Geometry=move.Geometry, Motion="{0,0,30}")  # -> Geometry, Transform; disabled
move_4 = Move(Geometry=getgeo._3DElementsIn_m, Motion="{0,0,30}")  # -> Geometry, Transform; disabled
move_5 = Move(Geometry=move_2.Geometry, Motion=Vector(0, 0, 10))  # -> Geometry, Transform; disabled
swatch = ColourSwatch(SwatchColor=RGB(255, 255, 255))  # disabled
swatch_2 = ColourSwatch(SwatchColor=RGB(255, 255, 255))  # disabled
swatch_3 = ColourSwatch(SwatchColor=RGB(255, 255, 255))  # disabled
swatch_4 = ColourSwatch(SwatchColor=RGB(255, 255, 255))  # disabled
panel_4 = Panel("true")  # disabled
panel_5 = Panel("all")  # disabled
panel_6 = Panel("1")  # disabled
panel_7 = Panel("2")  # disabled
panel_8 = Panel("1")  # disabled
reactionforce = ReactionForceDiagrams(
    Result=getres,
    Annotation=panel_4,
    SignificantDigits=panel_7,
    Colour=swatch,
    Display=3,
    force="kN",
    length="mm",
    model="m",
    moment="kN·m",
    Component="Resolved |F|")  # -> DiagramLines, Annotations; disabled
loaddiagram = LoadDiagrams(GSAModel=open, Annotation=False, SignificantDigits=3, force="kN", length="mm", model="m", Case_ID="L1", Load_Type="All")  # -> DiagramLines, Annotations; disabled
nodecontour = ContourNodeResults(
    Result=getres_2,
    Scalar=10,
    Display=3,
    Mode=0,
    force="kN",
    legend=True,
    legendScale=1,
    length="mm",
    model="m",
    moment="kN·m",
    noDec=0,
    Result_Type="Displacement",
    Component="Resolved |U|",
    slider=True,
    val=250,
    valMax=1000,
    valMin=0)  # -> P, Colours, Values_mm
deformedpreview3d = PreviewDeformed3DSections(Result=getres_3, ElementMemberFilterList=panel_5, noDec=0, val=250, valMax=1000, valMin=0)  # -> Mesh, Outlines; disabled
contour3d = Contour3DResults(
    Result=getres_2,
    Display=3,
    Mode=0,
    legend=True,
    legendScale=1,
    length="mm",
    model="m",
    noDec=0,
    Result_Type="Displacement",
    Component="Resolved |U|",
    slider=True,
    stress="MPa",
    val=250,
    valMax=1000,
    valMin=0)  # -> NgonMesh, Colours, Values_mm
preview3d = Preview3DSections(ElementMember1D2D=move_3.Geometry, Unit="m")  # -> AnalysisLayerMesh, AnalysisLayerOutlines, DesignLayerMesh, DesignLayerOutlines; disabled
preview3d_2 = Preview3DSections(ElementMember1D2D=move_4.Geometry, Unit="m")  # -> AnalysisLayerMesh, AnalysisLayerOutlines, DesignLayerMesh, DesignLayerOutlines; disabled
annotate_detailed = AnnotateDetailed(
    ElementMember=move_5.Geometry,
    Size=panel_6,
    Colour=swatch_2,
    id=True,
    material=True,
    name=True,
    property=True,
    Type="TextTag 3D",
    text3d=True)  # -> Annotations, Position, Text; disabled
annotate_detailed_2 = AnnotateDetailed(
    ElementMember=move_2.Geometry,
    Size=panel_8,
    Colour=swatch_3,
    id=True,
    material=True,
    name=True,
    property=True,
    Type="Regular Dot",
    text3d=False)  # -> Annotations, Position, Text; disabled
an = Annotate(NodeElementMemberLoadResultDiagram=[getgeo.NodesIn_m, getgeo._3DElementsIn_m], Colour=swatch_4)  # -> Annotations, Position, Text; disabled
meshresinfo = MeshResultInfo(M=contour3d.NgonMesh)  # -> Mesh, Vertices, R
ptresinfo = PointResultInfo(P=nodecontour.P)  # -> Point, R
null = NullItem(Item=[loaddiagram.DiagramLines, loaddiagram.Annotations, reactionforce.DiagramLines, reactionforce.Annotations])  # -> flatten(NullFlags), InvalidFlags, Description; disabled
null_2 = NullItem(Item=[preview3d_2.AnalysisLayerMesh, preview3d_2.AnalysisLayerOutlines, preview3d.DesignLayerMesh, preview3d.DesignLayerOutlines, deformedpreview3d.Mesh, deformedpreview3d.Outlines])  # -> flatten(NullFlags), InvalidFlags, Description; disabled
null_3 = NullItem(Item=[nodecontour.Colours, nodecontour.Values_mm, meshresinfo.Mesh, meshresinfo.Vertices, meshresinfo.R, contour3d.Colours, contour3d.Values_mm, nodecontour.P, ptresinfo.Point, ptresinfo.R])  # -> flatten(NullFlags), InvalidFlags, Description
null_4 = NullItem(Item=[an.Annotations, an.Position, an.Text, annotate_detailed_2.Annotations, annotate_detailed_2.Position, annotate_detailed.Annotations, annotate_detailed.Position, annotate_detailed.Text])  # -> NullFlags, InvalidFlags, Description; disabled
ma = MassAddition(Input=null.NullFlags)  # -> Result, PartialResults; disabled
ma_2 = MassAddition(Input=null_2.NullFlags)  # -> Result, PartialResults; disabled
ma_3 = MassAddition(Input=null_3.NullFlags)  # -> Result, PartialResults
ma_4 = MassAddition(Input=null_4.NullFlags)  # -> Result, PartialResults; disabled
panel_9 = Panel("0")  # disabled
panel_10 = Panel("0")  # disabled
panel_11 = Panel("0")  # disabled
equals = Equality(FirstNumber=ma.Result, SecondNumber=panel_10)  # -> Equality, Inequality; disabled
equals_2 = Equality(FirstNumber=ma_2.Result, SecondNumber=panel_9)  # -> Equality, Inequality; disabled
equals_3 = Equality(FirstNumber=ma_3.Result, SecondNumber="0")  # -> Equality, Inequality
equals_4 = Equality(FirstNumber=ma_4.Result, SecondNumber=panel_11)  # -> Equality, Inequality; disabled

# ---- group: Preview
bool = Boolean(equals_2.Equality)  # disabled

# ---- group: Diagrams
bool_2 = Boolean(equals.Equality)  # disabled

# ---- group: Results
bool_3 = Boolean(equals_3.Equality)

# ---- group: Annotate
bool_4 = Boolean(equals_4.Equality)  # disabled

# ----
panel_12 = Panel(bool)  # disabled
panel_13 = Panel(bool_2)  # disabled
panel_14 = Panel(bool_3)
panel_15 = Panel(bool_4)  # disabled
