# Grasshopper definition Elem1dResults.gh (Grasshopper 1.0.7)
# Copyright: Arup
# plug-ins: GSA

panel = Panel("https://samples.oasys-software.com/gsa/10.2/Training_General/TrGen_10.gwb")
c_script = CSharpScript(x=panel)  # -> A; inputs x: String
# ---------- c_script: C# usings ----------
using System.Linq;
# ---------- c_script: C# ----------
    string filePath = System.IO.Path.GetTempPath();
    string fileName = x.Split('/').Last();
    //create webclient and download example file:
    System.Net.WebClient webClient = new System.Net.WebClient();
    webClient.DownloadFile(
      x,
      filePath + fileName);

    A = filePath + fileName;
# ---------- end c_script ----------
open = OpenModel(FilenameAndPath=c_script)
analyse = AnalyseModel(ModelS=open, Analyse=True, ReMesh=False, Tolerance=0.05, Unit="m")  # -> Model, Report
gsa = Model(analyse.Model)
selres = SelectResults(GSAModel=analyse.Model, Type="AnalysisCase", Case_ID="A3")
selres_2 = SelectResults(GSAModel=gsa, Type="AnalysisCase", Case_ID="A2")
selres_3 = SelectResult(GSAModel=gsa, Type="Combination", Case_ID="C1", Permutation="All")
selres_4 = SelectResults(GSAModel=gsa, Type="AnalysisCase", Case_ID="A1")
selres_5 = SelectResults(GSAModel=gsa, Case="1", Type="AnalysisCase", Case_ID="A1")
strainenergy = BeamStrainEnergyDensity(Result=selres_3, ElementFilterList="1", checked=False, Energy_Unit="J")
strainenergy_2 = BeamStrainEnergyDensity(Result=selres_3, ElementFilterList="1 to 10", checked=True, Energy_Unit="J")  # -> flatten(StrainEnergyDensity_J_m³)
addition = Addition(A="7", B="2")
beamdisp = BeamDisplacements(Result=selres, ElementFilterList="5", IntermediatePoints=3, Unit="mm")  # -> TranslationsX_mm, TranslationsY_mm, TranslationsZ_mm, TranslationsXYZ_mm, RotationsXX_rad, RotationsYY_rad, RotationsZZ_rad, RotationsXYZ_rad
getgeo = GetModelGeometry(GSAModel=analyse.Model, NodeFilterList="All", ElementFilterList="5", MemberFilterList="All", Mode=1, Unit="m")  # -> NodesIn_m, _1DElementsIn_m, _2DElementsIn_m, _3DElementsIn_m, _1DMembersIn_m, _2DMembersIn_m, _3DMembersIn_m
contourelem1d = _1DContourResults(
    Result=selres,
    ElementFilterList="5",
    IntermediatePoints="3",
    Scale=10,
    Display=3,
    Mode=0,
    energy="MJ",
    force="kN",
    legend=True,
    legendScale=1,
    length="mm",
    model="m",
    moment="kN·m",
    noDec=0,
    Result_Type="Displacement",
    Component="Resolved |U|",
    slider=True,
    val=750,
    valMax=1000,
    valMin=0)  # -> Line, Colours, Values_mm
beamforces = BeamForcesAndMoments(Result=selres_2, ElementFilterList="All", IntermediatePoints="7", Force_Unit="kN", Moment_Unit="kN·m")  # -> ForceX_kN, ForceY_kN, ForceZ_kN, ForceXYZ_kN, MomentXX_kN_m, MomentYY_kN_m, MomentZZ_kN_m, MomentYYZZ_kN_m
contourelem1d_2 = _1DContourResults(
    Result=selres_2,
    ElementFilterList="9",
    IntermediatePoints="7",
    Scale=10,
    Display=0,
    Mode=1,
    energy="MJ",
    force="kN",
    legend=False,
    legendScale=1,
    length="mm",
    model="m",
    moment="kN·m",
    noDec=0,
    Result_Type="Force",
    Component="Axial Force Fx",
    slider=False,
    val=0,
    valMax=1000,
    valMin=0)  # -> Line, Colours, LegendValues_kN
contourelem1d_3 = _1DContourResults(
    Result=selres_2,
    ElementFilterList="9",
    IntermediatePoints="7",
    Scale=10,
    Display=5,
    Mode=1,
    energy="MJ",
    force="kN",
    legend=True,
    legendScale=1,
    length="mm",
    model="m",
    moment="kN·m",
    noDec=0,
    Result_Type="Force",
    Component="Moment Myy",
    slider=False,
    val=0,
    valMax=1000,
    valMin=0)  # -> Line, Colours, LegendValues_kN_m

# ---- group: Case2 :: Permutation 0 :: Element 9
path = ConstructPath(Indices=["2", "0", "9"])

# ----
strainenergy_3 = BeamStrainEnergyDensity(Result=selres_5, ElementFilterList="1", IntermediatePoints="3", checked=False, Energy_Unit="J")  # -> flatten(StrainEnergyDensity_J_m³)
strainenergy_4 = BeamStrainEnergyDensity(Result=selres_4, ElementFilterList="All", checked=True, Energy_Unit="J")  # -> flatten(StrainEnergyDensity_J_m³)
series = Series(Start=0, Step=1, Count=addition)
contour1d = Contour1DResults(
    Result=selres_5,
    ElementMemberFilterList="1",
    IntermediatePoints="3",
    Scale=10,
    Display=0,
    Mode=2,
    energy="J",
    force="kN",
    legend=True,
    legendScale=1,
    length="mm",
    model="m",
    moment="kN·m",
    noDec=0,
    Result_Type="Strain Energy",
    Component="Intermediate Pts",
    slider=False,
    val=0,
    valMax=1000,
    valMin=0)  # -> L, Colours, LegendValues_J
line = Line(contourelem1d.Line)
divide = DivideCurve(Curve=getgeo._1DElementsIn_m, Count="4", Kinks=False)  # -> Points, Tangents, Parameters
end = EndPoints(Curve=line)  # -> Start, End

# ---- group: CombinationStrainEnergyDensity
num = Number(strainenergy)

# ---- group: CombinationAverageStrainEnergyDensity
num_2 = Number(strainenergy_2)

# ----
e1dresinfo = Elem1dContourInfo(Line=contourelem1d_2.Line)  # -> Line, V1, V2
e1dresinfo_2 = Elem1dContourInfo(Line=contourelem1d_3.Line)  # -> Line, V1, V2
e1dresinfo_3 = Elem1dContourInfo(Line=contour1d.L)  # -> Line, V1, V2
item = ListItem(List=end.Start, Index=0, Wrap=True)
end_2 = EndPoints(Curve=e1dresinfo_2.Line)  # -> Start, End
panel_2 = Panel(num)
panel_3 = Panel(num_2)
ins = InsertItems(List=end.End, Item=item, Indices="0", Wrap=True)
item_2 = ListItem(List=e1dresinfo.V1, Index=0, Wrap=True)
item_3 = ListItem(List=e1dresinfo_2.V1, Index=0, Wrap=True)
item_4 = TreeItem(Tree=beamforces.ForceXYZ_kN, Path=path, Index=series, Wrap=True)
item_5 = TreeItem(Tree=beamforces.ForceX_kN, Path=path, Index=series, Wrap=True)
item_6 = TreeItem(Tree=beamforces.MomentXX_kN_m, Path=path, Index=series, Wrap=True)
item_7 = TreeItem(Tree=beamforces.ForceY_kN, Path=path, Index=series, Wrap=True)
item_8 = TreeItem(Tree=beamforces.ForceZ_kN, Path=path, Index=series, Wrap=True)
item_9 = TreeItem(Tree=beamforces.MomentYY_kN_m, Path=path, Index=series, Wrap=True)
item_10 = TreeItem(Tree=beamforces.MomentZZ_kN_m, Path=path, Index=series, Wrap=True)
item_11 = TreeItem(Tree=beamforces.MomentYYZZ_kN_m, Path=path, Index=series, Wrap=True)
item_12 = ListItem(List=e1dresinfo_3.V1, Index=0, Wrap=True)
tag = TextTag(Location=end_2.Start, Text=e1dresinfo_2.V1)
dist = Distance(PointA=divide.Points, PointB=ins)

# ---- group: Scaled to deformed shape
num_3 = Number(beamdisp.TranslationsXYZ_mm)
multiplication = Multiplication(A=num_3, B="750")  # -> flatten(Result)

# ---- group: Fx
num_4 = Number(item_5)

# ---- group: Fy
num_5 = Number(item_7)

# ---- group: Fz
num_6 = Number(item_8)

# ---- group: Fyz
num_7 = Number(item_4)

# ---- group: Ux
num_8 = Number(beamdisp.TranslationsX_mm)

# ---- group: Uy
num_9 = Number(beamdisp.TranslationsY_mm)

# ---- group: Uz
num_10 = Number(beamdisp.TranslationsZ_mm)

# ---- group: U
num_11 = Number(beamdisp.TranslationsXYZ_mm)

# ---- group: Mxx
num_12 = Number(item_6)

# ---- group: Myy
num_13 = Number(item_9)

# ---- group: Mzz
num_14 = Number(item_10)

# ---- group: Rxx
num_15 = Number(beamdisp.RotationsXX_rad)

# ---- group: Myz
num_16 = Number(item_11)

# ---- group: Ryy
num_17 = Number(beamdisp.RotationsYY_rad)

# ---- group: Scaled to mm
multiplication_2 = Multiplication(A=dist, B="1000")

# ---- group: Rzz
num_18 = Number(beamdisp.RotationsZZ_rad)

# ---- group: R
num_19 = Number(beamdisp.RotationsXYZ_rad)

# ----
ins_2 = InsertItems(List=e1dresinfo.V2, Item=item_2, Indices="0", Wrap=True)
ins_3 = InsertItems(List=e1dresinfo_2.V2, Item=item_3, Indices="0", Wrap=True)
ins_4 = InsertItems(List=e1dresinfo_3.V2, Item=item_12, Indices="0", Wrap=True)

# ---- group: AvgStrainEnergyDensity
num_20 = Number(strainenergy_4)

# ---- group: StrainEnergyDensity
num_21 = Number(strainenergy_3)

# ----
panel_4 = Panel(num_4)
panel_5 = Panel(num_5)
panel_6 = Panel(num_6)
panel_7 = Panel(num_7)
panel_8 = Panel(num_8)
panel_9 = Panel(num_9)
panel_10 = Panel(num_10)
panel_11 = Panel(num_11)
panel_12 = Panel(num_12)
panel_13 = Panel(num_14)
panel_14 = Panel(num_15)
panel_15 = Panel(num_16)
panel_16 = Panel(num_17)
panel_17 = Panel(num_18)
panel_18 = Panel(num_19)
panel_19 = Panel(num_21)
panel_20 = Panel(num_20)

# ---- group: MyyContour
num_22 = Number(ins_3)

# ---- group: FxContour
num_23 = Number(ins_2)

# ---- group: ScaledResults
num_24 = Number(multiplication)

# ---- group: ScaledContours
num_25 = Number(multiplication_2)

# ---- group: StrainEnergyDensityContour
num_26 = Number(ins_4)

# ----
panel_21 = Panel(num_13)
panel_22 = Panel(num_24)
panel_23 = Panel(num_25)
panel_24 = Panel(num_23)
panel_25 = Panel(num_22)
panel_26 = Panel(num_26)
