# Grasshopper definition Elem2dFromBrep.gh (Grasshopper 1.0.7)
# Copyright: Arup
# plug-ins: GSA

md_slider = MDSlider(
    SliderMode=0,
    slider_value=Point(0.1134807308, 0.6408806778, 0.5),
    x_domain=Domain(0, 1),
    y_domain=Domain(0, 1),
    z_domain=Domain(0, 1))
md_slider_2 = MDSlider(
    SliderMode=0,
    slider_value=Point(0.7745370632, 0.8395590433, 0.5),
    x_domain=Domain(0, 1),
    y_domain=Domain(0, 1),
    z_domain=Domain(0, 1))
md_slider_3 = MDSlider(
    SliderMode=0,
    slider_value=Point(0.2146259401, 0.2362998404, 0.5),
    x_domain=Domain(0, 1),
    y_domain=Domain(0, 1),
    z_domain=Domain(0, 1))
number_slider = Slider(0.5, range=0..1)
brep = Brep(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)
evalsrf = EvaluateSurface(Surface=reparameterize(brep), Point=md_slider_3)  # -> Point, Normal, UDirection, VDirection, Frame
crvsrf = CurveOnSurface(Surface=reparameterize(brep), UVCoordinates=[md_slider_2, md_slider], Closed=False)  # -> Curve, Length, Domain
elem2dfrombrep = Element2dFromBrep(Brep=brep, MeshSize_m=number_slider, Unit="m")  # -> _2DElements, InclNodes, InclElement1Ds
pt = Point(evalsrf.Point)
mem1d = Create1DMember(
    Curve=crvsrf.Curve,
    x1=False,
    x2=False,
    xx1=False,
    xx2=False,
    y1=False,
    y2=False,
    yy1=False,
    yy2=False,
    z1=False,
    z2=False,
    zz1=False,
    zz2=False)
e2d = Element2D(elem2dfrombrep._2DElements)
no = Node(pt)
elem2dfrombrep_2 = Element2dFromBrep(Brep=brep, InclPointsOrNodes=no, InclCurvesOr1DMembers=mem1d, MeshSize_m=number_slider, Unit="m")  # -> _2DElements, InclNodes, InclElement1Ds
elem2dedit = Edit2DElement(Element2D=e2d)  # -> Element2D, Number, AnalysisMesh, _2DProperty, Group, ElementType, Offset, OrientationAngle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
e1d = Element1D(elem2dfrombrep_2.InclElement1Ds)
no_2 = Node(elem2dfrombrep_2.InclNodes)
tsort = SortText(Keys=elem2dedit.ElementType, Culture=127)  # -> Keys, Values
lng = ListLength(List=elem2dedit.ElementType)  # -> flatten(Length)
lng_2 = ListLength(List=no_2)
lng_3 = ListLength(List=e1d)
dcon = DeleteConsecutive(Set=tsort.Keys, Wrap=False)  # -> Set, Count
fsim = FindSimilarMember(Data=dcon.Set, Set=tsort.Keys)  # -> Hit, flatten(Index)

# ---- group: Inclusions
int = Integer([lng_2, lng_3])

# ---- group: Types
txt = Text(dcon.Set)

# ---- group: TriQuadCounts
int_2 = Integer([fsim.Index, lng])
