# Grasshopper definition Elem2dResults.gh (Grasshopper 1.0.7)
# Copyright: Arup
# plug-ins: GSA

panel = Panel("https://samples.oasys-software.com/gsa/10.1/RC_Slab/RC_Slab_Rough_Mesh.gwb")

# ---- group: Original model only calculates stresses at centre of elements, create new task that will calculate at all points
σa = CreateAnalysisCase(Name="Case1", Description="L1")
σt = CreateAnalysisTask(AnalysisCases=σa, Solver="Static")

# ----
c_script = CSharpScript(x=panel)  # -> A; inputs x: String
# ---------- c_script: C# usings ----------
using System.Linq;
# ---------- c_script: C# ----------
    string filePath = System.IO.Path.GetTempPath();
    string fileName = x.Split('/').Last();
    //create webclient and download example file:
    System.Net.WebClient webClient = new System.Net.WebClient();
    webClient.DownloadFile(
      x,
      filePath + fileName);

    A = filePath + fileName;
# ---------- end c_script ----------
createcombination = CreateCombinationCase(ID=0, Name="Comb case 3", Description="1.75A3")
open = OpenModel(FilenameAndPath=c_script)
analyse = AnalyseModel(ModelS=open, AnalysisTasksCombinations=σt, Analyse=True, ReMesh=True, Tolerance=0.05, Unit="m")  # -> Model, Report
analyse_2 = AnalyseModel(ModelS=open, AnalysisTasksCombinations=[σt, createcombination], Analyse=True, ReMesh=True, Tolerance=0.05, Unit="m")  # -> Model, Report
selres = SelectResults(GSAModel=open, Type="AnalysisCase", Case_ID="A1")

# ---- group: New case is appended to existing cases
selres_2 = SelectResults(GSAModel=analyse.Model, Type="AnalysisCase", Case_ID="A3")

# ----
getgeo = GetModelGeometry(GSAModel=open, NodeFilterList="All", ElementFilterList="All", MemberFilterList="All", Mode=1, Unit="m")  # -> NodesIn_m, _1DElementsIn_m, _2DElementsIn_m, _3DElementsIn_m, _1DMembersIn_m, _2DMembersIn_m, _3DMembersIn_m
contourelem2d = _2DContourResults(
    Result=selres,
    ElementFilterList="All",
    Display=3,
    Mode=0,
    flayer=0,
    force="kN/m",
    legend=True,
    legendScale=1,
    length="mm",
    model="m",
    moment="kN",
    noDec=0,
    Result_Type="Displacement",
    Component="Resolved |U|",
    slider=True,
    stress="MPa",
    val=750,
    valMax=1000,
    valMin=0)  # -> Mesh, Colours, Values_mm
demesh = DeconstructMesh(Mesh=getgeo._2DElementsIn_m)  # -> Vertices, Faces, Colours, Normals
meshresinfo = MeshResultInfo(Mesh=contourelem2d.Mesh)  # -> Mesh, Vertices, R
selres_3 = SelectResults(GSAModel=analyse_2.Model, Type="Combination", Case_ID="C2", Permutation="All")
item = ListItem(List=reverse(meshresinfo.Vertices), Index=0, Wrap=True)
item_2 = ListItem(List=reverse(demesh.Vertices), Index=0, Wrap=True)
item_3 = ListItem(List=reverse(meshresinfo.R), Index=0, Wrap=True)
num = Number(item_3)
dist = Distance(PointA=item_2, PointB=item)
contourelem2d_2 = _2DContourResults(
    Result=selres,
    ElementFilterList="All",
    Display=5,
    Mode=1,
    flayer=0,
    force="kN/m",
    legend=True,
    legendScale=1,
    length="mm",
    model="m",
    moment="kN",
    noDec=0,
    Result_Type="Force",
    Component="Moment My",
    slider=False,
    stress="MPa",
    val=0,
    valMax=1000,
    valMin=0)  # -> Mesh, Colours, LegendValues_kN_m_m
contourelem2d_3 = _2DContourResults(
    Result=selres_2,
    ElementFilterList="All",
    Display=5,
    Mode=1,
    flayer=0,
    force="kN/m",
    legend=True,
    legendScale=1,
    length="mm",
    model="m",
    moment="kN",
    noDec=0,
    Result_Type="Force",
    Component="Moment My",
    slider=False,
    stress="MPa",
    val=0,
    valMax=1000,
    valMin=0)  # -> Mesh, Colours, LegendValues_kN_m_m
contourelem2d_4 = _2DContourResults(
    Result=selres_2,
    ElementFilterList="6",
    Display=5,
    Mode=2,
    flayer=1,
    force="kN/m",
    legend=True,
    legendScale=1,
    length="mm",
    model="m",
    moment="kN",
    noDec=0,
    Result_Type="Stress",
    Component="Stress yz",
    Layer="Top",
    slider=False,
    stress="kPa",
    val=0,
    valMax=1000,
    valMin=0)  # -> Mesh, Colours, LegendValues_kPa
multiplication = Multiplication(A=dist, B="1000")  # -> flatten(Result)
multiplication_2 = Multiplication(A=num, B="750")  # -> flatten(Result)
meshresinfo_2 = MeshResultInfo(Mesh=contourelem2d_2.Mesh)  # -> Mesh, Vertices, R
meshresinfo_3 = MeshResultInfo(Mesh=contourelem2d_3.Mesh)  # -> Mesh, Vertices, R
meshresinfo_4 = MeshResultInfo(Mesh=contourelem2d_4.Mesh)  # -> Mesh, Vertices, R

# ---- group: DeformedValue
num_2 = Number(multiplication)

# ---- group: ContourValueScaled
num_3 = Number(multiplication_2)

# ----
forces2d = _2DForcesAndMoments(Result=selres_2, ElementFilterList="6", Force_Unit="kN/m", Moment_Unit="kN")  # -> ForceX_kN_m, ForceY_kN_m, ForceZ_kN_m, ShearX_kN_m, ShearY_kN_m, MomentX_kN, MomentY_kN, MomentXY_kN, WoodArmerX_kN, WoodArmerY_kN
cp = ClosestPoint(Point=meshresinfo_2.Vertices, Cloud=meshresinfo_3.Vertices)  # -> ClosestPoint, CPIndex, Distance
# Rotation results not visible in GSA
disp2d = _2DDisplacements(Result=selres, ElementFilterList="26", Unit="mm")  # -> TranslationsX_mm, TranslationsY_mm, TranslationsZ_mm, TranslationsXYZ_mm, RotationsXX_rad, RotationsYY_rad, RotationsZZ_rad, RotationsXYZ_rad
item_4 = ListItem(List=reverse(disp2d.TranslationsXYZ_mm), Index=0, Wrap=True)
num_4 = Number(item_4)
multiplication_3 = Multiplication(A=num_4, B="750")  # -> flatten(Result)

# ---- group: ResultScaled
num_5 = Number(multiplication_3)

# ----
panel_2 = Panel([num_2, num_3, num_5])
tag = TextTag(Location=meshresinfo_2.Vertices, Text=meshresinfo_2.R)

# ---- group: MyContours
num_6 = Number(meshresinfo_2.R)

# ----
forces2d_2 = _2DForcesAndMoments(Result=selres_3, ElementFilterList="2", Force_Unit="kN/m", Moment_Unit="kN")  # -> ForceX_kN_m, ForceY_kN_m, ForceZ_kN_m, ShearX_kN_m, ShearY_kN_m, MomentX_kN, MomentY_kN, MomentXY_kN, WoodArmerX_kN, WoodArmerY_kN
stress2d = _2DStresses(Result=selres_2, ElementFilterList="6", StressLayer="-1", Unit="kPa")  # -> StressXX_kPa, StressYY_kPa, StressZZ_kPa, StressXY_kPa, StressYZ_kPa, StressZX_kPa

# ---- group: yzTopContour
num_7 = Number(meshresinfo_4.R)

# ----
tag_2 = TextTag(Location=meshresinfo_4.Vertices, Text=meshresinfo_4.R)
stress2d_2 = _2DStresses(Result=selres_3, ElementFilterList="6", StressLayer="-1", Unit="MPa")  # -> StressXX_MPa, StressYY_MPa, StressZZ_MPa, StressXY_MPa, StressYZ_MPa, StressZX_MPa
panel_3 = Panel(num_7)
item_5 = ListItem(List=meshresinfo_3.R, Index=cp.CPIndex, Wrap=True)
panel_4 = Panel(num_6)

# ---- group: MyContoursCentrePointValues
num_8 = Number(item_5)

# ---- group: Ux
num_9 = Number(disp2d.TranslationsX_mm)

# ---- group: Nx
num_10 = Number(forces2d.ForceX_kN_m)

# ---- group: Uy
num_11 = Number(disp2d.TranslationsY_mm)

# ---- group: Uz
num_12 = Number(disp2d.TranslationsZ_mm)

# ---- group: Ny
num_13 = Number(forces2d.ForceY_kN_m)

# ---- group: U
num_14 = Number(disp2d.TranslationsXYZ_mm)

# ---- group: Nxy
num_15 = Number(forces2d.ForceZ_kN_m)

# ---- group: Qx
num_16 = Number(forces2d.ShearX_kN_m)

# ---- group: Qy
num_17 = Number(forces2d.ShearY_kN_m)

# ---- group: Mx
num_18 = Number(forces2d.MomentX_kN)

# ---- group: My
num_19 = Number(forces2d.MomentY_kN)

# ---- group: Mxy
num_20 = Number(forces2d.MomentXY_kN)

# ---- group: xx
num_21 = Number(stress2d.StressXX_kPa)

# ---- group: yy
num_22 = Number(stress2d.StressYY_kPa)

# ---- group: zz
num_23 = Number(stress2d.StressZZ_kPa)

# ---- group: xy
num_24 = Number(stress2d.StressXY_kPa)

# ---- group: yz
num_25 = Number(stress2d.StressYZ_kPa)

# ---- group: zx
num_26 = Number(stress2d.StressZX_kPa)

# ---- group: NxComb
num_27 = Number(forces2d_2.ForceX_kN_m)

# ---- group: NyComb
num_28 = Number(forces2d_2.ForceY_kN_m)

# ---- group: NxyComb
num_29 = Number(forces2d_2.ForceZ_kN_m)

# ---- group: QxComb
num_30 = Number(forces2d_2.ShearX_kN_m)

# ---- group: M*xComb
num_31 = Number(forces2d_2.WoodArmerX_kN)

# ---- group: QyComb
num_32 = Number(forces2d_2.ShearY_kN_m)

# ---- group: MxComb
num_33 = Number(forces2d_2.MomentX_kN)

# ---- group: M*yComb
num_34 = Number(forces2d_2.WoodArmerY_kN)

# ---- group: MyComb
num_35 = Number(forces2d_2.MomentY_kN)

# ---- group: MxyComb
num_36 = Number(forces2d_2.MomentXY_kN)

# ---- group: Cxx
num_37 = Number(stress2d_2.StressXX_MPa)

# ---- group: Cyy
num_38 = Number(stress2d_2.StressYY_MPa)

# ---- group: Czz
num_39 = Number(stress2d_2.StressZZ_MPa)

# ---- group: Cxy
num_40 = Number(stress2d_2.StressXY_MPa)

# ---- group: Cyz
num_41 = Number(stress2d_2.StressYZ_MPa)

# ---- group: Czx
num_42 = Number(stress2d_2.StressZX_MPa)

# ----
panel_5 = Panel(num_9)
panel_6 = Panel(num_10)
panel_7 = Panel(num_11)
panel_8 = Panel(num_13)
panel_9 = Panel(num_12)
panel_10 = Panel(num_14)
panel_11 = Panel(num_15)
panel_12 = Panel(num_16)
panel_13 = Panel(num_17)
panel_14 = Panel(num_18)
panel_15 = Panel(num_19)
panel_16 = Panel(num_21)
panel_17 = Panel(num_22)
panel_18 = Panel(num_23)
panel_19 = Panel(num_24)
panel_20 = Panel(num_25)
panel_21 = Panel(num_26)
panel_22 = Panel(num_20)
panel_23 = Panel(num_27)
panel_24 = Panel(num_28)
panel_25 = Panel(num_29)
panel_26 = Panel(num_30)
panel_27 = Panel(num_31)
panel_28 = Panel(num_37)
panel_29 = Panel(num_39)
panel_30 = Panel(num_40)
panel_31 = Panel(num_41)
panel_32 = Panel(num_32)
panel_33 = Panel(num_34)
panel_34 = Panel(num_38)
panel_35 = Panel(num_42)
panel_36 = Panel(num_33)
panel_37 = Panel(num_35)
panel_38 = Panel(num_36)
