# Grasshopper definition FootfallResults.gh (Grasshopper 1.0.7)
# Copyright: Arup
# plug-ins: GSA

panel = Panel("https://samples.oasys-software.com/gsa/10.1/Footfall/Footfall_Steel.gwb")
c_script = CSharpScript(x=panel)  # -> A; inputs x: String
# ---------- c_script: C# usings ----------
using System.Linq;
# ---------- c_script: C# ----------
    string filePath = System.IO.Path.GetTempPath();
    string fileName = x.Split('/').Last();
    //create webclient and download example file:
    System.Net.WebClient webClient = new System.Net.WebClient();
    webClient.DownloadFile(
      x,
      filePath + fileName);

    A = filePath + fileName;
# ---------- end c_script ----------
open = OpenModel(FilenameAndPath=c_script)
analyse = AnalyseModel(ModelSAndLists=open, Analyse=True, ReMesh=False, Tolerance=0.01, Unit="m")  # -> Model, Errors, Warnings, Remarks, Logs
selres = SelectResults(GSAModel=analyse.Model, Type="AnalysisCase", Case_ID="A16")
selres_2 = SelectResults(GSAModel=analyse.Model, Type="AnalysisCase", Case_ID="A17")
contourelem2d = _2DContourResults(
    Result=selres,
    Display=0,
    Mode=3,
    envelope="Absolute",
    flayer=0,
    force="kN/m",
    legend=True,
    legendHeight=110,
    legendScale=1,
    legendWidth=120,
    length="mm",
    model="m",
    moment="kN",
    noDec=0,
    Result_Type="Footfall",
    Component="Resonant",
    slider=False,
    stress="MPa",
    val=0,
    valMax=1000,
    valMin=0)  # -> M, Colours, LegendValues_
footfall = FootfallResult(Result=selres_2)  # -> ResonantResponseFactor, TransientResponseFactor
contournode = NodeContourResults(
    Result=selres_2,
    Scalar=10,
    Display=0,
    Mode=2,
    envelope="Absolute",
    force="kN",
    legend=True,
    legendHeight=110,
    legendScale=1,
    legendWidth=120,
    length="mm",
    moment="kN·m",
    noDec=0,
    Result_Type="Footfall",
    Component="Resonant",
    slider=False,
    val=0,
    valMax=1000,
    valMin=0)  # -> P, Colours, Values_
contourelem1d = _1DContourResults(
    Result=selres,
    IntermediatePoints=10,
    Scale=10,
    Display=0,
    Mode=3,
    energy="MJ",
    envelope="Absolute",
    force="kN",
    legend=False,
    legendHeight=110,
    legendScale=1,
    legendWidth=120,
    length="mm",
    moment="kN·m",
    noDec=0,
    Result_Type="Footfall",
    Component="Resonant",
    slider=False,
    stress="MPa",
    val=0,
    valMax=1000,
    valMin=0)  # -> L, Colours, LegendValues_
sort = SortList(Keys=contourelem2d.LegendValues_)  # -> Keys, ValuesA
sort_2 = SortList(Keys=contourelem1d.LegendValues_)  # -> Keys, ValuesA
sort_3 = SortList(Keys=contournode.Values_)  # -> Keys, ValuesA
move = Move(Geometry=contournode.P, Motion=Vector(0, 0, 10))  # -> Geometry, Transform
mesh = Mesh(contourelem2d.M)

# ---- group: Transient
num = Number(footfall.TransientResponseFactor)

# ---- group: Resonant
num_2 = Number(footfall.ResonantResponseFactor)

# ----
item = ListItem(List=reverse(sort.Keys), Index=0, Wrap=True)  # -> Item1, Item
item_2 = ListItem(List=reverse(sort_2.Keys), Index=0, Wrap=True)  # -> Item1, Item
item_3 = ListItem(List=reverse(sort_3.Keys), Index=0, Wrap=True)  # -> Item1, Item

# ---- group: MaxLegend1d
num_3 = Number(item_2.Item)

# ---- group: MaxLegend2d
num_4 = Number(item.Item)

# ---- group: MaxLegendNode
num_5 = Number(item_3.Item)
