# Grasshopper definition GetExistingMaterialInNewModel.gh (Grasshopper 1.0.7)
# plug-ins: GSA

panel = Panel("https://samples.oasys-software.com/gsa/10.1/Footfall/Footfall_Steel.gwb")
panel_2 = Panel("https://samples.oasys-software.com/gsa/10.1/Footfall/Footfall_Concrete.gwb")
c_script = CSharpScript(x=panel)  # -> A; inputs x: String
# ---------- c_script: C# ----------
    string fileName = System.IO.Path.GetTempPath();

    //create webclient and download example file:
    System.Net.WebClient webClient = new System.Net.WebClient();
    webClient.DownloadFile(
      x,
      fileName + "Steel_Design_Simple.gwb");

    A = fileName + "Steel_Design_Simple.gwb";
# ---------- end c_script ----------
c_script_2 = CSharpScript(x=panel_2)  # -> A; inputs x: String; same code as c_script
open = OpenModel(FilenameAndPath=c_script, File="C:\Users\kristjan.nielsen\AppData\Local\Temp\Steel_Design_Simple.gwb")
open_2 = OpenModel(FilenameAndPath=c_script_2, File="C:\Users\kristjan.nielsen\AppData\Local\Temp\Steel_Design_Simple.gwb")
profile = CreateProfile(
    NumberOfInputs=0,
    catalogueIndex=3,
    inclSS=False,
    lengthUnit="Centimeter",
    mode="Catalogue",
    Profile_type="Catalogue",
    Catalogue="Europrofile",
    Type="EP HE beams",
    Profile="HE HE180.B",
    typeIndex=27)
getmats = GetModelMaterials(GSAModel=open)  # -> Steel, Concrete, PMat, Aluminium, Timber, Glass, Fabric, Custom
profile_2 = CreateProfile(
    Depth_cm="40",
    Width_cm="40",
    NumberOfInputs=2,
    catalogueIndex=3,
    inclSS=False,
    lengthUnit="Centimeter",
    mode="Other",
    Profile_type="Rectangle",
    Measure="Centimeter",
    Type="EP HE beams",
    Profile="HE HE180.B",
    typeIndex=27)
getmats_2 = GetModelMaterials(GSAModel=open_2)  # -> Steel, Concrete, PMat, Aluminium, Timber, Glass, Fabric, Custom
section = CreateSection(Profile=profile, Material=getmats.Steel, Basic_Offset="Centroid")
section_2 = CreateSection(Profile=profile_2, Material=getmats_2.Concrete, Basic_Offset="Centroid")
model = CreateModel(Properties=section, ReMesh=True, Tolerance=0.01, Unit="m")
model_2 = CreateModel(Properties=section_2, ReMesh=True, Tolerance=0.01, Unit="m")
getmats_3 = GetModelMaterials(GSAModel=model)  # -> Steel, Concrete, PMat, Aluminium, Timber, Glass, Fabric, Custom
getmats_4 = GetModelMaterials(GSAModel=model_2)  # -> Steel, Concrete, PMat, Aluminium, Timber, Glass, Fabric, Custom
matprop = MaterialProperties(Material=getmats_3.Steel, DensityUnit="KilogramPerCubicMeter", StressUnit="Megapascal", TemperatureUnit="DegreeCelsius")  # -> ElasticModulus_MPa, PoissonsRatio, Density_kg_m³, ThermalExpansion_C_¹
matprop_2 = MaterialProperties(Material=getmats.Steel, DensityUnit="KilogramPerCubicMeter", StressUnit="Megapascal", TemperatureUnit="DegreeCelsius")  # -> ElasticModulus_MPa, PoissonsRatio, Density_kg_m³, ThermalExpansion_C_¹
matprop_3 = MaterialProperties(
    Material=getmats_4.Concrete,
    DensityUnit="KilogramPerCubicMeter",
    StressUnit="Megapascal",
    TemperatureUnit="DegreeCelsius")  # -> ElasticModulus_MPa, PoissonsRatio, Density_kg_m³, ThermalExpansion_C_¹
matprop_4 = MaterialProperties(
    Material=getmats_2.Concrete,
    DensityUnit="KilogramPerCubicMeter",
    StressUnit="Megapascal",
    TemperatureUnit="DegreeCelsius")  # -> ElasticModulus_MPa, PoissonsRatio, Density_kg_m³, ThermalExpansion_C_¹
num = Number(matprop.ElasticModulus_MPa)
num_2 = Number(matprop_2.ElasticModulus_MPa)
num_3 = Number(matprop.Density_kg_m³)
num_4 = Number(matprop.PoissonsRatio)
num_5 = Number(matprop_2.Density_kg_m³)
num_6 = Number(matprop_2.PoissonsRatio)
num_7 = Number(matprop.ThermalExpansion_C_¹)
num_8 = Number(matprop_2.ThermalExpansion_C_¹)
num_9 = Number(matprop_3.ElasticModulus_MPa)
num_10 = Number(matprop_4.ElasticModulus_MPa)
num_11 = Number(matprop_3.Density_kg_m³)
num_12 = Number(matprop_3.PoissonsRatio)
num_13 = Number(matprop_4.Density_kg_m³)
num_14 = Number(matprop_4.PoissonsRatio)
num_15 = Number(matprop_3.ThermalExpansion_C_¹)
num_16 = Number(matprop_4.ThermalExpansion_C_¹)
equals = Equality(FirstNumber=num, SecondNumber=num_2)  # -> Equality, Inequality
equals_2 = Equality(FirstNumber=num_3, SecondNumber=num_5)  # -> Equality, Inequality
equals_3 = Equality(FirstNumber=num_4, SecondNumber=num_6)  # -> Equality, Inequality
equals_4 = Equality(FirstNumber=num_7, SecondNumber=num_8)  # -> Equality, Inequality
equals_5 = Equality(FirstNumber=num_9, SecondNumber=num_10)  # -> Equality, Inequality
equals_6 = Equality(FirstNumber=num_11, SecondNumber=num_13)  # -> Equality, Inequality
equals_7 = Equality(FirstNumber=num_12, SecondNumber=num_14)  # -> Equality, Inequality
equals_8 = Equality(FirstNumber=num_15, SecondNumber=num_16)  # -> Equality, Inequality
ma = MassAddition(Input=[equals.Inequality, equals_3.Inequality, equals_2.Inequality, equals_4.Inequality, equals_5.Inequality, equals_7.Inequality, equals_6.Inequality, equals_8.Inequality])  # -> Result, PartialResults

# ---- group: MaterialIsEqual
int = Integer(ma.Result)
