# Grasshopper definition GetGeometryToUnit.gh (Grasshopper 1.0.7)
# plug-ins: GSA

panel = Panel("https://samples.oasys-software.com/gsa/10.2/Steel/Steel_Design_Simple.gwb")
c_script = CSharpScript(x=panel)  # -> A; inputs x: String
# ---------- c_script: C# ----------
    string fileName = System.IO.Path.GetTempPath();

    //create webclient and download example file:
    System.Net.WebClient webClient = new System.Net.WebClient();
    webClient.DownloadFile(
      x,
      fileName + "Steel_Design_Simple.gwb");

    A = fileName + "Steel_Design_Simple.gwb";
# ---------- end c_script ----------
open = OpenModel(FilenameAndPath=c_script)
getgeo = GetModelGeometry(GSAModel=open, Mode=1, Unit="mm")  # -> NodesIn_mm, _1DElementsIn_mm, _2DElementsIn_mm, _3DElementsIn_mm, _1DMembersIn_mm, _2DMembersIn_mm, _3DMembersIn_mm
getgeo_2 = GetModelGeometry(GSAModel=open, Mode=1, Unit="cm")  # -> NodesIn_cm, _1DElementsIn_cm, _2DElementsIn_cm, _3DElementsIn_cm, _1DMembersIn_cm, _2DMembersIn_cm, _3DMembersIn_cm
getgeo_3 = GetModelGeometry(GSAModel=open, Mode=1, Unit="ft")  # -> NodesIn_ft, _1DElementsIn_ft, _2DElementsIn_ft, _3DElementsIn_ft, _1DMembersIn_ft, _2DMembersIn_ft, _3DMembersIn_ft
getgeo_4 = GetModelGeometry(GSAModel=open, Mode=1, Unit="m")  # -> NodesIn_m, _1DElementsIn_m, _2DElementsIn_m, _3DElementsIn_m, _1DMembersIn_m, _2DMembersIn_m, _3DMembersIn_m
getgeo_5 = GetModelGeometry(GSAModel=open, Mode=1, Unit="in")  # -> NodesIn_in, _1DElementsIn_in, _2DElementsIn_in, _3DElementsIn_in, _1DMembersIn_in, _2DMembersIn_in, _3DMembersIn_in
len = Length(Curve=getgeo._1DElementsIn_mm)
len_2 = Length(Curve=getgeo._1DMembersIn_mm)
len_3 = Length(Curve=getgeo_2._1DMembersIn_cm)
len_4 = Length(Curve=getgeo_2._1DElementsIn_cm)
len_5 = Length(Curve=getgeo_3._1DElementsIn_ft)
len_6 = Length(Curve=getgeo_3._1DMembersIn_ft)
len_7 = Length(Curve=getgeo_5._1DElementsIn_in)
len_8 = Length(Curve=getgeo_5._1DMembersIn_in)
len_9 = Length(Curve=getgeo_4._1DElementsIn_m)
len_10 = Length(Curve=getgeo_4._1DMembersIn_m)
equals = Equality(FirstNumber=len_5, SecondNumber=len_6)  # -> Equality, Inequality
equals_2 = Equality(FirstNumber=len_7, SecondNumber=len_8)  # -> Equality, Inequality
equals_3 = Equality(FirstNumber=len_9, SecondNumber=len_10)  # -> Equality, Inequality
equals_4 = Equality(FirstNumber=len_4, SecondNumber=len_3)  # -> Equality, Inequality
equals_5 = Equality(FirstNumber=len, SecondNumber=len_2)  # -> Equality, Inequality
not = GateNot(A=[equals.Equality, equals_2.Equality, equals_3.Equality, equals_4.Equality, equals_5.Equality])
expected = Panel("24.6063")
ma = MassAddition(Input=not)  # -> Result, PartialResults
expected_2 = Panel("750")
expected_3 = Panel("7500")
num = Number(len_5)
num_2 = Number(len_4)
num_3 = Number(len)
expected_4 = Panel("7.5")
expected_5 = Panel("295.276")
num_4 = Number(len_9)
num_5 = Number(len_7)
similar = Similarity(FirstNumber=num, SecondNumber=expected, Threshold=0.1)  # -> Similarity, AbsoluteDifference

# ---- group: ElemMemLengthEqual
int = Integer(ma.Result)

# ----
similar_2 = Similarity(FirstNumber=num_2, SecondNumber=expected_2, Threshold=0.1)  # -> Similarity, AbsoluteDifference
similar_3 = Similarity(FirstNumber=num_3, SecondNumber=expected_3, Threshold=0.1)  # -> Similarity, AbsoluteDifference
similar_4 = Similarity(FirstNumber=num_4, SecondNumber=expected_4, Threshold=0.1)  # -> Similarity, AbsoluteDifference
similar_5 = Similarity(FirstNumber=num_5, SecondNumber=expected_5, Threshold=0.1)  # -> Similarity, AbsoluteDifference
not_2 = GateNot(A=[similar_3.Similarity, similar_2.Similarity, similar_4.Similarity, similar_5.Similarity, similar.Similarity])
ma_2 = MassAddition(Input=not_2)  # -> Result, PartialResults

# ---- group: LengthAsExpected
int_2 = Integer(ma_2.Result)
