# Grasshopper definition GetResultsAndResultsInfo.gh (Grasshopper 1.0.7)
# plug-ins: GSA

panel = Panel("https://samples.oasys-software.com/gsa/10.1/Steel/Steel_Design_Simple.gwb")
c_script = CSharpScript(x=panel)  # -> A; inputs x: String
# ---------- c_script: C# ----------
    string fileName = System.IO.Path.GetTempPath();

    //create webclient and download example file:
    System.Net.WebClient webClient = new System.Net.WebClient();
    webClient.DownloadFile(
      x,
      fileName + "Steel_Design_Simple.gwb");

    A = fileName + "Steel_Design_Simple.gwb";
# ---------- end c_script ----------
open = OpenModel(FilenameAndPath=c_script)
getgeo = GetModelGeometry(GSAModel=open, Mode=1, Unit="m")  # -> NodesIn_m, _1DElementsIn_m, _2DElementsIn_m, _3DElementsIn_m, _1DMembersIn_m, _2DMembersIn_m, _3DMembersIn_m
getcases = GetResultCases(GSAModel=open)  # -> T, Case, Permutation
getres = GetResults(GSAModel=open, T="C", Case="1")
beamforces = BeamForcesAndMoments(
    Result=getres,
    ElementFilterList=getgeo._1DElementsIn_m,
    IntermediatePoints=3,
    Max_Min="All",
    Force_Unit="kN",
    Moment_Unit="N·m")  # -> ForceX_kN, ForceY_kN, ForceZ_kN, ForceXYZ_kN, MomentXX_N_m, MomentYY_N_m, MomentZZ_N_m, MomentYYZZ_N_m
mem1dforces = Member1DForcesAndMoments(
    Result=getres,
    MemberFilterList=getgeo._1DMembersIn_m,
    IntermediatePoints=3,
    Max_Min="All",
    Force_Unit="kN",
    Moment_Unit="N·m")  # -> ForceX_kN, ForceY_kN, ForceZ_kN, ForceXYZ_kN, MomentXX_N_m, MomentYY_N_m, MomentZZ_N_m, MomentYYZZ_N_m
item = TreeItem(Tree=getcases.Permutation, Path="1", Index="0", Wrap=True)

# ---- group: CaseIDs
int = Integer(getcases.Case)

# ---- group: Types
txt = Text(getcases.T)

# ---- group: Permutations
int_2 = Integer(item)

# ---- group: Myy1
num = Number(beamforces.MomentYY_N_m)

# ---- group: Myy2
num_2 = Number(mem1dforces.MomentYY_N_m)

# ----
panel_2 = Panel(num_2)
panel_3 = Panel(int)
panel_4 = Panel(txt)
panel_5 = Panel(int_2)
panel_6 = Panel(num)
