# Grasshopper definition GlobalPerformance_Buckling.gh (Grasshopper 1.0.7)
# Copyright: Arup
# plug-ins: GSA

panel = Panel("https://samples.oasys-software.com/gsa/10.1/Buckling/Archd.gwb")
c_script = CSharpScript(x=panel)  # -> A; inputs x: String
# ---------- c_script: C# usings ----------
using System.Linq;
# ---------- c_script: C# ----------
    string filePath = System.IO.Path.GetTempPath();
    string fileName = x.Split('/').Last();
    //create webclient and download example file:
    System.Net.WebClient webClient = new System.Net.WebClient();
    webClient.DownloadFile(
      x,
      filePath + fileName);

    A = filePath + fileName;
# ---------- end c_script ----------
open = OpenModel(FilenameAndPath=c_script)
panel_2 = Panel("""1
2
3""")
selres = SelectResults(GSAModel=open, Case=panel_2, Type="AnalysisCase", Case_ID="A3")
globalperformance = GlobalPerformanceResults(Result=selres, Mass_Unit="t", Inertia_Unit="m⁴", Stiffness_Unit="kN/m")  # -> EffectiveMassX_t, EffectiveMassY_t, EffectiveMassZ_t, EffectiveMassXYZ_t, EffectiveInertiaX_m⁴, EffectiveInertiaY_m⁴, EffectiveInertiaZ_m⁴, EffectiveInertiaXYZ_m⁴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
globalperformance_2 = GlobalPerformanceResults(Result=selres, Mass_Unit="t", Inertia_Unit="m⁴", Stiffness_Unit="kN/m")  # -> EffectiveMassX_t, EffectiveMassY_t, EffectiveMassZ_t, EffectiveInertiaX_m⁴, EffectiveInertiaY_m⁴, EffectiveInertiaZ_m⁴, Mode, ModalMass_t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
int = Integer(globalperformance_2.Mode)
num = Number(globalperformance_2.LoadFactor)
int_2 = Integer(globalperformance.Mode)
num_2 = Number(globalperformance.LoadFactor)
equals = Equality(FirstNumber=num_2, SecondNumber=num)  # -> Equality, Inequality
equals_2 = Equality(FirstNumber=int_2, SecondNumber=int)  # -> Equality, Inequality
p_n_c = PickNChoose(Pattern=equals_2.Equality, Stream1=int)
p_n_c_2 = PickNChoose(Pattern=equals.Equality, Stream1=num)

# ---- group: Modes
int_3 = Integer(p_n_c)

# ---- group: LoadFactors
num_3 = Number(p_n_c_2)

# ----
panel_3 = Panel(int_3)
panel_4 = Panel(num_3)
