# Grasshopper definition GlobalPerformance_Modal.gh (Grasshopper 1.0.7)
# Copyright: Arup
# plug-ins: GSA

panel = Panel("https://samples.oasys-software.com/gsa/10.1/Dynamic/Harmonic_2D_Model.gwb")
c_script = CSharpScript(x=panel)  # -> A; inputs x: String
# ---------- c_script: C# usings ----------
using System.Linq;
# ---------- c_script: C# ----------
    string filePath = System.IO.Path.GetTempPath();
    string fileName = x.Split('/').Last();
    //create webclient and download example file:
    System.Net.WebClient webClient = new System.Net.WebClient();
    webClient.DownloadFile(
      x,
      filePath + fileName);

    A = filePath + fileName;
# ---------- end c_script ----------
open = OpenModel(FilenameAndPath=c_script)
analyse = AnalyseModel(ModelS=open, Analyse=True, ReMesh=False, Tolerance=0.05, Unit="m")  # -> Model, Report
panel_2 = Panel("""1
2
4
5""")
selres = SelectResults(GSAModel=analyse.Model, Case=panel_2, Type="AnalysisCase", Case_ID="A5")
globalperformance = GlobalPerformanceResults(Result=selres, Mass_Unit="t", Inertia_Unit="m⁴", Stiffness_Unit="kN/m")  # -> EffectiveMassX_t, EffectiveMassY_t, EffectiveMassZ_t, EffectiveMassXYZ_t, EffectiveInertiaX_m⁴, EffectiveInertiaY_m⁴, EffectiveInertiaZ_m⁴, EffectiveInertiaXYZ_m⁴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
globalperformance_2 = GlobalPerformanceResults(Result=selres, Mass_Unit="t", Inertia_Unit="m⁴", Stiffness_Unit="kN/m")  # -> EffectiveMassX_t, EffectiveMassY_t, EffectiveMassZ_t, EffectiveInertiaX_m⁴, EffectiveInertiaY_m⁴, EffectiveInertiaZ_m⁴, Mode, ModalMass_t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
equals = Equality(FirstNumber=globalperformance.EffectiveMassZ_t, SecondNumber=globalperformance_2.EffectiveMassZ_t)  # -> Equality, Inequality
equals_2 = Equality(FirstNumber=globalperformance.ModalStiffness_kN_m, SecondNumber=globalperformance_2.ModalStiffness_kN_m)  # -> Equality, Inequality
equals_3 = Equality(FirstNumber=globalperformance.Frequency_Hz, SecondNumber=globalperformance_2.Frequency_Hz)  # -> Equality, Inequality
equals_4 = Equality(FirstNumber=globalperformance.ModalMass_t, SecondNumber=globalperformance_2.ModalMass_t)  # -> Equality, Inequality
equals_5 = Equality(FirstNumber=globalperformance.Mode, SecondNumber=globalperformance_2.Mode)  # -> Equality, Inequality
p_n_c = PickNChoose(Pattern=equals.Equality, Stream1=globalperformance_2.EffectiveMassZ_t)
p_n_c_2 = PickNChoose(Pattern=equals_2.Equality, Stream1=globalperformance_2.ModalStiffness_kN_m)
p_n_c_3 = PickNChoose(Pattern=equals_3.Equality, Stream1=globalperformance_2.Frequency_Hz)
p_n_c_4 = PickNChoose(Pattern=equals_4.Equality, Stream1=globalperformance_2.ModalMass_t)
p_n_c_5 = PickNChoose(Pattern=equals_5.Equality, Stream1=globalperformance_2.Mode)

# ---- group: Frequencies
num = Number(p_n_c_3)

# ---- group: EffectiveMassesZ
num_2 = Number(p_n_c)

# ---- group: Modes
int = Integer(p_n_c_5)

# ---- group: ModalMasses
num_3 = Number(p_n_c_4)

# ---- group: ModalStiffnesses
num_4 = Number(p_n_c_2)

# ----
panel_3 = Panel(num_2)
panel_4 = Panel(int)
panel_5 = Panel(num_3)
panel_6 = Panel(num_4)
panel_7 = Panel(num)
