# Grasshopper definition GridLoadPolyline.gh (Grasshopper 1.0.7)
# Copyright: Arup
# plug-ins: GSA

pt = ConstructPoint(XCoordinate="1", YCoordinate="1", ZCoordinate=0)
pt_2 = ConstructPoint(XCoordinate="2", YCoordinate="1", ZCoordinate=0)
pt_3 = ConstructPoint(XCoordinate="2", YCoordinate="3", ZCoordinate=0)
pt_4 = ConstructPoint(XCoordinate="3", YCoordinate="4", ZCoordinate=0)
pt_5 = ConstructPoint(XCoordinate="1", YCoordinate="2", ZCoordinate="-0.25")
pt_6 = ConstructPoint(XCoordinate="2", YCoordinate="1", ZCoordinate="-0.25")
pt_7 = ConstructPoint(XCoordinate="7", YCoordinate="1", ZCoordinate="-2.5")
pt_8 = ConstructPoint(XCoordinate="1", YCoordinate="7", ZCoordinate="-2.5")
pline = PolyLine(Vertices=[pt, pt_2, pt_3, pt_4], Closed=False)
srf4pt = _4PointSurface(CornerA=pt_5, CornerB=pt_6, CornerC=pt_7, CornerD=pt_8)
xy = XYPlane(Origin=Point(0, 0, 0))
yz = YZPlane(Origin=Point(0, 0, 0))
xz = XZPlane(Origin=Point(0, 0, 0))
lineload = CreateGridLineLoad(
    LoadCase=1,
    PolyLine=pline,
    Direction="z",
    Axis=0,
    Projected=False,
    ValueStart_kN_m="-5",
    ExpansionChanged=False,
    Mode=1,
    Unit="kN/m")
crv = Curve(pline)
mirror = Mirror(Geometry=srf4pt, Plane=xy)  # -> Geometry, Transform
model = CreateModel(Load=lineload, ReMesh=True, Tolerance=0.01, Unit="m")
mirror_2 = Mirror(Geometry=[srf4pt, mirror.Geometry], Plane=yz)  # -> Geometry, Transform
getloads = GetModelLoads(GSAModel=model, Unit="m")  # -> LC, Gr, No, Be, Fa, Pt, Ln, Ar, GPS
mirror_3 = Mirror(Geometry=[srf4pt, mirror.Geometry, mirror_2.Geometry], Plane=xz)  # -> Geometry, Transform
loadprop = LoadProperties(Load=getloads.Ln, Force_Unit="kN", Length_Unit="m")  # -> LoadCase, Name, Definition, Axis, Direction, Projected, LoadValueOrFactorX_forceUnitAbbreviation_kN_forcePerLengthUnit_kN_m_forcePerAreaUnit_kN_m², LoadValueOrFactorY_forceUnitAbbreviation_kN_forcePerLengthUnit_kN_m_forcePerAreaUnit_kN_m²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
brep = Brep(graft([srf4pt, mirror.Geometry, mirror_2.Geometry, mirror_3.Geometry]))
crv_2 = Curve(loadprop.Definition)
crv_3 = Curve(brep)
cp = ControlPoints(Curve=crv)  # -> Points, Weights, Knots
cp_2 = ControlPoints(Curve=crv_2)  # -> Points, Weights, Knots
areaload = CreateGridAreaLoad(
    LoadCase=1,
    Brep=brep,
    Direction="z",
    Axis=0,
    Projected=False,
    Value_kN_m²="-15",
    ExpansionChanged=False,
    Mode=1,
    Unit="kN/m²")
brep_2 = Brep(brep)
pdecon = Deconstruct(Point=cp.Points)  # -> XComponent, YComponent, ZComponent
pdecon_2 = Deconstruct(Point=cp_2.Points)  # -> XComponent, YComponent, ZComponent
cpoly = ControlPolygon(Curve=crv_3)  # -> Polygon, Points
model_2 = CreateModel(Load=areaload, ReMesh=True, Tolerance=0.01, Unit="m")
equals = Equality(
    FirstNumber=[pdecon.XComponent, pdecon.YComponent, pdecon.ZComponent],
    SecondNumber=[pdecon_2.XComponent, pdecon_2.YComponent, pdecon_2.ZComponent])  # -> Equality, Inequality
plfit = PlaneFit(Points=cpoly.Points)  # -> Plane, Deviation
getloads_2 = GetModelLoads(GSAModel=model_2, Unit="m")  # -> LC, Gr, No, Be, Fa, Pt, Ln, Ar, GPS
not = GateNot(A=equals.Equality)
loadprop_2 = LoadProperties(Load=getloads_2.Ar, Force_Unit="kN", Length_Unit="m")  # -> LoadCase, Name, Definition, Axis, Direction, Projected, LoadValueOrFactorX_forceUnitAbbreviation_kN_forcePerLengthUnit_kN_m_forcePerAreaUnit_kN_m², LoadValueOrFactorY_forceUnitAbbreviation_kN_forcePerLengthUnit_kN_m_forcePerAreaUnit_kN_m²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
ma = MassAddition(Input=not)  # -> Result, PartialResults
brep_3 = Brep(loadprop_2.Definition)
equals_2 = Equality(FirstNumber=ma.Result, SecondNumber="0")  # -> Equality, Inequality
deplane = DeconstructPlane(Plane=loadprop_2.GridPlaneSurface)  # -> Origin, XAxis, YAxis, ZAxis
deplane_2 = DeconstructPlane(Plane=plfit.Plane)  # -> Origin, XAxis, YAxis, ZAxis
area = Area(Geometry=brep_3)  # -> Area, Centroid

# ---- group: LinePolyline
bool = Boolean(equals_2.Equality)

# ----
area_2 = Area(Geometry=brep_2)  # -> Area, Centroid
pdecon_3 = Deconstruct(Point=deplane_2.Origin)  # -> XComponent, YComponent, ZComponent
devec = DeconstructVector(Vector=[deplane_2.XAxis, deplane_2.YAxis, deplane_2.ZAxis])  # -> XComponent, YComponent, ZComponent
pdecon_4 = Deconstruct(Point=deplane.Origin)  # -> XComponent, YComponent, ZComponent
devec_2 = DeconstructVector(Vector=[deplane.XAxis, deplane.YAxis, deplane.ZAxis])  # -> XComponent, YComponent, ZComponent
panel = Panel(bool)
pdecon_5 = Deconstruct(Point=area_2.Centroid)  # -> XComponent, YComponent, ZComponent
pdecon_6 = Deconstruct(Point=area.Centroid)  # -> XComponent, YComponent, ZComponent
similar = Similarity(FirstNumber=area.Area, SecondNumber="0", Threshold=0.1)  # -> Similarity, AbsoluteDifference
similar_2 = Similarity(
    FirstNumber=[pdecon_4.XComponent, pdecon_4.YComponent, pdecon_4.ZComponent, devec_2.XComponent, devec_2.YComponent, devec_2.ZComponent],
    SecondNumber=[pdecon_3.XComponent, pdecon_3.YComponent, pdecon_3.ZComponent, devec.XComponent, devec.YComponent, devec.ZComponent],
    Threshold=0.1)  # -> Similarity, AbsoluteDifference
similar_3 = Similarity(
    FirstNumber=[pdecon_5.XComponent, pdecon_5.YComponent, pdecon_5.ZComponent, area_2.Area],
    SecondNumber=[pdecon_6.XComponent, pdecon_6.YComponent, pdecon_6.ZComponent, area.Area],
    Threshold=0.1)  # -> Similarity, AbsoluteDifference
not_2 = GateNot(A=similar_2.Similarity)
not_3 = GateNot(A=similar_3.Similarity)
ma_2 = MassAddition(Input=flatten([not_3, similar.Similarity]))  # -> Result, PartialResults
ma_3 = MassAddition(Input=flatten(not_2))  # -> Result, PartialResults
equals_3 = Equality(FirstNumber=ma_3.Result, SecondNumber="0")  # -> Equality, Inequality
equals_4 = Equality(FirstNumber=ma_2.Result, SecondNumber="0")  # -> Equality, Inequality

# ---- group: AreaGridPlane
bool_2 = Boolean(equals_3.Equality)

# ---- group: AreaPolyline
bool_3 = Boolean(equals_4.Equality)

# ----
panel_2 = Panel([bool_3, bool_2])
