# Grasshopper definition GwaCommand.gh (Grasshopper 1.0.7)
# plug-ins: GSA

txt = Text(["TITLE.1\tOne Gallions\t\t\t121983\tCK", "UNIT_DATA.1\tFORCE\tN\t1", "UNIT_DATA.1\tLENGTH\tm\t1", "UNIT_DATA.1\tDISP\tm\t1", "UNIT_DATA.1\tSECTION\tm\t1", "UNIT_DATA.1\tMASS\tkg\t1"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])
gwa = GWACommand(GWAString=txt)  # -> Model, ReturnedResult

# ---- group: Add a new list
gwa_2 = GWACommand(GSAModel=gwa.Model, GWAString="ADD, LIST.1, 2, My list, ELEMENT, PB1 to PB3")  # -> Model, ReturnedResult

# ---- group: Get all analysis materials in model
gwa_3 = GWACommand(GSAModel=gwa.Model, GWAString="GET_ALL, MAT_ANAL")  # -> Model, ReturnedResult

# ---- group: Get all lists in model
gwa_4 = GWACommand(GSAModel=gwa.Model, GWAString="GET_ALL, LIST")  # -> Model, ReturnedResult

# ---- group: R_CreateGwaModel
int = Integer(gwa.ReturnedResult)

# ----
panel = Panel(int)
analyse = AnalyseModel(ModelS=gwa.Model, Analyse=True, ReMesh=True, Tolerance=0.01, Unit="m")
split = TextSplit(Text=gwa_4.ReturnedResult)
split_2 = TextSplit(Text=gwa_3.ReturnedResult)
gwa_5 = GWACommand(GSAModel=gwa_2.Model, GWAString="GET_ALL, LIST")  # -> Model, ReturnedResult
split_3 = TextSplit(Text=split, Separators=",")
split_4 = TextSplit(Text=split_2, Separators=",")
split_5 = TextSplit(Text=gwa_5.ReturnedResult)
panel_2 = Panel(split_4)
panel_3 = Panel(split_3)
selres = SelectResults(GSAModel=analyse, Type="AnalysisCase", Case_ID="A1")
split_6 = TextSplit(Text=split_5, Separators=",")
contourelem1d = _1DContourResults(
    Result=selres,
    ElementFilterList="All",
    IntermediatePoints=10,
    Scale=10,
    Display=3,
    Mode=0,
    energy="MJ",
    force="kN",
    legend=True,
    length="mm",
    model="m",
    moment="kN·m",
    noDec=0,
    Result_Type="Displacement",
    Component="Resolved |U|",
    slider=True,
    val=250,
    valMax=1000,
    valMin=0)  # -> L, Colours, Values_mm
item = ListItem(List=split_3, Index="2", Wrap=True)  # -> flatten(Item)
item_2 = ListItem(List=split_4, Index="3", Wrap=True)  # -> flatten(Item)
panel_4 = Panel(split_6)
item_3 = ListItem(List=split_6, Index="2", Wrap=True)  # -> flatten(Item)

# ---- group: MatNames
txt_2 = Text(item_2)

# ----
item_4 = ListItem(List=reverse(item_3), Index=0, Wrap=True)

# ---- group: ExistingList
txt_3 = Text(item)

# ----
panel_5 = Panel(txt_2)
panel_6 = Panel(txt_3)

# ---- group: NewList
txt_4 = Text(item_4)

# ----
panel_7 = Panel(txt_4)
