# Grasshopper definition LoadPanel.gh (Grasshopper 1.0.7)
# plug-ins: GSA, Kangaroo2 Components
# This script is used for ...

crv = Curve(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)
prop2d = Create2DProperty(Type="Load Panel", Support_Type="One-way")
mem2d = Create2DMember(Brep=crv, Property2D=prop2d, InternalOffset=True, Preview3dSection=False, Mesh_mode="Quad dominant")
profile = CreateProfile(
    catalogueIndex=3,
    inclSS=False,
    lengthUnit="Centimeter",
    mode="Catalogue",
    Profile_type="Catalogue",
    Catalogue="Europrofile",
    Type="EP HE beams",
    Profile="HE HE360.A",
    typeIndex=27)
mem2dedit = Edit2DMember(Member2D=mem2d, InternalOffset=Toggle(False), Preview3dSection=False)  # -> Member2D, MemberNumber, Brep, InclPoints, InclCurves, _2DProperty, MemberGroup, MemberType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
mat = CreateMaterial(Material_type="Steel", Design_Code="EN 1993-1-1:2005", Grade="S235")
explode = Explode(Curve=crv, Recursive=True)  # -> Segments, Vertices
section = CreateSection(Profile=profile, Material=mat, Basic_Offset="Centroid")
duppt = RemoveDuplicatePts(Points=explode.Vertices, Tolerance=0.01)
Z = UnitZ(Factor="-1")
line = LineSDL(Start=duppt, Direction=Z, Length=Slider(3, range=0..10))
end = EndPoints(Curve=line)  # -> Start, End
mem1d = Create1DMember(
    Curve=line,
    Property=section,
    Preview3dSection=False,
    x1=False,
    x2=False,
    xx1=False,
    xx2=False,
    y1=False,
    y2=False,
    yy1=False,
    yy2=False,
    z1=False,
    z2=False,
    zz1=False,
    zz2=False)  # -> flatten(Member1D)
mem1d_2 = Create1DMember(
    Curve=explode.Segments,
    Property=section,
    Preview3dSection=False,
    x1=False,
    x2=False,
    xx1=False,
    xx2=False,
    y1=False,
    y2=False,
    yy1=False,
    yy2=False,
    z1=False,
    z2=False,
    zz1=False,
    zz2=False)  # -> flatten(Member1D)
support = CreateSupport(Point=end.End, Plane=PlaneXY(0, 0, 0), x=True, xx=True, y=True, yy=True, z=True, zz=True)
faceload = CreateFaceLoad(
    LoadCase=Slider(2, range=0..10),
    Loadable2DObjects=mem2dedit.Member2D,
    Axis=-1,
    Direction="z",
    Projected=False,
    Value_kN_m²="-2",
    Type="Uniform",
    Unit="kN/m²")
analyse = AnalyseModel(
    GSAGeometryIn_m=flatten([mem2dedit.Member2D, mem1d_2, mem1d, support]),
    Load=flatten(faceload),
    Analyse=True,
    ReMesh=True,
    Tolerance=0.01,
    Unit="m")  # -> Model, Errors, Warnings, Remarks, Logs
