# Grasshopper definition LocalAxes.gh (Grasshopper 1.0.7)
# plug-ins: GSA

# ---- group: line
line = Line([Line((-2.598076211, 0, 1.5), (-2.33826859, 0, 1.879494613)), Line((-2.33826859, 0, 1.879494613), (-2.078460969, 0, 2.163330765)), Line((-2.078460969, 0, 2.163330765), (-1.818653348, 0, 2.385896058)), Line((-1.818653348, 0, 2.385896058), (-1.558845727, 0, 2.563201124)), Line((-1.558845727, 0, 2.563201124), (-1.299038106, 0, 2.704163457)), Line((-1.299038106, 0, 2.704163457), (-1.039230485, 0, 2.814249456))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])

# ----
pt = ConstructPoint(XCoordinate=0, YCoordinate=0, ZCoordinate=0)
vec = VectorXYZ(XComponent=Slider(38, range=0..100), YComponent=Slider(6, range=0..100), ZComponent=Slider(0, range=0..100))  # -> Vector, Length
mem1d = Create1DMember(
    Curve=line,
    Preview3dSection=False,
    x1=False,
    x2=False,
    xx1=False,
    xx2=False,
    y1=False,
    y2=False,
    yy1=False,
    yy2=False,
    z1=False,
    z2=False,
    zz1=False,
    zz2=False)
elem1d = Create1DElement(Line=line, Preview3dSection=False)
move = Move(Geometry=pt, Motion=vec.Vector)  # -> Geometry, Transform
elem1dedit = Edit1DElement(Element1D=elem1d, Preview3dSection=False)  # -> Element1D, Number, Line, Section, Group, Type, Offset, StartRelease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
mem1dedit = Edit1DMember(Member1D=mem1d, OrientationAngle=Slider(5, range=0..10), Preview3dSection=False)  # -> Member1D, Member1dNumber, Curve, Section, MemberGroup, MemberType, _1DElementType, Offset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
axis = LocalAxis(ElementMember1D=elem1dedit.Element1D)  # -> LocalX, LocalY, LocalZ
axis_2 = LocalAxis(ElementMember1D=mem1dedit.Member1D)  # -> LocalX, LocalY, LocalZ
model = CreateModel(GSAGeometryIn_m=mem1dedit.Member1D, ReMesh=True, Tolerance=0.05, Unit="m")
model_2 = CreateModel(GSAGeometryIn_m=elem1dedit.Element1D, ReMesh=True, Tolerance=0.05, Unit="m")

# ---- group: X3
vec_2 = Vector(axis_2.LocalX)

# ---- group: Z3
vec_3 = Vector(axis_2.LocalZ)

# ---- group: Y3
vec_4 = Vector(axis_2.LocalY)

# ---- group: Z1
vec_5 = Vector(axis.LocalZ)

# ---- group: X1
vec_6 = Vector(axis.LocalX)

# ---- group: Y1
vec_7 = Vector(axis.LocalY)

# ----
getgeo = GetModelGeometry(GSAModel=model, NodeFilterList="All", ElementFilterList="All", MemberFilterList="All", Mode=1, Unit="mm")  # -> NodesIn_mm, _1DElementsIn_mm, _2DElementsIn_mm, _3DElementsIn_mm, _1DMembersIn_mm, _2DMembersIn_mm, _3DMembersIn_mm
getgeo_2 = GetModelGeometry(GSAModel=model_2, NodeFilterList="All", ElementFilterList="All", MemberFilterList="All", Mode=1, Unit="mm")  # -> NodesIn_mm, _1DElementsIn_mm, _2DElementsIn_mm, _3DElementsIn_mm, _1DMembersIn_mm, _2DMembersIn_mm, _3DMembersIn_mm
axis_3 = LocalAxis(ElementMember1D=getgeo._1DElementsIn_mm)  # -> LocalX, LocalY, LocalZ
axis_4 = LocalAxis(ElementMember1D=getgeo_2._1DElementsIn_mm)  # -> LocalX, LocalY, LocalZ
end = EndPoints(Curve=line)  # -> Start, End
end_2 = EndPoints(Curve=line)  # -> Start, End
vdis = VectorDisplay(Anchor=end.Start, Vector=axis_3.LocalY)
vdis_2 = VectorDisplay(Anchor=end_2.Start, Vector=axis_4.LocalY)

# ---- group: Y2
vec_8 = Vector(axis_4.LocalY)

# ---- group: Z2
vec_9 = Vector(axis_4.LocalZ)

# ---- group: X2
vec_10 = Vector(axis_4.LocalX)

# ---- group: Y4
vec_11 = Vector(axis_3.LocalY)

# ---- group: X4
vec_12 = Vector(axis_3.LocalX)

# ---- group: Z4
vec_13 = Vector(axis_3.LocalZ)
