# Grasshopper definition NodeLocalAxisReactionForceDiagram.gh (Grasshopper 1.0.7)
# Copyright: Arup
# plug-ins: GSA

vec = VectorXYZ(XComponent=0, YComponent="1", ZComponent="1")  # -> Vector, Length
profile = CreateProfile(
    Depth_cm="30",
    Width_cm="30",
    catalogueIndex=-1,
    lengthUnit="Centimeter",
    mode="Other",
    Profile_type="Rectangle",
    Measure="cm",
    typeIndex=-1)
material = CreateCustomMaterial(
    ElasticModulus_MPa="18000",
    PoissonsRatio="0.3",
    Density_kg_m³="2500",
    Material_Type="Timber",
    Stress_Unit="MPa",
    Density_Unit="kg/m³",
    Temperature_Unit="°C")
pt = ConstructPoint(XCoordinate=0, YCoordinate=0, ZCoordinate=0)
pt_2 = ConstructPoint(XCoordinate="7", YCoordinate=0, ZCoordinate=0)
pl = PlaneNormal(Origin=Point(0, 0, 0), ZAxis=vec.Vector)
section = CreateSection(Profile=profile, Material=material, Basic_Offset="Centroid")
ln = Line(StartPoint=pt, EndPoint=pt_2)
support = CreateSupport(Point=pt_2, Plane=pl, x=True, xx=False, y=True, yy=False, z=True, zz=False)
support_2 = CreateSupport(Point=pt, Plane=PlaneXY(0, 0, 0), x=True, xx=True, y=True, yy=True, z=True, zz=True)
gravityload = CreateGravityLoad(LoadCase="2", GravityFactor=unitize(vec.Vector))
gravityload_2 = CreateGravityLoad(GravityFactor=Vector(0, 0, -1))
mem1d = Create1DMember(
    Curve=ln,
    Section=section,
    Preview3dSection=False,
    x1=False,
    x2=False,
    xx1=False,
    xx2=False,
    y1=False,
    y2=False,
    yy1=False,
    yy2=False,
    z1=False,
    z2=False,
    zz1=False,
    zz2=False)
analyse = AnalyseModel(
    GSAGeometryIn_m=[support_2, support, mem1d],
    Load=[gravityload_2, gravityload],
    Analyse=True,
    ReMesh=True,
    Tolerance=0.01,
    Unit="m")  # -> Model, Report
selres = SelectResults(GSAModel=analyse.Model, Type="AnalysisCase", Case_ID="A1")
selres_2 = SelectResults(GSAModel=analyse.Model, Type="AnalysisCase", Case_ID="A2")
reactionforce = ReactionForceDiagrams(
    Result=selres,
    Annotation=False,
    SignificantDigits=3,
    Scalar=Slider(1, range=0..1),
    Display=3,
    force="kN",
    length="mm",
    model="m",
    moment="kN·m",
    Component="Resolved |F|")  # -> DiagramLines, Annotations
reactionforce_2 = ReactionForceDiagrams(
    Result=selres_2,
    Annotation=False,
    SignificantDigits=3,
    Scalar=Slider(1, range=0..1),
    Display=3,
    force="kN",
    length="mm",
    model="m",
    moment="kN·m",
    Component="Resolved |F|")  # -> DiagramLines, Annotations
item = ListItem(List=reverse(reactionforce.DiagramLines), Index=0, Wrap=True)
item_2 = ListItem(List=reverse(reactionforce_2.DiagramLines), Index=0, Wrap=True)
devec = DeconstructVector(Vector=item)  # -> XComponent, YComponent, ZComponent
devec_2 = DeconstructVector(Vector=item_2)  # -> XComponent, YComponent, ZComponent

# ---- group: A1x
num = Number(devec.XComponent)

# ---- group: A1y
num_2 = Number(devec.YComponent)

# ---- group: A1z
num_3 = Number(devec.ZComponent)

# ---- group: A2x
num_4 = Number(devec_2.XComponent)

# ---- group: A2y
num_5 = Number(devec_2.YComponent)

# ---- group: A2z
num_6 = Number(devec_2.ZComponent)
