# Grasshopper definition NodeResults.gh (Grasshopper 1.0.7)
# Copyright: Arup
# plug-ins: GSA

panel = Panel("https://samples.oasys-software.com/gsa/10.1/Training_General/TrGen_10.gwb")
c_script = CSharpScript(x=panel)  # -> A; inputs x: String
# ---------- c_script: C# usings ----------
using System.Linq;
# ---------- c_script: C# ----------
    string filePath = System.IO.Path.GetTempPath();
    string fileName = x.Split('/').Last();
    //create webclient and download example file:
    System.Net.WebClient webClient = new System.Net.WebClient();
    webClient.DownloadFile(
      x,
      filePath + fileName);

    A = filePath + fileName;
# ---------- end c_script ----------
open = OpenModel(FilenameAndPath=c_script)
createcombination = CreateCombinationCase(ID=0, Name="Envelope 1", Description="(C1 or 1.5C1)")
analyse = AnalyseModel(ModelS=open, AnalysisTasksCombinations=createcombination, Analyse=True, ReMesh=True, Tolerance=0.05, Unit="m")  # -> Model, Errors, Warnings, Remarks, Log
getcases = GetResultCases(GSAModel=analyse.Model)  # -> T, Case, Permutation
getres = GetResults(GSAModel=analyse.Model, T="C", Case="3")

# ---- group: Permutations
int = Integer(getcases.Permutation)

# ----
panel_2 = Panel(int)
res = Result(getres)
reactforce = ReactionForces(Result=res, Max_Min="All", Force_Unit="kipf", Moment_Unit="kipf·ft")  # -> ForceX_kipf, ForceY_kipf, ForceZ_kipf, ForceXYZ_kipf, MomentXX_kipf_ft, MomentYY_kipf_ft, MomentZZ_kipf_ft, MomentXXYYZZ_kipf_ft, NodesIDs
getgeo = GetModelGeometry(GSAModel=analyse.Model, NodeFilterList="3351", ElementFilterList="All", MemberFilterList="All", Mode=1, Unit="m")  # -> NodesIn_m, _1DElementsIn_m, _2DElementsIn_m, _3DElementsIn_m, _1DMembersIn_m, _2DMembersIn_m, _3DMembersIn_m
selres = SelectResults(GSAModel=analyse.Model, Type="Combination", Case_ID="C3", Permutation="All")
selres_2 = SelectResults(GSAModel=analyse.Model, Type="Combination", Case_ID="C3", Permutation="All")
nodedisp = NodeDisplacements(Result=res, NodeFilterList="3351", Max_Min="All", Unit="mm")  # -> TranslationsX_mm, TranslationsY_mm, TranslationsZ_mm, TranslationsXYZ_mm, RotationsXX_rad, RotationsYY_rad, RotationsZZ_rad, RotationsXYZ_rad, NodesIDs
contournode = NodeContourResults(
    Result=selres,
    NodeFilterList="3351",
    Scalar=10,
    Display=3,
    Mode=0,
    envelope="Maximum",
    force="kN",
    legend=True,
    legendScale=1,
    length="mm",
    moment="kN·m",
    noDec=0,
    Result_Type="Displacement",
    Component="Resolved |U|",
    slider=True,
    val=250,
    valMax=1000,
    valMin=0)  # -> Point, Colours, Values_mm
contournode_2 = NodeContourResults(
    Result=selres,
    NodeFilterList="All",
    Scalar=10,
    Display=3,
    Mode=1,
    envelope="Minimum",
    force="kipf",
    legend=True,
    legendScale=1,
    length="mm",
    moment="kN·m",
    noDec=0,
    Result_Type="Reaction",
    Component="Resolved |F|",
    slider=False,
    val=0,
    valMax=1000,
    valMin=0)  # -> Point, Colours, Values_kipf
contournode_3 = NodeContourResults(
    Result=selres_2,
    NodeFilterList="All",
    Scalar=10,
    Display=3,
    Mode=1,
    envelope="Minimum",
    force="kipf",
    legend=True,
    legendScale=1,
    length="mm",
    moment="kN·m",
    noDec=0,
    Result_Type="Reaction",
    Component="Resolved |F|",
    slider=False,
    val=0,
    valMax=1000,
    valMin=0)  # -> Point, Colours, Values_kipf
flip = FlipMatrix(Data=reactforce.NodesIDs)
sort = SortList(Keys=flatten(reactforce.MomentYY_kipf_ft))  # -> Keys, ValuesA
sort_2 = SortList(Keys=flatten(reactforce.MomentZZ_kipf_ft))  # -> Keys, ValuesA
sort_3 = SortList(Keys=flatten(reactforce.MomentXXYYZZ_kipf_ft))  # -> Keys, ValuesA
sort_4 = SortList(Keys=flatten(reactforce.ForceY_kipf))  # -> Keys, ValuesA
sort_5 = SortList(Keys=flatten(reactforce.ForceZ_kipf))  # -> Keys, ValuesA
sort_6 = SortList(Keys=flatten(reactforce.ForceXYZ_kipf))  # -> Keys, ValuesA
sort_7 = SortList(Keys=flatten(reactforce.MomentXX_kipf_ft))  # -> Keys, ValuesA
sort_8 = SortList(Keys=flatten(reactforce.ForceX_kipf))  # -> Keys, ValuesA
path = ConstructPath(Indices=["3", "2"])
item = ListItem(List=flip, Index=0, Wrap=True)
noderesinfo = NodeContourInfo(Point=contournode_2.Point)  # -> Point, V
noderesinfo_2 = NodeContourInfo(Point=contournode_3.Point)  # -> Point, V
lng = ListLength(List=contournode_2.Point)

# ---- group: Measure scaled deformation
dist = Distance(PointA=getgeo.NodesIn_m, PointB=contournode.Point)

# ----
item_2 = ListItem(List=sort.Keys, Index=0, Wrap=True)  # -> Item1, Item
item_3 = ListItem(List=sort_2.Keys, Index=0, Wrap=True)  # -> Item1, Item
item_4 = ListItem(List=sort_3.Keys, Index=0, Wrap=True)  # -> Item1, Item
item_5 = ListItem(List=sort_4.Keys, Index=0, Wrap=True)  # -> Item1, Item
item_6 = ListItem(List=sort_5.Keys, Index=0, Wrap=True)  # -> Item1, Item
item_7 = ListItem(List=sort_6.Keys, Index=0, Wrap=True)  # -> Item1, Item
item_8 = ListItem(List=sort_7.Keys, Index=0, Wrap=True)  # -> Item1, Item
item_9 = ListItem(List=sort_8.Keys, Index=0, Wrap=True)  # -> Item1, Item
flip_2 = FlipMatrix(Data=item)
item_10 = TreeItem(Tree=nodedisp.TranslationsXYZ_mm, Path=path, Index=0, Wrap=True)

# ---- group: SupportPtsCount
int_2 = Integer(lng)

# ----
panel_3 = Panel("23")

# ---- group: Uz
num = Number(nodedisp.TranslationsZ_mm)

# ---- group: Ux
num_2 = Number(nodedisp.TranslationsX_mm)

# ---- group: Uy
num_3 = Number(nodedisp.TranslationsY_mm)

# ---- group: U
num_4 = Number(nodedisp.TranslationsXYZ_mm)

# ---- group: Rxx
num_5 = Number(nodedisp.RotationsXX_rad)

# ---- group: Ryy
num_6 = Number(nodedisp.RotationsYY_rad)

# ---- group: Rzz
T = Number(nodedisp.RotationsZZ_rad)

# ---- group: R
num_7 = Number(nodedisp.RotationsXYZ_rad)

# ---- group: Fy
num_8 = Number([item_5.Item1, item_5.Item])

# ---- group: Fz
num_9 = Number([item_6.Item1, item_6.Item])

# ---- group: F
num_10 = Number([item_7.Item1, item_7.Item])

# ---- group: Myy
num_11 = Number([item_2.Item1, item_2.Item])

# ---- group: Mzz
num_12 = Number([item_3.Item1, item_3.Item])

# ---- group: M
num_13 = Number([item_4.Item1, item_4.Item])

# ---- group: Mxx
num_14 = Number([item_8.Item1, item_8.Item])

# ---- group: Rids
int_3 = Integer(flip_2)

# ---- group: Fx
num_15 = Number([item_9.Item1, item_9.Item])

# ----
num_16 = Number(item_10)

# ---- group: Scale to mm
multiplication = Multiplication(A=dist, B="1000")  # -> flatten(Result)

# ----
tag = TextTag(Location=noderesinfo.Point, Text=noderesinfo.V)
panel_4 = Panel(int_2)
panel_5 = Panel(num_11)
panel_6 = Panel(num_12)
panel_7 = Panel(num_13)
panel_8 = Panel(num_8)
panel_9 = Panel(num_9)
panel_10 = Panel(num_10)
panel_11 = Panel(num_14)
panel_12 = Panel(num_15)
panel_13 = Panel(num_2)
panel_14 = Panel(num_3)
panel_15 = Panel(num)
panel_16 = Panel(num_4)
panel_17 = Panel(num_5)
panel_18 = Panel(num_6)
panel_19 = Panel(T)
panel_20 = Panel(num_7)
sort_9 = SortList(Keys=flatten([noderesinfo.V, noderesinfo_2.V]))  # -> Keys, ValuesA
panel_21 = Panel(int_3)

# ---- group: Scale result value
multiplication_2 = Multiplication(A=num_16, B="250")  # -> flatten(Result)

# ----
item_11 = ListItem(List=sort_9.Keys, Index=0, Wrap=True)  # -> Item1, Item

# ---- group: ScaledResult
num_17 = Number(multiplication_2)

# ---- group: FContour
num_18 = Number([item_11.Item1, item_11.Item])

# ---- group: ScaledContour
num_19 = Number(multiplication)

# ----
panel_22 = Panel(num_18)
panel_23 = Panel([num_17, num_19])
