# Grasshopper definition Prop2dAxis.gh (Grasshopper 1.0.7)
# Copyright: Arup
# plug-ins: GSA

rad = Radians(Degrees="33")
pt = ConstructPoint(XCoordinate=0, YCoordinate=0, ZCoordinate=0)
pt_2 = ConstructPoint(XCoordinate="7", YCoordinate=0, ZCoordinate=0)
pt_3 = ConstructPoint(XCoordinate="7", YCoordinate="5", ZCoordinate=0)
pt_4 = ConstructPoint(XCoordinate=0, YCoordinate="5", ZCoordinate=0)
material = CreateCustomMaterial(
    ElasticModulus_MPa="25000",
    PoissonsRatio="0.3",
    Density_kg_m³="2450",
    Material_Type="Timber",
    Stress_Unit="MPa",
    Density_Unit="kg/m³",
    Temperature_Unit="°C")
srf4pt = _4PointSurface(CornerA=pt, CornerB=pt_2, CornerC=pt_3, CornerD=pt_4)
area = Area(Geometry=srf4pt)  # -> Area, Centroid
xy = XYPlane(Origin=area.Centroid)
prot = RotatePlane(Plane=xy, Angle=rad)
prop2dedit = Edit2DProperty(Axis=prot, Material=material, Thickness_cm="160 cm", LengthUnit="Centimeter", ReferenceEdge=0, SupportType=0)  # -> Prop2D, Prop2dNumber, Prop2dName, Prop2dColour, Axis, Type, Material, Thickness_cm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
pln = Plane(prop2dedit.Axis)
panel = Panel(pln)
mem2d = Create2DMember(Brep=srf4pt, Property2D=prop2dedit.Prop2D, InternalOffset=True, Preview3dSection=False, Mesh_mode="Quad dominant")
rad_2 = Radians(Degrees="57")
deplane = DeconstructPlane(Plane=pln)  # -> Origin, XAxis, YAxis, ZAxis
mem2dedit = Edit2DMember(Member2D=mem2d, OrientationAngle=rad_2, Preview3dSection=False)  # -> Member2D, MemberNumber, Brep, InclPoints, InclCurves, _2DProperty, MemberGroup, MemberType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
pdecon = Deconstruct(Point=deplane.Origin)  # -> XComponent, YComponent, ZComponent
devec = DeconstructVector(Vector=deplane.ZAxis)  # -> XComponent, YComponent, ZComponent

# ---- group: RotationAngleTest
num = Number(mem2dedit.OrientationAngle)

# ---- group: paZX
num_2 = Number(devec.XComponent)

# ---- group: paZY
num_3 = Number(devec.YComponent)

# ---- group: paZZ
num_4 = Number(devec.ZComponent)

# ---- group: paOrigX
num_5 = Number(pdecon.XComponent)

# ---- group: paOrigY
num_6 = Number(pdecon.YComponent)

# ---- group: paOrigZ
num_7 = Number(pdecon.ZComponent)

# ----
model = CreateModel(GSAGeometryIn_m=mem2dedit.Member2D, ReMesh=True, Tolerance=0.01, Unit="m")
panel_2 = Panel(num)
panel_3 = Panel([num_5, num_6, num_7])
panel_4 = Panel([num_2, num_3, num_4])
getgeo = GetModelGeometry(GSAModel=model, NodeFilterList="All", ElementFilterList="All", MemberFilterList="All", Mode=1, Unit="m")  # -> NodesIn_m, _1DElementsIn_m, _2DElementsIn_m, _3DElementsIn_m, _1DMembersIn_m, _2DMembersIn_m, _3DMembersIn_m
elem2dedit = Edit2DElement(Element2D=getgeo._2DElementsIn_m, Preview3dSection=False)  # -> Element2D, Number, AnalysisMesh, _2DProperty, Group, ElementType, Offset, OrientationAngle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
prop2dedit_2 = Edit2DProperty(Prop2D=elem2dedit._2DProperty, LengthUnit="Centimeter", ReferenceEdge=0, SupportType=0)  # -> Prop2D, Prop2dNumber, Prop2dName, Prop2dColour, Axis, Type, Material, Thickness_cm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
deg = Degrees(Radians=elem2dedit.OrientationAngle)
deplane_2 = DeconstructPlane(Plane=prop2dedit_2.Axis)  # -> Origin, XAxis, YAxis, ZAxis
round = Round(Number=deg)  # -> Nearest, Floor, Ceiling
equals = Equality(FirstNumber=round.Nearest, SecondNumber="57")  # -> Equality, Inequality
X = UnitX(Factor=1)
ma = MassAddition(Input=equals.Inequality)  # -> Result, PartialResults
pdecon_2 = Deconstruct(Point=deplane_2.Origin)  # -> XComponent, YComponent, ZComponent
devec_2 = DeconstructVector(Vector=deplane_2.ZAxis)  # -> XComponent, YComponent, ZComponent
angle = Angle(VectorA=deplane_2.XAxis, VectorB=X)  # -> Angle, Reflex

# ---- group: RotationAngleCheck
int = Integer(ma.Result)

# ----
deg_2 = Degrees(Radians=angle.Angle)

# ---- group: elemZX
num_8 = Number(devec_2.XComponent)

# ---- group: elemZY
num_9 = Number(devec_2.YComponent)

# ---- group: elemZZ
num_10 = Number(devec_2.ZComponent)

# ---- group: elemOrigX
num_11 = Number(pdecon_2.XComponent)

# ---- group: elemOrigY
num_12 = Number(pdecon_2.YComponent)

# ---- group: elemOrigZ
num_13 = Number(pdecon_2.ZComponent)

# ----
equals_2 = Equality(FirstNumber=deg_2, SecondNumber="33")  # -> Equality, Inequality
panel_5 = Panel(num_10)
panel_6 = Panel(num_11)
panel_7 = Panel(num_12)
panel_8 = Panel(num_8)
panel_9 = Panel(num_13)
panel_10 = Panel(num_9)
ma_2 = MassAddition(Input=equals_2.Inequality)  # -> Result, PartialResults

# ---- group: AxisRotationCheck
int_2 = Integer(ma_2.Result)
