# Grasshopper definition Quantities.gh (Grasshopper 1.0.7)
# Copyright: Arup
# plug-ins: GSA

# ---- group: Length
num = Number(7.5)

# ---- group: StandardMaterial
mat = CreateMaterial(Material_type="Steel", Design_Code="EN 1993-1-1:2005", Grade="S235")

# ----
material = CreateCustomMaterial(
    ElasticModulus_MPa="2000",
    PoissonsRatio="0.3",
    Density_kg_m³="1800",
    Material_Type="Generic",
    Stress_Unit="MPa",
    Density_Unit="kg/m³",
    Temperature_Unit="°C")
pt = ConstructPoint(XCoordinate=0, YCoordinate=num, ZCoordinate=0)
pt_2 = ConstructPoint(XCoordinate=0, YCoordinate=0, ZCoordinate=0)
X = UnitX(Factor=num)
ln = Line(StartPoint=pt_2, EndPoint=pt)

# ---- group: MaterialPicker
bool = Boolean(False)

# ----
p_n_c = PickNChoose(Pattern=bool, Stream0=mat, Stream1=material)
propmat = MaterialProperties(Material=p_n_c, DensityUnit="KilogramPerCubicMeter", StressUnit="Megapascal", TemperatureUnit="DegreeCelsius")  # -> ElasticModulus_MPa, PoissonsRatio, Density_kg_m³, ThermalExpansion_C_¹

# ---- group: MatDensity
num_2 = Number(propmat.Density_kg_m³)

# ---- group: Depth
num_3 = Number(50)

# ---- group: Width
num_4 = Number(30)

# ----
profile = CreateProfile(
    Depth_cm=num_3,
    Width_cm=num_4,
    catalogueIndex=-1,
    lengthUnit="Centimeter",
    mode="Other",
    Profile_type="Rectangle",
    Measure="cm",
    typeIndex=-1)
extr = Extrude(Base=ln, Direction=X)
mat_2 = Material(p_n_c)

# ---- group: Thickness
num_5 = Number(280)

# ---- group: Offsets
num_6 = Number(0.1)

# ----
prop2d = Create2DProperty(Thickness_mm=num_5, Material=mat_2, Type="Shell", Unit="mm")
section = CreateSection(Profile=profile, Material=mat_2, Basic_Offset="Centroid")
offset = CreateOffset(OffsetX1_m=num_6, OffsetX2_m=num_6, Measure="m")
mem2d = Create2DMember(Brep=extr, Property2D=prop2d, InternalOffset=True, Preview3dSection=False, Mesh_mode="Quad dominant")
mem1dedit = Edit1DMember(Member1D=ln, Property=section, Offset=offset, Preview3dSection=False)  # -> Member1D, Member1dNumber, Curve, Property, MemberGroup, MemberType, _1DElementType, Offset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
model = CreateModel(GSAGeometryIn_m=[mem1dedit.Member1D, mem2d], ReMesh=True, Tolerance=0.01, Unit="m")

# ---- group: MatQuantities
matboq = MaterialsQuantities(Model=model, Layer="Design")  # -> SteelQuantities, ConcreteQuantities, FRPQuantities, AluminiumQuantities, TimberQuantities, GlassQuantities, CustomQuantities

# ---- group: PropertyQuantities
propboq = PropertyQuantities(Model=model, Layer="Analysis")  # -> SectionQuantities, _2DPropertyQuantities

# ---- group: MatQ
num_7 = Number([matboq.SteelQuantities, matboq.ConcreteQuantities, matboq.FRPQuantities, matboq.AluminiumQuantities, matboq.TimberQuantities, matboq.GlassQuantities, matboq.CustomQuantities])

# ---- group: PBQ
num_8 = Number(propboq.SectionQuantities)

# ---- group: PAQ
num_9 = Number(propboq._2DPropertyQuantities)
