# Grasshopper definition ReactionForceDiagrams.gh (Grasshopper 1.0.7)
# plug-ins: GSA

# ---- group: Chord sections
profile = CreateProfile(
    catalogueIndex=3,
    lengthUnit="Centimeter",
    mode="Catalogue",
    Profile_type="Catalogue",
    Catalogue="Europrofile",
    Type="EP HE beams",
    Profile="HE HE450.B",
    typeIndex=27)
material = CreateCustomMaterial(
    ElasticModulus_MPa="210000",
    PoissonsRatio=".3",
    Density_kg_m³="7850",
    Material_Type="Timber",
    Stress_Unit="MPa",
    Density_Unit="kg/m³",
    Temperature_Unit="°C")
section = CreateSection(Profile=profile, Material=material, Basic_Offset="Centroid")

# ----
number_slider = Slider(15, range=0..100)
pt = ConstructPoint(XCoordinate=0, YCoordinate=number_slider, ZCoordinate=0)
pt_2 = ConstructPoint(XCoordinate=0, YCoordinate=0, ZCoordinate=0)
ln = Line(StartPoint=pt_2, EndPoint=pt)
mem1d = Create1DMember(
    Curve=ln,
    Section=section,
    Preview3dSection=False,
    x1=False,
    x2=False,
    xx1=False,
    xx2=False,
    y1=False,
    y2=False,
    yy1=False,
    yy2=False,
    z1=False,
    z2=False,
    zz1=False,
    zz2=False)
division = Division(A=number_slider, B=Slider(9, range=9..30))
Z = UnitZ(Factor=division)
support = CreateSupport(Point=pt_2, Plane=PlaneXY(0, 0, 0), x=True, xx=True, y=True, yy=True, z=True, zz=True)

# ---- group: Vertical sections
profile_2 = CreateProfile(
    catalogueIndex=3,
    lengthUnit="Centimeter",
    mode="Catalogue",
    Profile_type="Catalogue",
    Catalogue="Europrofile",
    Type="EP HE beams",
    Profile="HE HE100.A",
    typeIndex=27)
material_2 = CreateCustomMaterial(
    ElasticModulus_MPa="210000",
    PoissonsRatio=".3",
    Density_kg_m³="7850",
    Material_Type="Timber",
    Stress_Unit="MPa",
    Density_Unit="kg/m³",
    Temperature_Unit="°C")
section_2 = CreateSection(Profile=profile_2, Material=material_2, Basic_Offset="Centroid")

# ----
move = Move(Geometry=support, Motion=Z)  # -> Geometry, Transform
move_2 = Move(Geometry=mem1d, Motion=Z)  # -> Geometry, Transform
divide = DivideCurve(Curve=move_2.Geometry, Count=Slider(7, range=5..15), Kinks=False)  # -> Points, Tangents, Parameters
rev = Reverse(Vector=Z)
no = Node([move.Geometry, support])
line = LineSDL(Start=divide.Points, Direction=rev, Length=rev)
m1d = _1DMember([mem1d, move_2.Geometry])
end = EndPoints(Curve=line)  # -> Start, End
shift = ShiftList(List=end.End, Shift=1, Wrap=False)
ln_2 = Line(StartPoint=divide.Points, EndPoint=shift)
X = UnitX(Factor=Slider(3, range=0..10))
no_2 = Node(no)
line_2 = LineSDL(Start=divide.Points, Direction=X, Length=X)
move_3 = Move(Geometry=no_2, Motion=X)  # -> Geometry, Transform
mem1d_2 = Create1DMember(
    Curve=[ln_2, line],
    Section=section_2,
    Preview3dSection=False,
    x1=False,
    x2=False,
    xx1=False,
    xx2=False,
    y1=False,
    y2=False,
    yy1=False,
    yy2=False,
    z1=False,
    z2=False,
    zz1=False,
    zz2=False)
no_3 = Node([no_2, move_3.Geometry])
mem1d_3 = Create1DMember(
    Curve=line_2,
    Section=section_2,
    Preview3dSection=False,
    x1=False,
    x2=False,
    xx1=False,
    xx2=False,
    y1=False,
    y2=False,
    yy1=False,
    yy2=False,
    z1=False,
    z2=False,
    zz1=False,
    zz2=False)
m1d_2 = _1DMember([m1d, mem1d_2])
move_4 = Move(Geometry=m1d_2, Motion=X)  # -> Geometry, Transform
m1d_3 = _1DMember([m1d_2, move_4.Geometry])
gravityload = CreateGravityLoad(LoadCase=null, GravityFactor=Vector(0, 0, -1))
analyse = AnalyseModel(
    GSAGeometryIn_m=flatten([no_3, m1d_3, mem1d_3]),
    Loads=gravityload,
    Analyse=True,
    ReMesh=True,
    Tolerance=0.05,
    Geometry_Unit="Meter")  # -> Model, Report
getgeo = GetModelGeometry(GSAModel=analyse.Model, NodeFilterList="All", ElementFilterList="All", MemberFilterList="All", Mode=1, Unit="m")  # -> NodesIn_m, _1DElementsIn_m, _2DElementsIn_m, _3DElementsIn_m, _1DMembersIn_m, _2DMembersIn_m, _3DMembersIn_m
selres = SelectResults(GSAModel=analyse.Model, RT="A", Case="1", Type="AnalysisCase", Case_ID="A1")
pt_3 = Point(getgeo.NodesIn_m)
res = Result(selres)
bbox = BoundingBox(Content=pt_3, Plane=PlaneXY(0, 0, 0), UnionBox=True)  # -> Box, Box_2
boxprop = BoxProperties(Box=bbox.Box)  # -> Center, Diagonal, Area, Volume, Degeneracy
reactionforce = ReactionForceDiagrams(
    Result=selres,
    Annotation=False,
    SignificantDigits=3,
    Colour=ColourSwatch(SwatchColor=RGB(255, 0, 0)),
    Display=0,
    force="kN",
    length="in",
    model="m",
    moment="kN·m",
    Component="Reaction Fx")  # -> DiagramLines, Annotations
reactionforce_2 = ReactionForceDiagrams(
    Result=selres,
    Annotation=False,
    SignificantDigits=3,
    Colour=ColourSwatch(SwatchColor=RGB(0, 30, 255)),
    Display=0,
    force="kN",
    length="in",
    model="m",
    moment="kN·m",
    Component="Reaction Fx")  # -> DiagramLines, Annotations
vlen = VectorLength(Vector=boxprop.Diagonal)
panel = Panel(vlen)
vec = Vector(reactionforce_2.DiagramLines)
vec_2 = Vector(reactionforce.DiagramLines)
vlen_2 = VectorLength(Vector=vec)
vlen_3 = VectorLength(Vector=vec_2)
sort = SortList(Keys=vlen_2)  # -> Keys, ValuesA
sort_2 = SortList(Keys=vlen_3)  # -> Keys, ValuesA

# ---- group: Max auto scaled vector should be normalised to 10% of bbox diagonal
multiplication = Multiplication(A=panel, B="0.1")

# ----
item = ListItem(List=reverse(sort.Keys), Index=0, Wrap=True)
item_2 = ListItem(List=reverse(sort_2.Keys), Index=0, Wrap=True)
reactionforce_3 = ReactionForceDiagrams(
    Result=res,
    Annotation=False,
    SignificantDigits="6",
    Scalar="1",
    Display=0,
    force="kN",
    length="in",
    model="m",
    moment="kN·m",
    Component="Reaction Fx")  # -> DiagramLines, Annotations
reactionforce_4 = ReactionForceDiagrams(
    Result=res,
    Annotation=False,
    SignificantDigits="6",
    Scalar="1",
    Display=1,
    force="kN",
    length="in",
    model="m",
    moment="kN·m",
    Component="Reaction Fy")  # -> DiagramLines, Annotations
reactionforce_5 = ReactionForceDiagrams(
    Result=res,
    Annotation=False,
    SignificantDigits="6",
    Scalar="1",
    Display=2,
    force="kN",
    length="in",
    model="m",
    moment="kN·m",
    Component="Reaction Fz")  # -> DiagramLines, Annotations
reactionforce_6 = ReactionForceDiagrams(
    Result=res,
    Annotation=False,
    SignificantDigits="6",
    Scalar="1",
    Display=3,
    force="kN",
    length="in",
    model="m",
    moment="kN·m",
    Component="Resolved |F|")  # -> DiagramLines, Annotations
reactionforce_7 = ReactionForceDiagrams(
    Result=res,
    Annotation=False,
    SignificantDigits="6",
    Scalar="1",
    Display=4,
    force="kN",
    length="in",
    model="m",
    moment="kN·m",
    Component="Reaction Mxx")  # -> DiagramLines, Annotations
reactionforce_8 = ReactionForceDiagrams(
    Result=res,
    Annotation=False,
    SignificantDigits="6",
    Scalar="1",
    Display=5,
    force="kN",
    length="in",
    model="m",
    moment="kN·m",
    Component="Reaction Myy")  # -> DiagramLines, Annotations
reactionforce_9 = ReactionForceDiagrams(
    Result=res,
    Annotation=False,
    SignificantDigits="6",
    Scalar="1",
    Display=6,
    force="kN",
    length="in",
    model="m",
    moment="kN·m",
    Component="Reaction Mzz")  # -> DiagramLines, Annotations
reactionforce_10 = ReactionForceDiagrams(
    Result=res,
    Annotation=False,
    SignificantDigits="6",
    Scalar="1",
    Display=7,
    force="kN",
    length="in",
    model="m",
    moment="kN·m",
    Component="Resolved |M|")  # -> DiagramLines, Annotations
similar = Similarity(FirstNumber=multiplication, SecondNumber=[item_2, item], Threshold=0.1)  # -> Similarity, AbsoluteDifference

# ---- group: Fx
num = Number(reactionforce_3.Annotations)

# ---- group: Fy
num_2 = Number(reactionforce_4.Annotations)

# ---- group: Mxx
num_3 = Number(reactionforce_7.Annotations)

# ---- group: Myy
num_4 = Number(reactionforce_8.Annotations)

# ---- group: Fz
num_5 = Number(reactionforce_5.Annotations)

# ---- group: F
num_6 = Number(reactionforce_6.Annotations)

# ---- group: M
num_7 = Number(reactionforce_10.Annotations)

# ---- group: Mzz
num_8 = Number(reactionforce_9.Annotations)

# ---- group: AutoScale
bool = Boolean(similar.Similarity)

# ----
vlen_4 = VectorLength(Vector=reactionforce_3.DiagramLines)
abs = Absolute(Value=num)
vlen_5 = VectorLength(Vector=reactionforce_4.DiagramLines)
abs_2 = Absolute(Value=num_2)
vlen_6 = VectorLength(Vector=reactionforce_5.DiagramLines)
abs_3 = Absolute(Value=num_5)
vlen_7 = VectorLength(Vector=reactionforce_6.DiagramLines)
abs_4 = Absolute(Value=num_6)
vlen_8 = VectorLength(Vector=reactionforce_7.DiagramLines)
abs_5 = Absolute(Value=num_3)
vlen_9 = VectorLength(Vector=reactionforce_8.DiagramLines)
abs_6 = Absolute(Value=num_4)
vlen_10 = VectorLength(Vector=reactionforce_9.DiagramLines)
abs_7 = Absolute(Value=num_8)
vlen_11 = VectorLength(Vector=reactionforce_10.DiagramLines)
abs_8 = Absolute(Value=num_7)
similar_2 = Similarity(FirstNumber=vlen_4, SecondNumber=abs, Threshold=0.1)  # -> Similarity, AbsoluteDifference
similar_3 = Similarity(FirstNumber=vlen_5, SecondNumber=abs_2, Threshold=0.1)  # -> Similarity, AbsoluteDifference
similar_4 = Similarity(FirstNumber=vlen_6, SecondNumber=abs_3, Threshold=0.1)  # -> Similarity, AbsoluteDifference
similar_5 = Similarity(FirstNumber=vlen_7, SecondNumber=abs_4, Threshold=0.1)  # -> Similarity, AbsoluteDifference
similar_6 = Similarity(FirstNumber=vlen_8, SecondNumber=abs_5, Threshold=0.1)  # -> Similarity, AbsoluteDifference
similar_7 = Similarity(FirstNumber=vlen_9, SecondNumber=abs_6, Threshold="5")  # -> Similarity, AbsoluteDifference
similar_8 = Similarity(FirstNumber=vlen_10, SecondNumber=abs_7, Threshold="5")  # -> Similarity, AbsoluteDifference
similar_9 = Similarity(FirstNumber=vlen_11, SecondNumber=abs_8, Threshold=0.1)  # -> Similarity, AbsoluteDifference

# ---- group: FxScale
bool_2 = Boolean(similar_2.Similarity)

# ---- group: FyScale
bool_3 = Boolean(similar_3.Similarity)

# ---- group: FzScale
bool_4 = Boolean(similar_4.Similarity)

# ---- group: ResFScale
bool_5 = Boolean(similar_5.Similarity)

# ---- group: MxxScale
bool_6 = Boolean(similar_6.Similarity)

# ---- group: MyyScale
bool_7 = Boolean(similar_7.Similarity)

# ---- group: MzzScale
bool_8 = Boolean(similar_8.Similarity)

# ---- group: ResMScale
bool_9 = Boolean(similar_9.Similarity)
