# Grasshopper definition ShowId.gh (Grasshopper 1.0.7)
# Copyright: Arup
# plug-ins: GSA

material = CustomMaterial(
    ElasticModulus_MPa="18000",
    PoissonsRatio="0.3",
    Density_kg_m³="8000",
    Material_Type="Timber",
    Stress_Unit="MPa",
    Density_Unit="kg/m³",
    Temperature_Unit="°C")
profile = CreateProfile(
    Depth_cm="40",
    Width_cm="40",
    NumberOfInputs=2,
    catalogueIndex=-1,
    inclSS=False,
    lengthUnit="Centimeter",
    mode="Other",
    Profile_type="Rectangle",
    Measure="cm",
    typeIndex=-1)
prop3d = Create3DProperty(Material=material)
prop2d = Create2DProperty(Thickness_cm="25", Material=material, Type="Shell", Unit="cm")
section = CreateSection(Profile=profile, Material=material, Basic_Offset="Centroid")
size = Slider(2, range=0..100)
movefact = Slider(0.5, range=0.1..0.9)
number_slider = Slider(3, range=0..10)
number_slider_2 = Slider(3, range=0..10)
pt = ConstructPoint(XCoordinate=0, YCoordinate=0, ZCoordinate=0)
pt_2 = ConstructPoint(XCoordinate=size, YCoordinate=size, ZCoordinate=size)
multiplication = Multiplication(A=size, B=movefact)
addition = Addition(A=number_slider_2, B="4")
vec = VectorXYZ(XComponent=multiplication, YComponent=multiplication, ZComponent=multiplication)  # -> Vector, Length
box = Box2Pt(PointA=pt, PointB=pt_2, Plane=PlaneXY(0, 0, 0))
pt_3 = ConstructPoint(XCoordinate="9", YCoordinate=0, ZCoordinate=0)
pt_4 = ConstructPoint(XCoordinate="9", YCoordinate=0, ZCoordinate=number_slider)
pt_5 = ConstructPoint(XCoordinate="9", YCoordinate=number_slider, ZCoordinate=number_slider)
pt_6 = ConstructPoint(XCoordinate="9", YCoordinate=number_slider, ZCoordinate=0)
pt_7 = ConstructPoint(XCoordinate="4", YCoordinate=0, ZCoordinate=0)
pt_8 = ConstructPoint(XCoordinate=addition, YCoordinate=0, ZCoordinate=0)
pt_9 = ConstructPoint(XCoordinate=addition, YCoordinate=number_slider_2, ZCoordinate=0)
pt_10 = ConstructPoint(XCoordinate="4", YCoordinate=number_slider_2, ZCoordinate=0)
move = Move(Geometry=box, Motion=vec.Vector)  # -> Geometry, Transform
srf4pt = _4PointSurface(CornerA=pt_7, CornerB=pt_8, CornerC=pt_9, CornerD=pt_10)
box_corners = BoxCorners(Box=box)  # -> CornerA, CornerB, CornerC, CornerD, CornerE, CornerF, CornerG, CornerH
pline = PolyLine(Vertices=[pt_3, pt_4, pt_5, pt_6], Closed=False)
sunion = SolidUnion(Breps=[box, move.Geometry])
mem2d = Create2DMember(Brep=srf4pt, Prop2D=prop2d, InternalOffset=False)
mem1d = Create1DMember(
    Curve=pline,
    Section=section,
    x1=False,
    x2=False,
    xx1=False,
    xx2=False,
    y1=False,
    y2=False,
    yy1=False,
    yy2=False,
    z1=False,
    z2=False,
    zz1=False,
    zz2=False)
support = CreateSupport(Point=[pt_3, pt_6], Plane=PlaneXY(0, 0, 0), x=True, xx=True, y=True, yy=True, z=True, zz=True)
mem3d = Create3DMember(Solid=sunion, Prop3D=prop3d)
support_2 = CreateSupport(
    Point=[box_corners.CornerA, box_corners.CornerB, box_corners.CornerC, box_corners.CornerD],
    Plane=PlaneXY(0, 0, 0),
    x=True,
    xx=False,
    y=True,
    yy=False,
    z=True,
    zz=False)
support_3 = CreateSupport(Point=[pt_7, pt_8, pt_9, pt_10], Plane=PlaneXY(0, 0, 0), x=True, xx=False, y=True, yy=False, z=True, zz=False)
mem2dedit = Edit2DMember(Member2D=mem2d, Member2dNumber="22", MeshSizeInModelUnits="0.7")  # -> Member2D, MemberNumber, Brep, InclPoints, InclCurves, _2DProperty, MemberGroup, MemberType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
mem3dedit = Edit3DMember(Member3D=mem3d, Member3dNumber="33")  # -> Member3D, MemberNumber, SolidMesh, _3DProperty, MeshSizeInModelUnits, MeshWithOthers, MemberName, MemberGroup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
mem1dedit = Edit1DMember(Member1D=mem1d, Member1dNumber="11", MeshSizeInModelUnits="0.5", LengthUnit="Meter")  # -> Member1D, Member1dNumber, Curve, Section, MemberGroup, MemberType, _1DElementType, Offset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
model = CreateModel(GSAGeometryIn_m=[mem3dedit.Member3D, support_2], ReMesh=True, Tolerance=0.01, Unit="m")
model_2 = CreateModel(GSAGeometryIn_m=[mem2dedit.Member2D, support_3], ReMesh=True, Tolerance=0.01, Unit="m")
model_3 = CreateModel(GSAGeometryIn_m=[mem1dedit.Member1D, support], ReMesh=True, Tolerance=0.01, Unit="m")
getgeo = GetModelGeometry(GSAModel=model, NodeFilterList="All", ElementFilterList="All", MemberFilterList="All", Mode=1, Unit="m")  # -> Nodes_m, _1DElements_m, _2DElements_m, _3DElements_m, _1DMembers_m, _2DMembers_m, _3DMembers_m
getgeo_2 = GetModelGeometry(GSAModel=model_2, NodeFilterList="All", ElementFilterList="All", MemberFilterList="All", Mode=1, Unit="m")  # -> Nodes_m, _1DElements_m, _2DElements_m, _3DElements_m, _1DMembers_m, _2DMembers_m, _3DMembers_m
getgeo_3 = GetModelGeometry(GSAModel=model_3, NodeFilterList="All", ElementFilterList="All", MemberFilterList="All", Mode=1, Unit="m")  # -> Nodes_m, _1DElements_m, _2DElements_m, _3DElements_m, _1DMembers_m, _2DMembers_m, _3DMembers_m
id = ShowID(NodeElementMemberResult=getgeo._3DMembers_m)  # -> Position, Index
id_2 = ShowID(NodeElementMemberResult=getgeo.Nodes_m)  # -> Position, Index
id_3 = ShowID(NodeElementMemberResult=getgeo._3DElements_m)  # -> Position, Index
id_4 = ShowID(NodeElementMemberResult=getgeo_2._2DMembers_m)  # -> Position, Index
id_5 = ShowID(NodeElementMemberResult=getgeo_2._2DElements_m)  # -> Position, Index
id_6 = ShowID(NodeElementMemberResult=getgeo_3._1DElements_m)  # -> Position, Index
id_7 = ShowID(NodeElementMemberResult=getgeo_3._1DMembers_m)  # -> Position, Index

# ---- group: NodeIds
int = Integer(id_2.Index)

# ---- group: Elem3dIds
int_2 = Integer(id_3.Index)

# ---- group: Mem3dId
int_3 = Integer(id.Index)

# ---- group: Elem2dIds
int_4 = Integer(id_5.Index)

# ---- group: Mem2dId
int_5 = Integer(id_4.Index)

# ---- group: Elem1dIds
int_6 = Integer(id_6.Index)

# ---- group: Mem1dId
int_7 = Integer(id_7.Index)

# ----
gravityload = CreateGravityLoad(LoadCase=1, GravityFactor=Vector(0, 0, -1))
gravityload_2 = CreateGravityLoad(LoadCase=1, GravityFactor=Vector(0, 0, -1))
gravityload_3 = CreateGravityLoad(LoadCase=1, GravityFactor=Vector(0, 0, -1))
analyse = AnalyseModel(ModelS=model_3, Load=gravityload, Analyse=True, ReMesh=False, Tolerance=0.01, Unit="m")
analyse_2 = AnalyseModel(ModelS=model, Load=gravityload_2, Analyse=True, ReMesh=False, Tolerance=0.01, Unit="m")
analyse_3 = AnalyseModel(ModelS=model_2, Load=gravityload_3, Analyse=True, ReMesh=False, Tolerance=0.01, Unit="m")
selres = SelectResults(GSAModel=analyse, Type="AnalysisCase", Case_ID="A1")
selres_2 = SelectResults(GSAModel=analyse_2, Type="AnalysisCase", Case_ID="A1")
selres_3 = SelectResults(GSAModel=analyse_3, Type="AnalysisCase", Case_ID="A1")
contourelem2d = _2DContourResults(
    Result=selres_3,
    ElementFilterList="All",
    Display=3,
    Mode=0,
    flayer=0,
    force="kN/m",
    legend=True,
    legendScale=1,
    length="mm",
    model="m",
    moment="kN",
    noDec=0,
    Result_Type="Displacement",
    Component="Resolved |U|",
    slider=True,
    stress="MPa",
    val=1000,
    valMax=1000,
    valMin=0)  # -> M, Colours, Values_mm
contourelem3d = _3DContourResults(
    Result=selres_2,
    ElementFilterList="All",
    Display=3,
    Mode=0,
    legend=True,
    legendScale=1,
    length="mm",
    model="m",
    noDec=0,
    Result_Type="Displacement",
    Component="Resolved |U|",
    slider=True,
    stress="MPa",
    val=1000,
    valMax=1000,
    valMin=0)  # -> NgonMesh, Colours, Values_mm
contournode = NodeContourResults(
    Result=selres_3,
    NodeFilterList="All",
    Scalar=10,
    Display=3,
    Mode=0,
    force="kN",
    legend=True,
    legendScale=1,
    length="mm",
    model="m",
    moment="kN·m",
    noDec=0,
    Result_Type="Displacement",
    Component="Resolved |U|",
    slider=True,
    val=1000,
    valMax=1000,
    valMin=0)  # -> P, Colours, Values_mm
contournode_2 = NodeContourResults(
    Result=selres_2,
    NodeFilterList="All",
    Scalar=10,
    Display=3,
    Mode=0,
    force="kN",
    legend=True,
    legendScale=1,
    length="mm",
    model="m",
    moment="kN·m",
    noDec=0,
    Result_Type="Displacement",
    Component="Resolved |U|",
    slider=True,
    val=1000,
    valMax=1000,
    valMin=0)  # -> P, Colours, Values_mm
reactionforce = ReactionForceDiagrams(
    Result=selres,
    NodeFilterList="All",
    Scalar=1,
    Display=3,
    force="kN",
    length="mm",
    model="m",
    moment="kN·m",
    Component="Resolved |F|")  # -> AnchorPoint, Vector, Value
contourelem1d = _1DContourResults(
    Result=selres,
    ElementFilterList="All",
    IntermediatePoints="4",
    Scale=10,
    Display=3,
    Mode=0,
    energy="MJ",
    force="kN",
    legend=True,
    legendScale=1,
    length="mm",
    model="m",
    moment="kN·m",
    noDec=0,
    Result_Type="Displacement",
    Component="Resolved |U|",
    slider=True,
    val=1000,
    valMax=1000,
    valMin=0)  # -> L, Colours, Values_mm
contournode_3 = NodeContourResults(
    Result=selres,
    NodeFilterList="All",
    Scalar=10,
    Display=3,
    Mode=0,
    force="kN",
    legend=True,
    legendScale=1,
    length="mm",
    model="m",
    moment="kN·m",
    noDec=0,
    Result_Type="Displacement",
    Component="Resolved |U|",
    slider=True,
    val=1000,
    valMax=1000,
    valMin=0)  # -> P, Colours, Values_mm
Y = UnitY(Factor="5")
Y_2 = UnitY(Factor="5")
Y_3 = UnitY(Factor="5")
move_2 = Move(Geometry=contourelem2d.M, Motion=Y)  # -> Geometry, Transform
move_3 = Move(Geometry=reactionforce.Vector, Motion=Y_3)  # -> Geometry, Transform
move_4 = Move(Geometry=contourelem3d.NgonMesh, Motion=Y_2)  # -> Geometry, Transform
move_5 = Move(Geometry=contournode.P, Motion=Y)  # -> Geometry, Transform
move_6 = Move(Geometry=contournode_2.P, Motion=Y_2)  # -> Geometry, Transform
move_7 = Move(Geometry=contournode_3.P, Motion=Y_3)  # -> Geometry, Transform
move_8 = Move(Geometry=contourelem1d.L, Motion=Y_3)  # -> Geometry, Transform
id_8 = ShowID(NodeElementMemberResult=move_2.Geometry)  # -> Position, Index
id_9 = ShowID(NodeElementMemberResult=move_4.Geometry)  # -> Position, Index
id_10 = ShowID(NodeElementMemberResult=move_5.Geometry)  # -> Position, Index

# ---- group: warning
id_11 = ShowID(NodeElementMemberResult="warning test")  # -> Position, Index

# ----
id_12 = ShowID(NodeElementMemberResult=move_6.Geometry)  # -> Position, Index
id_13 = ShowID(NodeElementMemberResult=move_7.Geometry)  # -> Position, Index
id_14 = ShowID(NodeElementMemberResult=move_3.Geometry)  # -> Position, Index
id_15 = ShowID(NodeElementMemberResult=move_8.Geometry)  # -> Position, Index

# ---- group: NodeRes2dIds
int_8 = Integer(id_10.Index)

# ---- group: Res3dIds
int_9 = Integer(id_9.Index)

# ---- group: Res2dIds
int_10 = Integer(id_8.Index)

# ----
null = NullItem(Item=id_11.Position)  # -> NullFlags, InvalidFlags, Description

# ---- group: NodeRes3dIds
int_11 = Integer(id_12.Index)

# ---- group: ResVectIds
int_12 = Integer(id_14.Index)

# ---- group: NodeRes1dIds
int_13 = Integer(id_13.Index)

# ---- group: Res1dIds
int_14 = Integer(id_15.Index)

# ---- group: invalidTest
bool = Boolean(null.InvalidFlags)
