# Grasshopper definition SpringReactionForces.gh (Grasshopper 1.0.7)
# Copyright: Arup
# plug-ins: GSA

# ---- group: Spring properties [values in SI units]
x = Slider(500, range=0..1000)
y = Slider(500, range=0..1000)
z = Slider(500, range=0..1000)
xx = Slider(500, range=0..1000)
yy = Slider(500, range=0..1000)
zz = Slider(500, range=0..1000)
int = Integer("0")
num = Number(x)
int_2 = Integer("0")
num_2 = Number(y)
int_3 = Integer("0")
num_3 = Number(z)
int_4 = Integer("0")
num_4 = Number(xx)
int_5 = Integer("0")
num_5 = Number(yy)
int_6 = Integer("0")
num_6 = Number(zz)
merge = Merge(
    Data1=int,
    Data2=num,
    Data3=int_2,
    Data4=num_2,
    Data5=int_3,
    Data6=num_3,
    Data7=int_4,
    Data8=num_4,
    Data9=int_5,
    Data10=num_5,
    Data11=int_6,
    Data12=num_6)
merge_2 = Merge(Data1="PROP_SPR.4\t1\tSpring prop. 1\tNO_RGB\tGENERAL", Data2=merge)
tab = Panel("\t")
join = TextJoin(Text=merge_2, Join=tab)

# ----
material = CreateMaterial(Material_type="Concrete", Design_Code="EC2-1-1", Grade="C20/25")
prop2d = Create2DProperty(Thickness_cm="500", Material=material, Type="Shell", Unit="cm")
rectangle = Rectangle(Plane=PlaneXY(0, 0, 0), XSize="15", YSize="15", Radius=0)  # -> Rectangle, Length
mem2d = Create2DMember(Brep=rectangle.Rectangle, Property2D=prop2d, InternalOffset=True, Preview3dSection=False, Mesh_mode="Quad dominant")
elemfrommem = ElementsFromMembers(_2DMembers_m=mem2d, Tolerance=0.05, Unit="m")  # -> Nodes, _1DElements, _2DElements, _3DElements, GSAModel
explode = Explode(Curve=mem2d, Recursive=True)  # -> Segments, Vertices
spring_id = Panel("1")
shift = ShiftList(List=explode.Vertices, Shift=1, Wrap=False)

# ---- group: Set at specific ID
int_7 = Integer(spring_id)
merge_3 = Merge(Data1="SET_AT", Data2=int_7, Data3=join)
tab_2 = Panel("\t")
join_2 = TextJoin(Text=merge_3, Join=tab_2)

# ---- group: Set node's Spring Property ID
nodeedit = EditNode(Node=shift, SpringProperty=spring_id, Mode=1)  # -> Node, NodeNumber, NodePosition, NodeLocalAxis, NodeRestraints, DamperProperty, MassProperty, SpringProperty, NodeName, NodeColour

# ----
panel = Panel(join_2)
Z = UnitZ(Factor="-15")
gwa = GWACommand(GSAModel=elemfrommem.GSAModel, GWAString=join_2)  # -> Model, ReturnedResult
gravityload = CreateGravityLoad(LoadCase=null, GravityFactor=Z)
createcombination = CreateCombinationCase(ID=0, Name="CombinationCase", Description="1.5A1")
analyse = AnalyseModel(
    ModelSAndLists=gwa.Model,
    GSAGeometryIn_m=nodeedit.Node,
    Load=gravityload,
    AnalysisTasksCombinations=createcombination,
    Analyse=True,
    ReMesh=True,
    Tolerance=0.01,
    Unit="m")  # -> Model, Report
selres = SelectResults(GSAModel=analyse.Model, Type="AnalysisCase", Case_ID="A1")
selres_2 = SelectResults(GSAModel=analyse.Model, Type="Combination", Case_ID="C1", Permutation="All")
springforce = SpringForces(Result=selres, Force_Unit="kN", Moment_Unit="kN·m")  # -> ForceX_kN, ForceY_kN, ForceZ_kN, ForceXYZ_kN, MomentXX_kN_m, MomentYY_kN_m, MomentZZ_kN_m, MomentXXYYZZ_kN_m, NodesIDs
springforce_2 = SpringForces(Result=selres_2, Force_Unit="kN", Moment_Unit="kN·m")  # -> ForceX_kN, ForceY_kN, ForceZ_kN, ForceXYZ_kN, MomentXX_kN_m, MomentYY_kN_m, MomentZZ_kN_m, MomentXXYYZZ_kN_m, NodesIDs

# ---- group: SpringForces
num_7 = Number(springforce.ForceXYZ_kN)

# ---- group: CombinationCaseSpringForces
num_8 = Number(springforce_2.ForceXYZ_kN)

# ----
panel_2 = Panel(num_8)
