# Grasshopper definition TaperPerimeterProfiles.gh (Grasshopper 1.0.7)
# plug-ins: GSA

crv = Curve(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)
rectangle = Rectangle(Plane=PlaneXY(0, 0, 0), XSize="-1 to 1", YSize="0 to 3", Radius=0)  # -> Rectangle, Length
rectangle_2 = Rectangle(Plane=PlaneXY(0, 0, 0), XSize="-3 to 0", YSize="-1 to 1", Radius=0)  # -> Rectangle, Length
profile = CreateProfile(
    Boundary=rectangle.Rectangle,
    catalogueIndex=-1,
    inclSS=False,
    lengthUnit="Centimeter",
    mode="Other",
    Profile_type="Perimeter",
    Measure="cm",
    typeIndex=-1)
profile_2 = CreateProfile(
    Boundary=rectangle_2.Rectangle,
    catalogueIndex=-1,
    inclSS=False,
    lengthUnit="Centimeter",
    mode="Other",
    Profile_type="Perimeter",
    Measure="cm",
    typeIndex=-1)
profile_3 = CreateProfile(
    Boundary=crv,
    catalogueIndex=-1,
    inclSS=False,
    lengthUnit="Centimeter",
    mode="Other",
    Profile_type="Perimeter",
    Measure="cm",
    typeIndex=-1)
taper = TaperProfile(ProfileStart=profile, ProfileEnd=profile_2)

# ---- group: Test2
taper_2 = TaperProfile(ProfileStart=profile_2, ProfileEnd=profile_3)

# ---- group: Test1
txt = Text(taper)

# ----
panel = Panel(txt)
