# Grasshopper definition GsaGH_Example1_FootFall.gh (Grasshopper 1.0.7)
# Copyright: Arup
# plug-ins: GSA

mat = CreateMaterial(Material_type="Concrete", Design_Code="EC2-1-1", Grade="C30/37")
prop2d = Create2DProperty(Thickness_cm="200", Material=mat, Type="Shell", Unit="cm")
mem2d = Create2DMember(Brep=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, Property2D=prop2d, InternalOffset=True, Preview3dSection=False, Mesh_mode="Quad dominant")
model = CreateModel(GSAGeometryIn_mm=mem2d, ReMesh=True, Tolerance=10, Unit="mm")
mdp = CreateModalDynamicParameter(Modes_3="4", Mode_Strategy="Number of modes", Mass_Option="Mass from shape function", Mass_Direction="X")
getgeo = GetModelGeometry(GSAModel=model, NodeFilterList="1,3", Mode=1, Unit="m")  # -> NodesIn_m, _1DElementsIn_m, _2DElementsIn_m, _3DElementsIn_m, _1DMembersIn_m, _2DMembersIn_m, _3DMembersIn_m, Assemblies
σt = CreateAnalysisTask(Name="footfall from component", ModalAnalysisTask="1", casesParamIndex=8, Solver="Footfall", Method="Self excitation")
σt_2 = CreateAnalysisTask(ModalDynamicParameter=mdp, casesParamIndex=2, Solver="Modal Dynamic")
nodeedit = EditNode(Node=getgeo.NodesIn_m, NodeRestraints="FFFFFF", Mode=1)  # -> Node, NodeNumber, NodePosition, NodeLocalAxis, NodeRestraints, DamperProperty, MassProperty, SpringProperty, NodeName, NodeColour
model_2 = CreateModel(
    GSAGeometryIn_m=[getgeo._2DMembersIn_m, nodeedit.Node],
    AnalysisTasksCombinations=[σt_2, σt],
    ReMesh=True,
    Tolerance=0.01,
    Unit="m")
analyse = AnalyseModel(ModelSAndLists=model_2, Analyse=True, ReMesh=True, Tolerance=0.01, Unit="m")  # -> Model, Errors, Warnings, Remarks, Logs
