# Grasshopper definition GsaGH_Example1_GerberMember.gh (Grasshopper 1.0.7)
# plug-ins: GSA

pt = ConstructPoint(XCoordinate=0, YCoordinate=0, ZCoordinate=0)
pt_2 = ConstructPoint(XCoordinate=0, YCoordinate=Slider(15, range=0..100), ZCoordinate=0)
ln = Line(StartPoint=pt, EndPoint=pt_2)

# ---- group: Split even distance from start and end
number_slider = Slider(0.179, range=0.001..0.5)
subtraction = Subtraction(A="1", B=number_slider)
eval = EvaluateCurve(Curve=reparameterize(ln), Parameter=[number_slider, subtraction])  # -> Point, Tangent, Angle

# ---- group: Section from catalogue profile and custom material
material = CustomMaterial(
    ElasticModulus_MPa="210000",
    PoissonsRatio=".3",
    Density_kg_m³="7850",
    Material_Type="Steel",
    Stress_Unit="Megapascal",
    Density_Unit="KilogramPerCubicMeter",
    Temperature_Unit="DegreeCelsius")
profile = CreateProfile(
    NumberOfInputs=0,
    catalogueIndex=3,
    inclSS=False,
    lengthUnit="Centimeter",
    mode="Catalogue",
    Profile_type="Catalogue",
    Catalogue="Europrofile",
    Type="EP HE beams",
    Profile="HE HE450.B",
    typeIndex=27)
section = CreateSection(Profile=profile, Material=material)

# ----
end = EndPoints(Curve=ln)  # -> Start, End

# ---- group: Polyline from start, support and end points
merge = Merge(Data1=end.Start, Data2=eval.Point, Data3=end.End)
pline = PolyLine(Vertices=merge, Closed=False)

# ---- group: Support [Global coordinate system]
support = CreateSupport(Point=eval.Point, Plane=PlaneXY(0, 0, 0), x=True, xx=False, y=True, yy=True, z=True, zz=True)

# ---- group: Create Member1D from polyline
mem1d = Create1DMember(
    Curve=pline,
    Section=section,
    x1=False,
    x2=False,
    xx1=False,
    xx2=False,
    y1=False,
    y2=False,
    yy1=False,
    yy2=False,
    z1=False,
    z2=False,
    zz1=False,
    zz2=False)

# ---- group: Loads
beamload = CreateBeamLoad(
    LoadCase="2",
    ElementList=mem1d,
    Axis=0,
    Direction="z",
    Projected=False,
    Value_kN_m=Slider(-3.5, range=-5..0),
    Type="Uniform",
    Unit="kN/m")
gravityload = CreateGravityLoad(LoadCase="1", GravityFactor=Vector(0, 0, -1))

# ---- group: Combinations
createcombination = CreateCombinationCase(Name="ULS combination", Description="1.35A1 + 1.5A2")

# ----
analyse = AnalyseModel(
    GSAGeometryIn_m=flatten([support, mem1d]),
    Loads=[beamload, gravityload],
    AnalysisTasksCombinations=createcombination,
    Analyse=True,
    ReMesh=True,
    Tolerance=0.05,
    Geometry_Unit="Meter")
save = SaveGSAModel(GSAModel=analyse, Save=True, FileAndPath="C:\Users\kristjan.nielsen\Desktop\2.gwb")
selres = SelectResults(GSAModel=analyse, RT="C", Case="1", Permutation="1", Type="Combination", Case_ID="C1")
beamforces = BeamForcesAndMoments(Result=selres, ElementFilterList="All", IntermediatePoints=3, Force_Unit="Kilonewton", Moment_Unit="KilonewtonMeter")  # -> ForceX_kN, ForceY_kN, ForceZ_kN, ForceXYZ_kN, MomentXX_kN_m, MomentYY_kN_m, MomentZZ_kN_m, MomentXXYYZZ_kN_m
abs = Absolute(Value=beamforces.MomentYY_kN_m)
contourelem1d = _1DContourResults(
    Result=selres,
    ElementFilterList="All",
    IntermediatePoints=Slider(85, range=0..100),
    Scale=Slider(40, range=1..100),
    Display=5,
    Mode=1,
    energy="MJ",
    force="kN",
    legend=True,
    legendScale=1,
    length="mm",
    model="m",
    moment="kN·m",
    noDec=0,
    Result_Type="Force",
    Component="Moment Myy",
    slider=False,
    val=0,
    valMax=1000,
    valMin=0)  # -> Line, Colours, LegendValues_kN_m
sort = SortList(Keys=flatten(abs))  # -> Keys, ValuesA
item = ListItem(List=reverse(sort.Keys), Index=0, Wrap=True)

# ---- group: MaxMyy
num = Number(item)

# ----
max_myy = Panel(num)
