# Grasshopper definition GsaGH_Example2_Reciprocal.gh (Grasshopper 1.0.7)
# plug-ins: GSA

# ---- group: Geometry
number_slider = Slider(5, range=0..10)
number_slider_2 = Slider(2.9, range=0..10)
number_slider_3 = Slider(3.2, range=0..10)

# ---- group: Profile
number_slider_4 = Slider(80, range=0..100)
number_slider_5 = Slider(50, range=0..100)

# ---- group: RH_IN:Radius
num = Number(number_slider_2)

# ---- group: RH_IN:Extension
num_2 = Number(number_slider_3)

# ---- group: RH_IN:Segments
int = Integer(number_slider)

# ----
polygon = Polygon(Plane=PlaneXY(0, 0, 0), Radius=num, Segments=int, FilletRadius=0)  # -> Polygon, Length

# ---- group: RH_IN:ProfileDepth
num_3 = Number(number_slider_5)

# ---- group: RH_IN:ProfileWidth
num_4 = Number(number_slider_4)

# ----
material = CustomMaterial(
    ElasticModulus_MPa="30000",
    PoissonsRatio=Slider(0.3, range=0..1),
    Density_kg_m³="2500",
    Material_Type="Steel",
    Stress_Unit="Megapascal",
    Density_Unit="KilogramPerCubicMeter",
    Temperature_Unit="DegreeCelsius")
profile = CreateProfile(
    Depth_cm=num_3,
    Width_cm=num_4,
    NumberOfInputs=2,
    catalogueIndex=-1,
    inclSS=False,
    lengthUnit="Centimeter",
    mode="Other",
    Profile_type="Rectangle",
    Measure="Centimeter",
    typeIndex=-1)
explode = Explode(Curve=polygon.Polygon, Recursive=True)  # -> Segments, Vertices
ext = ExtendCurve(Curve=explode.Segments, Type=0, Start=num_2, End="0")
section = CreateSection(Profile=profile, Material=material)
end = EndPoints(Curve=ext)  # -> Start, End
mem1d = Create1DMember(
    Curve=ext,
    Section=section,
    x1=False,
    x2=False,
    xx1=False,
    xx2=False,
    y1=False,
    y2=False,
    yy1=False,
    yy2=True,
    z1=False,
    z2=False,
    zz1=False,
    zz2=True)
support = CreateSupport(Point=end.Start, Plane=PlaneXY(0, 0, 0), x=True, xx=False, y=True, yy=False, z=True, zz=False)
gravityload = CreateGravityLoad(LoadCase=1, GravityFactor=Vector(0, 0, -1))
analyse = AnalyseModel(GSAGeometryIn_m=[mem1d, support], Loads=gravityload, Analyse=True, ReMesh=True, Tolerance=0.05, Geometry_Unit="Meter")
selres = SelectResults(GSAModel=analyse, RT="A", Case="1", Type="AnalysisCase", Case_ID="A1")
contourelem1d = _1DContourResults(
    Result=selres,
    ElementFilterList="All",
    IntermediatePoints=10,
    Scale=10,
    Display=5,
    Mode=1,
    energy="MJ",
    force="kN",
    legend=True,
    legendScale=1,
    length="mm",
    model="m",
    moment="kN·m",
    noDec=0,
    Result_Type="Force",
    Component="Moment Myy",
    slider=False,
    val=0,
    valMax=1000,
    valMin=0)  # -> Line, Colours, LegendValues_kN_m
reactionforce = ReactionForceDiagrams(Result=selres, Display=3, force="kN", length="mm", model="m", moment="kN·m", Component="Resolved |F|")  # -> AnchorPoint, Vector, Value
res = Result(selres)
num_5 = Number(reactionforce.Vector)

# ---- group: ReactionForceVector
geo = Geometry(reactionforce.Vector)

# ----
move = Move(Geometry=reactionforce.Vector, Motion=Vector(0, 0, 10))  # -> Geometry, Transform

# ---- group: NodeId
int_2 = Integer(reactionforce.Vector)

# ----
stretch = Stretch(Geometry=reactionforce.Vector, Axis=Line((0, 0, 0), (10, 10, 0)), Length=20, Rigid=False)
move_2 = Move(Geometry=contourelem1d.Line, Motion=Vector(0, 0, 10))  # -> Geometry, Transform
stretch_2 = Stretch(Geometry=contourelem1d.Line, Axis=Line((0, 0, 0), (10, 10, 0)), Length=20, Rigid=False)
vec = Vector(reactionforce.Vector)

# ---- group: ResultLine
geo_2 = Geometry(contourelem1d.Line)

# ----
line = Line(contourelem1d.Line)
crv = Curve(contourelem1d.Line)

# ---- group: CaseId
int_3 = Integer(contourelem1d.Line)

# ---- group: MorphVectorResult
geo_3 = Geometry(stretch)

# ---- group: TransformVectorResult
geo_4 = Geometry(move.Geometry)

# ---- group: MorphLineResult
geo_5 = Geometry(stretch_2)

# ---- group: TransformLineResult
geo_6 = Geometry(move_2.Geometry)

# ----
reacforce = ReactionForces(Result=res, NodeFilterList="All", Force_Unit="Kilonewton", Moment_Unit="KilonewtonMeter")  # -> ForceX_kN, ForceY_kN, ForceZ_kN, ForceXYZ_kN, MomentXX_kN_m, MomentYY_kN_m, MomentZZ_kN_m, MomentXXYYZZ_kN_m, NodesIDs
totalresults = TotalLoadsReactions(Result=res, Force_Unit="Kilonewton", Moment_Unit="KilonewtonMeter")  # -> ΣFx, ΣFy, ΣFz, Σ_F, ΣMxx, ΣMyy, ΣMzz, Σ_M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
beamforces = BeamForcesAndMoments(Result=res, ElementFilterList="All", IntermediatePoints=3, Force_Unit="Kilonewton", Moment_Unit="KilonewtonMeter")  # -> ForceX_kN, ForceY_kN, ForceZ_kN, ForceXYZ_kN, MomentXX_kN_m, MomentYY_kN_m, MomentZZ_kN_m, MomentXXYYZZ_kN_m
num_6 = Number(reacforce.ForceZ_kN)
num_7 = Number(totalresults.ΣFz)
sort = SortList(Keys=flatten(beamforces.MomentYY_kN_m))  # -> Keys, ValuesA
ma = MassAddition(Input=num_6)  # -> Result, PartialResults
item = ListItem(List=sort.Keys, Index=0, Wrap=True)
abs = Absolute(Value=num_7)
expected = Panel("-157.193672")

# ---- group: MaxMyy
num_8 = Number(item)

# ----
similar = Similarity(FirstNumber=ma.Result, SecondNumber=abs, Threshold="0.001")  # -> Similarity, AbsoluteDifference
panel = Panel(num_8)

# ---- group: SumLoadForce
bool = Boolean(similar.Similarity)
