# Grasshopper definition GsaGH_Example4_ReMeshing.gh (Grasshopper 1.0.7)
# plug-ins: GSA

pipeline = GeometryPipeline(
    GroupByLayer=False,
    GroupByType=False,
    IncludeHidden=True,
    IncludeLocked=True,
    LayerFilter="*",
    NameFilter="*",
    SublayerFiltering=True,
    TypeFilter=4)
pipeline_2 = GeometryPipeline(
    GroupByLayer=False,
    GroupByType=False,
    IncludeHidden=True,
    IncludeLocked=True,
    LayerFilter="*",
    NameFilter="*",
    SublayerFiltering=True,
    TypeFilter=1)
pipeline_3 = GeometryPipeline(
    GroupByLayer=False,
    GroupByType=False,
    IncludeHidden=True,
    IncludeLocked=True,
    LayerFilter="*",
    NameFilter="*",
    SublayerFiltering=True,
    TypeFilter=1073741848)
crv = Curve(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)
brep = Brep(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)
pt = Point(Point(-19.36228396, -2.750374083, 0))
number_slider = Slider(0.2, range=0..1)
mem1d = Create1DMember(
    Curve=crv,
    x1=False,
    x2=False,
    xx1=False,
    xx2=False,
    y1=False,
    y2=False,
    yy1=False,
    yy2=False,
    z1=False,
    z2=False,
    zz1=False,
    zz2=False)
mem2d = Create2DMember(Brep=brep, InclPoints=pt, MeshSizeInModelUnits=Slider(1, range=0.5..1.5))
mem1dedit = Edit1DMember(Member1D=mem1d, MeshSize_mm=number_slider, LengthUnit="Millimeter")  # -> Member1D, Member1dNumber, Curve, Section, MemberGroup, MemberType, _1DElementType, Offset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
mem1dedit_2 = Edit1DMember(Member1D=mem1d, MeshSize_mm=number_slider, LengthUnit="Millimeter")  # -> Member1D, Member1dNumber, Curve, Section, MemberGroup, MemberType, _1DElementType, Offset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
elemfrommem = ElementsFromMembers(_1DMembers_m=mem1dedit_2.Member1D, _2DMembers_m=mem2d, Unit="Meter")  # -> Nodes, _1DElements, _2DElements, _3DElements, GSAModel
explode = Explode(Curve=elemfrommem._1DElements, Recursive=True)  # -> flatten(Segments), Vertices
demesh = DeconstructMesh(Mesh=elemfrommem._2DElements)  # -> Vertices, Faces, Colours, Normals
lng = ListLength(List=demesh.Vertices)
lng_2 = ListLength(List=demesh.Faces)
lng_3 = ListLength(List=explode.Segments)

# ---- group: Elements
int = Integer(lng_3)

# ---- group: Vertices
int_2 = Integer(lng)

# ---- group: Faces
int_3 = Integer(lng_2)

# ----
panel = Panel([int, int_2, int_3])
