# Grasshopper definition GsaGH_Example5_4PointSrfMidSupport.gh (Grasshopper 1.0.7)
# plug-ins: GSA

pt = ConstructPoint(XCoordinate=Slider(1, range=0..15), YCoordinate=Slider(5, range=0..15), ZCoordinate=0)
pt_2 = ConstructPoint(XCoordinate=Slider(8, range=0..15), YCoordinate=Slider(0, range=0..15), ZCoordinate=0)
pt_3 = ConstructPoint(XCoordinate=Slider(7, range=0..15), YCoordinate=Slider(8, range=0..15), ZCoordinate=0)
pt_4 = ConstructPoint(XCoordinate=Slider(0, range=0..15), YCoordinate=Slider(0, range=0..15), ZCoordinate=0)
srf4pt = _4PointSurface(CornerA=pt_4, CornerB=pt_2, CornerC=pt_3, CornerD=pt)
number_slider = Slider(0.524, range=0..1)
number_slider_2 = Slider(0.404, range=0..1)
material = CustomMaterial(
    ElasticModulus_MPa="30000",
    PoissonsRatio="0.3",
    Density_kg_m³="2500",
    Material_Type="Concrete",
    Stress_Unit="Megapascal",
    Density_Unit="KilogramPerCubicMeter",
    Temperature_Unit="DegreeCelsius")

# ---- group: RH_IN:y
num = Number(number_slider_2)

# ---- group: RH_IN:x
num_2 = Number(number_slider)

# ----
brep = Brep(srf4pt)
pt_5 = ConstructPoint(XCoordinate=num_2, YCoordinate=num, ZCoordinate=0)
evalsrf = EvaluateSurface(Surface=reparameterize(brep), Point=pt_5)  # -> Point, Normal, UDirection, VDirection, Frame
explode = Explode(Curve=brep, Recursive=True)  # -> Segments, Vertices
prop2d = Create2DProperty(Thickness_mm=Slider(245, range=0..1000), Material=material, Type="Flat Plate", Unit="mm")
support = CreateSupport(Point=[evalsrf.Point, explode.Vertices], Plane=PlaneXY(0, 0, 0), x=True, xx=False, y=True, yy=False, z=True, zz=False)
mem2d = Create2DMember(
    Brep=srf4pt,
    InclPoints=evalsrf.Point,
    Prop2D=prop2d,
    MeshSizeInModelUnits=Slider(0.32, range=0..1),
    InternalOffset=False)

# ---- group: Loads
faceload = CreateFaceLoad(
    LoadCase="2",
    ElementList=mem2d,
    Axis=-1,
    Direction="z",
    Projected=False,
    Value_kN_m²=Slider(-3.5, range=-5..0),
    Type="Uniform",
    Unit="kN/m²")
gravityload = CreateGravityLoad(LoadCase="1", GravityFactor=Vector(0, 0, -1))

# ---- group: Combinations
createcombination = CreateCombinationCase(Name="ULS combination", Description="1.35A1 + 1.5A2")

# ----
analyse = AnalyseModel(
    GSAGeometryIn_m=flatten([mem2d, support]),
    Loads=[gravityload, faceload],
    AnalysisTasksCombinations=createcombination,
    Analyse=True,
    ReMesh=True,
    Tolerance=0.05,
    Geometry_Unit="Meter")
selres = SelectResults(GSAModel=analyse, RT="C", Case="1", Permutation="1", Type="Combination", Case_ID="C1")
contourelem2d = _2DContourResults(
    Result=selres,
    ElementFilterList="All",
    Display=3,
    Mode=0,
    flayer=0,
    force="kN/m",
    legend=True,
    legendScale=1,
    length="mm",
    model="m",
    moment="kN",
    noDec=0,
    Result_Type="Displacement",
    Component="Resolved |U|",
    slider=True,
    stress="MPa",
    val=250,
    valMax=1000,
    valMin=0)  # -> Mesh, Colours, Values_mm
contournode = NodeContourResults(
    Result=selres,
    Scalar=10,
    Display=3,
    Mode=1,
    force="kN",
    legend=False,
    legendScale=1,
    length="mm",
    model="m",
    moment="kN·m",
    noDec=0,
    Result_Type="Reaction",
    Component="Resolved |F|",
    slider=False,
    val=0,
    valMax=1000,
    valMin=0)  # -> P, Colours, Values_kN
nodedisp = NodeDisplacements(Result=selres, NodeFilterList="All", Unit="Millimeter")  # -> TranslationsX_mm, TranslationsY_mm, TranslationsZ_mm, TranslationsXYZ_mm, RotationsXX_rad, RotationsYY_rad, RotationsZZ_rad, RotationsXYZ_rad, NodesIDs
sort = SortList(Keys=nodedisp.TranslationsXYZ_mm, ValuesA=nodedisp.TranslationsXYZ_mm)  # -> Keys, ValuesA

# ---- group: RH_OUT:geometry
mesh = Mesh(contourelem2d.Mesh)

# ----
move = Move(Geometry=contourelem2d.Mesh, Motion=Vector(0, 0, 10))  # -> Geometry, Transform
stretch = Stretch(Geometry=contourelem2d.Mesh, Axis=Line((0, 0, 0), (10, 10, 0)), Length=20, Rigid=False)

# ---- group: ResultMesh
geo = Geometry(contourelem2d.Mesh)

# ----
mesh_2 = Mesh(contourelem2d.Mesh)
move_2 = Move(Geometry=contournode.P, Motion=Vector(0, 0, 10))  # -> Geometry, Transform
stretch_2 = Stretch(Geometry=contournode.P, Axis=Line((0, 0, 0), (10, 10, 0)), Length=20, Rigid=False)

# ---- group: ResultPoint
geo_2 = Geometry(contournode.P)

# ----
pt_6 = Point(contournode.P)
col = Colour(contournode.P)

# ---- group: NodeId
int = Integer(contournode.P)

# ----
galapagos = Galapagos(fitness=item, gene=[number_slider, number_slider_2])

# ---- group: Value
num_3 = Number(contournode.P)

# ----
item = ListItem(List=reverse(sort.Keys), Index=0, Wrap=True)
item_2 = ListItem(List=reverse(sort.ValuesA), Index=0, Wrap=True)

# ---- group: MorphMeshResult
geo_3 = Geometry(stretch)

# ---- group: TransformMeshResult
geo_4 = Geometry(move.Geometry)

# ---- group: MorphPointResult
geo_5 = Geometry(stretch_2)

# ---- group: TransformPointResult
geo_6 = Geometry(move_2.Geometry)

# ---- group: RH_OUT:deflection
num_4 = Number(item_2)

# ----
panel = Panel(num_4)
