# Grasshopper definition Annotate.gh (Grasshopper 1.0.7)
# Copyright: Arup
# plug-ins: GSA

material = CustomMaterial(
    ElasticModulus_MPa="18000",
    PoissonsRatio="0.3",
    Density_kg_m³="8000",
    Material_Type="Timber",
    Stress_Unit="MPa",
    Density_Unit="kg/m³",
    Temperature_Unit="°C")
profile = CreateProfile(
    Depth_cm="40",
    Width_cm="40",
    catalogueIndex=-1,
    lengthUnit="Centimeter",
    mode="Other",
    Profile_type="Rectangle",
    Measure="cm",
    typeIndex=-1)
prop3d = Create3DProperty(Material=material)
prop2d = Create2DProperty(Thickness_cm="25", Material=material, Type="Shell", Unit="cm")
section = CreateSection(Profile=profile, Material=material, Basic_Offset="Centroid")
size = Slider(2, range=0..100)
movefact = Slider(0.5, range=0.1..0.9)
number_slider = Slider(3, range=0..10)
number_slider_2 = Slider(3, range=0..10)
pt = ConstructPoint(XCoordinate=0, YCoordinate=0, ZCoordinate=0)
pt_2 = ConstructPoint(XCoordinate=size, YCoordinate=size, ZCoordinate=size)
multiplication = Multiplication(A=size, B=movefact)
addition = Addition(A=number_slider_2, B="4")
vec = VectorXYZ(XComponent=multiplication, YComponent=multiplication, ZComponent=multiplication)  # -> Vector, Length
box = Box2Pt(PointA=pt, PointB=pt_2, Plane=PlaneXY(0, 0, 0))
pt_3 = ConstructPoint(XCoordinate="9", YCoordinate=0, ZCoordinate=0)
pt_4 = ConstructPoint(XCoordinate="9", YCoordinate=0, ZCoordinate=number_slider)
pt_5 = ConstructPoint(XCoordinate="9", YCoordinate=number_slider, ZCoordinate=number_slider)
pt_6 = ConstructPoint(XCoordinate="9", YCoordinate=number_slider, ZCoordinate=0)
pt_7 = ConstructPoint(XCoordinate="4", YCoordinate=0, ZCoordinate=0)
pt_8 = ConstructPoint(XCoordinate=addition, YCoordinate=0, ZCoordinate=0)
pt_9 = ConstructPoint(XCoordinate=addition, YCoordinate=number_slider_2, ZCoordinate=0)
pt_10 = ConstructPoint(XCoordinate="4", YCoordinate=number_slider_2, ZCoordinate=0)
move = Move(Geometry=box, Motion=vec.Vector)  # -> Geometry, Transform
srf4pt = _4PointSurface(CornerA=pt_7, CornerB=pt_8, CornerC=pt_9, CornerD=pt_10)
box_corners = BoxCorners(Box=box)  # -> CornerA, CornerB, CornerC, CornerD, CornerE, CornerF, CornerG, CornerH
pline = PolyLine(Vertices=[pt_3, pt_4, pt_5, pt_6], Closed=False)
sunion = SolidUnion(Breps=[box, move.Geometry])
mem2d = Create2DMember(Brep=srf4pt, Property2D=prop2d, InternalOffset=True, Preview3dSection=False, Mesh_mode="Quad dominant")
mem1d = Create1DMember(
    Curve=pline,
    Section=section,
    Preview3dSection=False,
    x1=False,
    x2=False,
    xx1=False,
    xx2=False,
    y1=False,
    y2=False,
    yy1=False,
    yy2=False,
    z1=False,
    z2=False,
    zz1=False,
    zz2=False)
support = CreateSupport(Point=[pt_3, pt_6], Plane=PlaneXY(0, 0, 0), x=True, xx=True, y=True, yy=True, z=True, zz=True)
mem3d = Create3DMember(Solid=sunion, Prop3D=prop3d)
support_2 = CreateSupport(
    Point=[box_corners.CornerA, box_corners.CornerB, box_corners.CornerC, box_corners.CornerD],
    Plane=PlaneXY(0, 0, 0),
    x=True,
    xx=False,
    y=True,
    yy=False,
    z=True,
    zz=False)
support_3 = CreateSupport(Point=[pt_7, pt_8, pt_9, pt_10], Plane=PlaneXY(0, 0, 0), x=True, xx=False, y=True, yy=False, z=True, zz=False)
mem2dedit = Edit2DMember(
    Member2D=mem2d,
    Member2dNumber="22",
    _2DElementType="0",
    MeshSizeInModelUnits="0.7",
    MeshMode="3",
    Preview3dSection=False)  # -> Member2D, MemberNumber, Brep, InclPoints, InclCurves, _2DProperty, MemberGroup, MemberType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
mem3dedit = Edit3DMember(Member3D=mem3d, Member3dNumber="33")  # -> Member3D, MemberNumber, SolidMesh, _3DProperty, MeshSizeInModelUnits, MeshWithOthers, MemberName, MemberGroup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
mem1dedit = Edit1DMember(Member1D=mem1d, Member1dNumber="11", MeshSizeInModelUnits="0.5", LengthUnit="Meter", Preview3dSection=False)  # -> Member1D, Member1dNumber, Curve, Section, MemberGroup, MemberType, _1DElementType, Offset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
model = CreateModel(GSAGeometryIn_m=[mem3dedit.Member3D, support_2], ReMesh=True, Tolerance=0.01, Unit="m")
model_2 = CreateModel(GSAGeometryIn_m=[mem2dedit.Member2D, support_3], ReMesh=True, Tolerance=0.01, Unit="m")
model_3 = CreateModel(GSAGeometryIn_m=[mem1dedit.Member1D, support], ReMesh=True, Tolerance=0.01, Unit="m")
getgeo = GetModelGeometry(GSAModel=model, NodeFilterList="All", ElementFilterList="All", MemberFilterList="All", Mode=1, Unit="m")  # -> NodesIn_m, _1DElementsIn_m, _2DElementsIn_m, _3DElementsIn_m, _1DMembersIn_m, _2DMembersIn_m, _3DMembersIn_m
getgeo_2 = GetModelGeometry(GSAModel=model_2, NodeFilterList="All", ElementFilterList="All", MemberFilterList="All", Mode=1, Unit="m")  # -> NodesIn_m, _1DElementsIn_m, _2DElementsIn_m, _3DElementsIn_m, _1DMembersIn_m, _2DMembersIn_m, _3DMembersIn_m
getgeo_3 = GetModelGeometry(GSAModel=model_3, NodeFilterList="All", ElementFilterList="All", MemberFilterList="All", Mode=1, Unit="m")  # -> NodesIn_m, _1DElementsIn_m, _2DElementsIn_m, _3DElementsIn_m, _1DMembersIn_m, _2DMembersIn_m, _3DMembersIn_m
A = Annotate(NodeElementMemberLoadResultDiagram=getgeo.NodesIn_m)  # -> Annotations, Position, Text
A_2 = Annotate(NodeElementMemberLoadResultDiagram=getgeo._3DElementsIn_m)  # -> Annotations, Position, Text
A_3 = Annotate(NodeElementMemberLoadResultDiagram=getgeo._3DMembersIn_m)  # -> Annotations, Position, Text
A_4 = Annotate(NodeElementMemberLoadResultDiagram=getgeo_2._2DMembersIn_m)  # -> Annotations, Position, Text
A_5 = Annotate(NodeElementMemberLoadResultDiagram=getgeo_2._2DElementsIn_m)  # -> Annotations, Position, Text
A_6 = Annotate(NodeElementMemberLoadResultDiagram=getgeo_3._1DMembersIn_m)  # -> Annotations, Position, Text
A_7 = Annotate(NodeElementMemberLoadResultDiagram=getgeo_3._1DElementsIn_m)  # -> Annotations, Position, Text

# ---- group: NodeIds
int = Integer(A.Text)

# ---- group: Elem3dIds
int_2 = Integer(A_2.Text)

# ---- group: Mem3dId
int_3 = Integer(A_3.Text)

# ---- group: Elem2dIds
int_4 = Integer(A_5.Text)

# ---- group: Mem2dId
int_5 = Integer(A_4.Text)

# ---- group: Elem1dIds
int_6 = Integer(A_7.Text)

# ---- group: Mem1dId
int_7 = Integer(A_6.Text)

# ----
gravityload = CreateGravityLoad(LoadCase=null, GravityFactor=Vector(0, 0, -1))
gravityload_2 = CreateGravityLoad(LoadCase=null, GravityFactor=Vector(0, 0, -1))
gravityload_3 = CreateGravityLoad(LoadCase=null, GravityFactor=Vector(0, 0, -1))
analyse = AnalyseModel(ModelS=model_3, Load=gravityload, Analyse=True, ReMesh=False, Tolerance=0.01, Unit="m")  # -> Model, Report
analyse_2 = AnalyseModel(ModelS=model, Load=gravityload_2, Analyse=True, ReMesh=False, Tolerance=0.01, Unit="m")  # -> Model, Report
analyse_3 = AnalyseModel(ModelS=model_2, Load=gravityload_3, Analyse=True, ReMesh=False, Tolerance=0.01, Unit="m")  # -> Model, Report
selres = SelectResults(GSAModel=analyse.Model, Type="AnalysisCase", Case_ID="A1")
selres_2 = SelectResults(GSAModel=analyse_2.Model, Type="AnalysisCase", Case_ID="A1")
selres_3 = SelectResults(GSAModel=analyse_3.Model, Type="AnalysisCase", Case_ID="A1")
contourelem2d = _2DContourResults(
    Result=selres_3,
    ElementFilterList="All",
    Display=3,
    Mode=0,
    flayer=0,
    force="kN/m",
    legend=True,
    legendScale=1,
    length="mm",
    model="m",
    moment="kN",
    noDec=0,
    Result_Type="Displacement",
    Component="Resolved |U|",
    slider=True,
    stress="MPa",
    val=1000,
    valMax=1000,
    valMin=0)  # -> M, Colours, Values_mm
contourelem3d = _3DContourResults(
    Result=selres_2,
    ElementFilterList="All",
    Display=3,
    Mode=0,
    legend=True,
    legendScale=1,
    length="mm",
    model="m",
    noDec=0,
    Result_Type="Displacement",
    Component="Resolved |U|",
    slider=True,
    stress="MPa",
    val=1000,
    valMax=1000,
    valMin=0)  # -> NgonMesh, Colours, Values_mm
contournode = NodeContourResults(
    Result=selres_3,
    NodeFilterList="All",
    Scalar=10,
    Display=3,
    Mode=0,
    force="kN",
    legend=True,
    legendScale=1,
    length="mm",
    model="m",
    moment="kN·m",
    noDec=0,
    Result_Type="Displacement",
    Component="Resolved |U|",
    slider=True,
    val=1000,
    valMax=1000,
    valMin=0)  # -> P, Colours, Values_mm
contournode_2 = NodeContourResults(
    Result=selres_2,
    NodeFilterList="All",
    Scalar=10,
    Display=3,
    Mode=0,
    force="kN",
    legend=True,
    legendScale=1,
    length="mm",
    model="m",
    moment="kN·m",
    noDec=0,
    Result_Type="Displacement",
    Component="Resolved |U|",
    slider=True,
    val=1000,
    valMax=1000,
    valMin=0)  # -> P, Colours, Values_mm
contourelem1d = _1DContourResults(
    Result=selres,
    ElementFilterList="All",
    IntermediatePoints="4",
    Scale=10,
    Display=3,
    Mode=0,
    energy="MJ",
    force="kN",
    legend=True,
    legendScale=1,
    length="mm",
    model="m",
    moment="kN·m",
    noDec=0,
    Result_Type="Displacement",
    Component="Resolved |U|",
    slider=True,
    val=1000,
    valMax=1000,
    valMin=0)  # -> L, Colours, Values_mm
resultdiagram = ResultDiagrams(
    Result=selres,
    Annotation=False,
    SignificantDigits=3,
    force="kN",
    length="mm",
    model="m",
    moment="kN·m",
    Type="Force",
    Diagram="Moment Myy",
    stress="MPa")  # -> DiagramLines, Annotations
reactionforce = ReactionForceDiagrams(
    Result=selres,
    Annotation=False,
    SignificantDigits=3,
    Display=3,
    force="kN",
    length="mm",
    model="m",
    moment="kN·m",
    Component="Resolved |F|")  # -> DiagramLines, Annotations
contournode_3 = NodeContourResults(
    Result=selres,
    NodeFilterList="All",
    Scalar=10,
    Display=3,
    Mode=0,
    force="kN",
    legend=True,
    legendScale=1,
    length="mm",
    model="m",
    moment="kN·m",
    noDec=0,
    Result_Type="Displacement",
    Component="Resolved |U|",
    slider=True,
    val=1000,
    valMax=1000,
    valMin=0)  # -> P, Colours, Values_mm
Y = UnitY(Factor="5")
Y_2 = UnitY(Factor="5")
Y_3 = UnitY(Factor="5")
move_2 = Move(Geometry=contourelem2d.M, Motion=Y)  # -> Geometry, Transform
move_3 = Move(Geometry=reactionforce.DiagramLines, Motion=Y_3)  # -> Geometry, Transform
move_4 = Move(Geometry=resultdiagram.Annotations, Motion=Y_3)  # -> Geometry, Transform
move_5 = Move(Geometry=contourelem3d.NgonMesh, Motion=Y_2)  # -> Geometry, Transform
move_6 = Move(Geometry=contournode.P, Motion=Y)  # -> Geometry, Transform
move_7 = Move(Geometry=contournode_2.P, Motion=Y_2)  # -> Geometry, Transform
move_8 = Move(Geometry=contournode_3.P, Motion=Y_3)  # -> Geometry, Transform
move_9 = Move(Geometry=contourelem1d.L, Motion=Y_3)  # -> Geometry, Transform
A_8 = Annotate(NodeElementMemberLoadResultDiagram=move_2.Geometry)  # -> Annotations, Position, Text
null = NullItem(Item=move_3.Geometry)  # -> NullFlags, InvalidFlags, Description

# ---- group: throwWarning
A_9 = Annotate(NodeElementMemberLoadResultDiagram="warning test")  # -> Annotations, Position, Text

# ----
A_10 = Annotate(NodeElementMemberLoadResultDiagram=move_5.Geometry)  # -> Annotations, Position, Text
A_11 = Annotate(NodeElementMemberLoadResultDiagram=move_6.Geometry)  # -> Annotations, Position, Text
A_12 = Annotate(NodeElementMemberLoadResultDiagram=move_7.Geometry)  # -> Annotations, Position, Text
A_13 = Annotate(NodeElementMemberLoadResultDiagram=move_4.Geometry, Colour=ColourSwatch(SwatchColor=RGB(0, 72, 255)))  # -> Annotations, Position, Text
A_14 = Annotate(NodeElementMemberLoadResultDiagram=move_8.Geometry)  # -> Annotations, Position, Text
A_15 = Annotate(NodeElementMemberLoadResultDiagram=move_9.Geometry)  # -> Annotations, Position, Text

# ---- group: NodeRes2dIds
int_8 = Integer(A_11.Text)

# ---- group: Res3dIds
int_9 = Integer(A_10.Text)

# ---- group: Res2dIds
int_10 = Integer(A_8.Text)

# ----
null_2 = NullItem(Item=A_9.Annotations)  # -> NullFlags, InvalidFlags, Description

# ---- group: NodeRes3dIds
int_11 = Integer(A_12.Text)

# ---- group: DiagramLineNull
txt = Text(null.NullFlags)

# ---- group: DiagramValues
txt_2 = Text(A_13.Text)

# ---- group: NodeRes1dIds
int_12 = Integer(A_14.Text)

# ---- group: Res1dIds
int_13 = Integer(A_15.Text)

# ---- group: invalidTest
bool = Boolean(null_2.InvalidFlags)
