# Grasshopper definition AssembleWithIDsTestIdSequence.gh (Grasshopper 1.0.7)
# Copyright: Arup
# plug-ins: GSA

pt = ConstructPoint(XCoordinate=0, YCoordinate=0, ZCoordinate=0)
mplane = MeshPlane(Boundary={Plane=PlaneXY(0, 0, 0), Size=Domain2(u=-10..10, v=-10..10)}, WidthCount=10, HeightCount=10)  # -> Mesh, Area
series = Series(Start=0, Step=1, Count="4")
line = LineSDL(Start=pt, Direction=Vector(0, 0, 1), Length=1)
pt_2 = ConstructPoint(XCoordinate=0, YCoordinate=0, ZCoordinate=0)
pt_3 = ConstructPoint(XCoordinate="12", YCoordinate=0, ZCoordinate=0)
pt_4 = ConstructPoint(XCoordinate="12", YCoordinate="12", ZCoordinate=0)
pt_5 = ConstructPoint(XCoordinate=0, YCoordinate="12", ZCoordinate=0)
X = UnitX(Factor=series)
demesh = DeconstructMesh(Mesh=mplane.Mesh)  # -> Vertices, Faces, Colours, Normals
move = Move(Geometry=line, Motion=X)  # -> Geometry, Transform
srf4pt = _4PointSurface(CornerA=pt_2, CornerB=pt_3, CornerC=pt_4, CornerD=pt_5)
item = ListItem(List=demesh.Vertices, Index="24", Wrap=True)
move_2 = Move(Geometry=srf4pt, Motion=Vector(0, 0, 10))  # -> Geometry, Transform
elem2d = Create2DElement(Mesh=mplane.Mesh, Preview3dSection=False)
nodeedit = EditNode(Node=item, NodeNumber="5", Mode=1)  # -> Node, NodeNumber, NodePosition, NodeLocalAxis, NodeRestraints, DamperProperty, MassProperty, SpringProperty, NodeName, NodeColour
cull_i = CullIndex(List=move.Geometry, Indices="2", Wrap=True)
item_2 = ListItem(List=move.Geometry, Index="2", Wrap=True)
move_3 = Move(Geometry=move_2.Geometry, Motion=Vector(0, 0, 10))  # -> Geometry, Transform
mem2dedit = Edit2DMember(Member2dNumber="2", Brep=move_3.Geometry, Preview3dSection=False)  # -> Member2D, MemberNumber, Brep, InclPoints, InclCurves, _2DProperty, MemberGroup, MemberType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
mem2d = Create2DMember(Brep=[srf4pt, move_2.Geometry], InternalOffset=True, Preview3dSection=False, Mesh_mode="Quad dominant")
model = CreateModel(GSAGeometryIn_m=flatten([elem2d, nodeedit.Node]), ReMesh=True, Tolerance=-0.05, Unit="m")
getgeo = GetModelGeometry(GSAModel=model, NodeFilterList="All", ElementFilterList="All", MemberFilterList="All", Mode=1, Unit="m")  # -> NodesIn_m, _1DElementsIn_m, _2DElementsIn_m, _3DElementsIn_m, _1DMembersIn_m, _2DMembersIn_m, _3DMembersIn_m
model_2 = CreateModel(GSAGeometryIn_m=flatten([mem2d, mem2dedit.Member2D]), ReMesh=False, Tolerance=0.05, Unit="m")
mem1dedit = Edit1DMember(Member1dNumber="14", Curve=item_2, LengthUnit="Meter", Preview3dSection=False)  # -> Member1D, Member1dNumber, Curve, Section, MemberGroup, MemberType, _1DElementType, Offset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
elem1dedit = Edit1DElement(Number="14", Line=item_2, Preview3dSection=False)  # -> Element1D, Number, Line, Section, Group, Type, Offset, StartRelease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
mem1d = Create1DMember(
    Curve=cull_i,
    Preview3dSection=False,
    x1=False,
    x2=False,
    xx1=False,
    xx2=False,
    y1=False,
    y2=False,
    yy1=False,
    yy2=False,
    z1=False,
    z2=False,
    zz1=False,
    zz2=False)
elem1d = Create1DElement(Line=cull_i, Preview3dSection=False)
int = Integer(getgeo.NodesIn_m)
getgeo_2 = GetModelGeometry(GSAModel=model_2, NodeFilterList="All", ElementFilterList="All", MemberFilterList="All", Mode=1, Unit="m")  # -> NodesIn_m, _1DElementsIn_m, _2DElementsIn_m, _3DElementsIn_m, _1DMembersIn_m, _2DMembersIn_m, _3DMembersIn_m
equals = Equality(FirstNumber=int, SecondNumber="5")  # -> Equality, Inequality
explode = Explode(Curve=mem1dedit.Curve, Recursive=True)  # -> Segments, Vertices
model_3 = CreateModel(GSAGeometryIn_m=flatten([elem1d, elem1dedit.Element1D]), ReMesh=True, Tolerance=0.05, Unit="m")
model_4 = CreateModel(GSAGeometryIn_m=flatten([mem1d, mem1dedit.Member1D]), ReMesh=True, Tolerance=0.05, Unit="m")
lng = ListLength(List=getgeo.NodesIn_m)
cull = CullPattern(List=getgeo.NodesIn_m, CullPattern=equals.Equality)
subtraction = Subtraction(A="2", B=1)
nodeedit_2 = EditNode(Node=cull, Mode=1)  # -> Node, NodeNumber, NodePosition, NodeLocalAxis, NodeRestraints, DamperProperty, MassProperty, SpringProperty, NodeName, NodeColour
item_3 = ListItem(List=getgeo_2._2DMembersIn_m, Index=subtraction, Wrap=True)
getgeo_3 = GetModelGeometry(GSAModel=model_3, NodeFilterList="All", ElementFilterList="All", MemberFilterList="All", Mode=1, Unit="m")  # -> NodesIn_m, _1DElementsIn_m, _2DElementsIn_m, _3DElementsIn_m, _1DMembersIn_m, _2DMembersIn_m, _3DMembersIn_m
getgeo_4 = GetModelGeometry(GSAModel=model_4, NodeFilterList="All", ElementFilterList="All", MemberFilterList="All", Mode=1, Unit="m")  # -> NodesIn_m, _1DElementsIn_m, _2DElementsIn_m, _3DElementsIn_m, _1DMembersIn_m, _2DMembersIn_m, _3DMembersIn_m
mem2dedit_2 = Edit2DMember(Member2D=item_3, Preview3dSection=False)  # -> Member2D, MemberNumber, Brep, InclPoints, InclCurves, _2DProperty, MemberGroup, MemberType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
item_4 = ListItem(List=reverse(getgeo_3._1DElementsIn_m), Index=0, Wrap=True)
item_5 = ListItem(List=reverse(getgeo_4._1DMembersIn_m), Index=0, Wrap=True)

# ---- group: Mem2dIds
int_2 = Integer(getgeo_2._2DMembersIn_m)

# ----
pdecon = Deconstruct(Point=nodeedit.NodePosition)  # -> XComponent, YComponent, ZComponent
pdecon_2 = Deconstruct(Point=nodeedit_2.NodePosition)  # -> XComponent, YComponent, ZComponent

# ---- group: NPoints
int_3 = Integer(lng)

# ---- group: FixedId
int_4 = Integer(nodeedit_2.NodeNumber)

# ---- group: Elem1dIds
int_5 = Integer(getgeo_3._1DElementsIn_m)

# ---- group: Mem1dIds
int_6 = Integer(getgeo_4._1DMembersIn_m)

# ----
elem1dedit_2 = Edit1DElement(Element1D=item_4, Preview3dSection=False)  # -> Element1D, Number, Line, Section, Group, Type, Offset, StartRelease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
panel = Panel(int_2)
mem1dedit_2 = Edit1DMember(Member1D=item_5, LengthUnit="Meter", Preview3dSection=False)  # -> Member1D, Member1dNumber, Curve, Section, MemberGroup, MemberType, _1DElementType, Offset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
panel_2 = Panel(int_5)
explode_2 = Explode(Curve=mem2dedit_2.Brep, Recursive=True)  # -> Segments, Vertices
explode_3 = Explode(Curve=mem2dedit.Brep, Recursive=True)  # -> Segments, Vertices
panel_3 = Panel(int_4)
panel_4 = Panel(int_6)
panel_5 = Panel(int_3)
equals_2 = Equality(FirstNumber=pdecon_2.XComponent, SecondNumber=pdecon.XComponent)  # -> Equality, Inequality
equals_3 = Equality(FirstNumber=pdecon_2.YComponent, SecondNumber=pdecon.YComponent)  # -> Equality, Inequality
equals_4 = Equality(FirstNumber=pdecon_2.ZComponent, SecondNumber=pdecon.ZComponent)  # -> Equality, Inequality
explode_4 = Explode(Curve=elem1dedit_2.Line, Recursive=True)  # -> Segments, Vertices
explode_5 = Explode(Curve=elem1dedit.Line, Recursive=True)  # -> Segments, Vertices
pdecon_3 = Deconstruct(Point=explode_3.Vertices)  # -> XComponent, YComponent, ZComponent
pdecon_4 = Deconstruct(Point=explode_2.Vertices)  # -> XComponent, YComponent, ZComponent
explode_6 = Explode(Curve=mem1dedit_2.Curve, Recursive=True)  # -> Segments, Vertices
ma = MassAddition(Input=[equals_2.Inequality, equals_3.Inequality, equals_4.Inequality])  # -> Result, PartialResults
explode_7 = Explode(Curve=mem1dedit.Curve, Recursive=True)  # -> Segments, Vertices
pdecon_5 = Deconstruct(Point=explode_5.Vertices)  # -> XComponent, YComponent, ZComponent
pdecon_6 = Deconstruct(Point=explode_4.Vertices)  # -> XComponent, YComponent, ZComponent
equals_5 = Equality(FirstNumber=ma.Result, SecondNumber="0")  # -> Equality, Inequality
pdecon_7 = Deconstruct(Point=explode_7.Vertices)  # -> XComponent, YComponent, ZComponent
equals_6 = Equality(FirstNumber=pdecon_4.XComponent, SecondNumber=pdecon_3.XComponent)  # -> Equality, Inequality
equals_7 = Equality(FirstNumber=pdecon_4.YComponent, SecondNumber=pdecon_3.YComponent)  # -> Equality, Inequality
pdecon_8 = Deconstruct(Point=explode_6.Vertices)  # -> XComponent, YComponent, ZComponent
equals_8 = Equality(FirstNumber=pdecon_4.ZComponent, SecondNumber=pdecon_3.ZComponent)  # -> Equality, Inequality
equals_9 = Equality(FirstNumber=pdecon_6.XComponent, SecondNumber=pdecon_5.XComponent)  # -> Equality, Inequality
equals_10 = Equality(FirstNumber=pdecon_6.YComponent, SecondNumber=pdecon_5.YComponent)  # -> Equality, Inequality
equals_11 = Equality(FirstNumber=pdecon_6.ZComponent, SecondNumber=pdecon_5.ZComponent)  # -> Equality, Inequality

# ---- group: NodeSame
bool = Boolean(equals_5.Equality)

# ----
ma_2 = MassAddition(Input=[equals_6.Inequality, equals_7.Inequality, equals_8.Inequality])  # -> Result, PartialResults
equals_12 = Equality(FirstNumber=pdecon_8.XComponent, SecondNumber=pdecon_7.XComponent)  # -> Equality, Inequality
equals_13 = Equality(FirstNumber=pdecon_8.YComponent, SecondNumber=pdecon_7.YComponent)  # -> Equality, Inequality
equals_14 = Equality(FirstNumber=pdecon_8.ZComponent, SecondNumber=pdecon_7.ZComponent)  # -> Equality, Inequality
panel_6 = Panel(bool)
ma_3 = MassAddition(Input=[equals_9.Inequality, equals_10.Inequality, equals_11.Inequality])  # -> Result, PartialResults
equals_15 = Equality(FirstNumber=ma_2.Result, SecondNumber="0")  # -> Equality, Inequality
ma_4 = MassAddition(Input=[equals_12.Inequality, equals_13.Inequality, equals_14.Inequality])  # -> Result, PartialResults
equals_16 = Equality(FirstNumber=ma_3.Result, SecondNumber="0")  # -> Equality, Inequality

# ---- group: Mem2dSame
bool_2 = Boolean(equals_15.Equality)

# ----
equals_17 = Equality(FirstNumber=ma_4.Result, SecondNumber="0")  # -> Equality, Inequality

# ---- group: Elem1dSame
bool_3 = Boolean(equals_16.Equality)

# ----
panel_7 = Panel(bool_2)

# ---- group: Mem1dSame
bool_4 = Boolean(equals_17.Equality)

# ----
panel_8 = Panel(bool_3)
panel_9 = Panel(bool_4)
