# Grasshopper definition GetProperties_TrGen_10.gh (Grasshopper 1.0.7)
# plug-ins: GSA, UnitNumber

panel = Panel("https://samples.oasys-software.com/gsa/10.1/Training_General/TrGen_10.gwb")
c_script = CSharpScript(x=panel)  # -> A; inputs x: String
# ---------- c_script: C# ----------
    string fileName = System.IO.Path.GetTempPath();

    //create webclient and download example file:
    System.Net.WebClient webClient = new System.Net.WebClient();
    webClient.DownloadFile(
      x,
      fileName + "Steel_Design_Simple.gwb");

    A = fileName + "Steel_Design_Simple.gwb";
# ---------- end c_script ----------
open = OpenModel(FilenameAndPath=c_script)
getmats = GetModelMaterials(GSAModel=open)  # -> Steel, Concrete, PMat, Aluminium, Timber, Glass, Fabric, Custom
getprops = GetModelProperties(GSAModel=open)  # -> Sections, _2DProperties, _3DProperties
mat = Material([getmats.Steel, getmats.Custom])
sectionedit = EditSection(Section=getprops.Sections)  # -> Section, SectionNumber, SectionProfile, Material, BasicOffset, AddOffsetY_cm, AddOffsetZ_cm, SectionModifier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
prop2dedit = Edit2DProperty(Prop2D=getprops._2DProperties, LengthUnit="Centimeter", ReferenceEdge=0, SupportType=0)  # -> Prop2D, Prop2dNumber, Prop2dName, Prop2dColour, Axis, Type, Material, Thickness_cm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
getgeo = GetModelGeometry(GSAModel=open, NodeFilterList="All", ElementFilterList="All", MemberFilterList="All", Mode=1, Unit="m")  # -> NodesIn_m, _1DElementsIn_m, _2DElementsIn_m, _3DElementsIn_m, _1DMembersIn_m, _2DMembersIn_m, _3DMembersIn_m
pbm = SectionModifier(sectionedit.SectionModifier)
split = SplitList(List=prop2dedit.Axis, Index="1")  # -> ListA, ListB
materialedit = EditMaterial(Material=sectionedit.Material)  # -> Material, MaterialID, MaterialName, CustomMaterial, MaterialType
materialedit_2 = EditMaterial(Material=mat)  # -> Material, MaterialID, MaterialName, CustomMaterial, MaterialType
materialedit_3 = EditMaterial(Material=prop2dedit.Material)  # -> Material, MaterialID, MaterialName, CustomMaterial, MaterialType
filterunique = FilterUnique(A=materialedit.Material, K=materialedit.MaterialID)
filterunique_2 = FilterUnique(A=materialedit.MaterialType, K=materialedit.MaterialID)
filterunique_3 = FilterUnique(A=materialedit_3.Material, K=materialedit_3.MaterialID)
mem2dedit = Edit2DMember(Member2D=getgeo._2DMembersIn_m, Preview3dSection=False)  # -> Member2D, MemberNumber, Brep, InclPoints, InclCurves, _2DProperty, MemberGroup, MemberType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
mem1dedit = Edit1DMember(Member1D=getgeo._1DMembersIn_m, LengthUnit="Meter", Preview3dSection=False)  # -> Member1D, Member1dNumber, Curve, Section, MemberGroup, MemberType, _1DElementType, Offset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
elem2dedit = Edit2DElement(Element2D=getgeo._2DElementsIn_m, Preview3dSection=False)  # -> Element2D, Number, AnalysisMesh, _2DProperty, Group, ElementType, Offset, OrientationAngle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
elem1dedit = Edit1DElement(Element1D=getgeo._1DElementsIn_m, Preview3dSection=False)  # -> Element1D, Number, Line, Section, Group, Type, Offset, StartRelease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
matprop = MaterialProperties(Material=filterunique_3, DensityUnit="KilogramPerCubicMeter", StressUnit="Megapascal", TemperatureUnit="DegreeCelsius")  # -> ElasticModulus_MPa, PoissonsRatio, Density_kg_m³, ThermalExpansion_C_¹
un = UnitNumber(prop2dedit.Thickness_cm)
matprop_2 = MaterialProperties(Material=filterunique, DensityUnit="KilogramPerCubicMeter", StressUnit="Megapascal", TemperatureUnit="DegreeCelsius")  # -> ElasticModulus_MPa, PoissonsRatio, Density_kg_m³, ThermalExpansion_C_¹
deplane = DeconstructPlane(Plane=split.ListB)  # -> Origin, XAxis, YAxis, ZAxis
dcon = DeleteConsecutive(Set=sectionedit.SectionPool, Wrap=False)  # -> Set, Count
sectionedit_2 = EditSection(Section=elem1dedit.Section)  # -> Section, SectionNumber, SectionProfile, Material, BasicOffset, AddOffsetY_cm, AddOffsetZ_cm, SectionModifier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
sectionedit_3 = EditSection(Section=mem1dedit.Section)  # -> Section, SectionNumber, SectionProfile, Material, BasicOffset, AddOffsetY_cm, AddOffsetZ_cm, SectionModifier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
prop2dedit_2 = Edit2DProperty(Prop2D=flatten(mem2dedit._2DProperty), LengthUnit="Centimeter", ReferenceEdge=0, SupportType=0)  # -> Prop2D, Prop2dNumber, Prop2dName, Prop2dColour, Axis, Type, Material, Thickness_cm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
prop2dedit_3 = Edit2DProperty(Prop2D=flatten(elem2dedit._2DProperty), LengthUnit="Centimeter", ReferenceEdge=0, SupportType=0)  # -> Prop2D, Prop2dNumber, Prop2dName, Prop2dColour, Axis, Type, Material, Thickness_cm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
matprop_3 = MaterialProperties(
    Material=materialedit_2.Material,
    DensityUnit="KilogramPerCubicMeter",
    StressUnit="Megapascal",
    TemperatureUnit="DegreeCelsius")  # -> ElasticModulus_MPa, PoissonsRatio, Density_kg_m³, ThermalExpansion_C_¹
pdecon = Deconstruct(Point=deplane.Origin)  # -> XComponent, YComponent, ZComponent
pdecon_2 = Deconstruct(Point=deplane.ZAxis)  # -> XComponent, YComponent, ZComponent
filterunique_4 = FilterUnique(A=sectionedit_2.Section, K=sectionedit_2.SectionNumber)
filterunique_5 = FilterUnique(A=sectionedit_3.Section, K=sectionedit_3.SectionNumber)
filterunique_6 = FilterUnique(A=prop2dedit_3.Prop2D, K=prop2dedit_3.Prop2dNumber)

# ---- group: MatPoissons
num = Number(matprop_3.PoissonsRatio)

# ---- group: MatEs
num_2 = Number(matprop_3.ElasticModulus_MPa)

# ---- group: MatIds
int = Integer(materialedit_2.MaterialID)

# ---- group: PBs
pb = Section(sectionedit.Section)

# ---- group: MatRos
num_3 = Number(matprop_3.Density_kg_m³)

# ---- group: MatAlphas
num_4 = Number(matprop_3.ThermalExpansion_C_¹)

# ----
filterunique_7 = FilterUnique(A=prop2dedit_2.Prop2D, K=prop2dedit_2.Prop2dNumber)

# ---- group: PbIds
int_2 = Integer(sectionedit.SectionNumber)

# ---- group: Profiles
txt = Text(sectionedit.SectionProfile)

# ---- group: PbE
num_5 = Number(matprop_2.ElasticModulus_MPa)

# ---- group: PbPoisson
num_6 = Number(matprop_2.PoissonsRatio)

# ---- group: PbDensity
num_7 = Number(matprop_2.Density_kg_m³)

# ---- group: PbThermal
num_8 = Number(matprop_2.ThermalExpansion_C_¹)

# ---- group: MatType
txt_2 = Text(filterunique_2)

# ---- group: Pool
int_3 = Integer(dcon.Set)

# ---- group: PbName
txt_3 = Text(sectionedit.SectionName)

# ---- group: PAs
pa = Prop2D(prop2dedit.Prop2D)

# ---- group: PaIds
int_4 = Integer(prop2dedit.Prop2dNumber)

# ---- group: PaPoisson
num_9 = Number(matprop.PoissonsRatio)

# ---- group: PaDensity
num_10 = Number(matprop.Density_kg_m³)

# ---- group: PaThermal
num_11 = Number(matprop.ThermalExpansion_C_¹)

# ---- group: PaE
num_12 = Number(matprop.ElasticModulus_MPa)

# ---- group: PaAxis
int_5 = Integer(split.ListA)

# ---- group: PaName
txt_4 = Text(prop2dedit.Prop2dName)

# ---- group: PaType
txt_5 = Text(prop2dedit.Type)

# ---- group: PaAxOX
num_13 = Number(pdecon.XComponent)

# ---- group: PaAxOY
num_14 = Number(pdecon.YComponent)

# ---- group: PaAxOZ
num_15 = Number(pdecon.ZComponent)

# ---- group: PaAxZX
num_16 = Number(pdecon_2.XComponent)

# ---- group: PaAxZY
num_17 = Number(pdecon_2.YComponent)

# ---- group: PaAxZZ
num_18 = Number(pdecon_2.ZComponent)

# ---- group: Thickness
num_19 = Number(un)

# ---- group: SupportType
txt_6 = Text(prop2dedit.SupportType)

# ---- group: ReferenceEdge
int_6 = Integer(prop2dedit.ReferenceEdge)

# ---- group: PBsFromElem
pb_2 = Section(filterunique_4)

# ---- group: PBsFromMem
pb_3 = Section(filterunique_5)

# ---- group: PAsFromElem
pa_2 = Prop2D(filterunique_6)

# ---- group: PAsFromMem
pa_3 = Prop2D(filterunique_7)

# ----
panel_2 = Panel(int_2)
panel_3 = Panel(int)
panel_4 = Panel(num_2)
panel_5 = Panel(txt)
panel_6 = Panel(num_5)
panel_7 = Panel(num_6)
panel_8 = Panel(int_3)
panel_9 = Panel(txt_3)
panel_10 = Panel(num)
panel_11 = Panel(num_7)
panel_12 = Panel(num_3)
panel_13 = Panel(num_4)
panel_14 = Panel(num_8)
panel_15 = Panel(int_4)
panel_16 = Panel(txt_2)
panel_17 = Panel(num_12)
panel_18 = Panel(num_9)
panel_19 = Panel(num_10)
panel_20 = Panel(txt_6)
panel_21 = Panel(int_6)
panel_22 = Panel(num_11)
panel_23 = Panel(num_19)
panel_24 = Panel(txt_4)
panel_25 = Panel(txt_5)
panel_26 = Panel(int_5)

# ==== cluster FilterUnique
A = ClusterInput()
K = ClusterInput()
sort = SortList(Keys=K, ValuesA=A)  # -> Keys, ValuesA
dcon = DeleteConsecutive(Set=sort.Keys, Wrap=False)  # -> Set, Count
fsim = FindSimilarMember(Data=dcon.Set, Set=sort.Keys)  # -> Hit, Index
item = ListItem(List=sort.ValuesA, Index=fsim.Index, Wrap=True)
i = ClusterOutput(item)
