# Grasshopper definition GsaList_0-Basics.gh (Grasshopper 1.0.7)
# Copyright: Arup
# plug-ins: GSA

pt = ConstructPoint(XCoordinate=0, YCoordinate=0, ZCoordinate=0)
pt_2 = ConstructPoint(XCoordinate="10", YCoordinate=0, ZCoordinate=0)
pt_3 = ConstructPoint(XCoordinate="10", YCoordinate="10", ZCoordinate=0)
pt_4 = ConstructPoint(XCoordinate=0, YCoordinate="10", ZCoordinate=0)
mplane = MeshPlane(Boundary={Plane=PlaneXY(0, 0, 0), Size=Domain2(u=-10..10, v=-10..10)}, WidthCount=10, HeightCount=10)  # -> Mesh, Area
pt_5 = ConstructPoint(XCoordinate=0, YCoordinate=0, ZCoordinate=0)
srf4pt = _4PointSurface(CornerA=pt, CornerB=pt_2, CornerC=pt_3, CornerD=pt_4)
series = Series(Start="1", Step=1, Count=10)
elem2d = Create2DElement(Mesh=mplane.Mesh)
mem2d = Create2DMember(Brep=srf4pt, InternalOffset=False)
support = CreateSupport(Point=pt_5, Plane=PlaneXY(0, 0, 0), x=False, xx=False, y=False, yy=False, z=False, zz=False)
createlist = CreateList(Index=0, Definition=series, Type="Case")
createlist_2 = CreateList(Index=0, Definition=mem2d, Type="Member")
createlist_3 = CreateList(Index=0, Definition=elem2d, Type="Element")
createlist_4 = CreateList(Index=0, Definition=support, Type="Node")
model = CreateModel(ModelSAndLists=createlist_3, GSAGeometryIn_m=elem2d, ReMesh=False, Tolerance=0.01, Unit="m")
model_2 = CreateModel(ModelSAndLists=createlist, ReMesh=False, Tolerance=0.01, Unit="m")
model_3 = CreateModel(ModelSAndLists=createlist_2, GSAGeometryIn_m=mem2d, ReMesh=False, Tolerance=0.01, Unit="m")
model_4 = CreateModel(ModelSAndLists=createlist_4, GSAGeometryIn_m=support, ReMesh=False, Tolerance=0.01, Unit="m")
getlists = GetModelLists(GSAModel=model)
getlists_2 = GetModelLists(GSAModel=model_3)
getlists_3 = GetModelLists(GSAModel=model_4)
getlists_4 = GetModelLists(GSAModel=model_2)
listinfo = ListInfo(List=getlists_2, Unit="m")  # -> Index, Name, Type, Definition, ListObjects_m
listinfo_2 = ListInfo(List=getlists_4, Unit="m")  # -> Index, Name, Type, Definition, ListObjects_m
listinfo_3 = ListInfo(List=getlists, Unit="m")  # -> Index, Name, Type, Definition, ListObjects_m
listinfo_4 = ListInfo(List=getlists_3, Unit="m")  # -> Index, Name, Type, Definition, ListObjects_m
panel = Panel(listinfo_2.Index)
panel_2 = Panel(listinfo_2.Name)
panel_3 = Panel(listinfo_2.Type)
panel_4 = Panel(listinfo_2.Definition)
panel_5 = Panel(listinfo_2.ListObjects_m)
panel_6 = Panel(listinfo.Index)
panel_7 = Panel(listinfo.Name)
panel_8 = Panel(listinfo.Type)
panel_9 = Panel(listinfo.Definition)
panel_10 = Panel(listinfo.ListObjects_m)
panel_11 = Panel(listinfo_3.Index)
panel_12 = Panel(listinfo_3.Name)
panel_13 = Panel(listinfo_3.Type)
panel_14 = Panel(listinfo_3.Definition)
panel_15 = Panel(listinfo_3.ListObjects_m)
panel_16 = Panel(listinfo_4.Index)
panel_17 = Panel(listinfo_4.Name)
panel_18 = Panel(listinfo_4.Type)
panel_19 = Panel(listinfo_4.Definition)
panel_20 = Panel(listinfo_4.ListObjects_m)
