# Grasshopper definition GsaList_Elements.gh (Grasshopper 1.0.7)
# Copyright: Arup
# plug-ins: GSA

size = Slider(2, range=0..100)
movefact = Slider(0.5, range=0.1..0.9)
profile = CreateProfile(
    catalogueIndex=3,
    lengthUnit="Centimeter",
    mode="Catalogue",
    Profile_type="Catalogue",
    Catalogue="Europrofile",
    Type="EP HE beams",
    Profile="HE HE600.B",
    typeIndex=27)
pt = ConstructPoint(XCoordinate=0, YCoordinate=0, ZCoordinate=0)
pt_2 = ConstructPoint(XCoordinate=0, YCoordinate=0, ZCoordinate="7")
pt_3 = ConstructPoint(XCoordinate=0, YCoordinate="10", ZCoordinate="7")
pt_4 = ConstructPoint(XCoordinate=0, YCoordinate="10", ZCoordinate=0)
material = CustomMaterial(E="210000", ν="0.3", ρ="7850", Material_Type="Timber", Stress_Unit="MPa", Density_Unit="kg/m³", Temperature_Unit="°C")
pt_5 = ConstructPoint(XCoordinate="4", YCoordinate=0, ZCoordinate=0)
material_2 = CustomMaterial(E="18000", ν="0.3", ρ="2500", Material_Type="Timber", Stress_Unit="MPa", Density_Unit="kg/m³", Temperature_Unit="°C")
pt_6 = ConstructPoint(XCoordinate="4", YCoordinate="7", ZCoordinate=0)
multiplication = Multiplication(A=size, B=movefact)
pt_7 = ConstructPoint(XCoordinate=0, YCoordinate=0, ZCoordinate=0)
pt_8 = ConstructPoint(XCoordinate=size, YCoordinate=size, ZCoordinate=size)
rectangle = Rectangle(Plane=pt_5, XSize="9", YSize="7", Radius=0)  # -> Rectangle, Length
rectangle_2 = Rectangle(Plane=pt_6, XSize="9", YSize="2", Radius=0)  # -> Rectangle, Length
addition = Addition(A="9", B=1)
vec = VectorXYZ(XComponent=multiplication, YComponent=multiplication, ZComponent=multiplication)  # -> Vector, Length
section = CreateSection(Profile=profile, Material=material, Basic_Offset="Centroid")
box = Box2Pt(PointA=pt_7, PointB=pt_8, Plane=PlaneXY(0, 0, 0))
support = CreateSupport(Point=[pt, pt_4], Plane=PlaneXY(0, 0, 0), x=True, xx=True, y=True, yy=True, z=True, zz=True)
ln = Line(StartPoint=pt, EndPoint=pt_2)
ln_2 = Line(StartPoint=pt_2, EndPoint=pt_3)
ln_3 = Line(StartPoint=pt_3, EndPoint=pt_4)
series = Series(Start="4", Step=1, Count=addition)
mplane = MeshPlane(Boundary=rectangle.Rectangle, WidthCount="9", HeightCount="7")  # -> Mesh, Area
prop2d = Create2DProperty(Thickness_cm="25", Material=material_2, Type="Shell", Unit="cm")
mplane_2 = MeshPlane(Boundary=rectangle_2.Rectangle, WidthCount="9", HeightCount="2")  # -> Mesh, Area
move = Move(Geometry=box, Motion=vec.Vector)  # -> Geometry, Transform
pt_9 = ConstructPoint(XCoordinate=series, YCoordinate=0, ZCoordinate=0)
box_corners = BoxCorners(Box=box)  # -> CornerA, CornerB, CornerC, CornerD, CornerE, CornerF, CornerG, CornerH
sunion = SolidUnion(Breps=[box, move.Geometry])
elem2d = Create2DElement(Mesh=mplane.Mesh, Prop2D=prop2d, Preview3dSection=False)
support_2 = CreateSupport(Point=pt_9, Plane=PlaneXY(0, 0, 0), x=True, xx=True, y=True, yy=True, z=True, zz=True)
elem2d_2 = Create2DElement(Mesh=mplane_2.Mesh, Prop2D=prop2d, Preview3dSection=False)
elem1d = Create1DElement(Line=ln_2, Property=section, Preview3dSection=False)
elem1d_2 = Create1DElement(Line=[ln, ln_3], Property=section, Preview3dSection=False)
support_3 = CreateSupport(
    Point=[box_corners.CornerA, box_corners.CornerB, box_corners.CornerC, box_corners.CornerD],
    Plane=PlaneXY(0, 0, 0),
    x=True,
    xx=False,
    y=True,
    yy=False,
    z=True,
    zz=False)
mem3d = Create3DMember(Solid=sunion, Prop3D=material_2)
createlist = CreateList(Index=0, Definition=elem2d, Type="Element")
elemfrommem = CreateElementsFromMembers(_3DMembers_m=mem3d, Tolerance=0.01, Unit="m")  # -> Nodes, _1DElements, _2DElements, _3DElements, GSAModel
createlist_2 = CreateList(Index=0, Name="Slab edge", Definition=elem2d_2, Type="Element")
createlist_3 = CreateList(Index=0, Name="Columns", Definition=elem1d_2, Type="Element")
createlist_4 = CreateList(Index=0, Definition=elem1d, Type="Element")
createlist_5 = CreateList(Index=0, Name="E3d list", Definition=elemfrommem._3DElements, Type="Element")
faceload = CreateFaceLoad(
    LoadCase=1,
    ElementList=createlist_2,
    Axis=-1,
    Direction="z",
    Projected=False,
    Value_kN_m²="-5",
    Type="Uniform",
    Unit="kN/m²")
beamload = CreateBeamLoad(
    LoadCase=1,
    ElementList=createlist_3,
    Axis=0,
    Direction="y",
    Projected=False,
    Value_kN_m="5",
    Type="Uniform",
    Unit="kN/m")
gravityload = CreateGravityLoad(LoadableObjects=createlist_5, GravityFactor=Vector(0, 0, -1))
analyse = AnalyseModel(
    ModelSAndLists=createlist,
    GSAGeometryIn_m=flatten([support_2, elem2d, elem2d_2]),
    Load=faceload,
    Analyse=True,
    ReMesh=True,
    Tolerance=0.01,
    Unit="m")  # -> Model, Errors, Warnings, Remarks, Log
analyse_2 = AnalyseModel(
    ModelSAndLists=createlist_4,
    GSAGeometryIn_m=[support, elem1d_2, elem1d],
    Load=beamload,
    Analyse=True,
    ReMesh=True,
    Tolerance=0.01,
    Unit="m")  # -> Model, Errors, Warnings, Remarks, Log
analyse_3 = AnalyseModel(
    GSAGeometryIn_m=[support_3, elemfrommem._3DElements],
    Load=gravityload,
    Analyse=True,
    ReMesh=True,
    Tolerance=0.01,
    Unit="m")  # -> Model, Errors, Warnings, Remarks, Log

# ---- group: Warning
model = CreateModel(ModelSListsAndGridLines=[createlist_4, createlist, createlist_5], ReMesh=True, Tolerance=0.01, Unit="m")

# ----
selres = SelectResults(GSAModel=analyse.Model, Type="AnalysisCase", Case_ID="A1")
getlists = GetModelLists(GSAModel=analyse.Model)
getlists_2 = GetModelLists(GSAModel=analyse_3.Model)
selres_2 = SelectResults(GSAModel=analyse_3.Model, Type="AnalysisCase", Case_ID="A1")
item = ListItem(List=getlists, Index=0, Wrap=True)  # -> Item, Item1
contourelem2d = _2DContourResults(
    Result=selres,
    ElementFilterList=createlist_2,
    Display=3,
    Mode=0,
    envelope="Absolute",
    flayer=0,
    force="kN/m",
    legend=True,
    legendScale=1,
    length="mm",
    model="m",
    moment="kN",
    noDec=0,
    Result_Type="Displacement",
    Component="Resolved |U|",
    slider=True,
    stress="MPa",
    val=10,
    valMax=1000,
    valMin=0)  # -> M, Colours, Values_mm
getlists_3 = GetModelLists(GSAModel=analyse_2.Model)
selres_3 = SelectResults(GSAModel=analyse_2.Model, Type="AnalysisCase", Case_ID="A1")
getgeo = GetModelGeometry(GSAModel=analyse_2.Model, Mode=1, Unit="m")  # -> NodesIn_m, _1DElementsIn_m, _2DElementsIn_m, _3DElementsIn_m, _1DMembersIn_m, _2DMembersIn_m, _3DMembersIn_m
listinfo = ListInfo(List=getlists_2, Unit="m")  # -> Index, Name, Type, Definition, ListObjectsIn_m, ExpandList
contour3d = Contour3DResults(
    Result=selres_2,
    ElementMemberFilterList=createlist_5,
    Display=3,
    Mode=0,
    envelope="Absolute",
    legend=True,
    legendScale=1,
    length="mm",
    noDec=0,
    Result_Type="Displacement",
    Component="Resolved |U|",
    slider=True,
    stress="MPa",
    val=250,
    valMax=1000,
    valMin=0)  # -> NgonMesh, Colours, Values_mm
item_2 = ListItem(List=getlists_3, Index=0, Wrap=True)  # -> Item, Item1
listinfo_2 = ListInfo(List=item.Item1, Unit="m")  # -> Index, Name, Type, Definition, ListObjectsIn_m, ExpandList
listinfo_3 = ListInfo(List=item.Item, Unit="m")  # -> Index, Name, Type, Definition, ListObjectsIn_m, ExpandList
L = List(getgeo._1DElementsIn_m)
demesh = DeconstructMesh(Mesh=listinfo.ListObjectsIn_m)  # -> Vertices, Faces, Colours, Normals
an = Annotate(NodeElementMemberLoadResultDiagram=contour3d.NgonMesh)  # -> Annotations, Position, Text
an_2 = Annotate(NodeElementMemberLoadResultDiagram=contourelem2d.M)  # -> Annotations, Position, Text
contour1d = Contour1DResults(
    Result=selres_3,
    ElementMemberFilterList=createlist_3,
    IntermediatePoints=10,
    Scale=10,
    Display=3,
    Mode=0,
    energy="MJ",
    envelope="Absolute",
    force="kN",
    legend=True,
    legendScale=1,
    length="mm",
    moment="kN·m",
    noDec=0,
    Result_Type="Displacement",
    Component="Resolved |U|",
    slider=True,
    stress="MPa",
    val=250,
    valMax=1000,
    valMin=0)  # -> L, Colours, Values_mm
contour1d_2 = Contour1DResults(
    Result=selres_3,
    ElementMemberFilterList=getgeo._1DElementsIn_m,
    IntermediatePoints=10,
    Scale=10,
    Display=3,
    Mode=0,
    energy="MJ",
    envelope="Absolute",
    force="kN",
    legend=True,
    legendScale=1,
    length="mm",
    moment="kN·m",
    noDec=0,
    Result_Type="Displacement",
    Component="Resolved |U|",
    slider=True,
    stress="MPa",
    val=250,
    valMax=1000,
    valMin=0)  # -> L, Colours, Values_mm
contour1d_3 = Contour1DResults(
    Result=selres_3,
    ElementMemberFilterList=L,
    IntermediatePoints=10,
    Scale=10,
    Display=3,
    Mode=0,
    energy="MJ",
    envelope="Absolute",
    force="kN",
    legend=True,
    legendScale=1,
    length="mm",
    moment="kN·m",
    noDec=0,
    Result_Type="Displacement",
    Component="Resolved |U|",
    slider=True,
    stress="MPa",
    val=250,
    valMax=1000,
    valMin=0)  # -> L, Colours, Values_mm
listinfo_4 = ListInfo(List=item_2.Item1, Unit="m")  # -> Index, Name, Type, Definition, ListObjectsIn_m, ExpandList
listinfo_5 = ListInfo(List=item_2.Item, Unit="m")  # -> Index, Name, Type, Definition, ListObjectsIn_m, ExpandList
lng = ListLength(List=demesh.Vertices)
lng_2 = ListLength(List=demesh.Faces)
panel = Panel(listinfo_3.Index)
panel_2 = Panel(listinfo_3.Name)
panel_3 = Panel(listinfo_3.Type)
panel_4 = Panel(listinfo_2.Index)
panel_5 = Panel(listinfo_2.Name)
panel_6 = Panel(listinfo_2.Type)
panel_7 = Panel(listinfo_2.ListObjectsIn_m)
panel_8 = Panel(listinfo_3.Definition)
panel_9 = Panel(listinfo_3.ListObjectsIn_m)
panel_10 = Panel(listinfo_2.Definition)
sort = SortList(Keys=listinfo.ExpandList)  # -> Keys, ValuesA
sort_2 = SortList(Keys=an.Text)  # -> Keys, ValuesA
sort_3 = SortList(Keys=listinfo_2.ExpandList)  # -> Keys, ValuesA
sort_4 = SortList(Keys=an_2.Text)  # -> Keys, ValuesA

# ---- group: Test7Verticies
int = Integer(lng)

# ---- group: Test7Faces
int_2 = Integer(lng_2)

# ----
listinfo_6 = ListInfo(List=L, Unit="m")  # -> Index, Name, Type, Definition, ListObjectsIn_m, flatten(ExpandList)
A = Annotate(NodeElementMemberLoadResultDiagram=contour1d.L)  # -> Annotations, Position, Text
A_2 = Annotate(NodeElementMemberLoadResultDiagram=contour1d_2.L)  # -> Annotations, Position, Text
A_3 = Annotate(NodeElementMemberLoadResultDiagram=contour1d_3.L)  # -> Annotations, Position, Text
panel_11 = Panel(listinfo_5.Index)
panel_12 = Panel(listinfo_5.Name)
panel_13 = Panel(listinfo_5.Type)
panel_14 = Panel(listinfo_4.Index)
panel_15 = Panel(listinfo_4.Name)
panel_16 = Panel(listinfo_4.Type)
panel_17 = Panel(listinfo_4.ListObjectsIn_m)
panel_18 = Panel(listinfo_5.Definition)
panel_19 = Panel(listinfo_5.ListObjectsIn_m)
panel_20 = Panel(listinfo_4.Definition)
equals = Equality(FirstNumber=sort.Keys, SecondNumber=sort_2.Keys)  # -> Equality, Inequality
equals_2 = Equality(FirstNumber=sort_3.Keys, SecondNumber=sort_4.Keys)  # -> Equality, Inequality
demesh_2 = DeconstructMesh(Mesh=listinfo_3.ListObjectsIn_m)  # -> Vertices, Faces, Colours, Normals
demesh_3 = DeconstructMesh(Mesh=listinfo_2.ListObjectsIn_m)  # -> Vertices, Faces, Colours, Normals
dcon = DeleteConsecutive(Set=A.Text, Wrap=False)  # -> Set, Count
dcon_2 = DeleteConsecutive(Set=A_2.Text, Wrap=False)  # -> Set, Count
dcon_3 = DeleteConsecutive(Set=A_3.Text, Wrap=False)  # -> Set, Count
ma = MassAddition(Input=equals.Inequality)  # -> Result, PartialResults
int_3 = Integer(listinfo_4.ExpandList)
int_4 = Integer(listinfo_6.ExpandList)
int_5 = Integer(listinfo_6.ExpandList)
ma_2 = MassAddition(Input=equals_2.Inequality)  # -> Result, PartialResults
lng_3 = ListLength(List=demesh_2.Vertices)
lng_4 = ListLength(List=demesh_2.Faces)
lng_5 = ListLength(List=demesh_3.Vertices)
lng_6 = ListLength(List=demesh_3.Faces)
bang = ExplodeTree(Data=dcon.Set)  # -> Branch0, Branch1
end = EndPoints(Curve=listinfo_4.ListObjectsIn_m)  # -> Start, End
end_2 = EndPoints(Curve=listinfo_5.ListObjectsIn_m)  # -> Start, End

# ---- group: Test8IdsAreEqual
int_6 = Integer(ma.Result)

# ---- group: Test6IdsAreEqual
int_7 = Integer(ma_2.Result)

# ----
bang_2 = ExplodeTree(Data=dcon_2.Set)  # -> Branch0, Branch1, Branch2
bang_3 = ExplodeTree(Data=dcon_3.Set)  # -> Branch0, Branch1, Branch2
item_3 = ListItem(List=int_5, Index=0, Wrap=True)  # -> Item, Item1, Item2
item_4 = ListItem(List=int_4, Index=0, Wrap=True)  # -> Item, Item1, Item2
item_5 = ListItem(List=int_3, Index=0, Wrap=True)  # -> Item, Item1

# ---- group: Test4Vertices
int_8 = Integer(lng_3)

# ---- group: Test4Faces
int_9 = Integer(lng_4)

# ---- group: Test5Vertices
int_10 = Integer(lng_5)

# ---- group: Test5Faces
int_11 = Integer(lng_6)

# ----
pdecon = Deconstruct(Point=end.Start)  # -> XComponent, YComponent, ZComponent
pdecon_2 = Deconstruct(Point=end_2.Start)  # -> XComponent, YComponent, ZComponent
pdecon_3 = Deconstruct(Point=end.End)  # -> XComponent, YComponent, ZComponent
pdecon_4 = Deconstruct(Point=end_2.End)  # -> XComponent, YComponent, ZComponent
equals_3 = Equality(FirstNumber=item_5.Item, SecondNumber=bang.Branch0)  # -> Equality, Inequality
equals_4 = Equality(FirstNumber=item_5.Item1, SecondNumber=bang.Branch1)  # -> Equality, Inequality
equals_5 = Equality(FirstNumber=item_3.Item, SecondNumber=bang_2.Branch0)  # -> Equality, Inequality
equals_6 = Equality(FirstNumber=item_3.Item1, SecondNumber=bang_2.Branch1)  # -> Equality, Inequality
equals_7 = Equality(FirstNumber=item_3.Item2, SecondNumber=bang_2.Branch2)  # -> Equality, Inequality
equals_8 = Equality(FirstNumber=item_4.Item, SecondNumber=bang_3.Branch0)  # -> Equality, Inequality
equals_9 = Equality(FirstNumber=item_4.Item1, SecondNumber=bang_3.Branch1)  # -> Equality, Inequality
equals_10 = Equality(FirstNumber=item_4.Item2, SecondNumber=bang_3.Branch2)  # -> Equality, Inequality

# ---- group: Test2StartZs
num = Number(pdecon.ZComponent)

# ---- group: Test1StartZs
num_2 = Number(pdecon_2.ZComponent)

# ---- group: Test2StartYs
num_3 = Number(pdecon.YComponent)

# ---- group: Test1StartYs
num_4 = Number(pdecon_2.YComponent)

# ---- group: Test2EndZs
num_5 = Number(pdecon_3.YComponent)

# ---- group: Test1EndZs
num_6 = Number(pdecon_4.YComponent)

# ---- group: Test2EndYs
num_7 = Number(pdecon_3.XComponent)

# ---- group: Test1EndYs
num_8 = Number(pdecon_4.XComponent)

# ---- group: Test3Result1
bool = Boolean(equals_3.Equality)

# ---- group: Test9Result1
bool_2 = Boolean(equals_5.Equality)

# ---- group: Test3Result2
bool_3 = Boolean(equals_4.Equality)

# ---- group: Test9Result2
bool_4 = Boolean(equals_6.Equality)

# ---- group: Test10Result1
bool_5 = Boolean(equals_8.Equality)

# ---- group: Test9Result3
bool_6 = Boolean(equals_7.Equality)

# ---- group: Test10Result2
bool_7 = Boolean(equals_9.Equality)

# ---- group: Test10Result3
bool_8 = Boolean(equals_10.Equality)
