# Grasshopper definition GsaList_ElementsFromMembers.gh (Grasshopper 1.0.7)
# Copyright: Arup
# plug-ins: GSA

pt = ConstructPoint(XCoordinate="20", YCoordinate=0, ZCoordinate=0)
pt_2 = ConstructPoint(XCoordinate="35", YCoordinate="15", ZCoordinate=0)
pt_3 = ConstructPoint(XCoordinate=0, YCoordinate=0, ZCoordinate=0)
pt_4 = ConstructPoint(XCoordinate="15", YCoordinate="15", ZCoordinate=0)
pt_5 = ConstructPoint(XCoordinate="20", YCoordinate="15", ZCoordinate=0)
pt_6 = ConstructPoint(XCoordinate="35", YCoordinate=0, ZCoordinate=0)
pt_7 = ConstructPoint(XCoordinate=0, YCoordinate="15", ZCoordinate=0)
pt_8 = ConstructPoint(XCoordinate="15", YCoordinate=0, ZCoordinate=0)
material = CustomMaterial(E="18000", ν="0.3", ρ="2500", Material_Type="Timber", Stress_Unit="MPa", Density_Unit="kg/m³", Temperature_Unit="°C")
material_2 = CustomMaterial(E="18000", ν="0.3", ρ="2500", Material_Type="Timber", Stress_Unit="MPa", Density_Unit="kg/m³", Temperature_Unit="°C")
srf4pt = _4PointSurface(CornerA=pt, CornerB=pt_5, CornerC=pt_2, CornerD=pt_6)
srf4pt_2 = _4PointSurface(CornerA=pt_3, CornerB=pt_7, CornerC=pt_4, CornerD=pt_8)
neg = Negative(Value="3.5")
neg_2 = Negative(Value="2.5")
area = Area(Geometry=srf4pt)  # -> Area, Centroid
area_2 = Area(Geometry=srf4pt_2)  # -> Area, Centroid
dom = ConstructDomain(DomainStart=neg, DomainEnd="3.5")
dom_2 = ConstructDomain(DomainStart=neg_2, DomainEnd="2.5")
prop2d = Create2DProperty(Thickness_cm="25", Material=material, Type="Shell", Unit="cm")
prop2d_2 = Create2DProperty(Thickness_cm="25", Material=material_2, Type="Shell", Unit="cm")
rectangle = Rectangle(Plane=area.Centroid, XSize=dom, YSize=dom, Radius=0)  # -> Rectangle, Length
rectangle_2 = Rectangle(Plane=area_2.Centroid, XSize=dom_2, YSize=dom_2, Radius=0)  # -> Rectangle, Length
support = CreateSupport(
    Point=[pt, pt_5, pt_2, pt_6, area.Centroid],
    Plane=PlaneXY(0, 0, 0),
    x=True,
    xx=False,
    y=True,
    yy=False,
    z=True,
    zz=False)
support_2 = CreateSupport(
    Point=[pt_3, pt_7, pt_4, pt_8, area_2.Centroid],
    Plane=PlaneXY(0, 0, 0),
    x=True,
    xx=False,
    y=True,
    yy=False,
    z=True,
    zz=False)
mem2d = Create2DMember(
    Brep=rectangle_2.Rectangle,
    InclPoints=area_2.Centroid,
    Property2D=prop2d,
    InternalOffset=True,
    Preview3dSection=False,
    Mesh_mode="Quad dominant")
mem2d_2 = Create2DMember(Brep=srf4pt_2, Property2D=prop2d, InternalOffset=True, Preview3dSection=False, Mesh_mode="Quad dominant")
mem2d_3 = Create2DMember(Brep=srf4pt, Property2D=prop2d_2, InternalOffset=True, Preview3dSection=False, Mesh_mode="Quad dominant")
mem2d_4 = Create2DMember(
    Brep=rectangle.Rectangle,
    InclPoints=area.Centroid,
    Property2D=prop2d_2,
    InternalOffset=True,
    Preview3dSection=False,
    Mesh_mode="Quad dominant")
createlist = CreateList(Index=0, Name="Punching zone", Definition=mem2d_4, Type="Member")
createlist_2 = CreateList(Index=0, Name="Punching zone", Definition=mem2d, Type="Element")
faceload = CreateFaceLoad(
    LoadCase=1,
    ElementList=createlist,
    Axis=-1,
    Direction="z",
    Projected=False,
    Value_kN_m²="-5",
    Type="Uniform",
    Unit="kN/m²")
gravityload = CreateGravityLoad(LoadCase=null, GravityFactor=Vector(0, 0, -1))
analyse = AnalyseModel(GSAGeometryIn_m=[mem2d_3, mem2d_4, support], Load=faceload, Analyse=True, ReMesh=True, Tolerance=0.01, Unit="m")  # -> Model, Report
analyse_2 = AnalyseModel(
    ModelSAndLists=createlist_2,
    GSAGeometryIn_m=[mem2d_2, mem2d, support_2],
    Load=gravityload,
    Analyse=True,
    ReMesh=True,
    Tolerance=0.01,
    Unit="m")  # -> Model, Report
selres = SelectResults(GSAModel=analyse_2.Model, Type="AnalysisCase", Case_ID="A1")
getlists = GetModelLists(GSAModel=analyse.Model)
selres_2 = SelectResults(GSAModel=analyse.Model, Type="AnalysisCase", Case_ID="A1")
getlists_2 = GetModelLists(GSAModel=analyse_2.Model)
item = ListItem(List=getlists, Index=0, Wrap=True)  # -> Item, Item1
listinfo = ListInfo(List=getlists_2, Unit="m")  # -> Index, Name, Type, Definition, ListObjectsIn_m, ExpandList
listinfo_2 = ListInfo(List=item.Item1, Unit="m")  # -> Index, Name, Type, Definition, ListObjectsIn_m, ExpandList
getgeo = GetModelGeometry(GSAModel=analyse.Model, Mode=1, Unit="m")  # -> NodesIn_m, _1DElementsIn_m, _2DElementsIn_m, _3DElementsIn_m, _1DMembersIn_m, _2DMembersIn_m, _3DMembersIn_m
contourelem2d = _2DContourResults(
    Result=selres,
    ElementFilterList=createlist_2,
    Display=4,
    Mode=1,
    flayer=0,
    force="kN/m",
    legend=False,
    legendScale=1,
    length="mm",
    model="m",
    moment="kN",
    noDec=0,
    Result_Type="Force",
    Component="Moment Mx",
    slider=False,
    stress="MPa",
    val=0,
    valMax=1000,
    valMin=0)  # -> M, Colours, LegendValues_kN_m_m
listinfo_3 = ListInfo(List=item.Item, Unit="m")  # -> Index, Name, Type, Definition, ListObjectsIn_m, ExpandList
contour2d = Contour2DResults(
    Result=selres_2,
    ElementFilterList=createlist,
    Display=3,
    Mode=0,
    flayer=0,
    force="kN/m",
    legend=True,
    legendScale=1,
    length="mm",
    model="m",
    moment="kN",
    noDec=0,
    Result_Type="Displacement",
    Component="Resolved |U|",
    slider=True,
    stress="MPa",
    val=250,
    valMax=1000,
    valMin=0)  # -> M, Colours, Values_mm
elem2dedit = Edit2DElement(Element2D=getgeo._2DElementsIn_m, Preview3dSection=False)  # -> Element2D, Number, AnalysisMesh, _2DProperty, Group, ElementType, Offset, OrientationAngle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
A = Annotate(NodeElementMemberLoadResultDiagram=contourelem2d.M)  # -> Annotations, Position, Text
an = Annotate(NodeElementMemberLoadResultDiagram=contour2d.M)  # -> Annotations, Position, Text
mem2dedit = Edit2DMember(Member2D=listinfo_3.ListObjectsIn_m, Preview3dSection=False)  # -> Member2D, MemberNumber, Brep, InclPoints, InclCurves, _2DProperty, MemberGroup, MemberType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
sort = SortList(Keys=listinfo.ExpandList)  # -> Keys, ValuesA
sort_2 = SortList(Keys=A.Text)  # -> Keys, ValuesA
equals = Equality(FirstNumber=listinfo_2.ExpandList, SecondNumber=elem2dedit.ParentMembers)  # -> Equality, Inequality
pt_9 = Point(mem2dedit.InclPoints)
equals_2 = Equality(FirstNumber=sort.Keys, SecondNumber=sort_2.Keys)  # -> Equality, Inequality
cull = CullPattern(List=elem2dedit.Number, CullPattern=equals.Equality)
pdecon = Deconstruct(Point=pt_9)  # -> XComponent, YComponent, ZComponent
ma = MassAddition(Input=equals_2.Inequality)  # -> Result, PartialResults
sort_3 = SortList(Keys=flatten(cull))  # -> Keys, ValuesA
sort_4 = SortList(Keys=an.Text)  # -> Keys, ValuesA

# ---- group: Test1IdsAreEqual
int = Integer(ma.Result)

# ---- group: Test2X
num = Number(pdecon.XComponent)

# ---- group: Test2Y
num_2 = Number(pdecon.YComponent)

# ----
equals_3 = Equality(FirstNumber=sort_3.Keys, SecondNumber=sort_4.Keys)  # -> Equality, Inequality
ma_2 = MassAddition(Input=equals_3.Inequality)  # -> Result, PartialResults

# ---- group: Test2IdsAreEqual
int_2 = Integer(ma_2.Result)
