# Grasshopper definition GsaList_Materials.gh (Grasshopper 1.0.7)
# Copyright: Arup
# plug-ins: GSA

mat = CreateMaterial(Material_type="Steel", Design_Code="EN 1993-1-1:2005", Grade="S235")
mat_2 = CreateMaterial(Material_type="FRP", Grade="Sika CarboDur S")
mat_3 = CreateMaterial(Material_type="Concrete", Design_Code="EC2-1-1", Grade="C30/37")
mat_4 = CreateMaterial(Material_type="Aluminium", Grade="1050A")
material = CreateCustomMaterial(
    MaterialName="Custom",
    ElasticModulus_MPa="200",
    PoissonsRatio="200",
    Density_kg_m³="200",
    Material_Type="Generic",
    Stress_Unit="MPa",
    Density_Unit="kg/m³",
    Temperature_Unit="°C")
createlist = CreateList(Index=0, Name="memberlist from Frp", Definition=mat_2, Type="Member")
createlist_2 = CreateList(Index=0, Name="memberlist from Custom", Definition=material, Type="Member")
createlist_3 = CreateList(Index=0, Name="elementlist from Frp", Definition=mat_2, Type="Element")
createlist_4 = CreateList(Index=0, Name="elementlist from Custom", Definition=material, Type="Element")
createlist_5 = CreateList(Index=0, Name="memberlist from Steel", Definition=mat, Type="Member")

# ---- group: Error
createlist_6 = CreateList(Index=0, Name="memberlist from Aluminium", Definition=mat_4, Type="Member")

createlist_7 = CreateList(Index=0, Name="elementlist from Aluminium", Definition=mat_4, Type="Element")

# ----
createlist_8 = CreateList(Index=0, Name="memberlist from Concrete", Definition=mat_3, Type="Member")
createlist_9 = CreateList(Index=0, Name="elementlist from Concrete", Definition=mat_3, Type="Element")
createlist_10 = CreateList(Index=0, Name="elementlist from Steel", Definition=mat, Type="Element")
createlist_11 = CreateList(Index=0, Name="memberlist from Steel", Definition=mat, Type="Member")
createlist_12 = CreateList(Index=0, Name="elementlist from Concrete", Definition=mat_3, Type="Element")
model = CreateModel(
    ModelSListsAndGridLines=[createlist_9, createlist_8, createlist_10, createlist_5, createlist_3, createlist, createlist_4, createlist_2],
    Properties=[mat_3, mat, mat_2, material],
    ReMesh=False,
    Tolerance=0.01,
    Unit="m")
getlists = GetModelLists(GSAModel=model)

# ---- group: Warning
model_2 = CreateModel(ModelSListsAndGridLines=[createlist_12, createlist_11], ReMesh=False, Tolerance=0.01, Unit="m")

# ----
listinfo = ListInfo(List=getlists, Unit="m")  # -> Index, Name, Type, Definition, ListObjectsIn_m, ExpandList

# ---- group: List from material Names
txt = Text(listinfo.Name)

# ---- group: List from material Definitions
txt_2 = Text(listinfo.Definition)

# ----
panel = Panel(txt_2)
