# Grasshopper definition GsaList_Members.gh (Grasshopper 1.0.7)
# Copyright: Arup
# plug-ins: GSA

size = Slider(2, range=0..100)
movefact = Slider(0.5, range=0.1..0.9)
number_slider = Slider(2, range=0..10)
number_slider_2 = Slider(3, range=0..10)
number_slider_3 = Slider(6.75, range=0..10)
number_slider_4 = Slider(8.1, range=0..10)
multiplication = Multiplication(A=size, B=movefact)
pt = ConstructPoint(XCoordinate=0, YCoordinate=0, ZCoordinate=0)
pt_2 = ConstructPoint(XCoordinate=size, YCoordinate=size, ZCoordinate=size)
vec = VectorXYZ(XComponent=multiplication, YComponent=multiplication, ZComponent=multiplication)  # -> Vector, Length
box = Box2Pt(PointA=pt, PointB=pt_2, Plane=PlaneXY(0, 0, 0))
multiplication_2 = Multiplication(A=number_slider_3, B=number_slider_2)
multiplication_3 = Multiplication(A=number_slider_4, B=number_slider)
recgrid = Rectangular(Plane=PlaneXY(0, 0, 0), SizeX=number_slider_3, SizeY=number_slider_4, ExtentX=number_slider_2, ExtentY=number_slider)  # -> Cells, Points
move = Move(Geometry=box, Motion=vec.Vector)  # -> Geometry, Transform
series = Series(Start=Slider(4.5, range=0..10), Step=Slider(3.6, range=0..10), Count=Slider(5, range=0..100))
sunion = SolidUnion(Breps=[box, move.Geometry])
explode = Explode(Curve=recgrid.Cells, Recursive=True)  # -> Segments, Vertices
rectangle = Rectangle(Plane=PlaneXY(0, 0, 0), XSize=multiplication_2, YSize=multiplication_3, Radius=0)  # -> Rectangle, Length
pt_3 = Point(recgrid.Points)
rev = ReverseList(List=explode.Segments)
boundary = BoundarySurfaces(Edges=rectangle.Rectangle)
Z = UnitZ(Factor=flatten(["0", series]))
item = ListItem(List=explode.Segments, Index=0, Wrap=True)
item_2 = ListItem(List=explode.Segments, Index="2", Wrap=True)
item_3 = ListItem(List=rev, Index=0, Wrap=True)
item_4 = ListItem(List=rev, Index="2", Wrap=True)  # -> reverse(Item)
move_2 = Move(Geometry=flatten(pt_3), Motion=graft(Z))  # -> Geometry, Transform
pshift = ShiftPaths(Data=item, Offset=-1)
pshift_2 = ShiftPaths(Data=item_2, Offset=-1)
pshift_3 = ShiftPaths(Data=item_3, Offset=-1)
pshift_4 = ShiftPaths(Data=item_4, Offset=-1)
item_5 = ListItem(List=reverse(pshift_2), Index=0, Wrap=True)
flip = FlipMatrix(Data=pshift_4)
flip_2 = FlipMatrix(Data=move_2.Geometry)
item_6 = ListItem(List=reverse(flip), Index=0, Wrap=True)
Z_2 = UnitZ(Factor=flatten(series))
pline = PolyLine(Vertices=flip_2, Closed=False)  # -> flatten(Polyline)
ins = InsertItems(List=simplify(item_5), Item=pshift, Indices=simplify("0"), Wrap=True)  # -> flatten(List)
flip_3 = FlipMatrix(Data=item_6)
shift = ShiftList(List=reverse(pt_3), Shift=1, Wrap=False)
item_7 = ListItem(List=reverse(pt_3), Index=0, Wrap=True)
ins_2 = InsertItems(List=simplify(flip_3), Item=pshift_3, Indices=simplify("0"), Wrap=True)  # -> flatten(List)
move_3 = Move(Geometry=ins, Motion=graft(Z_2))  # -> flatten(Geometry), Transform
move_4 = Move(Geometry=ins_2, Motion=graft(Z_2))  # -> flatten(Geometry), Transform
move_5 = Move(Geometry=boundary, Motion=Z_2)  # -> Geometry, Transform
support = CreateSupport(Point=flatten([shift, item_7]), Plane=PlaneXY(0, 0, 0), x=True, xx=True, y=True, yy=True, z=True, zz=True)
mem3d = Create3DMember(Solid=sunion)
mem2d = Create2DMember(Brep=boundary, InternalOffset=True, Preview3dSection=False, Mesh_mode="Quad dominant")
mem1d = Create1DMember(
    Curve=pline,
    Preview3dSection=False,
    x1=False,
    x2=False,
    xx1=False,
    xx2=False,
    y1=False,
    y2=False,
    yy1=False,
    yy2=False,
    z1=False,
    z2=False,
    zz1=False,
    zz2=False)
mem1d_2 = Create1DMember(
    Curve=move_3.Geometry,
    Preview3dSection=False,
    x1=False,
    x2=False,
    xx1=False,
    xx2=False,
    y1=False,
    y2=False,
    yy1=False,
    yy2=False,
    z1=False,
    z2=False,
    zz1=False,
    zz2=False)
mem1d_3 = Create1DMember(
    Curve=move_4.Geometry,
    Preview3dSection=False,
    x1=False,
    x2=False,
    xx1=False,
    xx2=False,
    y1=False,
    y2=False,
    yy1=False,
    yy2=False,
    z1=False,
    z2=False,
    zz1=False,
    zz2=False)
mem2d_2 = Create2DMember(Brep=move_5.Geometry, InternalOffset=True, Preview3dSection=False, Mesh_mode="Quad dominant")
createlist = CreateList(Index="1", Name="Columns", Definition=mem1d, Type="Member")
createlist_2 = CreateList(Index="3", Name="Primaries", Definition=mem1d_2, Type="Member")
createlist_3 = CreateList(Index="4", Definition=mem1d_3, Type="Member")
createlist_4 = CreateList(Index="99", Name="3d list", Definition=mem3d, Type="Member")
createlist_5 = CreateList(Index=0, Name="Typical Floors", Definition=mem2d_2, Type="Member")
createlist_6 = CreateList(Index="11", Name="Ground floor", Definition=mem2d, Type="Member")
model = CreateModel(
    ModelSAndLists=[createlist, createlist_2, createlist_3, createlist_5, createlist_6, createlist_4],
    GSAGeometryIn_m=[support, mem1d, mem1d_2, mem1d_3, mem2d_2, mem2d, mem3d],
    ReMesh=True,
    Tolerance=0.01,
    Unit="m")

# ---- group: Warning
model_2 = CreateModel(ModelSListsAndGridLines=[createlist, createlist_2, createlist_3], ReMesh=True, Tolerance=0.01, Unit="m")

# ----
getgeo = GetModelGeometry(GSAModel=model, Mode=1, Unit="m")  # -> NodesIn_m, _1DElementsIn_m, _2DElementsIn_m, _3DElementsIn_m, _1DMembersIn_m, _2DMembersIn_m, _3DMembersIn_m
getlists = GetModelLists(GSAModel=model)
L = List(getgeo._1DMembersIn_m)
item_8 = ListItem(List=getlists, Index=0, Wrap=True)  # -> Item, Item1, Item2, Item3, Item4, Item5
listinfo = ListInfo(List=item_8.Item, Unit="m")  # -> Index, Name, Type, Definition, ListObjectsIn_m, ExpandList
listinfo_2 = ListInfo(List=item_8.Item3, Unit="m")  # -> Index, Name, Type, Definition, ListObjectsIn_m, ExpandList
listinfo_3 = ListInfo(List=item_8.Item1, Unit="m")  # -> Index, Name, Type, Definition, ListObjectsIn_m, ExpandList
listinfo_4 = ListInfo(List=item_8.Item4, Unit="m")  # -> Index, Name, Type, Definition, ListObjectsIn_m, ExpandList
listinfo_5 = ListInfo(List=item_8.Item5, Unit="m")  # -> Index, Name, Type, Definition, ListObjectsIn_m, ExpandList
listinfo_6 = ListInfo(List=item_8.Item2, Unit="m")  # -> Index, Name, Type, Definition, ListObjectsIn_m, ExpandList
lng = ListLength(List=listinfo.ListObjectsIn_m)
lng_2 = ListLength(List=listinfo_2.ListObjectsIn_m)
lng_3 = ListLength(List=listinfo_3.ListObjectsIn_m)
lng_4 = ListLength(List=listinfo_4.ListObjectsIn_m)
lng_5 = ListLength(List=listinfo_5.ListObjectsIn_m)
lng_6 = ListLength(List=listinfo_6.ListObjectsIn_m)

# ---- group: Test4Id
int = Integer(listinfo_2.Index)

# ---- group: Test4Name
txt = Text(listinfo_2.Name)

# ---- group: Test4Type
txt_2 = Text(listinfo_2.Type)

# ---- group: Test4Count
int_2 = Integer(lng_2)

# ---- group: Test5Id
int_3 = Integer(listinfo_4.Index)

# ---- group: Test5Name
txt_3 = Text(listinfo_4.Name)

# ---- group: Test5Type
txt_4 = Text(listinfo_4.Type)

# ---- group: Test5Count
int_4 = Integer(lng_4)

# ---- group: Test6Id
int_5 = Integer(listinfo_5.Index)

# ---- group: Test1Id
int_6 = Integer(listinfo.Index)

# ---- group: Test1Name
txt_5 = Text(listinfo.Name)

# ---- group: Test1Type
txt_6 = Text(listinfo.Type)

# ---- group: Test1Count
int_7 = Integer(lng)

# ---- group: Test2Id
int_8 = Integer(listinfo_3.Index)

# ---- group: Test2Name
txt_7 = Text(listinfo_3.Name)

# ---- group: Test2Type
txt_8 = Text(listinfo_3.Type)

# ---- group: Test2Count
int_9 = Integer(lng_3)

# ---- group: Test3Id
int_10 = Integer(listinfo_6.Index)

# ---- group: Test3Name
txt_9 = Text(listinfo_6.Name)

# ---- group: Test3Type
txt_10 = Text(listinfo_6.Type)

# ---- group: Test3Count
int_11 = Integer(lng_6)

# ---- group: Test6Name
txt_11 = Text(listinfo_5.Name)

# ---- group: Test6Type
txt_12 = Text(listinfo_5.Type)

# ---- group: Test6Count
int_12 = Integer(lng_5)
