# Grasshopper definition GsaList_Param.gh (Grasshopper 1.0.7)
# Copyright: Arup
# plug-ins: GSA

pt = ConstructPoint(XCoordinate="4", YCoordinate="4", ZCoordinate=0)
pt_2 = ConstructPoint(XCoordinate="6", YCoordinate="7", ZCoordinate=0)
ln = Line(StartPoint=pt, EndPoint=pt_2)
mem1d = Create1DMember(
    Curve=ln,
    Preview3dSection=False,
    x1=False,
    x2=False,
    xx1=False,
    xx2=False,
    y1=False,
    y2=False,
    yy1=False,
    yy2=False,
    z1=False,
    z2=False,
    zz1=False,
    zz2=False)
int = Integer("1")
no = Node(pt_2)
m1d = Member1D(mem1d)
elem1d = Create1DElement(Line=ln, Preview3dSection=False)
e1d = Element1D(elem1d)
createlist = CreateList(Index=0, Definition="1 to 5", Type="Member")
createlist_2 = CreateList(Index=0, Definition=[mem1d, m1d], Type="Member")
createlist_3 = CreateList(Index=0, Definition="1 to 5", Type="Case")
createlist_4 = CreateList(Index=0, Definition=["1", int], Type="Case")
L = List(mem1d)
createlist_5 = CreateList(Index=0, Definition=[pt, no], Type="Node")
createlist_6 = CreateList(Index=0, Definition="1 to 5", Type="Node")
L_2 = List(no)
createlist_7 = CreateList(Index=0, Definition="1 to 5", Type="Element")
createlist_8 = CreateList(Index=0, Definition=[elem1d, e1d], Type="Element")
L_3 = List(elem1d)

# ---- group: CaseList
txt = Text([createlist_4, createlist_3])

# ---- group: MemberList
txt_2 = Text([createlist_2, createlist, L])

# ---- group: ElementList
txt_3 = Text([createlist_8, createlist_7, L_3])

# ---- group: Node List
txt_4 = Text([createlist_5, createlist_6, L_2])
