# Grasshopper definition GsaList_Properties.gh (Grasshopper 1.0.7)
# Copyright: Arup
# plug-ins: GSA

number_slider = Slider(2, range=0..10)
number_slider_2 = Slider(3, range=0..10)
number_slider_3 = Slider(6.75, range=0..10)
pt = ConstructPoint(XCoordinate=0, YCoordinate=0, ZCoordinate=0)
pt_2 = ConstructPoint(XCoordinate=0, YCoordinate=0, ZCoordinate="7")
pt_3 = ConstructPoint(XCoordinate=0, YCoordinate="10", ZCoordinate="7")
pt_4 = ConstructPoint(XCoordinate=0, YCoordinate="10", ZCoordinate=0)
number_slider_4 = Slider(8.1, range=0..10)
profile = CreateProfile(
    NumberOfInputs=0,
    catalogueIndex=3,
    inclSS=False,
    lengthUnit="Centimeter",
    mode="Catalogue",
    Profile_type="Catalogue",
    Catalogue="Europrofile",
    Type="EP HE beams",
    Profile="HE HE600.B",
    typeIndex=27)
material = CustomMaterial(E="210000", ν="0.3", ρ="7850", Material_Type="Steel", Stress_Unit="MPa", Density_Unit="kg/m³", Temperature_Unit="°C")
material_2 = CustomMaterial(E="210000", ν="0.3", ρ="7850", Material_Type="Steel", Stress_Unit="MPa", Density_Unit="kg/m³", Temperature_Unit="°C")
pt_5 = ConstructPoint(XCoordinate="4", YCoordinate=0, ZCoordinate=0)
pt_6 = ConstructPoint(XCoordinate="15", YCoordinate="15", ZCoordinate=0)
material_3 = CustomMaterial(E="18000", ν="0.3", ρ="2500", Material_Type="Concrete", Stress_Unit="MPa", Density_Unit="kg/m³", Temperature_Unit="°C")
pt_7 = ConstructPoint(XCoordinate="4", YCoordinate="7", ZCoordinate=0)
size = Slider(2, range=0..100)
movefact = Slider(0.5, range=0.1..0.9)
rectangle = Rectangle(Plane=pt_5, XSize="9", YSize="7", Radius=0)  # -> Rectangle, Length
rectangle_2 = Rectangle(Plane=pt_7, XSize="9", YSize="2", Radius=0)  # -> Rectangle, Length
addition = Addition(A="9", B=1)
profile_2 = CreateProfile(
    catalogueIndex=3,
    inclSS=False,
    lengthUnit="Centimeter",
    mode="Catalogue",
    Profile_type="Catalogue",
    Catalogue="Europrofile",
    Type="EP HE beams",
    Profile="HE HE600.B",
    typeIndex=27)
material_4 = CustomMaterial(E="210000", ν="0.3", ρ="7850", Material_Type="Steel", Stress_Unit="MPa", Density_Unit="kg/m³", Temperature_Unit="°C")
material_5 = CustomMaterial(E="210000", ν="0.3", ρ="7850", Material_Type="Steel", Stress_Unit="MPa", Density_Unit="kg/m³", Temperature_Unit="°C")
support = CreateSupport(Point=[pt, pt_4], Plane=PlaneXY(0, 0, 0), x=True, xx=True, y=True, yy=True, z=True, zz=True)
section = CreateSection(Profile=profile, Material=material_2, Basic_Offset="Centroid")
section_2 = CreateSection(Profile=profile, Material=material, Basic_Offset="Centroid")
ln = Line(StartPoint=pt, EndPoint=pt_2)
ln_2 = Line(StartPoint=pt_2, EndPoint=pt_3)
ln_3 = Line(StartPoint=pt_3, EndPoint=pt_4)
series = Series(Start="4", Step=1, Count=addition)
prop2d = Create2DProperty(Thickness_cm="25", Material=material_3, Type="Shell", Unit="cm")
mplane = MeshPlane(Boundary=rectangle.Rectangle, WidthCount="9", HeightCount="7")  # -> Mesh, Area
prop2d_2 = Create2DProperty(Thickness_cm="20", Material=material_3, Type="Shell", Unit="cm")
mplane_2 = MeshPlane(Boundary=rectangle_2.Rectangle, WidthCount="9", HeightCount="2")  # -> Mesh, Area
multiplication = Multiplication(A=number_slider_3, B=number_slider_2)
multiplication_2 = Multiplication(A=number_slider_4, B=number_slider)
multiplication_3 = Multiplication(A=size, B=movefact)
pt_8 = ConstructPoint(XCoordinate=0, YCoordinate=0, ZCoordinate=0)
pt_9 = ConstructPoint(XCoordinate=series, YCoordinate=0, ZCoordinate=0)
pt_10 = ConstructPoint(XCoordinate=size, YCoordinate=size, ZCoordinate=size)
recgrid = Rectangular(Plane=pt_6, SizeX=number_slider_3, SizeY=number_slider_4, ExtentX=number_slider_2, ExtentY=number_slider)  # -> Cells, Points
series_2 = Series(Start=Slider(4.5, range=0..10), Step=Slider(3.6, range=0..10), Count=Slider(5, range=0..100))
vec = VectorXYZ(XComponent=multiplication_3, YComponent=multiplication_3, ZComponent=multiplication_3)  # -> Vector, Length
elem2d = Create2DElement(Mesh=mplane.Mesh, Prop2D=prop2d, Preview3dSection=False)
support_2 = CreateSupport(Point=pt_9, Plane=PlaneXY(0, 0, 0), x=True, xx=True, y=True, yy=True, z=True, zz=True)
elem2d_2 = Create2DElement(Mesh=mplane_2.Mesh, Prop2D=prop2d_2, Preview3dSection=False)
box = Box2Pt(PointA=pt_8, PointB=pt_10, Plane=PlaneXY(0, 0, 0))
elem1d = Create1DElement(Line=ln_2, Section=section, Preview3dSection=False)
elem1d_2 = Create1DElement(Line=[ln, ln_3], Section=section_2, Preview3dSection=False)
move = Move(Geometry=box, Motion=vec.Vector)  # -> Geometry, Transform
section_3 = CreateSection(Profile=profile_2, Material=material_5, Basic_Offset="Centroid")
section_4 = CreateSection(Profile=profile_2, Material=material_4, Basic_Offset="Centroid")
explode = Explode(Curve=recgrid.Cells, Recursive=True)  # -> Segments, Vertices
rectangle_3 = Rectangle(Plane=pt_6, XSize=multiplication, YSize=multiplication_2, Radius=0)  # -> Rectangle, Length
createlist = CreateList(Index=0, Name="Material list", Definition=material_3, Type="Element")
createlist_2 = CreateList(Index="2", Name="Slab edge", Definition=prop2d_2, Type="Element")
sunion = SolidUnion(Breps=[box, move.Geometry])
prop3d = Create3DProperty(Material=material_4)
createlist_3 = CreateList(Index="1", Name="Material list", Definition=material_2, Type="Element")
createlist_4 = CreateList(Index=0, Name="Property list", Definition=section_2, Type="Element")
pt_11 = Point(recgrid.Points)
rev = ReverseList(List=explode.Segments)
boundary = BoundarySurfaces(Edges=rectangle_3.Rectangle)
material_6 = CustomMaterial(E="18000", ν="0.3", ρ="2500", Material_Type="Concrete", Stress_Unit="MPa", Density_Unit="kg/m³", Temperature_Unit="°C")
Z = UnitZ(Factor=flatten(["0", series_2]))
item = ListItem(List=explode.Segments, Index=0, Wrap=True)
item_2 = ListItem(List=explode.Segments, Index="2", Wrap=True)
item_3 = ListItem(List=rev, Index=0, Wrap=True)
item_4 = ListItem(List=rev, Index="2", Wrap=True)  # -> reverse(Item)
faceload = CreateFaceLoad(
    LoadCase=1,
    ElementList=createlist_2,
    Axis=-1,
    Direction="z",
    Projected=False,
    Value_kN_m²="-1.5",
    Type="Uniform",
    Unit="kN/m²")
faceload_2 = CreateFaceLoad(
    LoadCase=1,
    ElementList=createlist,
    Axis=-1,
    Direction="z",
    Projected=False,
    Value_kN_m²="-3.5",
    Type="Uniform",
    Unit="kN/m²")
move_2 = Move(Geometry=flatten(pt_11), Motion=graft(Z))  # -> Geometry, Transform
mem3d = Create3DMember(Solid=sunion, Prop3D=prop3d)
pshift = ShiftPaths(Data=item, Offset=-1)
pshift_2 = ShiftPaths(Data=item_2, Offset=-1)
pshift_3 = ShiftPaths(Data=item_3, Offset=-1)
pshift_4 = ShiftPaths(Data=item_4, Offset=-1)
beamload = CreateBeamLoad(
    LoadCase=1,
    ElementList=createlist_4,
    Axis=0,
    Direction="y",
    Projected=False,
    Value_kN_m="5",
    Type="Uniform",
    Unit="kN/m")
beamload_2 = CreateBeamLoad(
    LoadCase=1,
    ElementList=createlist_3,
    Axis=0,
    Direction="z",
    Projected=False,
    Value_kN_m="5",
    Type="Uniform",
    Unit="kN/m")
item_5 = ListItem(List=reverse(pshift_2), Index=0, Wrap=True)
prop2d_3 = Create2DProperty(Thickness_cm="18", Material=material_6, Type="Shell", Unit="cm")
prop2d_4 = Create2DProperty(Thickness_cm="30", Material=material_6, Type="Shell", Unit="cm")
flip = FlipMatrix(Data=pshift_4)
flip_2 = FlipMatrix(Data=move_2.Geometry)
analyse = AnalyseModel(
    GSAGeometryIn_m=flatten([support_2, elem2d, elem2d_2]),
    Load=[faceload, faceload_2],
    Analyse=True,
    ReMesh=True,
    Tolerance=0.01,
    Unit="m")  # -> Model, Report
item_6 = ListItem(List=reverse(flip), Index=0, Wrap=True)
createlist_5 = CreateList(Index="1", Name="Beams Material list", Definition=section_4, Type="Member")
createlist_6 = CreateList(Index=0, Name="Column Property list", Definition=section_3, Type="Element")
analyse_2 = AnalyseModel(
    GSAGeometryIn_m=[support, elem1d_2, elem1d],
    Load=[beamload, beamload_2],
    Analyse=True,
    ReMesh=True,
    Tolerance=0.01,
    Unit="m")  # -> Model, Report
Z_2 = UnitZ(Factor=flatten(series_2))
pline = PolyLine(Vertices=flip_2, Closed=False)  # -> flatten(Polyline)
ins = InsertItems(List=simplify(item_5), Item=pshift, Indices=simplify("0"), Wrap=True)  # -> flatten(List)
flip_3 = FlipMatrix(Data=item_6)
shift = ShiftList(List=reverse(pt_11), Shift=1, Wrap=False)
item_7 = ListItem(List=reverse(pt_11), Index=0, Wrap=True)
ins_2 = InsertItems(List=simplify(flip_3), Item=pshift_3, Indices=simplify("0"), Wrap=True)  # -> flatten(List)
selres = SelectResults(GSAModel=analyse.Model, Type="AnalysisCase", Case_ID="A1")
getlists = GetModelLists(GSAModel=analyse.Model)

# ---- group: Error
createlist_7 = CreateList(Index=0, Name="M3d list", Definition=prop3d, Type="Member")

# ----
elemfrommem = CreateElementsFromMembers(_3DMembers_m=mem3d, Tolerance=0.01, Unit="m")  # -> Nodes, _1DElements, _2DElements, _3DElements, GSAModel
createlist_8 = CreateList(Index=0, Name="E3d list", Definition=prop3d, Type="Element")
createlist_9 = CreateList(Index=0, Name="Slabs Material list", Definition=material_6, Type="Element")
createlist_10 = CreateList(Index="2", Name="Raft Property list", Definition=prop2d_4, Type="Member")
move_3 = Move(Geometry=ins, Motion=graft(Z_2))  # -> flatten(Geometry), Transform
item_8 = ListItem(List=getlists, Index=0, Wrap=True)  # -> Item, Item1
move_4 = Move(Geometry=ins_2, Motion=graft(Z_2))  # -> flatten(Geometry), Transform
move_5 = Move(Geometry=boundary, Motion=Z_2)  # -> Geometry, Transform
contourelem2d = _2DContourResults(
    Result=selres,
    ElementFilterList=createlist_2,
    Display=3,
    Mode=0,
    flayer=0,
    force="kN/m",
    legend=True,
    legendScale=1,
    length="mm",
    model="m",
    moment="kN",
    noDec=0,
    Result_Type="Displacement",
    Component="Resolved |U|",
    slider=True,
    stress="MPa",
    val=10,
    valMax=1000,
    valMin=0)  # -> M, Colours, Values_mm
support_3 = CreateSupport(Point=flatten([shift, item_7]), Plane=PlaneXY(0, 0, 0), x=True, xx=True, y=True, yy=True, z=True, zz=True)
getlists_2 = GetModelLists(GSAModel=analyse_2.Model)
selres_2 = SelectResults(GSAModel=analyse_2.Model, Type="AnalysisCase", Case_ID="A1")
elem3dedit = Edit3DElement(Element3D=elemfrommem._3DElements, _3DProperty=prop3d)  # -> Element3D, Number, AnalysisMesh, _3DProperty, Group, ElementType, Name, Colour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
item_9 = ListItem(List=getlists_2, Index=0, Wrap=True)  # -> Item, Item1
listinfo = ListInfo(List=item_8.Item1, Unit="m")  # -> Index, Name, Type, Definition, ListObjectsIn_m, ExpandList
listinfo_2 = ListInfo(List=item_8.Item, Unit="m")  # -> Index, Name, Type, Definition, ListObjectsIn_m, ExpandList
mem2d = Create2DMember(Brep=move_5.Geometry, Property2D=prop2d_3, InternalOffset=True, Preview3dSection=False, Mesh_mode="Quad dominant")
mem1d = Create1DMember(
    Curve=pline,
    Section=section_3,
    Preview3dSection=False,
    x1=False,
    x2=False,
    xx1=False,
    xx2=False,
    y1=False,
    y2=False,
    yy1=False,
    yy2=False,
    z1=False,
    z2=False,
    zz1=False,
    zz2=False)
mem1d_2 = Create1DMember(
    Curve=move_3.Geometry,
    Section=section_4,
    Preview3dSection=False,
    x1=False,
    x2=False,
    xx1=False,
    xx2=False,
    y1=False,
    y2=False,
    yy1=False,
    yy2=False,
    z1=False,
    z2=False,
    zz1=False,
    zz2=False)
mem1d_3 = Create1DMember(
    Curve=move_4.Geometry,
    Section=section_4,
    Preview3dSection=False,
    x1=False,
    x2=False,
    xx1=False,
    xx2=False,
    y1=False,
    y2=False,
    yy1=False,
    yy2=False,
    z1=False,
    z2=False,
    zz1=False,
    zz2=False)
mem2d_2 = Create2DMember(Brep=boundary, Property2D=prop2d_4, InternalOffset=True, Preview3dSection=False, Mesh_mode="Quad dominant")
A = Annotate(NodeElementMemberLoadResultDiagram=listinfo.ListObjectsIn_m)  # -> Annotations, Position, Text
A_2 = Annotate(NodeElementMemberLoadResultDiagram=contourelem2d.M)  # -> Annotations, Position, Text
model = CreateModel(ModelSListsAndGridLines=createlist_8, GSAGeometryIn_m=elem3dedit.Element3D, ReMesh=True, Tolerance=0.01, Unit="m")
listinfo_3 = ListInfo(List=item_9.Item1, Unit="m")  # -> Index, Name, Type, Definition, ListObjectsIn_m, ExpandList
listinfo_4 = ListInfo(List=item_9.Item, Unit="m")  # -> Index, Name, Type, Definition, ListObjectsIn_m, ExpandList
contourelem1d = _1DContourResults(
    Result=selres_2,
    ElementFilterList=createlist_4,
    IntermediatePoints=10,
    Scale=10,
    Display=3,
    Mode=0,
    energy="MJ",
    force="kN",
    legend=False,
    legendScale=1,
    length="mm",
    model="m",
    moment="kN·m",
    noDec=0,
    Result_Type="Displacement",
    Component="Resolved |U|",
    slider=True,
    val=150,
    valMax=1000,
    valMin=0)  # -> L, Colours, Values_mm
panel = Panel(listinfo_2.Index)
panel_2 = Panel(listinfo_2.Name)
panel_3 = Panel(listinfo_2.Type)
panel_4 = Panel(listinfo.Index)
panel_5 = Panel(listinfo.Name)
panel_6 = Panel(listinfo.Type)
panel_7 = Panel(listinfo.ListObjectsIn_m)
panel_8 = Panel(listinfo_2.Definition)
panel_9 = Panel(listinfo_2.ListObjectsIn_m)
panel_10 = Panel(listinfo.Definition)
sort = SortList(Keys=A_2.Text)  # -> Keys, ValuesA
sort_2 = SortList(Keys=A.Text)  # -> Keys, ValuesA
an = Annotate(NodeElementMemberLoadResultDiagram=contourelem1d.L)  # -> Annotations, Position, Text
panel_11 = Panel(listinfo_4.Index)
panel_12 = Panel(listinfo_4.Name)
panel_13 = Panel(listinfo_4.Type)
panel_14 = Panel(listinfo_3.Index)
panel_15 = Panel(listinfo_3.Name)
panel_16 = Panel(listinfo_3.Type)
panel_17 = Panel(listinfo_3.ListObjectsIn_m)
panel_18 = Panel(listinfo_4.Definition)
panel_19 = Panel(listinfo_4.ListObjectsIn_m)
panel_20 = Panel(listinfo_3.Definition)
int = Integer(listinfo_3.ListObjectsIn_m)
equals = Equality(FirstNumber=sort_2.Keys, SecondNumber=sort.Keys)  # -> Equality, Inequality
demesh = DeconstructMesh(Mesh=listinfo_2.ListObjectsIn_m)  # -> Vertices, Faces, Colours, Normals
demesh_2 = DeconstructMesh(Mesh=listinfo.ListObjectsIn_m)  # -> Vertices, Faces, Colours, Normals
dcon = DeleteConsecutive(Set=an.Text, Wrap=False)  # -> Set, Count
ma = MassAddition(Input=equals.Inequality)  # -> Result, PartialResults
lng = ListLength(List=demesh.Vertices)  # -> flatten(Length)
lng_2 = ListLength(List=demesh.Faces)  # -> flatten(Length)
lng_3 = ListLength(List=demesh_2.Vertices)
lng_4 = ListLength(List=demesh_2.Faces)
bang = ExplodeTree(Data=dcon.Set)  # -> Branch0, Branch1
end = EndPoints(Curve=listinfo_3.ListObjectsIn_m)  # -> Start, End
end_2 = EndPoints(Curve=listinfo_4.ListObjectsIn_m)  # -> Start, End
getlists_3 = GetModelLists(GSAModel=model)

# ---- group: Test6IdsAreEqual
int_2 = Integer(ma.Result)

# ----
item_10 = ListItem(List=int, Index=0, Wrap=True)  # -> Item, Item1

# ---- group: Test4Vertices
int_3 = Integer(lng)

# ---- group: Test4Faces
int_4 = Integer(lng_2)

# ---- group: Test5Vertices
int_5 = Integer(lng_3)

# ---- group: Test5Faces
int_6 = Integer(lng_4)

# ----
pdecon = Deconstruct(Point=end.Start)  # -> XComponent, YComponent, ZComponent
pdecon_2 = Deconstruct(Point=end_2.Start)  # -> XComponent, YComponent, ZComponent
pdecon_3 = Deconstruct(Point=end.End)  # -> XComponent, YComponent, ZComponent
pdecon_4 = Deconstruct(Point=end_2.End)  # -> XComponent, YComponent, ZComponent
equals_2 = Equality(FirstNumber=item_10.Item, SecondNumber=bang.Branch0)  # -> Equality, Inequality
equals_3 = Equality(FirstNumber=item_10.Item1, SecondNumber=bang.Branch1)  # -> Equality, Inequality
model_2 = CreateModel(
    ModelSAndLists=[createlist_6, createlist_10, createlist_5, createlist_9],
    GSAGeometryIn_m=[support_3, mem1d, mem1d_2, mem1d_3, mem2d, mem2d_2],
    ReMesh=True,
    Tolerance=0.01,
    Unit="m")

# ---- group: Test2StartZs
num = Number(pdecon.ZComponent)

# ---- group: Test1StartZs
num_2 = Number(pdecon_2.ZComponent)

# ---- group: Test2StartYs
num_3 = Number(pdecon.YComponent)

# ---- group: Test1StartYs
num_4 = Number(pdecon_2.YComponent)

# ---- group: Test2EndZs
num_5 = Number(pdecon_3.YComponent)

# ---- group: Test1EndZs
num_6 = Number(pdecon_4.YComponent)

# ---- group: Test2EndYs
num_7 = Number(pdecon_3.XComponent)

# ---- group: Test1EndYs
num_8 = Number(pdecon_4.XComponent)

# ---- group: Test3Result1
bool = Boolean(equals_2.Equality)

# ---- group: Test3Result2
bool_2 = Boolean(equals_3.Equality)

# ---- group: Warning
model_3 = CreateModel(
    ModelSListsAndGridLines=[createlist_8, createlist_9, createlist_10, createlist_5, createlist_6, createlist, createlist_2],
    ReMesh=True,
    Tolerance=0.01,
    Unit="m")

# ----
getlists_4 = GetModelLists(GSAModel=model_2)
item_11 = ListItem(List=getlists_4, Index=0, Wrap=True)  # -> Item, Item1, Item2, Item3
listinfo_5 = ListInfo(List=item_11.Item, Unit="m")  # -> Index, Name, Type, Definition, ListObjectsIn_m, ExpandList
listinfo_6 = ListInfo(List=item_11.Item3, Unit="m")  # -> Index, Name, Type, Definition, ListObjectsIn_m, ExpandList
listinfo_7 = ListInfo(List=item_11.Item1, Unit="m")  # -> Index, Name, Type, Definition, ListObjectsIn_m, ExpandList
listinfo_8 = ListInfo(List=item_11.Item2, Unit="m")  # -> Index, Name, Type, Definition, ListObjectsIn_m, ExpandList
listinfo_9 = ListInfo(List=getlists_3, Unit="m")  # -> Index, Name, Type, Definition, ListObjectsIn_m, ExpandList
lng_5 = ListLength(List=listinfo_5.ListObjectsIn_m)
lng_6 = ListLength(List=listinfo_7.ListObjectsIn_m)
lng_7 = ListLength(List=listinfo_6.ListObjectsIn_m)
lng_8 = ListLength(List=listinfo_8.ListObjectsIn_m)
lng_9 = ListLength(List=listinfo_9.ListObjectsIn_m)

# ---- group: Test10Id
int_7 = Integer(listinfo_6.Index)

# ---- group: Test10Name
txt = Text(listinfo_6.Name)

# ---- group: Test10Type
txt_2 = Text(listinfo_6.Type)

# ---- group: Test10Count
int_8 = Integer(lng_7)

# ---- group: Test7Id
int_9 = Integer(listinfo_5.Index)

# ---- group: Test7Name
txt_3 = Text(listinfo_5.Name)

# ---- group: Test7Type
txt_4 = Text(listinfo_5.Type)

# ---- group: Test7Count
int_10 = Integer(lng_5)

# ---- group: Test8Id
int_11 = Integer(listinfo_7.Index)

# ---- group: Test8Name
txt_5 = Text(listinfo_7.Name)

# ---- group: Test8Type
txt_6 = Text(listinfo_7.Type)

# ---- group: Test8Count
int_12 = Integer(lng_6)

# ---- group: Test9Id
int_13 = Integer(listinfo_8.Index)

# ---- group: Test9Name
txt_7 = Text(listinfo_8.Name)

# ---- group: Test9Type
txt_8 = Text(listinfo_8.Type)

# ---- group: Test9Count
int_14 = Integer(lng_8)

# ---- group: Test11Id
int_15 = Integer(listinfo_9.Index)

# ---- group: Test11Name
txt_9 = Text(listinfo_9.Name)

# ---- group: Test11Type
txt_10 = Text(listinfo_9.Type)

# ---- group: Test11Count
int_16 = Integer(lng_9)
