# Grasshopper definition CreateEditBucklingFactors.gh (Grasshopper 1.0.7)
# plug-ins: GSA

pt = ConstructPoint(XCoordinate=0, YCoordinate=0, ZCoordinate=0)
bfs = CreateBucklingFactors(FactorLsy="0.9", FactorLsz="1.5", EquivalentUniformMomentFactorForLTB="2")
line = LineSDL(Start=pt, Direction=Vector(0, 0, 1), Length="10")
bfs_2 = CreateBucklingFactors(FactorLsy="1")
bfs_3 = CreateBucklingFactors(FactorLsz="1")
bfs_4 = CreateBucklingFactors(EquivalentUniformMomentFactorForLTB="1")
bucklingfactorsedit = EditBucklingFactors(BucklingFactors=bfs_2)  # -> BucklingFactors, FactorLsy, FactorLsz, EquivalentUniformMomentFactorForLTB
bucklingfactorsedit_2 = EditBucklingFactors(BucklingFactors=bfs_3)  # -> BucklingFactors, FactorLsy, FactorLsz, EquivalentUniformMomentFactorForLTB
bucklingfactorsedit_3 = EditBucklingFactors(BucklingFactors=bfs_4)  # -> BucklingFactors, FactorLsy, FactorLsz, EquivalentUniformMomentFactorForLTB
mem1dedit = Edit1DMember(Curve=line, SetBucklingFactors=bfs, LengthUnit="Meter")  # -> Member1D, Member1dNumber, Curve, Section, MemberGroup, MemberType, _1DElementType, Offset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
null = NullItem(Item=[bucklingfactorsedit.FactorLsz, bucklingfactorsedit.EquivalentUniformMomentFactorForLTB])  # -> NullFlags, InvalidFlags, Description
null_2 = NullItem(Item=[bucklingfactorsedit_2.FactorLsy, bucklingfactorsedit_2.EquivalentUniformMomentFactorForLTB])  # -> NullFlags, InvalidFlags, Description
null_3 = NullItem(Item=[bucklingfactorsedit_3.FactorLsy, bucklingfactorsedit_3.FactorLsz])  # -> NullFlags, InvalidFlags, Description
bucklingfactorsedit_4 = EditBucklingFactors(BucklingFactors=mem1dedit.GetBucklingFactors)  # -> BucklingFactors, FactorLsy, FactorLsz, EquivalentUniformMomentFactorForLTB
not = GateNot(A=null.NullFlags)
not_2 = GateNot(A=null_2.NullFlags)
not_3 = GateNot(A=null_3.NullFlags)

# ---- group: TestLsy
num = Number(bucklingfactorsedit_4.FactorLsy)

# ---- group: TestLsz
num_2 = Number(bucklingfactorsedit_4.FactorLsz)

# ---- group: TestLtb
num_3 = Number(bucklingfactorsedit_4.EquivalentUniformMomentFactorForLTB)

# ----
ma = MassAddition(Input=flatten([not, not_2, not_3]))  # -> Result, PartialResults
panel = Panel([num, num_2, num_3])

# ---- group: null tests
int = Integer(ma.Result)
