# Grasshopper definition CreateOffsetTest.gh (Grasshopper 1.0.7)
# Copyright: Arup
# plug-ins: GSA

offset = CreateOffset(OffsetX1_m="1", OffsetX2_m="2", OffsetY_m="3", OffsetZ_m="4", Measure="Meter")

# ---- group: Of
off = Offset(offset)

# ----
panel = Panel(off)
