# Grasshopper definition CreateProfile.gh (Grasshopper 1.0.7)
# Copyright: Arup
# plug-ins: GSA

crv = Curve(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)
panel = Panel("30")
profile = CreateProfile(
    Depth_mm="500",
    Width_mm="100",
    WebThk_mm="10",
    FlangeThk_mm="20",
    NumberOfInputs=4,
    catalogueIndex=-1,
    inclSS=False,
    lengthUnit="Millimeter",
    mode="Other",
    Profile_type="I Beam Symmetrical",
    Measure="Millimeter",
    typeIndex=-1)
profile_2 = CreateProfile(
    Boundary=crv,
    NumberOfInputs=1,
    catalogueIndex=-1,
    inclSS=False,
    lengthUnit="Meter",
    mode="Other",
    Profile_type="Perimeter",
    Measure="Meter",
    typeIndex=-1)
profile_3 = CreateProfile(
    Depth_mm="500",
    Width_mm="100",
    TopFlangeWidth_mm="10",
    BottomFlangeWidth_mm="20",
    FlangeThickness_mm="30",
    WebThickness_mm="30",
    NumberOfInputs=6,
    catalogueIndex=-1,
    inclSS=False,
    lengthUnit="Millimeter",
    mode="Other",
    Profile_type="Sheet Pile",
    Measure="Millimeter",
    typeIndex=-1)
profile_4 = CreateProfile(
    Depth_mm="500",
    Width_mm="100",
    NumberOfInputs=2,
    catalogueIndex=-1,
    inclSS=False,
    lengthUnit="Millimeter",
    mode="Other",
    Profile_type="Rectangle",
    Measure="Millimeter",
    typeIndex=-1)
profile_5 = CreateProfile(
    Depth_mm="500",
    TopFlangeWidth_mm="100",
    BottomFlangeWidth_mm="10",
    WebThickness_mm="20",
    TopFlangeThk_mm="30",
    BottomFlangeThk_mm="30",
    NumberOfInputs=6,
    catalogueIndex=-1,
    inclSS=False,
    lengthUnit="Millimeter",
    mode="Other",
    Profile_type="I Beam Asymmetrical",
    Measure="Millimeter",
    typeIndex=-1)
profile_6 = CreateProfile(
    Diameter_in="11",
    NumberOfInputs=1,
    catalogueIndex=-1,
    inclSS=False,
    lengthUnit="Inch",
    mode="Other",
    Profile_type="Circle",
    Measure="Inch",
    typeIndex=-1)
profile_7 = CreateProfile(
    Depth_mm="500",
    Width_mm="100",
    WebThk_mm="10",
    FlangeThk_mm="20",
    NumberOfInputs=4,
    catalogueIndex=-1,
    inclSS=False,
    lengthUnit="Millimeter",
    mode="Other",
    Profile_type="Rectangle Hollow",
    Measure="Millimeter",
    typeIndex=-1)
profile_8 = CreateProfile(
    Depth_mm="500",
    Width_mm="100",
    NumberOfInputs=2,
    catalogueIndex=-1,
    inclSS=False,
    lengthUnit="Millimeter",
    mode="Other",
    Profile_type="Recto Circle",
    Measure="Millimeter",
    typeIndex=-1)
profile_9 = CreateProfile(
    Diameter_mm="500",
    PileCentres_mm="100",
    PileCount="10",
    IsWall=Toggle(False),
    NumberOfInputs=4,
    catalogueIndex=-1,
    inclSS=False,
    lengthUnit="Millimeter",
    mode="Other",
    Profile_type="Secant Pile",
    Measure="Millimeter",
    typeIndex=-1)
profile_10 = CreateProfile(
    Depth_mm="500",
    TopWidth_mm="100",
    BottomWidth_mm="10",
    NumberOfInputs=3,
    catalogueIndex=-1,
    inclSS=False,
    lengthUnit="Millimeter",
    mode="Other",
    Profile_type="Trapezoid",
    Measure="Millimeter",
    typeIndex=-1)
profile_11 = CreateProfile(
    Depth_mm="500",
    Width_mm="100",
    WebThk_mm="10",
    FlangeThk_mm="20",
    NumberOfInputs=4,
    catalogueIndex=-1,
    inclSS=False,
    lengthUnit="Millimeter",
    mode="Other",
    Profile_type="Angle",
    Measure="Millimeter",
    typeIndex=-1)
profile_12 = CreateProfile(
    Depth_mm="500",
    Width_mm="100",
    WebThk_mm="10",
    FlangeThk_mm="20",
    NumberOfInputs=4,
    catalogueIndex=-1,
    inclSS=False,
    lengthUnit="Millimeter",
    mode="Other",
    Profile_type="Cruciform Symmetrical",
    Measure="Millimeter",
    typeIndex=-1)
profile_13 = CreateProfile(
    Depth_mm="500",
    Width_mm="100",
    WebThk_mm="10",
    FlangeThk_mm="20",
    NumberOfInputs=4,
    catalogueIndex=-1,
    inclSS=False,
    lengthUnit="Millimeter",
    mode="Other",
    Profile_type="T Section",
    Measure="Millimeter",
    typeIndex=-1)
profile_14 = CreateProfile(
    Depth_mm="500",
    TopWidth_mm="100",
    BottomWidth_mm="10",
    TopLip_mm="20",
    Lip_mm="30",
    Thickness_mm="30",
    NumberOfInputs=6,
    catalogueIndex=-1,
    inclSS=False,
    lengthUnit="Millimeter",
    mode="Other",
    Profile_type="General Z",
    Measure="Millimeter",
    typeIndex=-1)
profile_15 = CreateProfile(
    Depth_mm="500",
    DepthFlat_mm="100",
    Width_mm="10",
    WidthFlat_mm="20",
    NumberOfInputs=4,
    catalogueIndex=-1,
    inclSS=False,
    lengthUnit="Millimeter",
    mode="Other",
    Profile_type="Recto Ellipse",
    Measure="Millimeter",
    typeIndex=-1)
profile_16 = CreateProfile(
    Depth_cm="50",
    Width_cm="10",
    WebThk_cm="1",
    FlangeThk_cm="2",
    NumberOfInputs=4,
    catalogueIndex=-1,
    inclSS=False,
    lengthUnit="Centimeter",
    mode="Other",
    Profile_type="Channel",
    Measure="Centimeter",
    Type="All",
    Profile="All",
    typeIndex=-1)
profile_17 = CreateProfile(
    Diameter_m="5",
    Thickness_m="0.1",
    NumberOfInputs=2,
    catalogueIndex=-1,
    inclSS=False,
    lengthUnit="Meter",
    mode="Other",
    Profile_type="Circle Hollow",
    Measure="Meter",
    typeIndex=-1)
profile_18 = CreateProfile(
    Depth_mm="500",
    Width_mm="100",
    WebThk_mm="10",
    FlangeThk_mm="20",
    WebOpening_mm="300",
    Pitch_mm="3000",
    NumberOfInputs=6,
    catalogueIndex=-1,
    inclSS=False,
    lengthUnit="Millimeter",
    mode="Other",
    Profile_type="I Beam Cellular",
    Measure="mm",
    typeIndex=-1)
profile_19 = CreateProfile(
    Depth_mm="500",
    Width_mm="100",
    NumberOfInputs=2,
    catalogueIndex=-1,
    inclSS=False,
    lengthUnit="Millimeter",
    mode="Other",
    Profile_type="Rectangle",
    Measure="Millimeter",
    typeIndex=-1)
profile_20 = CreateProfile(
    Depth_mm="500",
    Width_mm="100",
    Thickness_mm="10",
    NumberOfInputs=3,
    catalogueIndex=-1,
    inclSS=False,
    lengthUnit="Millimeter",
    mode="Other",
    Profile_type="Ellipse Hollow",
    Measure="Millimeter",
    typeIndex=-1)
profile_21 = CreateProfile(
    Depth_mm="500",
    Width_mm="100",
    Lip_mm="10",
    Thickness_mm="20",
    NumberOfInputs=4,
    catalogueIndex=-1,
    inclSS=False,
    lengthUnit="Millimeter",
    mode="Other",
    Profile_type="General C",
    Measure="Millimeter",
    typeIndex=-1)
panel_3 = Panel(profile_3)
panel_4 = Panel(profile_10)
panel_5 = Panel(profile_9)
panel_6 = Panel(profile_13)
panel_7 = Panel(profile)
panel_8 = Panel(profile_5)
panel_9 = Panel(profile_17)
panel_10 = Panel(profile_18)
panel_11 = Panel(profile_4)
panel_12 = Panel(profile_7)
panel_13 = Panel(profile_14)
panel_14 = Panel(profile_2)
panel_15 = Panel(profile_11)
panel_16 = Panel(profile_19)
panel_17 = Panel(profile_8)
panel_18 = Panel(profile_16)
panel_19 = Panel(profile_6)
panel_20 = Panel(profile_21)
panel_21 = Panel(profile_15)
panel_22 = Panel(profile_12)
panel_23 = Panel(profile_20)
