# Grasshopper definition EditBool6Test.gh (Grasshopper 1.0.7)
# Copyright: Arup
# plug-ins: GSA

b6 = CreateBool6(
    X=Toggle(True),
    Y=Toggle(False),
    Z=Toggle(True),
    XX=Toggle(False),
    YY=Toggle(True),
    ZZ=Toggle(False),
    x=True,
    xx=False,
    y=False,
    yy=True,
    z=True,
    zz=False)
bool6edit = EditBool6(Bool6=b6, X=Toggle(False), Y=Toggle(True), Z=Toggle(False), XX=Toggle(True), YY=Toggle(False), ZZ=Toggle(True))  # -> Bool6, X, Y, Z, XX, YY, ZZ

# ---- group: X
bool = Boolean(bool6edit.X)

# ---- group: Y
bool_2 = Boolean(bool6edit.Y)

# ---- group: Z
bool_3 = Boolean(bool6edit.Z)

# ---- group: XX
bool_4 = Boolean(bool6edit.XX)

# ---- group: YY
bool_5 = Boolean(bool6edit.YY)

# ---- group: ZZ
bool_6 = Boolean(bool6edit.ZZ)

# ----
panel = Panel(bool)
panel_2 = Panel(bool_2)
panel_3 = Panel(bool_3)
panel_4 = Panel(bool_4)
panel_5 = Panel(bool_5)
panel_6 = Panel(bool_6)
