# Grasshopper definition EditOffsetTest.gh (Grasshopper 1.0.7)
# Copyright: Arup
# plug-ins: GSA

offset = CreateOffset(OffsetX1_m="1", OffsetX2_m="2", OffsetY_m="3", OffsetZ_m="4", Measure="Meter")
offsetedit = EditOffset(Offset=offset, OffsetX1_cm="4", OffsetX2_cm="3", OffsetY_cm="2", OffsetZ_cm="1", LengthUnit="Centimeter")  # -> Offset, OffsetX1_cm, OffsetX2_cm, OffsetY_cm, OffsetZ_cm
panel = Panel(offset)

# ---- group: Of
off = Offset(offsetedit.Offset)

# ----
panel_2 = Panel(off)
