# Grasshopper definition GetProperties_TrGen_10.gh (Grasshopper 1.0.7)
# plug-ins: GSA, UnitNumber

panel = Panel("https://samples.oasys-software.com/gsa/10.1/Training_General/TrGen_10.gwb")
c_script = CSharpScript(x=panel)  # -> A; inputs x: String
# ---------- c_script: C# ----------
    string fileName = System.IO.Path.GetTempPath();

    //create webclient and download example file:
    System.Net.WebClient webClient = new System.Net.WebClient();
    webClient.DownloadFile(
      x,
      fileName + "Steel_Design_Simple.gwb");

    A = fileName + "Steel_Design_Simple.gwb";
# ---------- end c_script ----------
open = OpenModel(FilenameAndPath=c_script, File="C:\Users\tilman.reinhardt\AppData\Local\Temp\Steel_Design_Simple.gwb")
getprops = GetModelProperties(GSAModel=open)  # -> Sections, _2DProperties, _3DProperties
sectionedit = EditSection(Section=getprops.Sections)  # -> Section, SectionNumber, SectionProfile, Material, Section_2, SectionPool, SectionName, SectionColour
prop2dedit = Edit2DProperty(Prop2D=getprops._2DProperties, LengthUnit="Centimeter")  # -> Prop2D, Prop2dNumber, Material, Thickness_cm, Axis, Prop2dName, Prop2dColour, Type
getgeo = GetModelGeometry(GSAModel=open, NodeFilterList="All", ElementFilterList="All", MemberFilterList="All", Mode=1, Unit="m")  # -> Nodes_m, _1DElements_m, _2DElements_m, _3DElements_m, _1DMembers_m, _2DMembers_m, _3DMembers_m
pbm = SectionModifier(sectionedit.Section_2)
split = SplitList(List=prop2dedit.Axis, Index="1")  # -> ListA, ListB
deplane = DeconstructPlane(Plane=split.ListB)  # -> Origin, XAxis, YAxis, ZAxis
materialedit = EditMaterial(Material=sectionedit.Material)  # -> Material, AnalysisProperty, MaterialType, MaterialGrade
materialedit_2 = EditMaterial(Material=prop2dedit.Material)  # -> Material, AnalysisProperty, MaterialType, MaterialGrade
pdecon = Deconstruct(Point=deplane.Origin)  # -> XComponent, YComponent, ZComponent
pdecon_2 = Deconstruct(Point=deplane.ZAxis)  # -> XComponent, YComponent, ZComponent
filterunique = FilterUnique(A=materialedit.Material, K=materialedit.AnalysisProperty)
filterunique_2 = FilterUnique(A=materialedit.MaterialType, K=materialedit.AnalysisProperty)
filterunique_3 = FilterUnique(A=materialedit_2.Material, K=materialedit_2.AnalysisProperty)
mem1dedit = Edit1DMember(Member1D=getgeo._1DMembers_m, LengthUnit="Meter")  # -> Member1D, Member1dNumber, Curve, Section, MemberGroup, MemberType, _1DElementType, Offset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
mem2dedit = Edit2DMember(Member2D=getgeo._2DMembers_m)  # -> Member2D, MemberNumber, Brep, InclPoints, InclCurves, _2DProperty, MemberGroup, MemberType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
elem2dedit = Edit2DElement(Element2D=getgeo._2DElements_m)  # -> Element2D, Number, AnalysisMesh, _2DProperty, Group, ElementType, Offset, OrientationAngle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
elem1dedit = Edit1DElement(Element1D=getgeo._1DElements_m)  # -> Element1D, Number, Line, Section, Group, Type, Offset, StartRelease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

# ---- group: PaAxOY
num = Number(pdecon.YComponent)

# ---- group: PaAxOZ
num_2 = Number(pdecon.ZComponent)

# ---- group: PaAxZY
num_3 = Number(pdecon_2.YComponent)

# ---- group: PaAxOX
num_4 = Number(pdecon.XComponent)

# ---- group: PaAxZX
num_5 = Number(pdecon_2.XComponent)

# ---- group: PaAxZZ
num_6 = Number(pdecon_2.ZComponent)

# ----
matprop = MaterialProperties(Material=filterunique_3, DensityUnit="KilogramPerCubicMeter", StressUnit="Megapascal", TemperatureUnit="DegreeCelsius")  # -> ElasticModulus_MPa, PoissonsRatio, Density_kg_m³, ThermalExpansion_C_¹
un = UnitNumber(prop2dedit.Thickness_cm)
matprop_2 = MaterialProperties(Material=filterunique, DensityUnit="KilogramPerCubicMeter", StressUnit="Megapascal", TemperatureUnit="DegreeCelsius")  # -> ElasticModulus_MPa, PoissonsRatio, Density_kg_m³, ThermalExpansion_C_¹
dcon = DeleteConsecutive(Set=sectionedit.SectionPool, Wrap=False)  # -> Set, Count
sectionedit_2 = EditSection(Section=elem1dedit.Section)  # -> Section, SectionNumber, SectionProfile, Material, SectionModifier, SectionPool, SectionName, SectionColour
sectionedit_3 = EditSection(Section=mem1dedit.Section)  # -> Section, SectionNumber, SectionProfile, Material, SectionModifier, SectionPool, SectionName, SectionColour
prop2dedit_2 = Edit2DProperty(Prop2D=flatten(elem2dedit._2DProperty), LengthUnit="Centimeter")  # -> Prop2D, Prop2dNumber, Material, Thickness_cm, Axis, Prop2dName, Prop2dColour, Type
prop2dedit_3 = Edit2DProperty(Prop2D=flatten(mem2dedit._2DProperty), LengthUnit="Centimeter")  # -> Prop2D, Prop2dNumber, Material, Thickness_cm, Axis, Prop2dName, Prop2dColour, Type
filterunique_4 = FilterUnique(A=sectionedit_2.Section, K=sectionedit_2.SectionNumber)
filterunique_5 = FilterUnique(A=sectionedit_3.Section, K=sectionedit_3.SectionNumber)
filterunique_6 = FilterUnique(A=prop2dedit_2.Prop2D, K=prop2dedit_2.Prop2dNumber)
filterunique_7 = FilterUnique(A=prop2dedit_3.Prop2D, K=prop2dedit_3.Prop2dNumber)

# ---- group: PBs
pb = Section(sectionedit.Section)

# ---- group: PbIds
int = Integer(sectionedit.SectionNumber)

# ---- group: Profiles
txt = Text(sectionedit.SectionProfile)

# ---- group: PbE
num_7 = Number(matprop_2.ElasticModulus_MPa)

# ---- group: PbPoisson
num_8 = Number(matprop_2.PoissonsRatio)

# ---- group: PbDensity
num_9 = Number(matprop_2.Density_kg_m³)

# ---- group: PbThermal
num_10 = Number(matprop_2.ThermalExpansion_C_¹)

# ---- group: MatType
txt_2 = Text(filterunique_2)

# ---- group: Pool
int_2 = Integer(dcon.Set)

# ---- group: PbName
txt_3 = Text(sectionedit.SectionName)

# ---- group: PAs
pa = Prop2D(prop2dedit.Prop2D)

# ---- group: PaIds
int_3 = Integer(prop2dedit.Prop2dNumber)

# ---- group: PaPoisson
num_11 = Number(matprop.PoissonsRatio)

# ---- group: PaDensity
num_12 = Number(matprop.Density_kg_m³)

# ---- group: PaThermal
num_13 = Number(matprop.ThermalExpansion_C_¹)

# ---- group: PaE
num_14 = Number(matprop.ElasticModulus_MPa)

# ---- group: PaAxis
int_4 = Integer(split.ListA)

# ---- group: PaName
txt_4 = Text(prop2dedit.Prop2dName)

# ---- group: PaType
txt_5 = Text(prop2dedit.Type)

# ---- group: Thickness
num_15 = Number(un)

# ---- group: PBsFromElem
pb_2 = Section(filterunique_4)

# ---- group: PBsFromMem
pb_3 = Section(filterunique_5)

# ---- group: PAsFromElem
pa_2 = Prop2D(filterunique_6)

# ---- group: PAsFromMem
pa_3 = Prop2D(filterunique_7)

# ----
panel_2 = Panel(int)
panel_3 = Panel(txt)
panel_4 = Panel(num_7)
panel_5 = Panel(num_8)
panel_6 = Panel(int_2)
panel_7 = Panel(txt_3)
panel_8 = Panel(num_9)
panel_9 = Panel(num_10)
panel_10 = Panel(int_3)
panel_11 = Panel(txt_2)
panel_12 = Panel(num_14)
panel_13 = Panel(num_11)
panel_14 = Panel(num_12)
panel_15 = Panel(num_13)
panel_16 = Panel(num_15)
panel_17 = Panel(txt_4)
panel_18 = Panel(txt_5)
panel_19 = Panel(int_4)

# ==== cluster FilterUnique
A = ClusterInput()
K = ClusterInput()
sort = SortList(Keys=K, ValuesA=A)  # -> Keys, ValuesA
dcon = DeleteConsecutive(Set=sort.Keys, Wrap=False)  # -> Set, Count
fsim = FindSimilarMember(Data=dcon.Set, Set=sort.Keys)  # -> Hit, Index
item = ListItem(List=sort.ValuesA, Index=fsim.Index, Wrap=True)
i = ClusterOutput(item)
