# Grasshopper definition Materials.gh (Grasshopper 1.0.7)
# Copyright: Arup
# plug-ins: GSA

material = CreateMaterial(GradeName="S235", Material_type="Steel", Design_Code="EN 1993-1-1:2005", Grade="S235")
material_2 = CreateMaterial(Material_type="FRP", Grade="Sika CarboDur S")
material_3 = CreateMaterial(Material_type="Fabric", Grade="Taconic Solus 1120")
material_4 = CreateMaterial(GradeName="C30/37", Material_type="Concrete", Design_Code="EC2-1-1", Grade="C30/37")
material_5 = CreateMaterial(Material_type="Timber", Grade="EN 338 C14")
material_6 = CreateMaterial(Material_type="Glass", Grade="Soda-lime")
material_7 = CreateMaterial(Material_type="Aluminium", Grade="1050A")
material_8 = CustomMaterial(
    Na="my Custom",
    E="123456",
    ν="0.3",
    ρ="1000",
    Material_Type="Timber",
    Stress_Unit="MPa",
    Density_Unit="kg/m³",
    Temperature_Unit="°C")
merge = Merge(
    Data1=flatten(material),
    Data2=flatten(material_4),
    Data3=flatten(material_2),
    Data4=flatten(material_7),
    Data5=flatten(material_5),
    Data6=flatten(material_6),
    Data7=flatten(material_3),
    Data8=flatten(material_8))
profile = CreateProfile(
    NumberOfInputs=0,
    catalogueIndex=3,
    inclSS=False,
    lengthUnit="Centimeter",
    mode="Catalogue",
    Profile_type="Catalogue",
    Catalogue="Europrofile",
    Type="EP HE beams",
    Profile="HE HE320.B",
    typeIndex=27)
mat = Material(flatten(merge))
panel = Panel("""4
5
6
7
0
0
0
0""")
materialedit = EditMaterial(Material=mat, MaterialID=panel)  # -> Material, MaterialID, MaterialName, CustomMaterial, MaterialType
section = CreateSection(Profile=profile, Material=materialedit.Material, Basic_Offset="Centroid")
model = CreateModel(Properties=section, ReMesh=False, Tolerance=0.01, Unit="m")
getmats = GetModelMaterials(GSAModel=model)  # -> Steel, Concrete, PMat, Aluminium, Timber, Glass, Fabric, Custom
mat_2 = Material([getmats.Steel, getmats.Concrete, getmats.PMat, getmats.Aluminium, getmats.Timber, getmats.Glass, getmats.Fabric, getmats.Custom])
mat_3 = Material([getmats.Steel, getmats.Concrete, getmats.PMat, getmats.Aluminium, getmats.Timber, getmats.Glass, getmats.Custom])
matprop = MaterialProperties(Material=mat_3, DensityUnit="KilogramPerCubicMeter", StressUnit="Megapascal", TemperatureUnit="DegreeCelsius")  # -> ElasticModulus_MPa, PoissonsRatio, Density_kg_m³, ThermalExpansion_C_¹
materialedit_2 = EditMaterial(Material=mat_2)  # -> Material, MaterialID, MaterialName, CustomMaterial, MaterialType

# ---- group: ID
int = Integer(materialedit_2.MaterialID)

# ---- group: Name
txt = Text(materialedit_2.MaterialName)

# ---- group: E-modulus
num = Number(matprop.ElasticModulus_MPa)

# ---- group: Type
txt_2 = Text(materialedit_2.MaterialType)
