# Grasshopper definition AssemblyPreview.gh (Grasshopper 1.0.7)
# Copyright: Arup
# plug-ins: GSA

pt = ConstructPoint(XCoordinate="10", YCoordinate="10", ZCoordinate=0)
pt_2 = ConstructPoint(XCoordinate=0, YCoordinate=0, ZCoordinate=0)
pt_3 = ConstructPoint(XCoordinate=0, YCoordinate=0, ZCoordinate="10")
pt_4 = Point([pt_2, pt_3, pt])
panel = Panel("""1
2
3""")
nodeedit = EditNode(Node=pt_4, NodeNumber=panel, Mode=1)  # -> Node, NodeNumber, NodePosition, NodeLocalAxis, NodeRestraints, DamperProperty, MassProperty, SpringProperty, NodeName, NodeColour
panel_2 = Panel("""0
1
2
3""")
panel_3 = Panel("""1
2
3""")
assembly = CreateAssembly(
    Name="Assembly 1",
    Topology1="1",
    Topology2="2",
    OrientationNode="3",
    CurveFit=2,
    ExplicitPositions_m=panel_3,
    Type="Explicit positions",
    Length_Unit="m")
assembly_2 = CreateAssembly(
    Name="Assembly 2",
    Topology1="1",
    Topology2="2",
    OrientationNode="3",
    CurveFit=2,
    Type="Number of points",
    Length_Unit="cm")
assembly_3 = CreateAssembly(
    Name="Assembly 3",
    Topology1="1",
    Topology2="2",
    OrientationNode="3",
    CurveFit=2,
    Spacing="1",
    Type="Spacing of points",
    Length_Unit="m")
assembly_4 = CreateAssembly(Name="Assembly 4", Topology1="1", Topology2="2", OrientationNode="3", Type="Storey", Length_Unit="cm")
gridplane = CreateGridPlane(GridElevationInModelUnits=panel_2, Type="Storey")
model = CreateModel(GSAGeometryIn_m=flatten([nodeedit.Node, assembly_4]), Load=gridplane, ReMesh=False, Tolerance=0.01, Unit="m")
model_2 = CreateModel(GSAGeometryIn_m=flatten([nodeedit.Node, assembly]), ReMesh=False, Tolerance=0.01, Unit="m")
model_3 = CreateModel(GSAGeometryIn_m=flatten([nodeedit.Node, assembly_2]), ReMesh=False, Tolerance=0.01, Unit="m")
model_4 = CreateModel(GSAGeometryIn_m=flatten([nodeedit.Node, assembly_3]), ReMesh=False, Tolerance=0.01, Unit="m")
getgeo = GetModelGeometry(GSAModel=model_2, Mode=1, Unit="m")  # -> NodesIn_m, _1DElementsIn_m, _2DElementsIn_m, _3DElementsIn_m, _1DMembersIn_m, _2DMembersIn_m, _3DMembersIn_m, Assemblies
getgeo_2 = GetModelGeometry(GSAModel=model_3, Mode=1, Unit="m")  # -> NodesIn_m, _1DElementsIn_m, _2DElementsIn_m, _3DElementsIn_m, _1DMembersIn_m, _2DMembersIn_m, _3DMembersIn_m, Assemblies
getgeo_3 = GetModelGeometry(GSAModel=model_4, Mode=1, Unit="m")  # -> NodesIn_m, _1DElementsIn_m, _2DElementsIn_m, _3DElementsIn_m, _1DMembersIn_m, _2DMembersIn_m, _3DMembersIn_m, Assemblies
getgeo_4 = GetModelGeometry(GSAModel=model, Mode=1, Unit="m")  # -> NodesIn_m, _1DElementsIn_m, _2DElementsIn_m, _3DElementsIn_m, _1DMembersIn_m, _2DMembersIn_m, _3DMembersIn_m, Assemblies

# ---- group: Assemblies
as = Assembly([getgeo.Assemblies, getgeo_2.Assemblies, getgeo_3.Assemblies, getgeo_4.Assemblies])
