# Grasshopper definition CreateEffectiveLengthOptions.gh (Grasshopper 1.0.7)
# plug-ins: GSA

panel = Panel("""Free
TopFlangeLateral
BottomFlangeLateral
TopAndBottomFlangeLAteral
0
1
2
3""")
panel_2 = Panel("""Free
TopFlangeLateral
Pinned
0
1
2""")
txt = Text(graft(panel))
txt_2 = Text(graft(panel_2))
endrestraint = CreateMemberEndRestraint(Shortcuts="TopFlangeLateral")
endrestraint_2 = CreateMemberEndRestraint(Shortcuts="PartialRotational")
endrestraint_3 = CreateMemberEndRestraint(Shortcuts="Fixed")
endrestraint_4 = CreateMemberEndRestraint(Shortcuts="FullRotational")
endrestraint_5 = CreateMemberEndRestraint(Shortcuts="Pinned")
endrestraint_6 = CreateMemberEndRestraint(Shortcuts="Free")
effectivelengthoptions = CreateEffectiveLengthOptions(DestabilisingLoadHeight=0, FactorLsy="1", Options="Automatic", Load_position="Shear centre")
effectivelengthoptions_2 = CreateEffectiveLengthOptions(DestabilisingLoadHeight=0, EquivalentUniformMomentFactorForLTB="1", Options="Automatic", Load_position="Shear centre")
effectivelengthoptions_3 = CreateEffectiveLengthOptions(DestabilisingLoadHeight=0, FactorLsz="1", Options="Automatic", Load_position="Shear centre")
pt = ConstructPoint(XCoordinate=0, YCoordinate=0, ZCoordinate=0)
line = LineSDL(Start=pt, Direction=Vector(0, 0, 1), Length="10")
effectivelengthoptions_4 = CreateEffectiveLengthOptions(
    MemberRestraintStart=endrestraint_6,
    MemberRestraintEnd=endrestraint_4,
    DestabilisingLoadHeight="0.1",
    FactorLsy="0.9",
    FactorLsz="1.5",
    EquivalentUniformMomentFactorForLTB="2",
    Options="Automatic",
    Load_position="Bottom flange")
effectivelengthoptions_5 = CreateEffectiveLengthOptions(
    MemberRestraintStart=endrestraint_6,
    MemberRestraintEnd=endrestraint_4,
    RestraintAlongMember=txt_2,
    IntermediateBracingPointRestraints=txt,
    DestabilisingLoadHeight="0.1",
    FactorLsy="0.9",
    FactorLsz="1.5",
    EquivalentUniformMomentFactorForLTB="2",
    Options="Internal restraints",
    Load_position="Shear centre")
effectivelengthoptions_6 = CreateEffectiveLengthOptions(
    MemberRestraintStart=endrestraint_5,
    MemberRestraintEnd=endrestraint_3,
    DestabilisingLoadHeight="0.1",
    FactorLsy="0.9",
    FactorLsz="1.5",
    EquivalentUniformMomentFactorForLTB="2",
    Options="Automatic",
    Load_position="Shear centre")
effectivelengthoptions_7 = CreateEffectiveLengthOptions(
    MemberRestraintStart=endrestraint_5,
    MemberRestraintEnd=endrestraint_3,
    DestabilisingLoadHeight="0.1",
    FactorLsy="0.9",
    FactorLsz="1.5",
    EquivalentUniformMomentFactorForLTB="2",
    Options="Automatic",
    Load_position="Top flange")
effectivelengthoptions_8 = CreateEffectiveLengthOptions(
    MemberRestraintStart=endrestraint_2,
    MemberRestraintEnd=endrestraint,
    RestraintAlongMember=txt_2,
    IntermediateBracingPointRestraints=txt,
    DestabilisingLoadHeight="0.1",
    FactorLsy="0.9",
    FactorLsz="1.5",
    EquivalentUniformMomentFactorForLTB="2",
    Options="Internal restraints",
    Load_position="Top flange")
effectivelengthoptions_9 = GetEffectiveLengthOptions(EffectiveLengthOptions=effectivelengthoptions_2)  # -> CO, ER1, ER2, RAM, IBR, Lsy, Lsz, Ltb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
effectivelengthoptions_10 = CreateEffectiveLengthOptions(
    MemberRestraintStart=endrestraint_2,
    MemberRestraintEnd=endrestraint,
    RestraintAlongMember=txt_2,
    IntermediateBracingPointRestraints=txt,
    DestabilisingLoadHeight="0.1",
    FactorLsy="0.9",
    FactorLsz="1.5",
    EquivalentUniformMomentFactorForLTB="2",
    Options="Internal restraints",
    Load_position="Bottom flange")
effectivelengthoptions_11 = GetEffectiveLengthOptions(EffectiveLengthOptions=effectivelengthoptions_3)  # -> CO, ER1, ER2, RAM, IBR, Lsy, Lsz, Ltb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
effectivelengthoptions_12 = GetEffectiveLengthOptions(EffectiveLengthOptions=effectivelengthoptions)  # -> CO, ER1, ER2, RAM, IBR, Lsy, Lsz, Ltb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
effectivelengthoptions_13 = CreateEffectiveLengthOptions(
    EffectiveLengthAboutY="2.0",
    EffectiveLengthAboutZ="2.0",
    EffectiveLengthLTB="2.0",
    DestabilisingLoadHeight="0.1",
    FactorLsy="0.9",
    FactorLsz="1.5",
    EquivalentUniformMomentFactorForLTB="2",
    Options="User specified",
    Load_position="Bottom flange")
effectivelengthoptions_14 = CreateEffectiveLengthOptions(
    EffectiveLengthAboutY="-0.5",
    EffectiveLengthAboutZ="-0.5",
    EffectiveLengthLTB="-0.5",
    DestabilisingLoadHeight="0.1",
    FactorLsy="0.9",
    FactorLsz="1.5",
    EquivalentUniformMomentFactorForLTB="2",
    Options="User specified",
    Load_position="Shear centre")
effectivelengthoptions_15 = CreateEffectiveLengthOptions(
    EffectiveLengthAboutY="1.0",
    EffectiveLengthAboutZ="1.0",
    EffectiveLengthLTB="1.0",
    DestabilisingLoadHeight="0.1",
    FactorLsy="0.9",
    FactorLsz="1.5",
    EquivalentUniformMomentFactorForLTB="2",
    Options="User specified",
    Load_position="Top flange")
null = NullItem(Item=[effectivelengthoptions_9.fLy, effectivelengthoptions_9.fLz])  # -> NullFlags, InvalidFlags, Description
null_2 = NullItem(Item=[effectivelengthoptions_12.fLz, effectivelengthoptions_12.fLtb])  # -> NullFlags, InvalidFlags, Description
null_3 = NullItem(Item=[effectivelengthoptions_11.fLy, effectivelengthoptions_11.fLtb])  # -> NullFlags, InvalidFlags, Description
mem1dedit = Edit1DMember(
    Curve=line,
    SetBucklingFactors=[effectivelengthoptions_6, effectivelengthoptions_7, effectivelengthoptions_4, effectivelengthoptions_5, effectivelengthoptions_8, effectivelengthoptions_10, effectivelengthoptions_14, effectivelengthoptions_15, effectivelengthoptions_13],
    Preview3dSection=False)  # -> Member1D, Member1dNumber, Curve, Section, MemberGroup, MemberType, _1DElementType, Offset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
not = GateNot(A=null_2.NullFlags)
not_2 = GateNot(A=null_3.NullFlags)
not_3 = GateNot(A=null.NullFlags)
effectivelengthoptions_16 = GetEffectiveLengthOptions(EffectiveLengthOptions=flatten(mem1dedit.GetBucklingFactors))  # -> CO, ER1, ER2, RAM, IBR, Lsy, Lsz, Ltb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
ma = MassAddition(Input=flatten([not, not_2, not_3]))  # -> Result, PartialResults

# ---- group: TestLtb
num = Number(effectivelengthoptions_16.fLtb)

# ---- group: TestLsz
num_2 = Number(effectivelengthoptions_16.fLz)

# ---- group: TestLsy
num_3 = Number(effectivelengthoptions_16.fLy)

# ---- group: null tests
int = Integer(ma.Result)

# ----
panel_3 = Panel([num_3, num_2, num])
le = EffectiveLengthOptions(flatten(mem1dedit.GetBucklingFactors))
panel_4 = Panel(le)
