# Grasshopper definition Elem2dIds.gh (Grasshopper 1.0.7)
# Copyright: Arup
# plug-ins: GSA

mesh = Mesh([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])
int = Integer(Tree({0;0;0}: [99227, 99228, 99229, 99230, 99263, 99264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], {0;0;1}: [107006, 107007, 107008, 107009, 107013, 107014, 107015, 107016, 107017, 107018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], {0;0;2}: [108138, 108139, 108140, 108141, 108152, 108153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], {0;0;3}: [113523, 113524, 113576, 113577, 113578, 113579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]))
elem2d = Create2DElement(Mesh=mesh)
elem2dedit = Edit2DElement(Element2D=simplify(graft(elem2d)), Element2dNumber=simplify(int))  # -> flatten(Element2D), Number, AnalysisMesh, _2DProperty, Group, ElementType, Offset, OrientationAngle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
model = CreateModel(GSAGeometryIn_m=elem2dedit.Element2D, ReMesh=True, Tolerance=0.01, Unit="m")
getgeo = GetModelGeometry(GSAModel=model, Mode=1, Unit="m")  # -> Nodes_m, _1DElements_m, _2DElements_m, _3DElements_m, _1DMembers_m, _2DMembers_m, _3DMembers_m
A = Annotate(NodeElementMemberLoadResultDiagram=getgeo._2DElements_m)  # -> Annotations, Position, Text

# ---- group: IDs
int_2 = Integer(A.Text)
