# Grasshopper definition ExpandBeamToShell.gh (Grasshopper 1.0.7)
# Copyright: Arup
# plug-ins: GSA

pt = ConstructPoint(XCoordinate=0, YCoordinate=0, ZCoordinate=0)
pt_2 = ConstructPoint(XCoordinate="3", YCoordinate="2", ZCoordinate="1")
ln = Line(StartPoint=pt, EndPoint=pt_2)
series = Series(Start=0, Step="2.5", Count="13")
Y = UnitY(Factor=series)
move = Move(Geometry=ln, Motion=Y)  # -> Geometry, Transform
item = ListItem(List=move.Geometry, Index=0, Wrap=True)  # -> Item, Item1, Item2, Item3, Item4, Item5, Item6, Item7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
rectangle = Rectangle(Plane=PlaneXY(0, 0, 0), XSize=Domain(-1, 1), YSize=Domain(-2, 2), Radius=0)  # -> Rectangle, Length
profile = CreateProfile(
    catalogueIndex=3,
    inclSS=False,
    lengthUnit="Centimeter",
    mode="Catalogue",
    Profile_type="Catalogue",
    Catalogue="Europrofile",
    Type="EP HE beams",
    Profile="HE HE500.A",
    typeIndex=27)
profile_2 = CreateProfile(
    Depth_mm="500",
    Width_mm="100",
    Lip_mm="50",
    Thickness_mm="20",
    catalogueIndex=-1,
    inclSS=False,
    lengthUnit="Millimeter",
    mode="Other",
    Profile_type="General C",
    Measure="mm",
    typeIndex=-1)
profile_3 = CreateProfile(
    Depth_mm="500",
    Width_mm="100",
    WebThk_mm="10",
    FlangeThk_mm="20",
    catalogueIndex=-1,
    inclSS=False,
    lengthUnit="Millimeter",
    mode="Other",
    Profile_type="I Beam Symmetrical",
    Measure="mm",
    typeIndex=-1)
profile_4 = CreateProfile(
    Depth_mm="500",
    Width_mm="100",
    WebThk_mm="10",
    FlangeThk_mm="20",
    catalogueIndex=-1,
    inclSS=False,
    lengthUnit="Millimeter",
    mode="Other",
    Profile_type="T Section",
    Measure="mm",
    typeIndex=-1)
profile_5 = CreateProfile(
    Depth_mm="500",
    Width_mm="100",
    WebThk_mm="10",
    FlangeThk_mm="20",
    catalogueIndex=-1,
    inclSS=False,
    lengthUnit="Millimeter",
    mode="Other",
    Profile_type="Angle",
    Measure="mm",
    typeIndex=-1)
profile_6 = CreateProfile(
    Depth_cm="50",
    Width_cm="10",
    WebThk_cm="1",
    FlangeThk_cm="2",
    catalogueIndex=-1,
    inclSS=False,
    lengthUnit="Centimeter",
    mode="Other",
    Profile_type="Channel",
    Measure="cm",
    typeIndex=-1)
profile_7 = CreateProfile(
    Depth_mm="500",
    TopWidth_mm="100",
    BottomWidth_mm="200",
    TopLip_mm="40",
    Lip_mm="50",
    Thickness_mm="10",
    catalogueIndex=-1,
    inclSS=False,
    lengthUnit="Millimeter",
    mode="Other",
    Profile_type="General Z",
    Measure="mm",
    typeIndex=-1)
profile_8 = CreateProfile(
    Diameter_cm="50",
    Thickness_cm="0.25",
    catalogueIndex=-1,
    inclSS=False,
    lengthUnit="Centimeter",
    mode="Other",
    Profile_type="Circle Hollow",
    Measure="cm",
    typeIndex=-1)
profile_9 = CreateProfile(
    Depth_mm="500",
    Width_mm="100",
    WebThk_mm="10",
    FlangeThk_mm="20",
    WebOpening_mm="300",
    Pitch_mm="3000",
    catalogueIndex=-1,
    inclSS=False,
    lengthUnit="Millimeter",
    mode="Other",
    Profile_type="I Beam Cellular",
    Measure="mm",
    typeIndex=-1)
profile_10 = CreateProfile(
    catalogueIndex=2,
    inclSS=False,
    lengthUnit="Millimeter",
    mode="Catalogue",
    Profile_type="Catalogue",
    Catalogue="British",
    Type="Parallel flange channels(PFC) - EN10365:2017",
    Profile="BSI-PFC PFC230x75x26",
    typeIndex=260)
profile_11 = CreateProfile(
    Depth_mm="500",
    Width_mm="100",
    WebThk_mm="10",
    FlangeThk_mm="20",
    catalogueIndex=-1,
    inclSS=False,
    lengthUnit="Millimeter",
    mode="Other",
    Profile_type="Rectangle Hollow",
    Measure="mm",
    typeIndex=-1)
profile_12 = CreateProfile(
    Depth_mm="500",
    Width_mm="100",
    WebThk_mm="10",
    FlangeThk_mm="20",
    catalogueIndex=-1,
    inclSS=False,
    lengthUnit="Millimeter",
    mode="Other",
    Profile_type="Cruciform Symmetrical",
    Measure="mm",
    typeIndex=-1)
profile_13 = CreateProfile(
    Depth_mm="500",
    TopFlangeWidth_mm="100",
    BottomFlangeWidth_mm="300",
    WebThickness_mm="20",
    TopFlangeThk_mm="20",
    BottomFlangeThk_mm="30",
    catalogueIndex=-1,
    inclSS=False,
    lengthUnit="Millimeter",
    mode="Other",
    Profile_type="I Beam Asymmetrical",
    Measure="mm",
    typeIndex=-1)
profile_14 = CreateProfile(
    Depth_mm="500",
    Width_mm="100",
    Thickness_mm="10",
    catalogueIndex=-1,
    inclSS=False,
    lengthUnit="Millimeter",
    mode="Other",
    Profile_type="Ellipse Hollow",
    Measure="mm",
    typeIndex=-1)
profile_15 = CreateProfile(
    Depth_mm="100",
    Width_mm="500",
    catalogueIndex=-1,
    inclSS=False,
    lengthUnit="Millimeter",
    mode="Other",
    Profile_type="Recto Circle",
    Measure="mm",
    typeIndex=-1)
profile_16 = CreateProfile(
    Diameter_mm="500",
    PileCentres_mm="100",
    PileCount="10",
    IsWall=Toggle(False),
    catalogueIndex=-1,
    inclSS=False,
    lengthUnit="Millimeter",
    mode="Other",
    Profile_type="Secant Pile",
    Measure="mm",
    typeIndex=-1)
profile_17 = CreateProfile(
    Depth_mm="500",
    DepthFlat_mm="400",
    Width_mm="350",
    WidthFlat_mm="300",
    catalogueIndex=-1,
    inclSS=False,
    lengthUnit="Millimeter",
    mode="Other",
    Profile_type="Recto Ellipse",
    Measure="mm",
    typeIndex=-1)
profile_18 = CreateProfile(
    Depth_mm="500",
    Width_mm="100",
    TopFlangeWidth_mm="10",
    BottomFlangeWidth_mm="20",
    FlangeThickness_mm="30",
    WebThickness_mm="30",
    catalogueIndex=-1,
    inclSS=False,
    lengthUnit="Millimeter",
    mode="Other",
    Profile_type="Sheet Pile",
    Measure="mm",
    typeIndex=-1)
profile_19 = CreateProfile(
    Depth_mm="500",
    Width_mm="100",
    catalogueIndex=-1,
    inclSS=False,
    lengthUnit="Millimeter",
    mode="Other",
    Profile_type="Rectangle",
    Measure="mm",
    typeIndex=-1)
profile_20 = CreateProfile(
    Depth_mm="500",
    TopWidth_mm="100",
    BottomWidth_mm="10",
    catalogueIndex=-1,
    inclSS=False,
    lengthUnit="Millimeter",
    mode="Other",
    Profile_type="Trapezoid",
    Measure="mm",
    typeIndex=-1)
profile_21 = CreateProfile(
    Boundary=rectangle.Rectangle,
    catalogueIndex=-1,
    inclSS=False,
    lengthUnit="Meter",
    mode="Other",
    Profile_type="Perimeter",
    Measure="m",
    typeIndex=-1)
profile_22 = CreateProfile(
    Diameter_in="11",
    catalogueIndex=-1,
    inclSS=False,
    lengthUnit="Inch",
    mode="Other",
    Profile_type="Circle",
    Measure="in",
    typeIndex=-1)
join = TextJoin(Text=[profile_17, " 2"])
txt = Text(profile_5)
txt_2 = Text(profile_8)
txt_3 = Text(profile_6)
txt_4 = Text(profile)
txt_5 = Text(profile_12)
txt_6 = Text(profile_14)
txt_7 = Text(profile_2)
txt_8 = Text(profile_7)
txt_9 = Text(profile_3)
txt_10 = Text(profile_13)
txt_11 = Text(profile_9)
txt_12 = Text(profile_11)

# ---- group: Circle
txt_13 = Text(profile_22)

# ----
txt_14 = Text(profile_4)

# ---- group: Perimeter
txt_15 = Text(profile_21)

# ---- group: RectoCircle
txt_16 = Text(profile_15)

# ---- group: SheetPile
txt_17 = Text(profile_18)

# ---- group: Rectangle
txt_18 = Text(profile_19)

# ---- group: RectoEllipse
txt_19 = Text(join)

# ---- group: SecantPile
txt_20 = Text(profile_16)

# ---- group: Trapezoid
txt_21 = Text(profile_20)

# ---- group: PFC
txt_22 = Text(profile_10)

# ----
series_2 = Series(Start="0", Step=1, Count="9")
panel = Panel(txt_14)
panel_2 = Panel(txt_9)
panel_3 = Panel(txt_2)
panel_4 = Panel(txt_10)
panel_5 = Panel(txt_11)
panel_6 = Panel(txt_12)
panel_7 = Panel(txt_4)
panel_8 = Panel(txt_8)
panel_9 = Panel(txt)
panel_10 = Panel(txt_3)
panel_11 = Panel(txt_7)
panel_12 = Panel(txt_5)
panel_13 = Panel(txt_6)
panel_14 = Panel(txt_22)
panel_15 = Panel(txt_17)
panel_16 = Panel(txt_21)
panel_17 = Panel(txt_20)
panel_18 = Panel(txt_15)
panel_19 = Panel(txt_18)
panel_20 = Panel(txt_16)
panel_21 = Panel(txt_13)
panel_22 = Panel(txt_19)
rad = Radians(Degrees=Slider(30, range=0..100))
editpb = EditSection(Section=txt_4, BasicOffset=series_2, AddOffsetY_cm="3.5", AddOffsetZ_cm="-4.2")  # -> Section, SectionNumber, SectionProfile, Material, BasicOffset, AddOffsetY_cm, AddOffsetZ_cm, SectionModifier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
editpf = EditProfile(Profile=txt_4, OrientationAngle=rad, ReflectHorizontal=False, ReflectVertical=False)
Z = UnitZ(Factor=series_2)
Y_2 = UnitY(Factor=Slider(0.54, range=0..1))
section = CreateSection(Profile=editpf, Basic_Offset="Centroid")
move_2 = Move(Geometry=ln, Motion=Z)  # -> Geometry, Transform
move_3 = Move(Geometry=item.Item5, Motion=Y_2)  # -> Geometry, Transform
cluster = Cluster_3(crv=item.Item1, txt=panel_9)
cluster_2 = Cluster_3(crv=item.Item12, txt=panel)
cluster_3 = Cluster_3(crv=item.Item3, txt=panel_3)
cluster_4 = Cluster_3(crv=item.Item2, txt=panel_10)
cluster_5 = Cluster_3(crv=item.Item10, txt=panel_2)
cluster_6 = Cluster_3(crv=item.Item11, txt=panel_6)
cluster_7 = Cluster_3(crv=item.Item, txt=panel_7)
cluster_8 = Cluster_3(crv=item.Item8, txt=panel_4)
cluster_9 = Cluster_3(crv=item.Item9, txt=panel_5)
cluster_10 = Cluster_3(crv=item.Item4, txt=panel_12)
cluster_11 = Cluster_3(crv=item.Item7, txt=panel_8)
cluster_12 = Cluster_3(crv=item.Item5, txt=panel_13)
cluster_13 = Cluster_3(crv=item.Item6, txt=panel_11)
replace = ReplaceItems(List=editpb.Section, Item=section, Indices="0", Wrap=False)
mem1d = Create1DMember(
    Curve=ln,
    Property=[panel_21, panel_18, panel_19, panel_22, panel_20, panel_17, panel_15, panel_16, panel_14],
    Preview3dSection=False,
    x1=False,
    x2=False,
    xx1=False,
    xx2=False,
    y1=False,
    y2=False,
    yy1=False,
    yy2=False,
    z1=False,
    z2=False,
    zz1=False,
    zz2=False)
brep = Brep(Tree({0;0}: [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], {1;0}: [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], {2;0}: [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], {3;0}: [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], {4;0}: [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], {5;0}: [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], {6;0}: [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], {7;0}: [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], {8;0}: [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]))
brep_2 = Brep(cluster)
brep_3 = Brep(Tree({0;0}: [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], {1;0}: [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], {2;0}: [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], {3;0}: [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], {4;0}: [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], {5;0}: [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], {6;0}: [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], {7;0}: [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], {8;0}: [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]))
brep_4 = Brep(cluster_4)
brep_5 = Brep(Tree({0;0}: [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], {1;0}: [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], {2;0}: [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], {3;0}: [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], {4;0}: [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], {5;0}: [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], {6;0}: [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], {7;0}: [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], {8;0}: [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]))
brep_6 = Brep(cluster_3)
move_4 = Move(Geometry=cluster_12, Motion=expr("-x", Y_2))  # -> Geometry, Transform
brep_7 = Brep(Tree({0;0}: [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], {1;0}: [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], {2;0}: [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], {3;0}: [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], {4;0}: [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], {5;0}: [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], {6;0}: [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], {7;0}: [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], {8;0}: [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]))
brep_8 = Brep(cluster_2)
brep_9 = Brep(Tree({0;0}: [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], {1;0}: [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], {2;0}: [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], {3;0}: [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], {4;0}: [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], {5;0}: [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], {6;0}: [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], {7;0}: [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], {8;0}: [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]))
brep_10 = Brep(cluster_5)
brep_11 = Brep(Tree({0;0}: [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], {1;0}: [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], {2;0}: [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], {3;0}: [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], {4;0}: [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], {5;0}: [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], {6;0}: [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], {7;0}: [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], {8;0}: [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]))
brep_12 = Brep(cluster_6)
brep_13 = Brep(Tree({0;0}: [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], {1;0}: [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], {2;0}: [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], {3;0}: [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], {4;0}: [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], {5;0}: [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], {6;0}: [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], {7;0}: [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], {8;0}: [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]))
brep_14 = Brep(cluster_8)
brep_15 = Brep(Tree({0;0}: [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], {1;0}: [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], {2;0}: [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], {3;0}: [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], {4;0}: [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], {5;0}: [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], {6;0}: [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], {7;0}: [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], {8;0}: [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]))
brep_16 = Brep(cluster_9)
brep_17 = Brep(Tree({0;0}: [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], {1;0}: [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], {2;0}: [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], {3;0}: [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], {4;0}: [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], {5;0}: [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], {6;0}: [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], {7;0}: [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], {8;0}: [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]))
brep_18 = Brep(cluster_10)
brep_19 = Brep(Tree({0;0}: [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], {1;0}: [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], {2;0}: [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], {3;0}: [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], {4;0}: [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], {5;0}: [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], {6;0}: [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], {7;0}: [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], {8;0}: [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]))
brep_20 = Brep(cluster_11)
brep_21 = Brep(Tree({0;0}: [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], {1;0}: [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], {2;0}: [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], {3;0}: [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], {4;0}: [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], {5;0}: [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], {6;0}: [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], {7;0}: [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], {8;0}: [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]))
brep_22 = Brep(cluster_12)
brep_23 = Brep(Tree({0;0}: [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], {1;0}: [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], {2;0}: [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], {3;0}: [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], {4;0}: [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], {5;0}: [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], {6;0}: [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], {7;0}: [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], {8;0}: [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]))
brep_24 = Brep(Tree({0;0}: [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], {1;0}: [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], {2;0}: [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], {3;0}: [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], {4;0}: [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], {5;0}: [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], {6;0}: [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], {7;0}: [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], {8;0}: [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]))
brep_25 = Brep(cluster_7)
brep_26 = Brep(Tree({0;0}: [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], {1;0}: [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], {2;0}: [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], {3;0}: [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], {4;0}: [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], {5;0}: [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], {6;0}: [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], {7;0}: [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], {8;0}: [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]))
brep_27 = Brep(cluster_13)
offset = CreateOffset(
    OffsetX1_cm=Slider(15, range=0.5..15),
    OffsetX2_cm=Slider(5.2, range=0.5..15),
    OffsetY_cm=Slider(12.3, range=0.5..15),
    OffsetZ_cm=Slider(2.5, range=0.5..15),
    Measure="cm")
elem1d = Create1DElement(Line=move_2.Geometry, Property=replace, Preview3dSection=False)
cluster_14 = Cluster_2(brep_2=brep_7, brep=brep_8)
cluster_15 = Cluster_2(brep_2=brep_11, brep=brep_12)
cluster_16 = Cluster_2(brep_2=brep_9, brep=brep_10)
cluster_17 = Cluster_2(brep_2=brep_15, brep=brep_16)
cluster_18 = Cluster_2(brep_2=brep_13, brep=brep_14)
cluster_19 = Cluster_2(brep_2=brep_19, brep=brep_20)
cluster_20 = Cluster_2(brep_2=brep_26, brep=brep_27)
cluster_21 = Cluster_2(brep_2=brep_23, brep=brep_22)
cluster_22 = Cluster_2(brep_2=brep_17, brep=brep_18)
cluster_23 = Cluster_2(brep_2=brep_5, brep=brep_6)

# ---- group: Error
b2s = ExpandBeamToShell(ElementMember1D=mem1d, LengthUnit="Meter", Tolerance=0.02)

# ----
cluster_24 = Cluster_2(brep_2=brep_3, brep=brep_4)
cluster_25 = Cluster_2(brep_2=brep, brep=brep_2)
cluster_26 = Cluster_2(brep_2=brep_24, brep=brep_25)
elem1dedit = Edit1DElement(Element1D=elem1d, Offset=offset, Preview3dSection=False)  # -> simplify(graft(Element1D)), Number, Line, Property, Group, Type, Offset, StartRelease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

# ---- group: T
int = Integer(cluster_14)

# ---- group: RHS
int_2 = Integer(cluster_15)

# ---- group: I
int_3 = Integer(cluster_16)

# ---- group: CB
int_4 = Integer(cluster_17)

# ---- group: GI
int_5 = Integer(cluster_18)

# ---- group: GZ
int_6 = Integer(cluster_19)

# ---- group: GC
int_7 = Integer(cluster_20)

# ---- group: OVAL
int_8 = Integer(cluster_21)

# ---- group: X
int_9 = Integer(cluster_22)

# ---- group: CHS
int_10 = Integer(cluster_23)

# ---- group: CH
int_11 = Integer(cluster_24)

# ---- group: A
int_12 = Integer(cluster_25)

# ----
panel_23 = Panel(int)
panel_24 = Panel(int_2)
panel_25 = Panel(int_3)
panel_26 = Panel(int_4)
panel_27 = Panel(int_5)
panel_28 = Panel(int_6)
panel_29 = Panel(int_7)
panel_30 = Panel(int_8)
panel_31 = Panel(int_9)
panel_32 = Panel(int_10)
panel_33 = Panel(int_11)
panel_34 = Panel(int_12)
b2s_2 = ExpandBeamToShell(ElementMember1D=elem1dedit.Element1D, LengthUnit="Meter", Tolerance=0.02)
cluster_27 = Cluster_2(brep_2=brep_21, brep=b2s_2)
ma = MassAddition(Input=[cluster_27, cluster_26])  # -> Result, PartialResults

# ---- group: CAT
int_13 = Integer(ma.Result)

# ----
panel_35 = Panel(int_13)

# ==== cluster Cluster_2
brep = ClusterInput()
brep_2 = ClusterInput()
brep_3 = Brep(brep)
brep_4 = Brep(brep_2)
simplify = SimplifyCurve(Curve=brep_3)  # -> Curve, Simplified
simplify_2 = SimplifyCurve(Curve=brep_4)  # -> Curve, Simplified
explode = Explode(Curve=simplify_2.Curve, Recursive=True)  # -> Segments, Vertices
explode_2 = Explode(Curve=simplify.Curve, Recursive=True)  # -> Segments, Vertices
pdecon = Deconstruct(Point=explode_2.Vertices)  # -> XComponent, YComponent, ZComponent
pdecon_2 = Deconstruct(Point=explode.Vertices)  # -> XComponent, YComponent, ZComponent
len = Length(Curve=explode_2.Segments)  # -> flatten(Length)
len_2 = Length(Curve=explode.Segments)  # -> flatten(Length)
lng = ListLength(List=explode_2.Segments)  # -> flatten(Length)
lng_2 = ListLength(List=explode.Segments)  # -> flatten(Length)
lng_3 = ListLength(List=explode_2.Vertices)  # -> flatten(Length)
lng_4 = ListLength(List=explode.Vertices)  # -> flatten(Length)
equals = Equality(FirstNumber=lng_2, SecondNumber=lng)  # -> Equality, Inequality
equals_2 = Equality(FirstNumber=lng_4, SecondNumber=lng_3)  # -> Equality, Inequality
cluster = Cluster(A=len_2, B=len)
cluster_2 = Cluster(A=pdecon_2.XComponent, B=pdecon.XComponent)  # -> flatten(bool_2)
cluster_3 = Cluster(A=pdecon_2.YComponent, B=pdecon.YComponent)  # -> flatten(bool_2)
cluster_4 = Cluster(A=pdecon_2.ZComponent, B=pdecon.ZComponent)  # -> flatten(bool_2)
not = GateNot(A=equals.Equality)  # -> flatten(Result)
not_2 = GateNot(A=[equals.Equality, equals_2.Equality, cluster, cluster_2, cluster_3, cluster_4])  # -> flatten(Result)
cull = CullPattern(List=flatten(pdecon.YComponent), CullPattern=invert(cluster_3))
cull_2 = CullPattern(List=flatten(pdecon_2.YComponent), CullPattern=invert(cluster_3))
cull_3 = CullPattern(List=flatten(pdecon.XComponent), CullPattern=invert(cluster_2))
cull_4 = CullPattern(List=flatten(pdecon.ZComponent), CullPattern=invert(cluster_4))
cull_5 = CullPattern(List=flatten(pdecon_2.XComponent), CullPattern=invert(cluster_2))
cull_6 = CullPattern(List=flatten(pdecon_2.ZComponent), CullPattern=invert(cluster_4))
ma = MassAddition(Input=not)  # -> Result, PartialResults
ma_2 = MassAddition(Input=not_2)  # -> Result, PartialResults
pt = ConstructPoint(XCoordinate=cull_3, YCoordinate=cull, ZCoordinate=cull_4)
pt_2 = ConstructPoint(XCoordinate=cull_5, YCoordinate=cull_2, ZCoordinate=cull_6)
R = ClusterOutput(ma_2.Result)
ln = Line(StartPoint=pt_2, EndPoint=pt)

# ==== cluster Cluster_3
txt = ClusterInput()
crv = ClusterInput()
txt_2 = Text(txt)
crv_2 = Curve(crv)
series = Series(Start="0", Step=1, Count="9")
rad = Radians(Degrees=Slider(30, range=0..100))
editpb = EditSection(Section=txt_2, BasicOffset=series, AddOffsetY_cm="3.5", AddOffsetZ_cm="-4.2")  # -> Section, SectionNumber, SectionProfile, Material, BasicOffset, AddOffsetY_cm, AddOffsetZ_cm, SectionModifier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
editpf = EditProfile(Profile=txt_2, OrientationAngle=rad, ReflectHorizontal=False, ReflectVertical=False)
Z = UnitZ(Factor=series)
section = CreateSection(Profile=editpf, Basic_Offset="Centroid")
move = Move(Geometry=crv_2, Motion=Z)  # -> Geometry, Transform
replace = ReplaceItems(List=editpb.Section, Item=section, Indices="0", Wrap=False)
offset = CreateOffset(
    OffsetX1_cm=Slider(15, range=0.5..15),
    OffsetX2_cm=Slider(5.2, range=0.5..15),
    OffsetY_cm=Slider(12.3, range=0.5..15),
    OffsetZ_cm=Slider(2.5, range=0.5..15),
    Measure="cm")
mem1d = Create1DMember(
    Curve=move.Geometry,
    Property=replace,
    Preview3dSection=True,
    x1=False,
    x2=False,
    xx1=False,
    xx2=False,
    y1=False,
    y2=False,
    yy1=False,
    yy2=False,
    z1=False,
    z2=False,
    zz1=False,
    zz2=False)
mem1dedit = Edit1DMember(Member1D=mem1d, Offset=offset, Preview3dSection=False)  # -> simplify(graft(Member1D)), Member1dNumber, Curve, Property, MemberGroup, MemberType, _1DElementType, Offset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
b2s = ExpandBeamToShell(ElementMember1D=mem1dedit.Member1D, LengthUnit="Meter", Tolerance=0.02)
m2d = Member2D(b2s)
m2d_2 = ClusterOutput(m2d)

# ==== cluster Cluster
A = ClusterInput()
B = ClusterInput()
num = Number(A)
num_2 = Number(B)
subtraction = Subtraction(A=num, B=num_2)
_10º = PowerOf10(Value="6")
multiplication = Multiplication(A=subtraction, B=_10º)
abs = Absolute(Value=multiplication)
larger = LargerThan(FirstNumber=abs, SecondNumber=0.999)  # -> LargerThan, OrEqualTo
not = GateNot(A=larger.LargerThan)
bool = Boolean(not)
bool_2 = ClusterOutput(bool)
