# Grasshopper definition GetGeometry_TrGen_10.gh (Grasshopper 1.0.7)
# plug-ins: GSA

panel = Panel("https://samples.oasys-software.com/gsa/10.1/Training_General/TrGen_10.gwb")
c_script = CSharpScript(x=panel)  # -> A; inputs x: String
# ---------- c_script: C# ----------
    string fileName = System.IO.Path.GetTempPath();

    //create webclient and download example file:
    System.Net.WebClient webClient = new System.Net.WebClient();
    webClient.DownloadFile(
      x,
      fileName + "Steel_Design_Simple.gwb");

    A = fileName + "Steel_Design_Simple.gwb";
# ---------- end c_script ----------
open = OpenModel(FilenameAndPath=c_script, File="C:\Users\kristjan.nielsen\AppData\Local\Temp\Steel_Design_Simple.gwb")
save = SaveGSAModel(
    GSAModel=open,
    Save=False,
    FileAndPath="C:\Users\kristjan.nielsen\Desktop\test2.gwb",
    File="C:\Users\kristjan.nielsen\Desktop\test2.gwb")
getgeo = GetModelGeometry(GSAModel=open, NodeFilterList="All", ElementFilterList="All", MemberFilterList="All", Mode=1, Unit="Meter")  # -> Nodes_m, _1DElements_m, _2DElements_m, _3DElements_m, _1DMembers_m, _2DMembers_m, _3DMembers_m
no = Node(getgeo.Nodes_m)
m1d = Member1D(getgeo._1DMembers_m)
e2d = Element2D(getgeo._2DElements_m)
m2d = Member2D(getgeo._2DMembers_m)
e1d = Element1D(getgeo._1DElements_m)
elem1dedit = Edit1DElement(Element1D=e1d)  # -> Element1D, Number, Line, Section, Group, Type, Offset, StartRelease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
elem2dedit = Edit2DElement(Element2D=e2d)  # -> Element2D, Number, AnalysisMesh, _2DProperty, Group, ElementType, Offset, Name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
nodeedit = EditNode(Node=no, Mode=1)  # -> Node, NodeNumber, NodePosition, NodeLocalAxis, NodeRestraints, DamperProperty, MassProperty, SpringProperty, NodeName, NodeColour
mem1dedit = Edit1DMember(Member1D=m1d, LengthUnit="Meter")  # -> Member1D, Member1dNumber, Curve, Section, MemberGroup, MemberType, _1DElementType, Offset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
mem2dedit = Edit2DMember(Member2D=m2d)  # -> Member2D, MemberNumber, Brep, InclPoints, InclCurves, _2DProperty, MemberGroup, MemberType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
deg = Degrees(Radians=elem1dedit.OrientationAngle)
int = Integer("87")
int_2 = Integer("88")
pt = Point(nodeedit.Node)
item = TreeItem(Tree=elem1dedit.Topology, Path="87", Index="0", Wrap=True)
item_2 = ListItem(List=flatten(elem2dedit.ElementType), Index=0, Wrap=True)
lng = ListLength(List=elem2dedit.Number)  # -> flatten(Length)
item_3 = TreeItem(Tree=elem2dedit.Topology, Path="88", Index="0", Wrap=True)
item_4 = ListItem(List=flatten(elem1dedit.Type), Index=0, Wrap=True)
item_5 = ListItem(List=reverse(elem1dedit.Group), Index=0, Wrap=True)
keysearch = KeyValueSearch(Keys=elem1dedit.Number, Values=elem1dedit.Number, Search=int)
keysearch_2 = KeyValueSearch(Keys=elem1dedit.Number, Values=elem1dedit.Number, Search=int_2)
item_6 = ListItem(List=reverse(mem1dedit.MemberGroup), Index=0, Wrap=True)
item_7 = ListItem(List=mem1dedit.Topology, Index=0, Wrap=True)
item_8 = ListItem(List=mem1dedit.MemberType, Index=0, Wrap=True)
item_9 = ListItem(List=mem2dedit.MemberType, Index=0, Wrap=True)
item_10 = ListItem(List=mem2dedit._2DElementType, Index=0, Wrap=True)
item_11 = ListItem(List=mem1dedit._1DElementType, Index=0, Wrap=True)
item_12 = ListItem(List=mem2dedit.Topology, Index=0, Wrap=True)
item_13 = ListItem(List=reverse(deg), Index=0, Wrap=True)
lng_2 = ListLength(List=mem1dedit.Member1D)
lng_3 = ListLength(List=mem2dedit.Member2D)
lng_4 = ListLength(List=elem2dedit.Element2D)
lng_5 = ListLength(List=pt)
item_14 = ListItem(List=nodeedit.MassProperty, Index=0, Wrap=True)
item_15 = ListItem(List=nodeedit.SpringProperty, Index=0, Wrap=True)
item_16 = ListItem(List=nodeedit.DamperProperty, Index=0, Wrap=True)
lng_6 = ListLength(List=elem1dedit.Element1D)
null = NullItem(Item=keysearch)  # -> NullFlags, InvalidFlags, Description
null_2 = NullItem(Item=keysearch_2)  # -> NullFlags, InvalidFlags, Description

# ---- group: Mem1dGroup
int_3 = Integer(item_6)

# ---- group: Mem2dTopo
txt = Text(item_12)

# ---- group: Mem1dCount
int_4 = Integer(lng_2)

# ---- group: Mem2dCount
int_5 = Integer(lng_3)

# ---- group: Mem1dType
txt_2 = Text(item_8)

# ---- group: Mem1dTopo
txt_3 = Text(item_7)

# ---- group: Mem2dType
txt_4 = Text(item_9)

# ---- group: Mem1dElemType
txt_5 = Text(item_11)

# ---- group: Mem2dAnalysisType
txt_6 = Text(item_10)

# ---- group: Elem1dTopo
int_6 = Integer(item)

# ---- group: NodeCount
int_7 = Integer(lng_5)

# ---- group: Elem1dIDs
bool = Boolean([null.NullFlags, null_2.NullFlags])

# ---- group: Elem1dType
txt_7 = Text(item_4)

# ---- group: Elem1dGrp
int_8 = Integer(item_5)

# ---- group: RotationAngle
num = Number(item_13)

# ---- group: Elem2dCount
int_9 = Integer(lng_4)

# ---- group: Elem2dsCount
int_10 = Integer(lng)

# ---- group: Elem2dType
txt_8 = Text(item_2)

# ---- group: Elem2dTopo
int_11 = Integer(item_3)

# ---- group: Elem1dCount
int_12 = Integer(lng_6)

# ---- group: MassProp
int_13 = Integer(item_14)

# ---- group: SpringProp
int_14 = Integer(item_15)

# ---- group: DamperProp
int_15 = Integer(item_16)

# ----
panel_2 = Panel(int_6)
panel_3 = Panel(int_7)
panel_4 = Panel(bool)
panel_5 = Panel(txt_7)
panel_6 = Panel(int_8)
panel_7 = Panel(num)
panel_8 = Panel(int_9)
panel_9 = Panel(int_10)
panel_10 = Panel(txt_8)
panel_11 = Panel(int_11)
panel_12 = Panel(int_12)
panel_13 = Panel(int_13)
panel_14 = Panel(int_14)
panel_15 = Panel(int_15)
panel_16 = Panel(int_3)
panel_17 = Panel(txt_2)
panel_18 = Panel(txt_3)
panel_19 = Panel(txt_4)
panel_20 = Panel(txt_6)
panel_21 = Panel(txt)
panel_22 = Panel(int_4)
panel_23 = Panel(txt_5)
panel_24 = Panel(int_5)
panel_25 = Panel(elem1dedit.Element1D)
panel_26 = Panel(elem2dedit.Element2D)
panel_27 = Panel(mem1dedit.Member1D)
panel_28 = Panel(mem2dedit.Member2D)
