# Grasshopper definition Member2d.gh (Grasshopper 1.0.7)
# Copyright: Arup
# plug-ins: GSA

brep = Brep(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)
pt = Point([Point(-1, 2, 0), Point(-1, 4, 0)])
crv = Curve([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])
mem2d = Create2DMember(Brep=brep, InclPoints=pt, InclCurves=crv, InternalOffset=True, Preview3dSection=False, Mesh_mode="Quad dominant")
mem2dedit = Edit2DMember(Member2D=mem2d, Preview3dSection=False)  # -> Member2D, MemberNumber, Brep, InclPoints, InclCurves, _2DProperty, MemberGroup, MemberType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

# ---- group: Member2d
m2d = Member2D(mem2dedit.Member2D)
