# Grasshopper definition Section3dPreview.gh (Grasshopper 1.0.7)
# Copyright: Arup
# plug-ins: GSA

crv = Curve([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])
brep = Brep(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)
mat = CreateMaterial(Material_type="Concrete", Design_Code="EC2-1-1", Grade="C30/37")
mat_2 = CreateMaterial(Material_type="Steel", Design_Code="EN 1993-1-1:2005", Grade="S355")
profile = CreateProfile(
    catalogueIndex=3,
    inclSS=False,
    lengthUnit="Centimeter",
    mode="Catalogue",
    Profile_type="Catalogue",
    Catalogue="Europrofile",
    Type="EP HE beams",
    Profile="HE HE300.A",
    typeIndex=27)
prop2d = Create2DProperty(Thickness_cm="30cm", Material=mat, ReferenceSurface="2", Type="Shell", Unit="cm")
end = EndPoints(Curve=crv)  # -> Start, End
section = CreateSection(Profile=profile, Material=mat_2, Basic_Offset="Top")
support = CreateSupport(Point=end.Start, Plane=PlaneXY(0, 0, 0), x=True, xx=False, y=True, yy=False, z=True, zz=False)
support_2 = CreateSupport(Point=end.End, Plane=PlaneXY(0, 0, 0), x=False, xx=False, y=True, yy=False, z=True, zz=False)
mem1d = Create1DMember(
    Curve=crv,
    Section=section,
    Preview3dSection=True,
    x1=False,
    x2=False,
    xx1=False,
    xx2=False,
    y1=False,
    y2=False,
    yy1=False,
    yy2=False,
    z1=False,
    z2=False,
    zz1=False,
    zz2=False)
mem2d = Create2DMember(Brep=brep, Property2D=prop2d, InternalOffset=True, Preview3dSection=True, Mesh_mode="Quad dominant")
faceload = CreateFaceLoad(Loadable2DObjects=mem2d, Axis=-1, Direction="z", Projected=False, Value_kN_m²="-5", Type="Uniform", Unit="kN/m²")
analyse = AnalyseModel(GSAGeometryIn_m=[support, support_2, mem1d, mem2d], Load=faceload, Analyse=True, ReMesh=True, Tolerance=0.01, Unit="m")  # -> Model, Report
move = Move(Geometry=mem1d, Motion=Vector(0, 0, 10))  # -> Geometry, Transform
move_2 = Move(Geometry=mem2d, Motion=Vector(0, 0, 10))  # -> Geometry, Transform
stretch = Stretch(Geometry=mem1d, Axis=Line((0, 0, 0), (10, 10, 0)), Length=20, Rigid=False)
stretch_2 = Stretch(Geometry=mem2d, Axis=Line((0, 0, 0), (10, 10, 0)), Length=20, Rigid=False)
selres = SelectResult(GSAModel=analyse.Model, Type="AnalysisCase", Case_ID="A1")
preview3d = Preview3DSections(ElementMember1D2D=analyse.Model, Unit="m")  # -> AnalysisLayerMesh, AnalysisLayerOutlines, DesignLayerMesh, DesignLayerOutlines
deformedpreview3d = PreviewDeformed3DSections(Result=selres, noDec=0, val=250, valMax=1000, valMin=0)  # -> Mesh, Outlines

# ---- group: DeformedMesh
mesh = Mesh(deformedpreview3d.Mesh)

# ---- group: DeformedOutlines
crv_2 = Curve(deformedpreview3d.Outlines)

# ---- group: AnalysisLayerMesh
mesh_2 = Mesh(preview3d.AnalysisLayerMesh)

# ---- group: AnalysisLayerOutlines
crv_3 = Curve(preview3d.AnalysisLayerOutlines)

# ---- group: DesignLayerMesh
mesh_3 = Mesh(preview3d.DesignLayerMesh)

# ---- group: DesignLayerOutlines
crv_4 = Curve(preview3d.DesignLayerOutlines)

# ---- group: TransformedMember1dPreview
mesh_4 = Mesh(move.Geometry)

# ---- group: TransformedMember2dPreview
mesh_5 = Mesh(move_2.Geometry)

# ---- group: MorphedMember1dPreview
mesh_6 = Mesh(stretch)

# ---- group: MorphedMember2dPreview
mesh_7 = Mesh(stretch_2)
