# Grasshopper definition GridPlaneSurface.gh (Grasshopper 1.0.7)
# Copyright: Arup
# plug-ins: GSA

gridplane = CreateGridPlane(GridPlaneID=0, Type="General")
gridplane_2 = CreateGridPlane(
    GridPlaneID=0,
    GridElevationInModelUnits=Slider(15, range=0..100),
    ToleranceAbove=Slider(0.11, range=0..1),
    ToleranceBelow=Slider(0.12, range=0..1),
    Type="Storey")
gridplane_3 = CreateGridPlane(GridPlaneID=0, GridElevationInModelUnits="15 m", ToleranceAbove="110mm", ToleranceBelow="120 mm", Type="Storey")
gridsurface = CreateGridSurface(GridSurfaceID=0, SpanDirection=0, Type="1D, One-way span")
gridsurface_2 = CreateGridSurface(
    GridPlane=gridplane_2,
    GridSurfaceID=0,
    ToleranceInModelUnits=Slider(0.25, range=0..1),
    SpanDirection=0,
    Type="1D, One-way span")
gridsurface_3 = CreateGridSurface(GridPlane=gridplane_3, GridSurfaceID=0, ToleranceInModelUnits="25 cm", SpanDirection=0, Type="1D, One-way span")
model = CreateModel(Load=gridplane, ReMesh=True, Tolerance=0.01, Unit="m")
model_2 = CreateModel(Load=gridsurface, ReMesh=True, Tolerance=0.01, Unit="m")
model_3 = CreateModel(Load=gridsurface_2, ReMesh=True, Tolerance=0.01, Unit="m")
model_4 = CreateModel(Load=gridsurface_3, ReMesh=True, Tolerance=0.01, Unit="m")
getloads = GetModelLoads(GSAModel=model, Unit="cm")  # -> LoadCases, GravityLoads, NodeLoads, BeamLoads, GridPointLoads_cm, GridLineLoads_cm, GridAreaLoads_cm, GridPlaneSurfaces_cm, GridPlaneSurfaces_m
getloads_2 = GetModelLoads(GSAModel=model_3, Unit="cm")  # -> LoadCases, GravityLoads, NodeLoads, BeamLoads, GridPointLoads_cm, GridLineLoads_cm, GridAreaLoads_cm, GridPlaneSurfaces_cm, GridPlaneSurfaces_m
getloads_3 = GetModelLoads(GSAModel=model_2, Unit="cm")  # -> LoadCases, GravityLoads, NodeLoads, BeamLoads, GridPointLoads_cm, GridLineLoads_cm, GridAreaLoads_cm, GridPlaneSurfaces_cm, GridPlaneSurfaces_m
getloads_4 = GetModelLoads(GSAModel=model_4, Unit="cm")  # -> LoadCases, GravityLoads, NodeLoads, BeamLoads, GridPointLoads_cm, GridLineLoads_cm, GridAreaLoads_cm, GridPlaneSurfaces_cm, GridPlaneSurfaces_m
gridplanesurfaceprop = GridPlaneSurfaceProperties(GridPlaneSurface=getloads.GridPlaneSurfaces_m, LengthUnit="Centimeter")  # -> GridPlane, GridPlaneID, GridPlaneName, IsStorey, Axis, AxisID, Elevation_cm, GridPlaneToleranceAbove_cm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
gridplanesurfaceprop_2 = GridPlaneSurfaceProperties(GridPlaneSurface=getloads_3.GridPlaneSurfaces_m, LengthUnit="Centimeter")  # -> GridPlane, GridPlaneID, GridPlaneName, IsStorey, Axis, AxisID, Elevation_cm, GridPlaneToleranceAbove_cm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
gridplanesurfaceprop_3 = GridPlaneSurfaceProperties(GridPlaneSurface=getloads_2.GridPlaneSurfaces_m, LengthUnit="Centimeter")  # -> GridPlane, GridPlaneID, GridPlaneName, IsStorey, Axis, AxisID, Elevation_cm, GridPlaneToleranceAbove_cm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
gridplanesurfaceprop_4 = GridPlaneSurfaceProperties(GridPlaneSurface=getloads_4.GridPlaneSurfaces_m, LengthUnit="Centimeter")  # -> GridPlane, GridPlaneID, GridPlaneName, IsStorey, Axis, AxisID, Elevation_cm, GridPlaneToleranceAbove_cm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

# ---- group: DefaultGpElevation
txt = Text(gridplanesurfaceprop.Elevation_cm)

# ---- group: DefaultGpTolAbove
txt_2 = Text(gridplanesurfaceprop.GridPlaneToleranceAbove_cm)

# ---- group: DefaultGpTolBelow
txt_3 = Text(gridplanesurfaceprop.GridPlaneToleranceBelow_cm)

# ---- group: DefaultGpTolerance
txt_4 = Text(gridplanesurfaceprop.GridSurfaceTolerance_cm)

# ---- group: DefaultGsElevation
txt_5 = Text(gridplanesurfaceprop_2.Elevation_cm)

# ---- group: DefaultGsTolAbove
txt_6 = Text(gridplanesurfaceprop_2.GridPlaneToleranceAbove_cm)

# ---- group: DefaultGsTolBelow
txt_7 = Text(gridplanesurfaceprop_2.GridPlaneToleranceBelow_cm)

# ---- group: DefaultGsTolerance
txt_8 = Text(gridplanesurfaceprop_2.GridSurfaceTolerance_cm)

# ---- group: NumInputElevation
txt_9 = Text(gridplanesurfaceprop_3.Elevation_cm)

# ---- group: NumInputTolAbove
txt_10 = Text(gridplanesurfaceprop_3.GridPlaneToleranceAbove_cm)

# ---- group: NumInputTolBelow
txt_11 = Text(gridplanesurfaceprop_3.GridPlaneToleranceBelow_cm)

# ---- group: NumInputTolerance
txt_12 = Text(gridplanesurfaceprop_3.GridSurfaceTolerance_cm)

# ---- group: TxtInputElevation
txt_13 = Text(gridplanesurfaceprop_4.Elevation_cm)

# ---- group: TxtInputTolAbove
txt_14 = Text(gridplanesurfaceprop_4.GridPlaneToleranceAbove_cm)

# ---- group: TxtInputTolBelow
txt_15 = Text(gridplanesurfaceprop_4.GridPlaneToleranceBelow_cm)

# ---- group: TxtInputTolerance
txt_16 = Text(gridplanesurfaceprop_4.GridSurfaceTolerance_cm)

# ----
panel = Panel(txt)
panel_2 = Panel(txt_2)
panel_3 = Panel(txt_3)
panel_4 = Panel(txt_4)
panel_5 = Panel(txt_5)
panel_6 = Panel(txt_6)
panel_7 = Panel(txt_7)
panel_8 = Panel(txt_8)
panel_9 = Panel(txt_9)
panel_10 = Panel(txt_10)
panel_11 = Panel(txt_11)
panel_12 = Panel(txt_12)
panel_13 = Panel(txt_13)
panel_14 = Panel(txt_14)
panel_15 = Panel(txt_15)
panel_16 = Panel(txt_16)
