# Grasshopper definition GridPointLoad.gh (Grasshopper 1.0.7)
# Copyright: Arup
# plug-ins: GSA

pt = ConstructPoint(XCoordinate="7.5", YCoordinate=0, ZCoordinate=0)
Z = UnitZ(Factor="4.5")
yz = YZPlane(Origin=pt)
xy = XYPlane(Origin=Z)
rev = Reverse(Vector=Z)
pt_2 = ConstructPoint(XCoordinate=Slider(5.5, range=0..5.5), YCoordinate=Slider(3.2, range=0..5.5), ZCoordinate="4.5")
mat = CreateMaterial(Material_type="Concrete", Design_Code="EC2-1-1", Grade="C30/37")
rectangle = Rectangle(Plane=xy, XSize="7.5", YSize="5.5", Radius=0)  # -> Rectangle, Length
explode = Explode(Curve=rectangle.Rectangle, Recursive=True)  # -> Segments, Vertices
shift = ShiftList(List=explode.Vertices, Shift=1, Wrap=False)
line = LineSDL(Start=shift, Direction=rev, Length="4.5")
profile = CreateProfile(
    Depth_cm="40",
    Width_cm="50",
    catalogueIndex=-1,
    inclSS=False,
    lengthUnit="Centimeter",
    mode="Other",
    Profile_type="Rectangle",
    Measure="cm",
    typeIndex=-1)
end = EndPoints(Curve=line)  # -> Start, End
prop2d = Create2DProperty(Thickness_cm="25", Material=mat, Type="Shell", Unit="cm")
pointload = CreateGridPointLoad(Point=pt_2, Direction="z", Axis=0, Value_kN="-500", ExpansionChanged=True, Mode=2, Unit="kN")

# ---- group: Remark
pointload_2 = CreateGridPointLoad(
    LoadCase="2",
    Point=pt_2,
    GridPlaneSurface=yz,
    Direction="z",
    Axis=0,
    Value_kN="-5",
    ExpansionChanged=True,
    Mode=2,
    Unit="kN")

# ----
section = CreateSection(Profile=profile, Material=mat, Basic_Offset="Centroid")
support = CreateSupport(Point=end.End, Plane=PlaneXY(0, 0, 0), x=True, xx=False, y=True, yy=False, z=True, zz=True)
mem2d = Create2DMember(Brep=rectangle.Rectangle, Property2D=prop2d, InternalOffset=True, Preview3dSection=False, Mesh_mode="Quad dominant")
mem1d = Create1DMember(
    Curve=line,
    Section=section,
    Preview3dSection=False,
    x1=False,
    x2=False,
    xx1=False,
    xx2=False,
    y1=False,
    y2=False,
    yy1=False,
    yy2=False,
    z1=False,
    z2=False,
    zz1=False,
    zz2=False)
model = CreateModel(GSAGeometryIn_m=flatten([mem1d, mem2d, support]), Load=[pointload, pointload_2], ReMesh=True, Tolerance=0.01, Unit="m")
analyse = AnalyseModel(ModelSAndLists=model, Analyse=True, ReMesh=False, Tolerance=0.01, Unit="m")  # -> Model, Report
loaddiagram = LoadDiagrams(GSAModel=model, Annotation=False, SignificantDigits=3, force="kN", length="mm", model="m", Case_ID="L1", Load_Type="All")  # -> DiagramLines, Annotations
item = ListItem(List=reverse(loaddiagram.DiagramLines), Index=0, Wrap=True)
selres = SelectResult(GSAModel=analyse.Model, Type="AnalysisCase", Case_ID="A1")
line_2 = Line(item)
totalresults = TotalLoadsAndReactions(Result=selres, Force_Unit="kN", Moment_Unit="kN·m")  # -> ΣFx, ΣFy, ΣFz, Σ_F, ΣMxx, ΣMyy, ΣMzz, Σ_M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
end_2 = EndPoints(Curve=line_2)  # -> Start, End
pdecon = Deconstruct(Point=end_2.End)  # -> XComponent, YComponent, ZComponent
pdecon_2 = Deconstruct(Point=pt_2)  # -> XComponent, YComponent, ZComponent
num = Number(totalresults.ΣFz)
equals = Equality(
    FirstNumber=[pdecon.XComponent, pdecon.YComponent, pdecon.ZComponent],
    SecondNumber=[pdecon_2.XComponent, pdecon_2.YComponent, pdecon_2.ZComponent])  # -> Equality, Inequality
equals_2 = Equality(FirstNumber=num, SecondNumber="-500")  # -> Equality, Inequality
ma = MassAddition(Input=equals.Inequality)  # -> Result, PartialResults
ma_2 = MassAddition(Input=equals_2.Inequality)  # -> Result, PartialResults

# ---- group: PointIsEqual
int = Integer(ma.Result)

# ---- group: LoadIsEqual
int_2 = Integer(ma_2.Result)
