# Grasshopper definition AnalysisTaskAndCase.gh (Grasshopper 1.0.7)
# plug-ins: GSA

panel = Panel("https://samples.oasys-software.com/gsa/10.1/Steel/Steel_Design_Simple.gwb")
c_script = CSharpScript(x=panel)  # -> A; inputs x: String
# ---------- c_script: C# ----------
    string fileName = System.IO.Path.GetTempPath();

    //create webclient and download example file:
    System.Net.WebClient webClient = new System.Net.WebClient();
    webClient.DownloadFile(
      x,
      fileName + "Steel_Design_Simple.gwb");

    A = fileName + "Steel_Design_Simple.gwb";
# ---------- end c_script ----------
open = OpenModel(FilenameAndPath=c_script)
getanalysis = GetModelAnalysis(GSAModel=open)  # -> AnalysisTasks, AnalysisCases, CombinationCases, DesignTasks
combinationinfo = CombinationCaseInfo(CombinationCase=getanalysis.CombinationCases)  # -> ID, Name, Description
caseinfo = AnalysisCaseInfo(AnalysisCase=getanalysis.AnalysisCases)  # -> Name, Description, CaseID
taskinfo = AnalysisTaskInfo(AnalysisTask=getanalysis.AnalysisTasks)  # -> Name, AnalysisCaseS, SolverType, TaskID

# ---- group: AnalysisTaskType
txt = Text(taskinfo.SolverType)

# ---- group: AnalysisTaskId
int = Integer(taskinfo.TaskID)

# ---- group: CombinationCaseName
txt_2 = Text(combinationinfo.Name)

# ---- group: AnalysisTaskName
txt_3 = Text(taskinfo.Name)

# ---- group: AnalysisTaskDescriptions
txt_4 = Text(taskinfo.AnalysisCaseS)

# ---- group: CombinationCaseDescription
txt_5 = Text(combinationinfo.Description)

# ---- group: CombinationCaseId
int_2 = Integer(combinationinfo.ID)

# ---- group: AnalysisCaseDescription
txt_6 = Text(caseinfo.Description)

# ---- group: AnalysisCaseId
int_3 = Integer(caseinfo.CaseID)

# ---- group: AnalysisCaseName
txt_7 = Text(caseinfo.Name)

# ----
panel_2 = Panel(txt_7)
panel_3 = Panel(txt_6)
panel_4 = Panel(int_3)
panel_5 = Panel(int_2)
panel_6 = Panel(txt_3)
panel_7 = Panel(int)
panel_8 = Panel(txt_2)
panel_9 = Panel(txt_5)
panel_10 = Panel(txt_4)
panel_11 = Panel(txt)
