# Grasshopper definition GetCreateAnalysisTaskAndCase.gh (Grasshopper 1.0.7)
# plug-ins: GSA

panel = Panel("https://samples.oasys-software.com/gsa/10.1/Steel/Steel_Design_Simple.gwb")
c_script = CSharpScript(x=panel)  # -> A; inputs x: String
# ---------- c_script: C# ----------
    string fileName = System.IO.Path.GetTempPath();

    //create webclient and download example file:
    System.Net.WebClient webClient = new System.Net.WebClient();
    webClient.DownloadFile(
      x,
      fileName + "Steel_Design_Simple.gwb");

    A = fileName + "Steel_Design_Simple.gwb";
# ---------- end c_script ----------
open = OpenModel(FilenameAndPath=c_script, File="C:\Users\kristjan.nielsen\AppData\Local\Temp\Steel_Design_Simple.gwb")
getanalysistasks = GetModelAnalysisTasks(GSAModel=open)  # -> AnalysisTasks, AnalysisCases
σc = CreateAnalysisCase(Name="acase1", Description="1.5L2")
σc_2 = CreateAnalysisCase(Name="acase2", Description="0.9L1")
edittask = EditAnalysisTask(AnalysisTask=getanalysistasks.AnalysisTasks, AnalysisCaseS=[σc, σc_2])  # -> AnalysisTask, Name, AnalysisCaseS, SolverType, TaskID
edittask_2 = EditAnalysisTask(AnalysisTask=getanalysistasks.AnalysisTasks)  # -> AnalysisTask, Name, AnalysisCaseS, SolverType, TaskID
caseinfo = AnalysisCaseInfo(AnalysisCase=getanalysistasks.AnalysisCases)  # -> Name, Description, CaseID
caseinfo_2 = AnalysisCaseInfo(AnalysisCase=edittask.AnalysisCaseS)  # -> Name, Description, CaseID
caseinfo_3 = AnalysisCaseInfo(AnalysisCase=edittask_2.AnalysisCaseS)  # -> Name, Description, CaseID
txt = Text(caseinfo.Description)
int = Integer(caseinfo.CaseID)

# ---- group: NewCaseDescriptions
txt_2 = Text(caseinfo_2.Description)

# ---- group: NewCaseIDs
int_2 = Integer(caseinfo_2.CaseID)

# ----
txt_3 = Text(caseinfo.Name)

# ---- group: NewCaseNames
txt_4 = Text(caseinfo_2.Name)

# ---- group: OriginalTask
σt = AnalysisTask(edittask_2.AnalysisTask)

# ---- group: OriginalTaskName
txt_5 = Text(edittask_2.Name)

# ---- group: OriginalCaseNames
txt_6 = Text(caseinfo_3.Name)

# ---- group: OriginalCaseDescriptions
txt_7 = Text(caseinfo_3.Description)

# ---- group: OriginalCaseIDs
int_3 = Integer(caseinfo_3.CaseID)

# ---- group: OriginalTaskType
txt_8 = Text(edittask_2.SolverType)

# ---- group: OriginalTaskID
int_4 = Integer(edittask_2.TaskID)

# ----
panel_2 = Panel(txt_3)
panel_3 = Panel(txt_4)
panel_4 = Panel(txt)
panel_5 = Panel(int)
panel_6 = Panel(txt_2)
panel_7 = Panel(int_2)
panel_8 = Panel(σt)
panel_9 = Panel(txt_5)
panel_10 = Panel(txt_6)
panel_11 = Panel(txt_7)
panel_12 = Panel(int_3)
panel_13 = Panel(txt_8)
panel_14 = Panel(int_4)
