# Grasshopper definition SteelDesignAndTask.gh (Grasshopper 1.0.7)
# Copyright: Arup
# plug-ins: GSA

profile = CreateProfile(
    catalogueIndex=3,
    lengthUnit="Centimeter",
    mode="Catalogue",
    Profile_type="Catalogue",
    Catalogue="Europrofile",
    Type="EP HE beams",
    Profile="HE HE550.B",
    typeIndex=27)
profile_2 = CreateProfile(
    catalogueIndex=3,
    lengthUnit="Centimeter",
    mode="Catalogue",
    Profile_type="Catalogue",
    Catalogue="Europrofile",
    Type="EP HE beams",
    Profile="HE HE400.A",
    typeIndex=27)
pt = ConstructPoint(XCoordinate=0, YCoordinate=0, ZCoordinate=0)
pt_2 = ConstructPoint(XCoordinate=0, YCoordinate="15", ZCoordinate=0)
pt_3 = ConstructPoint(XCoordinate="9.5", YCoordinate=0, ZCoordinate=0)
pt_4 = ConstructPoint(XCoordinate="9.5", YCoordinate="15", ZCoordinate=0)
mat = CreateMaterial(Material_type="Steel", Design_Code="EN 1993-1-1:2005", Grade="S355")
number_slider = Slider(0.6, range=0..1)
section = CreateSection(Profile=profile, Material=mat, Basic_Offset="Centroid")
section_2 = CreateSection(Profile=profile_2, Material=mat, Basic_Offset="Centroid")
ln = Line(StartPoint=pt, EndPoint=pt_2)
ln_2 = Line(StartPoint=pt_3, EndPoint=pt_4)
eval = EvaluateCurve(Curve=ln_2, Parameter=number_slider)  # -> Point, Tangent, Angle
eval_2 = EvaluateCurve(Curve=ln, Parameter=number_slider)  # -> Point, Tangent, Angle
editpb = EditSection(Section=[section, section_2], SectionPool="1")  # -> Section, SectionNumber, SectionProfile, Material, BasicOffset, AddOffsetY_cm, AddOffsetZ_cm, SectionModifier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
ln_3 = Line(StartPoint=eval_2.Point, EndPoint=eval.Point)
item = ListItem(List=editpb.Section, Index=0, Wrap=True)  # -> Item, Item1
support = CreateSupport(Point=[pt, pt_2, pt_3, pt_4], Plane=PlaneXY(0, 0, 0), x=True, xx=False, y=True, yy=False, z=True, zz=True)
mem1d = Create1DMember(
    Curve=ln_3,
    Property=item.Item1,
    MeshSizeInModelUnits="0.5",
    Preview3dSection=False,
    x1=False,
    x2=False,
    xx1=False,
    xx2=False,
    y1=False,
    y2=False,
    yy1=False,
    yy2=False,
    z1=False,
    z2=False,
    zz1=False,
    zz2=False)
mem1d_2 = Create1DMember(
    Curve=[ln, ln_2],
    Property=item.Item,
    MeshSizeInModelUnits="0.5",
    Preview3dSection=False,
    x1=False,
    x2=False,
    xx1=False,
    xx2=False,
    y1=False,
    y2=False,
    yy1=False,
    yy2=False,
    z1=False,
    z2=False,
    zz1=False,
    zz2=False)
panel = Panel("Fixed")

# ---- group: Effective Length
effectivelengthoptions = CreateEffectiveLengthOptions(
    MemberRestraintStart="Pinned",
    MemberRestraintEnd="Pinned",
    RestraintAlongMember="1",
    DestabilisingLoadHeight=0,
    Options="Internal restraints",
    Load_position="Shear centre")
mem1dedit = Edit1DMember(Member1D=mem1d_2, SetEffectiveLengthOptions=effectivelengthoptions, Preview3dSection=False)  # -> Member1D, Member1dNumber, Curve, Property, MemberGroup, MemberType, _1DElementType, Offset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
mem1dedit_2 = Edit1DMember(Member1D=mem1d, SetEffectiveLengthOptions=effectivelengthoptions, Preview3dSection=False)  # -> Member1D, Member1dNumber, Curve, Property, MemberGroup, MemberType, _1DElementType, Offset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

# ---- group: Loads
beamload = CreateBeamLoad(
    LoadCase="2",
    Loadable1DObjects="All",
    Axis=0,
    Direction="z",
    Projected=False,
    Value_kN_m="-5",
    Type="Uniform",
    Unit="kN/m")
gravityload = CreateGravityLoad(GravityFactor=Vector(0, 0, -1))

# ---- group: CombinationCase
createcombination = CreateCombinationCase(ID=0, Name="Combo", Description="1.35A1 + 1.5A2")

# ---- group: Heavy gravity to trigger multiple iterations
Z = UnitZ(Factor="-25")
gravityload_2 = CreateGravityLoad(GravityFactor=Z)

# ---- group: Create Section Pool
profile_3 = CreateProfile(
    Search="HEB",
    catalogueIndex=3,
    lengthUnit="Centimeter",
    mode="Catalogue",
    Profile_type="Catalogue",
    Catalogue="Europrofile",
    Type="EP HE beams",
    Profile="All",
    typeIndex=27)
section_3 = CreateSection(Profile=profile_3, Material=mat, Basic_Offset="Centroid")
panel_2 = Panel("1")
section_pool = CreateSteelSectionPool(SectionPoolID=panel_2, Section=section_3)

# ---- group: DesignTasks
σd = CreateSteelDesignTask(
    Name="Steel design task",
    Number=0,
    CombinationCase="1",
    TargetUtilisation=0.9,
    LowerLimit=0.05,
    GroupedDesign=False,
    Primary="Min Weight",
    Secondary="Min Depth")
σd_2 = CreateSteelDesignTask(
    Name="Steel design task main beams",
    Number="4",
    Definition=mem1dedit.Member1D,
    CombinationCase="1",
    TargetUtilisation="0.85",
    LowerLimit="0.65",
    GroupedDesign=Toggle(True),
    Primary="Min Cost",
    Secondary="Sustainable")

# ---- group: Probs without material
section_pool_2 = CreateSteelSectionPool(SectionPoolID=panel_2, Section=profile_3)

# ---- group: Warning
analyse = AnalyseModel(
    GSAGeometryIn_m=[support, mem1dedit.Member1D, mem1dedit_2.Member1D],
    Load=[beamload, gravityload],
    AnalysisTasksCombinations=[σd, σd_2],
    Analyse=True,
    ReMesh=True,
    Tolerance=0.01,
    Unit="m")  # -> Model, Errors, Warnings, Remarks, Logs

# ----
analyse_2 = AnalyseModel(
    GSAGeometryIn_m=[support, mem1dedit.Member1D, mem1dedit_2.Member1D],
    Load=[beamload, gravityload],
    AnalysisTasksCombinations=[createcombination, σd, σd_2],
    Analyse=True,
    ReMesh=True,
    Tolerance=0.01,
    Unit="m")  # -> Model, Errors, Warnings, Remarks, Logs
analyse_3 = AnalyseModel(
    Properties=section_pool_2,
    GSAGeometryIn_m=[support, mem1dedit.Member1D, mem1dedit_2.Member1D],
    Load=[beamload, gravityload_2],
    AnalysisTasksCombinations=[createcombination, σd, σd_2],
    Analyse=True,
    ReMesh=True,
    Tolerance=0.01,
    Unit="m")  # -> Model, Errors, Warnings, Remarks, Logs
analyse_4 = AnalyseModel(
    Properties=section_pool,
    GSAGeometryIn_m=[support, mem1dedit.Member1D, mem1dedit_2.Member1D],
    Load=[beamload, gravityload_2],
    AnalysisTasksCombinations=[createcombination, σd, σd_2],
    Analyse=True,
    ReMesh=True,
    Tolerance=0.01,
    Unit="m")  # -> Model, Errors, Warnings, Remarks, Logs
analyse_5 = AnalyseModel(
    Properties=section_pool,
    GSAGeometryIn_m=[support, mem1dedit.Member1D, mem1dedit_2.Member1D],
    Load=[beamload, gravityload_2],
    AnalysisTasksCombinations=[createcombination, σd, σd_2],
    Analyse=True,
    ReMesh=True,
    Tolerance=0.01,
    Unit="m")  # -> Model, Errors, Warnings, Remarks, Logs

# ---- group: Warning
steeldesign = SteelDesign(Model=analyse_3.Model, TaskNumber="1", Iterations=0, CheckOnly=False)  # -> Model, Errors, Warnings, Remarks, Logs

# ---- group: Error
steeldesign_2 = SteelDesign(Model=analyse_3.Model, TaskNumber="3", Iterations=0, CheckOnly=False)  # -> Model, Errors, Warnings, Remarks, Logs

steeldesign_3 = SteelDesign(Model=analyse_3.Model, Iterations="1", CheckOnly=False)  # -> Model, Errors, Warnings, Remarks, Logs

# ----
steeldesign_4 = SteelDesign(Model=analyse_5.Model, Iterations="1", CheckOnly=False)  # -> Model, Errors, Warnings, Remarks, Logs
steeldesign_5 = SteelDesign(Model=analyse_4.Model, Iterations="5", CheckOnly=False)  # -> Model, Errors, Warnings, Remarks, Logs
steeldesign_6 = SteelDesign(Model=analyse_2.Model, TaskNumber="1", Iterations=0, CheckOnly=False)  # -> Model, Errors, Warnings, Remarks, Logs
steeldesign_7 = SteelDesign(Model=analyse_2.Model, Iterations="3", CheckOnly=False)  # -> Model, Errors, Warnings, Remarks, Logs
steeldesign_8 = SteelDesign(Model=analyse_2.Model, Iterations=0, CheckOnly=Toggle(True))  # -> Model, Errors, Warnings, Remarks, Logs
item_2 = ListItem(List=steeldesign_3.Errors, Index=0, Wrap=True)
item_3 = ListItem(List=steeldesign.Warnings, Index=0, Wrap=True)
null = NullItem(Item=steeldesign_2.Model)  # -> NullFlags, InvalidFlags, Description

# ---- group: Converged1
txt = Text(steeldesign_7.Remarks)

# ---- group: AnalysisError
txt_2 = Text(item_2)

# ---- group: Converged2
txt_3 = Text(steeldesign_5.Remarks)

# ---- group: InefficiencyWarning
txt_4 = Text(item_3)

# ---- group: DesignTaskIdError
bool = Boolean(null.NullFlags)

# ---- group: NoIterations
txt_5 = Text(steeldesign_6.Remarks)

# ---- group: NotConverged
txt_6 = Text(steeldesign_4.Remarks)

# ---- group: CheckOption
txt_7 = Text(steeldesign_8.Logs)

# ----
selres = SelectResult(GSAModel=steeldesign_6.Model, Type="Combination", Case_ID="C1", Permutation="All")
contour1d = Contour1DResults(
    Result=selres,
    IntermediatePoints=10,
    Scale=10,
    Display=0,
    Mode=6,
    energy="MJ",
    envelope="Absolute",
    force="kN",
    legend=True,
    legendScale=1,
    length="mm",
    moment="kN·m",
    noDec=0,
    Result_Type="Steel Design",
    Component="Utilisation",
    slider=False,
    stress="MPa",
    val=0,
    valMax=1000,
    valMin=0)  # -> L, Colours, LegendValues

# ---- group: DesignTask test
getanalysis = GetModelAnalysis(GSAModel=analyse_2.Model)  # -> AnalysisTasks, AnalysisCases, CombinationCases, DesignTasks
item_4 = ListItem(List=getanalysis.DesignTasks, Index=0, Wrap=True)  # -> Item, Item1
designtaskinfo = DesignTaskInfo(DesignTask=item_4.Item1)  # -> Name, Number, Definition, CombinationCase, TargetUtilisation, LowerLimit, GroupedDesign, PrimaryObjective, SecondaryObjective
designtaskinfo_2 = DesignTaskInfo(DesignTask=item_4.Item)  # -> Name, Number, Definition, CombinationCase, TargetUtilisation, LowerLimit, GroupedDesign, PrimaryObjective, SecondaryObjective
designtaskinfo_3 = DesignTaskInfo(DesignTask=σd)  # -> Name, Number, Definition, CombinationCase, TargetUtilisation, LowerLimit, GroupedDesign, PrimaryObjective, SecondaryObjective
listinfo = ListInfo(List=designtaskinfo_3.Definition, Unit="m")  # -> Index, Name, Type, Definition, ListObjectsIn_m, ExpandList
listinfo_2 = ListInfo(List=designtaskinfo.Definition, Unit="m")  # -> Index, Name, Type, Definition, ListObjectsIn_m, ExpandList
listinfo_3 = ListInfo(List=designtaskinfo_2.Definition, Unit="m")  # -> Index, Name, Type, Definition, ListObjectsIn_m, ExpandList

# ---- group: DesignTask test / eta2
num = Number(designtaskinfo.TargetUtilisation)

# ---- group: DesignTask test / eta1
num_2 = Number(designtaskinfo_2.TargetUtilisation)

# ---- group: DesignTask test / Id2
int = Integer(designtaskinfo.Number)

# ---- group: DesignTask test / Id1
int_2 = Integer(designtaskinfo_2.Number)

# ---- group: DesignTask test / Name2
txt_8 = Text(designtaskinfo.Name)

# ---- group: DesignTask test / Case2
int_3 = Integer(designtaskinfo.CombinationCase)

# ---- group: DesignTask test / Name1
txt_9 = Text(designtaskinfo_2.Name)

# ---- group: DesignTask test / Case1
int_4 = Integer(designtaskinfo_2.CombinationCase)

# ---- group: DesignTask test / etamin2
num_3 = Number(designtaskinfo.LowerLimit)

# ---- group: DesignTask test / etamin1
num_4 = Number(designtaskinfo_2.LowerLimit)

# ---- group: DesignTask test / Group2
bool_2 = Boolean(designtaskinfo.GroupedDesign)

# ---- group: DesignTask test / Group1
bool_3 = Boolean(designtaskinfo_2.GroupedDesign)

# ---- group: DesignTask test / Primary2
txt_10 = Text(designtaskinfo.PrimaryObjective)

# ---- group: DesignTask test / Primary1
txt_11 = Text(designtaskinfo_2.PrimaryObjective)

# ---- group: DesignTask test / Secondary2
txt_12 = Text(designtaskinfo.SecondaryObjective)

# ---- group: DesignTask test / Secondary1
txt_13 = Text(designtaskinfo_2.SecondaryObjective)

# ---- group: DesignTask test / ListDefinition2
txt_14 = Text(listinfo_2.Definition)

# ---- group: DesignTask test / ListDefinition1
txt_15 = Text(listinfo_3.Definition)

# ---- group: DesignTask test / ListDefinition3
txt_16 = Text(listinfo.Definition)
