# Grasshopper definition SteelDesignTask.gh (Grasshopper 1.0.7)
# Copyright: Arup
# plug-ins: GSA

profile = CreateProfile(
    catalogueIndex=3,
    lengthUnit="Centimeter",
    mode="Catalogue",
    Profile_type="Catalogue",
    Catalogue="Europrofile",
    Type="EP HE beams",
    Profile="HE HE550.B",
    typeIndex=27)
profile_2 = CreateProfile(
    catalogueIndex=3,
    lengthUnit="Centimeter",
    mode="Catalogue",
    Profile_type="Catalogue",
    Catalogue="Europrofile",
    Type="EP HE beams",
    Profile="HE HE400.A",
    typeIndex=27)
pt = ConstructPoint(XCoordinate=0, YCoordinate=0, ZCoordinate=0)
pt_2 = ConstructPoint(XCoordinate=0, YCoordinate="15", ZCoordinate=0)
pt_3 = ConstructPoint(XCoordinate="9.5", YCoordinate=0, ZCoordinate=0)
pt_4 = ConstructPoint(XCoordinate="9.5", YCoordinate="15", ZCoordinate=0)
mat = CreateMaterial(Material_type="Steel", Design_Code="EN 1993-1-1:2005", Grade="S355")
number_slider = Slider(0.6, range=0..1)
section = CreateSection(Profile=profile, Material=mat, Basic_Offset="Centroid")
section_2 = CreateSection(Profile=profile_2, Material=mat, Basic_Offset="Centroid")
ln = Line(StartPoint=pt, EndPoint=pt_2)
ln_2 = Line(StartPoint=pt_3, EndPoint=pt_4)
eval = EvaluateCurve(Curve=ln_2, Parameter=number_slider)  # -> Point, Tangent, Angle
eval_2 = EvaluateCurve(Curve=ln, Parameter=number_slider)  # -> Point, Tangent, Angle
editpb = EditSection(Section=[section, section_2], SectionPool="1")  # -> Section, SectionNumber, SectionProfile, Material, BasicOffset, AddOffsetY_cm, AddOffsetZ_cm, SectionModifier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
ln_3 = Line(StartPoint=eval_2.Point, EndPoint=eval.Point)
item = ListItem(List=editpb.Section, Index=0, Wrap=True)  # -> Item, Item1
support = CreateSupport(Point=[pt, pt_2, pt_3, pt_4], Plane=PlaneXY(0, 0, 0), x=True, xx=False, y=True, yy=False, z=True, zz=True)
mem1d = Create1DMember(
    Curve=ln_3,
    Property=item.Item1,
    Preview3dSection=False,
    x1=False,
    x2=False,
    xx1=False,
    xx2=False,
    y1=False,
    y2=False,
    yy1=False,
    yy2=False,
    z1=False,
    z2=False,
    zz1=False,
    zz2=False)
mem1d_2 = Create1DMember(
    Curve=[ln, ln_2],
    Property=item.Item,
    Preview3dSection=False,
    x1=False,
    x2=False,
    xx1=False,
    xx2=False,
    y1=False,
    y2=False,
    yy1=False,
    yy2=False,
    z1=False,
    z2=False,
    zz1=False,
    zz2=False)
beamload = CreateBeamLoad(
    LoadCase="2",
    Loadable1DObjects="All",
    Axis=0,
    Direction="z",
    Projected=False,
    Value_kN_m="-5",
    Type="Uniform",
    Unit="kN/m")
gravityload = CreateGravityLoad(GravityFactor=Vector(0, 0, -1))
createcombination = CreateCombinationCase(ID=0, Name="Combo", Description="1.35A1 + 1.5A2")
σd = CreateSteelDesignTask(
    Name="Steel design task",
    Number=0,
    CombinationCase="1",
    TargetUtilisation=0.9,
    LowerLimit=0.05,
    GroupedDesign=False,
    Primary="Min Weight",
    Secondary="Min Depth")
σd_2 = CreateSteelDesignTask(
    Name="Steel design task main beams",
    Number="4",
    Definition=mem1d_2,
    CombinationCase="1",
    TargetUtilisation="0.85",
    LowerLimit="0.65",
    GroupedDesign=Toggle(True),
    Primary="Min Cost",
    Secondary="Sustainable")

# ---- group: Warning
analyse = AnalyseModel(
    GSAGeometryIn_m=[support, mem1d_2, mem1d],
    Load=[beamload, gravityload],
    AnalysisTasksCombinations=[σd, σd_2],
    Analyse=True,
    ReMesh=True,
    Tolerance=0.01,
    Unit="m")  # -> Model, Errors, Warnings, Remarks, Logs

# ----
analyse_2 = AnalyseModel(
    GSAGeometryIn_m=[support, mem1d_2, mem1d],
    Load=[beamload, gravityload],
    AnalysisTasksCombinations=[createcombination, σd, σd_2],
    Analyse=True,
    ReMesh=True,
    Tolerance=0.01,
    Unit="m")  # -> Model, Errors, Warnings, Remarks, Logs
getanalysis = GetModelAnalysis(GSAModel=analyse_2.Model)  # -> AnalysisTasks, AnalysisCases, CombinationCases, DesignTasks
selres = SelectResult(GSAModel=analyse_2.Model, Type="AnalysisCase", Case_ID="A1")
item_2 = ListItem(List=getanalysis.DesignTasks, Index=0, Wrap=True)  # -> Item, Item1
resultdiagram = ResultDiagrams(
    Result=selres,
    Annotation=False,
    SignificantDigits=3,
    force="kN",
    moment="kN·m",
    Type="Force",
    Diagram="Moment Myy",
    stress="MPa")  # -> DiagramLines, Annotations
designtaskinfo = DesignTaskInfo(DesignTask=item_2.Item1)  # -> Name, Number, Definition, CombinationCase, TargetUtilisation, LowerLimit, GroupedDesign, PrimaryObjective, SecondaryObjective
designtaskinfo_2 = DesignTaskInfo(DesignTask=item_2.Item)  # -> Name, Number, Definition, CombinationCase, TargetUtilisation, LowerLimit, GroupedDesign, PrimaryObjective, SecondaryObjective
designtaskinfo_3 = DesignTaskInfo(DesignTask=σd)  # -> Name, Number, Definition, CombinationCase, TargetUtilisation, LowerLimit, GroupedDesign, PrimaryObjective, SecondaryObjective
listinfo = ListInfo(List=designtaskinfo_3.Definition, Unit="m")  # -> Index, Name, Type, Definition, ListObjectsIn_m, ExpandList

# ---- group: eta2
num = Number(designtaskinfo.TargetUtilisation)

# ---- group: eta1
num_2 = Number(designtaskinfo_2.TargetUtilisation)

# ---- group: Name2
txt = Text(designtaskinfo.Name)

# ---- group: Id2
int = Integer(designtaskinfo.Number)

# ---- group: Case2
int_2 = Integer(designtaskinfo.CombinationCase)

# ---- group: Name1
txt_2 = Text(designtaskinfo_2.Name)

# ---- group: Id1
int_3 = Integer(designtaskinfo_2.Number)

# ---- group: Case1
int_4 = Integer(designtaskinfo_2.CombinationCase)

# ---- group: etamin2
num_3 = Number(designtaskinfo.LowerLimit)

# ---- group: etamin1
num_4 = Number(designtaskinfo_2.LowerLimit)

# ---- group: Group2
bool = Boolean(designtaskinfo.GroupedDesign)

# ---- group: Group1
bool_2 = Boolean(designtaskinfo_2.GroupedDesign)

# ---- group: Primary2
txt_3 = Text(designtaskinfo.PrimaryObjective)

# ---- group: Primary1
txt_4 = Text(designtaskinfo_2.PrimaryObjective)

# ---- group: Secondary2
txt_5 = Text(designtaskinfo.SecondaryObjective)

# ---- group: Secondary1
txt_6 = Text(designtaskinfo_2.SecondaryObjective)

# ----
listinfo_2 = ListInfo(List=designtaskinfo.Definition, Unit="m")  # -> Index, Name, Type, Definition, ListObjectsIn_m, ExpandList
listinfo_3 = ListInfo(List=designtaskinfo_2.Definition, Unit="m")  # -> Index, Name, Type, Definition, ListObjectsIn_m, ExpandList

# ---- group: ListDefinition2
txt_7 = Text(listinfo_2.Definition)

# ---- group: ListDefinition1
txt_8 = Text(listinfo_3.Definition)

# ---- group: ListDefinition3
txt_9 = Text(listinfo.Definition)
