# Grasshopper definition Element1dStandardAxis.gh (Grasshopper 1.0.7)
# plug-ins: GSA

profile = CreateProfile(
    catalogueIndex=3,
    lengthUnit="Centimeter",
    mode="Catalogue",
    Profile_type="Catalogue",
    Catalogue="Europrofile",
    Type="EP HE beams",
    Profile="HE HE450.B",
    typeIndex=27)
material = CustomMaterial(
    ElasticModulus_MPa="210000",
    PoissonsRatio=".3",
    Density_kg_m³="7850",
    Material_Type="Steel",
    Stress_Unit="MPa",
    Density_Unit="kg/m³",
    Temperature_Unit="°C")
pt = ConstructPoint(XCoordinate=0, YCoordinate=0, ZCoordinate=0)
pt_2 = ConstructPoint(XCoordinate=0, YCoordinate=Slider(10, range=0..100), ZCoordinate=0)
number_slider = Slider(1000, range=0..1000)
section = CreateSection(Profile=profile, Material=material, Basic_Offset="Centroid")
ln = Line(StartPoint=pt, EndPoint=pt_2)
end = EndPoints(Curve=ln)  # -> Start, End
midpt = CurveMiddle(Curve=ln)
pi = Pi(Factor=1)
spring = CreateSpringProperty(
    StiffnessX_N_mm=number_slider,
    StiffnessY_N_mm=number_slider,
    StiffnessZ_N_mm=number_slider,
    StiffnessXx_N_m_rad=number_slider,
    StiffnessYy_N_m_rad=number_slider,
    StiffnessZz_N_m_rad=number_slider,
    Type="General",
    Stiffness_Unit="N/mm",
    Rotational_Stiffness_Unit="N·m/rad")
mem1d = Create1DMember(
    Curve=ln,
    Property=section,
    MeshSizeInModelUnits="5",
    Preview3dSection=True,
    x1=False,
    x2=False,
    xx1=False,
    xx2=False,
    y1=False,
    y2=False,
    yy1=False,
    yy2=False,
    z1=False,
    z2=False,
    zz1=False,
    zz2=False)
support = CreateSupport(Point=end.End, Plane=PlaneXY(0, 0, 0), x=True, xx=True, y=True, yy=True, z=False, zz=True)
multiplication = Multiplication(A="0.5", B=pi)
support_2 = CreateSupport(Point=midpt, Plane=PlaneXY(0, 0, 0), x=False, xx=False, y=False, yy=False, z=False, zz=False)
mem1dedit = Edit1DMember(Member1D=mem1d, OrientationAngle=multiplication, Preview3dSection=False)  # -> Member1D, Member1dNumber, Curve, Property, MemberGroup, MemberType, _1DElementType, Offset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
nodeedit = EditNode(Node=end.Start, SpringProperty=spring, Mode=1)  # -> Node, NodeNumber, NodePosition, NodeLocalAxis, NodeRestraints, DamperProperty, MassProperty, SpringProperty, NodeName, NodeColour
xz = XZPlane(Origin=Point(0, 0, 0))
beamload = CreateBeamLoad(
    LoadCase="2",
    ElementList=mem1dedit.Member1D,
    Axis=0,
    Direction="x",
    Projected=False,
    Value_kN_m=Slider(100, range=0..100),
    Type="Uniform",
    Unit="kN/m")
gravityload = CreateGravityLoad(LoadCase="1", GravityFactor=Vector(0, 0, -1))
createcombination = CreateCombinationCase(ID=0, Name="ULS combination", Description="1.35A1 + 1.5A2")
nodeedit_2 = EditNode(Node=[support, support_2, nodeedit.Node], NodeLocalAxis=xz, Mode=1)  # -> Node, NodeNumber, NodePosition, NodeLocalAxis, NodeRestraints, DamperProperty, MassProperty, SpringProperty, NodeName, NodeColour
analyse = AnalyseModel(
    GSAGeometryIn_m=flatten([mem1dedit.Member1D, nodeedit_2.Node]),
    Loads=[gravityload, beamload],
    AnalysisTasksCombinations=createcombination,
    Analyse=True,
    ReMesh=True,
    Tolerance=0.05,
    Geometry_Unit="Meter")  # -> Model, Errors, Warnings, Remarks, Log
getgeo = GetModelGeometry(GSAModel=analyse.Model, Mode=1, Unit="m")  # -> NodesIn_m, _1DElementsIn_m, _2DElementsIn_m, _3DElementsIn_m, _1DMembersIn_m, _2DMembersIn_m, _3DMembersIn_m, Assemblies
selres = SelectResults(GSAModel=analyse.Model, Type="Combination", Case_ID="C1", Permutation="P1")
axes = LocalAxes(ElementMember1D=getgeo._1DMembersIn_m)  # -> LocalX, LocalY, LocalZ
deformedpreview3d = PreviewDeformed3DSections(Result=selres, noDec=0, val=4, valMax=1000, valMin=0)  # -> Mesh, Outlines
reactforce = ReactionForces(Result=selres, NodeFilterList="1", Axis="0", Max_Min="All", Force_Unit="kN", Moment_Unit="kN·m")  # -> ForceX_kN, ForceY_kN, ForceZ_kN, ForceXYZ_kN, MomentXX_kN_m, MomentYY_kN_m, MomentZZ_kN_m, MomentXXYYZZ_kN_m, NodesIDs
reactforce_2 = ReactionForces(Result=selres, NodeFilterList="1", Axis="-1", Max_Min="All", Force_Unit="kN", Moment_Unit="kN·m")  # -> ForceX_kN, ForceY_kN, ForceZ_kN, ForceXYZ_kN, MomentXX_kN_m, MomentYY_kN_m, MomentZZ_kN_m, MomentXXYYZZ_kN_m, NodesIDs
nodedisp = NodeDisplacements(Result=selres, Axis="-1", Max_Min="All", Unit="mm")  # -> TranslationsX_mm, TranslationsY_mm, TranslationsZ_mm, TranslationsXYZ_mm, RotationsXX_rad, RotationsYY_rad, RotationsZZ_rad, RotationsXYZ_rad, NodesIDs
nodedisp_2 = NodeDisplacements(Result=selres, Axis="0", Max_Min="All", Unit="mm")  # -> TranslationsX_mm, TranslationsY_mm, TranslationsZ_mm, TranslationsXYZ_mm, RotationsXX_rad, RotationsYY_rad, RotationsZZ_rad, RotationsXYZ_rad, NodesIDs
mem1ddisp = Member1DDisplacements(Result=selres, IntermediatePoints=3, Axis="0", Max_Min="All", Unit="mm")  # -> TranslationsX_mm, TranslationsY_mm, TranslationsZ_mm, TranslationsXYZ_mm, RotationsXX_rad, RotationsYY_rad, RotationsZZ_rad, RotationsXYZ_rad
mem1ddisp_2 = Member1DDisplacements(Result=selres, IntermediatePoints=3, Axis="-1", Max_Min="All", Unit="mm")  # -> TranslationsX_mm, TranslationsY_mm, TranslationsZ_mm, TranslationsXYZ_mm, RotationsXX_rad, RotationsYY_rad, RotationsZZ_rad, RotationsXYZ_rad
beamdisp = BeamDisplacements(Result=selres, ElementMemberFilterList="1", IntermediatePoints=3, Axis="-1", Max_Min="All", Unit="mm")  # -> TranslationsX_mm, TranslationsY_mm, TranslationsZ_mm, TranslationsXYZ_mm, RotationsXX_rad, RotationsYY_rad, RotationsZZ_rad, RotationsXYZ_rad
beamdisp_2 = BeamDisplacements(Result=selres, ElementMemberFilterList="1", IntermediatePoints=3, Axis="0", Max_Min="All", Unit="mm")  # -> TranslationsX_mm, TranslationsY_mm, TranslationsZ_mm, TranslationsXYZ_mm, RotationsXX_rad, RotationsYY_rad, RotationsZZ_rad, RotationsXYZ_rad
springforce = SpringReactionForces(Result=selres, NodeFilterList="3", Axis="0", Max_Min="All", Force_Unit="kN", Moment_Unit="kN·m")  # -> ForceX_kN, ForceY_kN, ForceZ_kN, ForceXYZ_kN, MomentXX_kN_m, MomentYY_kN_m, MomentZZ_kN_m, MomentXXYYZZ_kN_m, NodesIDs
springforce_2 = SpringReactionForces(Result=selres, NodeFilterList="3", Axis="-1", Max_Min="All", Force_Unit="kN", Moment_Unit="kN·m")  # -> ForceX_kN, ForceY_kN, ForceZ_kN, ForceXYZ_kN, MomentXX_kN_m, MomentYY_kN_m, MomentZZ_kN_m, MomentXXYYZZ_kN_m, NodesIDs
abs = Absolute(Value=springforce_2.ForceZ_kN)
abs_2 = Absolute(Value=springforce_2.ForceXYZ_kN)
abs_3 = Absolute(Value=springforce_2.MomentZZ_kN_m)
abs_4 = Absolute(Value=springforce_2.MomentXXYYZZ_kN_m)
abs_5 = Absolute(Value=springforce_2.ForceX_kN)
abs_6 = Absolute(Value=springforce_2.MomentXX_kN_m)
abs_7 = Absolute(Value=springforce.MomentZZ_kN_m)
abs_8 = Absolute(Value=springforce.MomentXXYYZZ_kN_m)
abs_9 = Absolute(Value=springforce_2.ForceY_kN)
abs_10 = Absolute(Value=springforce_2.MomentYY_kN_m)
abs_11 = Absolute(Value=springforce.MomentXX_kN_m)
abs_12 = Absolute(Value=springforce.ForceZ_kN)
abs_13 = Absolute(Value=springforce.ForceXYZ_kN)
abs_14 = Absolute(Value=springforce.MomentYY_kN_m)
abs_15 = Absolute(Value=springforce.ForceX_kN)
abs_16 = Absolute(Value=reactforce_2.ForceZ_kN)
abs_17 = Absolute(Value=reactforce_2.ForceXYZ_kN)
abs_18 = Absolute(Value=reactforce_2.MomentZZ_kN_m)
abs_19 = Absolute(Value=reactforce_2.MomentXXYYZZ_kN_m)
abs_20 = Absolute(Value=springforce.ForceY_kN)
abs_21 = Absolute(Value=reactforce_2.ForceX_kN)
abs_22 = Absolute(Value=reactforce_2.MomentXX_kN_m)
abs_23 = Absolute(Value=reactforce.MomentZZ_kN_m)
abs_24 = Absolute(Value=reactforce.MomentXXYYZZ_kN_m)
abs_25 = Absolute(Value=reactforce_2.ForceY_kN)
abs_26 = Absolute(Value=reactforce_2.MomentYY_kN_m)
abs_27 = Absolute(Value=reactforce.MomentXX_kN_m)
abs_28 = Absolute(Value=reactforce.ForceZ_kN)
abs_29 = Absolute(Value=reactforce.ForceXYZ_kN)
abs_30 = Absolute(Value=reactforce.MomentYY_kN_m)
abs_31 = Absolute(Value=nodedisp.TranslationsZ_mm)
abs_32 = Absolute(Value=nodedisp.TranslationsXYZ_mm)
abs_33 = Absolute(Value=reactforce.ForceX_kN)
abs_34 = Absolute(Value=nodedisp_2.TranslationsZ_mm)
abs_35 = Absolute(Value=nodedisp_2.TranslationsXYZ_mm)
abs_36 = Absolute(Value=nodedisp.TranslationsX_mm)
abs_37 = Absolute(Value=reactforce.ForceY_kN)
abs_38 = Absolute(Value=nodedisp_2.TranslationsX_mm)
abs_39 = Absolute(Value=nodedisp.TranslationsY_mm)
abs_40 = Absolute(Value=nodedisp_2.TranslationsY_mm)
abs_41 = Absolute(Value=beamdisp.TranslationsZ_mm)
abs_42 = Absolute(Value=beamdisp.TranslationsXYZ_mm)
abs_43 = Absolute(Value=beamdisp_2.TranslationsZ_mm)
abs_44 = Absolute(Value=beamdisp_2.TranslationsXYZ_mm)
abs_45 = Absolute(Value=beamdisp.TranslationsX_mm)
abs_46 = Absolute(Value=beamdisp_2.TranslationsX_mm)
abs_47 = Absolute(Value=beamdisp.TranslationsY_mm)
abs_48 = Absolute(Value=beamdisp_2.TranslationsY_mm)
abs_49 = Absolute(Value=mem1ddisp_2.TranslationsZ_mm)
abs_50 = Absolute(Value=mem1ddisp_2.TranslationsXYZ_mm)
abs_51 = Absolute(Value=mem1ddisp.TranslationsZ_mm)
abs_52 = Absolute(Value=mem1ddisp.TranslationsXYZ_mm)
abs_53 = Absolute(Value=mem1ddisp_2.TranslationsX_mm)
abs_54 = Absolute(Value=mem1ddisp.TranslationsX_mm)
abs_55 = Absolute(Value=mem1ddisp_2.TranslationsY_mm)
abs_56 = Absolute(Value=mem1ddisp.TranslationsY_mm)
sort = SortList(Keys=flatten(abs))  # -> Keys, ValuesA
sort_2 = SortList(Keys=flatten(abs_2))  # -> Keys, ValuesA
sort_3 = SortList(Keys=flatten(abs_3))  # -> Keys, ValuesA
sort_4 = SortList(Keys=flatten(abs_4))  # -> Keys, ValuesA
sort_5 = SortList(Keys=flatten(abs_5))  # -> Keys, ValuesA
sort_6 = SortList(Keys=flatten(abs_6))  # -> Keys, ValuesA
sort_7 = SortList(Keys=flatten(abs_7))  # -> Keys, ValuesA
sort_8 = SortList(Keys=flatten(abs_8))  # -> Keys, ValuesA
sort_9 = SortList(Keys=flatten(abs_9))  # -> Keys, ValuesA
sort_10 = SortList(Keys=flatten(abs_10))  # -> Keys, ValuesA
sort_11 = SortList(Keys=flatten(abs_11))  # -> Keys, ValuesA
sort_12 = SortList(Keys=flatten(abs_12))  # -> Keys, ValuesA
sort_13 = SortList(Keys=flatten(abs_13))  # -> Keys, ValuesA
sort_14 = SortList(Keys=flatten(abs_14))  # -> Keys, ValuesA
sort_15 = SortList(Keys=flatten(abs_15))  # -> Keys, ValuesA
sort_16 = SortList(Keys=flatten(abs_16))  # -> Keys, ValuesA
sort_17 = SortList(Keys=flatten(abs_17))  # -> Keys, ValuesA
sort_18 = SortList(Keys=flatten(abs_18))  # -> Keys, ValuesA
sort_19 = SortList(Keys=flatten(abs_19))  # -> Keys, ValuesA
sort_20 = SortList(Keys=flatten(abs_20))  # -> Keys, ValuesA
sort_21 = SortList(Keys=flatten(abs_21))  # -> Keys, ValuesA
sort_22 = SortList(Keys=flatten(abs_22))  # -> Keys, ValuesA
sort_23 = SortList(Keys=flatten(abs_23))  # -> Keys, ValuesA
sort_24 = SortList(Keys=flatten(abs_24))  # -> Keys, ValuesA
sort_25 = SortList(Keys=flatten(abs_25))  # -> Keys, ValuesA
sort_26 = SortList(Keys=flatten(abs_26))  # -> Keys, ValuesA
sort_27 = SortList(Keys=flatten(abs_27))  # -> Keys, ValuesA
sort_28 = SortList(Keys=flatten(abs_28))  # -> Keys, ValuesA
sort_29 = SortList(Keys=flatten(abs_29))  # -> Keys, ValuesA
sort_30 = SortList(Keys=flatten(abs_30))  # -> Keys, ValuesA
sort_31 = SortList(Keys=flatten(abs_31))  # -> Keys, ValuesA
sort_32 = SortList(Keys=flatten(abs_32))  # -> Keys, ValuesA
sort_33 = SortList(Keys=flatten(abs_33))  # -> Keys, ValuesA
sort_34 = SortList(Keys=flatten(abs_34))  # -> Keys, ValuesA
sort_35 = SortList(Keys=flatten(abs_35))  # -> Keys, ValuesA
sort_36 = SortList(Keys=flatten(abs_36))  # -> Keys, ValuesA
sort_37 = SortList(Keys=flatten(abs_37))  # -> Keys, ValuesA
sort_38 = SortList(Keys=flatten(abs_38))  # -> Keys, ValuesA
sort_39 = SortList(Keys=flatten(abs_39))  # -> Keys, ValuesA
sort_40 = SortList(Keys=flatten(abs_40))  # -> Keys, ValuesA
sort_41 = SortList(Keys=flatten(abs_41))  # -> Keys, ValuesA
sort_42 = SortList(Keys=flatten(abs_42))  # -> Keys, ValuesA
sort_43 = SortList(Keys=flatten(abs_43))  # -> Keys, ValuesA
sort_44 = SortList(Keys=flatten(abs_44))  # -> Keys, ValuesA
sort_45 = SortList(Keys=flatten(abs_45))  # -> Keys, ValuesA
sort_46 = SortList(Keys=flatten(abs_46))  # -> Keys, ValuesA
sort_47 = SortList(Keys=flatten(abs_47))  # -> Keys, ValuesA
sort_48 = SortList(Keys=flatten(abs_48))  # -> Keys, ValuesA
sort_49 = SortList(Keys=flatten(abs_49))  # -> Keys, ValuesA
sort_50 = SortList(Keys=flatten(abs_50))  # -> Keys, ValuesA
sort_51 = SortList(Keys=flatten(abs_51))  # -> Keys, ValuesA
sort_52 = SortList(Keys=flatten(abs_52))  # -> Keys, ValuesA
sort_53 = SortList(Keys=flatten(abs_53))  # -> Keys, ValuesA
sort_54 = SortList(Keys=flatten(abs_54))  # -> Keys, ValuesA
sort_55 = SortList(Keys=flatten(abs_55))  # -> Keys, ValuesA
sort_56 = SortList(Keys=flatten(abs_56))  # -> Keys, ValuesA
item = ListItem(List=reverse(sort.Keys), Index=0, Wrap=True)
item_2 = ListItem(List=reverse(sort_2.Keys), Index=0, Wrap=True)
item_3 = ListItem(List=reverse(sort_3.Keys), Index=0, Wrap=True)
item_4 = ListItem(List=reverse(sort_5.Keys), Index=0, Wrap=True)
item_5 = ListItem(List=reverse(sort_6.Keys), Index=0, Wrap=True)
item_6 = ListItem(List=reverse(sort_7.Keys), Index=0, Wrap=True)
item_7 = ListItem(List=reverse(sort_8.Keys), Index=0, Wrap=True)
item_8 = ListItem(List=reverse(sort_9.Keys), Index=0, Wrap=True)
item_9 = ListItem(List=reverse(sort_10.Keys), Index=0, Wrap=True)
item_10 = ListItem(List=reverse(sort_11.Keys), Index=0, Wrap=True)
item_11 = ListItem(List=reverse(sort_12.Keys), Index=0, Wrap=True)
item_12 = ListItem(List=reverse(sort_13.Keys), Index=0, Wrap=True)
item_13 = ListItem(List=reverse(sort_14.Keys), Index=0, Wrap=True)
item_14 = ListItem(List=reverse(sort_15.Keys), Index=0, Wrap=True)
item_15 = ListItem(List=reverse(sort_16.Keys), Index=0, Wrap=True)
item_16 = ListItem(List=reverse(sort_17.Keys), Index=0, Wrap=True)
item_17 = ListItem(List=reverse(sort_18.Keys), Index=0, Wrap=True)
item_18 = ListItem(List=reverse(sort_20.Keys), Index=0, Wrap=True)
item_19 = ListItem(List=reverse(sort_21.Keys), Index=0, Wrap=True)
item_20 = ListItem(List=reverse(sort_22.Keys), Index=0, Wrap=True)
item_21 = ListItem(List=reverse(sort_23.Keys), Index=0, Wrap=True)
item_22 = ListItem(List=reverse(sort_24.Keys), Index=0, Wrap=True)
item_23 = ListItem(List=reverse(sort_25.Keys), Index=0, Wrap=True)
item_24 = ListItem(List=reverse(sort_26.Keys), Index=0, Wrap=True)
item_25 = ListItem(List=reverse(sort_27.Keys), Index=0, Wrap=True)
item_26 = ListItem(List=reverse(sort_28.Keys), Index=0, Wrap=True)
item_27 = ListItem(List=reverse(sort_29.Keys), Index=0, Wrap=True)
item_28 = ListItem(List=reverse(sort_30.Keys), Index=0, Wrap=True)
item_29 = ListItem(List=reverse(sort_31.Keys), Index=0, Wrap=True)
item_30 = ListItem(List=reverse(sort_32.Keys), Index=0, Wrap=True)
item_31 = ListItem(List=reverse(sort_33.Keys), Index=0, Wrap=True)
item_32 = ListItem(List=reverse(sort_34.Keys), Index=0, Wrap=True)
item_33 = ListItem(List=reverse(sort_35.Keys), Index=0, Wrap=True)
item_34 = ListItem(List=reverse(sort_36.Keys), Index=0, Wrap=True)
item_35 = ListItem(List=reverse(sort_37.Keys), Index=0, Wrap=True)
item_36 = ListItem(List=reverse(sort_38.Keys), Index=0, Wrap=True)
item_37 = ListItem(List=reverse(sort_39.Keys), Index=0, Wrap=True)
item_38 = ListItem(List=reverse(sort_40.Keys), Index=0, Wrap=True)
item_39 = ListItem(List=reverse(sort_41.Keys), Index=0, Wrap=True)
item_40 = ListItem(List=reverse(sort_42.Keys), Index=0, Wrap=True)
item_41 = ListItem(List=reverse(sort_43.Keys), Index=0, Wrap=True)
item_42 = ListItem(List=reverse(sort_44.Keys), Index=0, Wrap=True)
item_43 = ListItem(List=reverse(sort_45.Keys), Index=0, Wrap=True)
item_44 = ListItem(List=reverse(sort_46.Keys), Index=0, Wrap=True)
item_45 = ListItem(List=reverse(sort_47.Keys), Index=0, Wrap=True)
item_46 = ListItem(List=reverse(sort_48.Keys), Index=0, Wrap=True)
item_47 = ListItem(List=reverse(sort_49.Keys), Index=0, Wrap=True)
item_48 = ListItem(List=reverse(sort_50.Keys), Index=0, Wrap=True)
item_49 = ListItem(List=reverse(sort_51.Keys), Index=0, Wrap=True)
item_50 = ListItem(List=reverse(sort_52.Keys), Index=0, Wrap=True)
item_51 = ListItem(List=reverse(sort_53.Keys), Index=0, Wrap=True)
item_52 = ListItem(List=reverse(sort_54.Keys), Index=0, Wrap=True)
item_53 = ListItem(List=reverse(sort_55.Keys), Index=0, Wrap=True)
item_54 = ListItem(List=reverse(sort_56.Keys), Index=0, Wrap=True)
num = Number(item_5)
num_2 = Number(item_3)
num_3 = Number(item_7)
num_4 = Number(item_10)
num_5 = Number(item_4)
num_6 = Number(item)
num_7 = Number(item_2)
num_8 = Number(item_6)
num_9 = Number(item_7)
num_10 = Number(item_8)
num_11 = Number(item_9)
num_12 = Number(item_14)
num_13 = Number(item_13)
num_14 = Number(item_11)
num_15 = Number(item_12)
num_16 = Number(item_18)
num_17 = Number(item_19)
num_18 = Number(item_20)
num_19 = Number(item_17)
num_20 = Number(item_22)
num_21 = Number(item_25)
num_22 = Number(item_21)
num_23 = Number(item_15)
num_24 = Number(item_16)
num_25 = Number(item_24)
num_26 = Number(item_22)
num_27 = Number(item_23)
num_28 = Number(item_31)
num_29 = Number(item_26)
num_30 = Number(item_28)
num_31 = Number(item_34)
num_32 = Number(item_29)
num_33 = Number(item_30)
num_34 = Number(item_27)
num_35 = Number(item_36)
num_36 = Number(item_32)
num_37 = Number(item_33)
num_38 = Number(item_35)
num_39 = Number(item_38)
num_40 = Number(item_37)
num_41 = Number(item_44)
num_42 = Number(item_43)
num_43 = Number(item_39)
num_44 = Number(item_40)
num_45 = Number(item_41)
num_46 = Number(item_42)
num_47 = Number(item_45)
num_48 = Number(item_46)
num_49 = Number(item_51)
num_50 = Number(item_47)
num_51 = Number(item_52)
num_52 = Number(item_49)
num_53 = Number(item_48)
num_54 = Number(item_50)
num_55 = Number(item_53)
num_56 = Number(item_54)
max_f = Panel(num_7)
max_fy = Panel(num_10)
max_fz = Panel(num_6)
max_fx = Panel(num_5)
max_f_2 = Panel(num_24)
max_mzz = Panel(num_2)
max_m = Panel(num_3)
max_fy_2 = Panel(num_27)
max_mzz_2 = Panel(num_8)
max_m_2 = Panel(num_9)
max_myy = Panel(num_11)
max_fz_2 = Panel(num_23)
max_myy_2 = Panel(num_13)
max_fz_3 = Panel(num_14)
max_f_3 = Panel(num_15)
max_u = Panel(num_33)
max_fy_3 = Panel(num_16)
max_uy = Panel(num_40)
max_uz = Panel(num_32)
max_fx_2 = Panel(num_17)
max_mzz_3 = Panel(num_19)
max_mxx = Panel(num)
max_m_3 = Panel(num_20)
max_mzz_4 = Panel(num_22)
max_m_4 = Panel(num_26)
max_myy_3 = Panel(num_25)
max_mxx_2 = Panel(num_4)
max_ux = Panel(num_31)
max_myy_4 = Panel(num_30)
max_fz_4 = Panel(num_29)
max_f_4 = Panel(num_34)
max_fx_3 = Panel(num_12)
max_uz_2 = Panel(num_36)
max_fy_4 = Panel(num_38)
max_u_2 = Panel(num_44)
max_u_3 = Panel(num_37)
max_mxx_3 = Panel(num_18)
max_uy_2 = Panel(num_39)
max_mxx_4 = Panel(num_21)
max_uy_3 = Panel(num_47)
max_uz_3 = Panel(num_43)
max_fx_4 = Panel(num_28)
max_ux_2 = Panel(num_42)
max_ux_3 = Panel(num_35)
max_u_4 = Panel(num_53)
max_uy_4 = Panel(num_55)
max_uz_4 = Panel(num_45)
max_u_5 = Panel(num_46)
max_uz_5 = Panel(num_50)
max_uy_5 = Panel(num_48)
max_ux_4 = Panel(num_49)
max_uz_6 = Panel(num_52)
max_u_6 = Panel(num_54)
max_ux_5 = Panel(num_41)
max_uy_6 = Panel(num_56)
max_ux_6 = Panel(num_51)
subtraction = Subtraction(A=max_ux_3, B=max_ux)
subtraction_2 = Subtraction(A=max_uy_2, B=max_uz)
subtraction_3 = Subtraction(A=max_u_3, B=max_u)
subtraction_4 = Subtraction(A=max_uz_2, B=max_uy)
subtraction_5 = Subtraction(A=max_myy_2, B=max_mzz)
subtraction_6 = Subtraction(A=max_m_2, B=max_m)
subtraction_7 = Subtraction(A=max_mzz_2, B=max_myy)
subtraction_8 = Subtraction(A=max_fx_3, B=max_fx)
subtraction_9 = Subtraction(A=max_fy_3, B=max_fz)
subtraction_10 = Subtraction(A=max_f_3, B=max_f)
subtraction_11 = Subtraction(A=max_mxx_2, B=max_mxx)
subtraction_12 = Subtraction(A=max_fz_3, B=max_fy)
subtraction_13 = Subtraction(A=max_ux_5, B=max_uz_3)
subtraction_14 = Subtraction(A=max_uy_5, B=max_ux_2)
subtraction_15 = Subtraction(A=max_u_5, B=max_u_2)
subtraction_16 = Subtraction(A=max_myy_4, B=max_mzz_3)
subtraction_17 = Subtraction(A=max_m_4, B=max_m_3)
subtraction_18 = Subtraction(A=max_uz_4, B=max_uy_3)
subtraction_19 = Subtraction(A=max_mzz_4, B=max_myy_3)
subtraction_20 = Subtraction(A=max_fx_4, B=max_fx_2)
subtraction_21 = Subtraction(A=max_fy_4, B=max_fz_2)
subtraction_22 = Subtraction(A=max_f_4, B=max_f_2)
subtraction_23 = Subtraction(A=max_mxx_4, B=max_mxx_3)
subtraction_24 = Subtraction(A=max_fz_4, B=max_fy_2)
subtraction_25 = Subtraction(A=max_ux_6, B=max_uz_5)
subtraction_26 = Subtraction(A=max_uy_6, B=max_ux_4)
subtraction_27 = Subtraction(A=max_u_6, B=max_u_4)
subtraction_28 = Subtraction(A=max_uz_6, B=max_uy_4)

# ---- group: d31
num_57 = Number(subtraction)

# ---- group: d32
num_58 = Number(subtraction_2)

# ---- group: d58
num_59 = Number(subtraction_6)

# ---- group: d33
num_60 = Number(subtraction_4)

# ---- group: d34
num_61 = Number(subtraction_3)

# ---- group: d56
num_62 = Number(subtraction_5)

# ---- group: d57
num_63 = Number(subtraction_7)

# ---- group: d55
num_64 = Number(subtraction_11)

# ---- group: d51
num_65 = Number(subtraction_8)

# ---- group: d52
num_66 = Number(subtraction_9)

# ---- group: d54
num_67 = Number(subtraction_10)

# ---- group: d21
num_68 = Number(subtraction_13)

# ---- group: d22
num_69 = Number(subtraction_14)

# ---- group: d24
num_70 = Number(subtraction_15)

# ---- group: d23
num_71 = Number(subtraction_18)

# ---- group: d45
num_72 = Number(subtraction_23)

# ---- group: d46
num_73 = Number(subtraction_16)

# ---- group: d48
num_74 = Number(subtraction_17)

# ---- group: d47
num_75 = Number(subtraction_19)

# ---- group: d41
num_76 = Number(subtraction_20)

# ---- group: d42
num_77 = Number(subtraction_21)

# ---- group: d44
num_78 = Number(subtraction_22)

# ---- group: d53
num_79 = Number(subtraction_12)

# ---- group: d11
num_80 = Number(subtraction_25)

# ---- group: d12
num_81 = Number(subtraction_26)

# ---- group: d14
num_82 = Number(subtraction_27)

# ---- group: d13
num_83 = Number(subtraction_28)

# ---- group: d43
num_84 = Number(subtraction_24)

# ----
panel = Panel(num_60)
panel_2 = Panel(num_61)
panel_3 = Panel(num_57)
panel_4 = Panel(num_58)
panel_5 = Panel(num_63)
panel_6 = Panel(num_59)
panel_7 = Panel(num_64)
panel_8 = Panel(num_79)
panel_9 = Panel(num_67)
panel_10 = Panel(num_62)
panel_11 = Panel(num_65)
panel_12 = Panel(num_71)
panel_13 = Panel(num_70)
panel_14 = Panel(num_68)
panel_15 = Panel(num_75)
panel_16 = Panel(num_74)
panel_17 = Panel(num_66)
panel_18 = Panel(num_72)
panel_19 = Panel(num_69)
panel_20 = Panel(num_84)
panel_21 = Panel(num_78)
panel_22 = Panel(num_73)
panel_23 = Panel(num_76)
panel_24 = Panel(num_83)
panel_25 = Panel(num_82)
panel_26 = Panel(num_80)
panel_27 = Panel(num_77)
panel_28 = Panel(num_81)
