# Grasshopper definition Element2dStandardAxis.gh (Grasshopper 1.0.7)
# plug-ins: GSA

number_slider = Slider(10, range=0..100)
number_slider_2 = Slider(10, range=0..100)
mat = CreateMaterial(Material_type="Concrete", Design_Code="EC2-1-1", Grade="C30/37")
pt = ConstructPoint(XCoordinate=0, YCoordinate=0, ZCoordinate=number_slider_2)
pt_2 = ConstructPoint(XCoordinate=0, YCoordinate=number_slider, ZCoordinate=number_slider_2)
pt_3 = ConstructPoint(XCoordinate=0, YCoordinate=number_slider, ZCoordinate=0)
pt_4 = ConstructPoint(XCoordinate=0, YCoordinate=0, ZCoordinate=0)
prop2d = Create2DProperty(Thickness_mm="500", Material=mat, Type="Shell", Unit="mm")
srf4pt = _4PointSurface(CornerA=pt_4, CornerB=pt, CornerC=pt_2, CornerD=pt_3)
pi = Pi(Factor=1)
support = CreateSupport(Point=[pt_4, pt_3], Plane=PlaneXY(0, 0, 0), x=True, xx=True, y=True, yy=True, z=True, zz=True)
mem2d = Create2DMember(
    Brep=srf4pt,
    Property2D=prop2d,
    MeshSizeInModelUnits="5",
    InternalOffset=True,
    Preview3dSection=False,
    Mesh_mode="Quad only")
multiplication = Multiplication(A="0.5", B=pi)
mem2dedit = Edit2DMember(Member2D=mem2d, OrientationAngle=multiplication, Preview3dSection=False)  # -> Member2D, MemberNumber, Brep, InclPoints, InclCurves, _2DProperty, MemberGroup, MemberType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
vec = VectorXYZ(XComponent=0, YComponent=0, ZComponent=Slider(-100, range=-100..0))  # -> Vector, Length
faceload = CreateFaceLoad(
    LoadCase="1",
    Loadable2DObjects=mem2dedit.Member2D,
    Axis=-1,
    Direction="z",
    Projected=False,
    Value_kN_m²=Slider(10, range=0..100),
    Type="Uniform",
    Unit="kN/m²")
gravityload = CreateGravityLoad(LoadCase="1", GravityFactor=vec.Vector)
analyse = AnalyseModel(
    GSAGeometryIn_m=[support, mem2dedit.Member2D],
    Load=[faceload, gravityload],
    Analyse=True,
    ReMesh=True,
    Tolerance=0.01,
    Unit="m")  # -> Model, Errors, Warnings, Remarks, Logs
selres = SelectResult(GSAModel=analyse.Model, Type="AnalysisCase", Case_ID="A1")
deformedpreview3d = PreviewDeformed3DSections(Result=selres, noDec=0, val=43, valMax=1000, valMin=0)  # -> Mesh, Outlines
disp2d = Element2DDisplacements(Result=selres, ElementMemberFilterList="1", Axis="-1", Max_Min="All", Unit="mm")  # -> TranslationsX_mm, TranslationsY_mm, TranslationsZ_mm, TranslationsXYZ_mm, RotationsXX_rad, RotationsYY_rad, RotationsZZ_rad, RotationsXYZ_rad
forces2d = Element2DForcesAndMoments(Result=selres, ElementMemberFilterList="1", Axis="0", Max_Min="All", Force_Unit="kN/m", Moment_Unit="kN")  # -> ForceX_kN_m, ForceY_kN_m, ForceZ_kN_m, ShearX_kN_m, ShearY_kN_m, MomentX_kN, MomentY_kN, MomentXY_kN, WoodArmerX_kN, WoodArmerY_kN
stress2d = Element2DStresses(Result=selres, ElementMemberFilterList="1", StressLayer=0, Axis="-1", Max_Min="All", Unit="MPa")  # -> StressXX_MPa, StressYY_MPa, StressZZ_MPa, StressXY_MPa, StressYZ_MPa, StressZX_MPa
forces2d_2 = Element2DForcesAndMoments(Result=selres, ElementMemberFilterList="1", Axis="-1", Max_Min="All", Force_Unit="kN/m", Moment_Unit="kN")  # -> ForceX_kN_m, ForceY_kN_m, ForceZ_kN_m, ShearX_kN_m, ShearY_kN_m, MomentX_kN, MomentY_kN, MomentXY_kN, WoodArmerX_kN, WoodArmerY_kN
disp2d_2 = Element2DDisplacements(Result=selres, ElementMemberFilterList="1", Axis="0", Max_Min="All", Unit="mm")  # -> TranslationsX_mm, TranslationsY_mm, TranslationsZ_mm, TranslationsXYZ_mm, RotationsXX_rad, RotationsYY_rad, RotationsZZ_rad, RotationsXYZ_rad
stress2d_2 = Element2DStresses(Result=selres, ElementMemberFilterList="1", StressLayer=0, Axis="0", Max_Min="All", Unit="MPa")  # -> StressXX_MPa, StressYY_MPa, StressZZ_MPa, StressXY_MPa, StressYZ_MPa, StressZX_MPa
abs = Absolute(Value=forces2d_2.ForceZ_kN_m)
abs_2 = Absolute(Value=forces2d_2.ShearX_kN_m)
abs_3 = Absolute(Value=forces2d_2.MomentY_kN)
abs_4 = Absolute(Value=forces2d_2.MomentXY_kN)
abs_5 = Absolute(Value=forces2d_2.ForceX_kN_m)
abs_6 = Absolute(Value=forces2d_2.ShearY_kN_m)
abs_7 = Absolute(Value=forces2d.MomentY_kN)
abs_8 = Absolute(Value=forces2d.MomentXY_kN)
abs_9 = Absolute(Value=forces2d_2.ForceY_kN_m)
abs_10 = Absolute(Value=forces2d_2.MomentX_kN)
abs_11 = Absolute(Value=forces2d.ShearY_kN_m)
abs_12 = Absolute(Value=forces2d.ForceZ_kN_m)
abs_13 = Absolute(Value=forces2d.ShearX_kN_m)
abs_14 = Absolute(Value=forces2d.MomentX_kN)
abs_15 = Absolute(Value=forces2d.ForceX_kN_m)
abs_16 = Absolute(Value=forces2d.ForceY_kN_m)
abs_17 = Absolute(Value=stress2d_2.StressYZ_MPa)
abs_18 = Absolute(Value=stress2d_2.StressZZ_MPa)
abs_19 = Absolute(Value=stress2d_2.StressXY_MPa)
abs_20 = Absolute(Value=stress2d_2.StressZX_MPa)
abs_21 = Absolute(Value=stress2d_2.StressXX_MPa)
abs_22 = Absolute(Value=stress2d_2.StressYY_MPa)
abs_23 = Absolute(Value=stress2d.StressXX_MPa)
abs_24 = Absolute(Value=stress2d.StressYY_MPa)
abs_25 = Absolute(Value=stress2d.StressYZ_MPa)
abs_26 = Absolute(Value=stress2d.StressZX_MPa)
abs_27 = Absolute(Value=stress2d.StressZZ_MPa)
abs_28 = Absolute(Value=stress2d.StressXY_MPa)
abs_29 = Absolute(Value=disp2d.TranslationsZ_mm)
abs_30 = Absolute(Value=disp2d.TranslationsXYZ_mm)
abs_31 = Absolute(Value=disp2d.RotationsZZ_rad)
abs_32 = Absolute(Value=disp2d.RotationsXYZ_rad)
abs_33 = Absolute(Value=disp2d.TranslationsX_mm)
abs_34 = Absolute(Value=disp2d.RotationsXX_rad)
abs_35 = Absolute(Value=disp2d_2.RotationsZZ_rad)
abs_36 = Absolute(Value=disp2d_2.RotationsXYZ_rad)
abs_37 = Absolute(Value=disp2d.TranslationsY_mm)
abs_38 = Absolute(Value=disp2d.RotationsYY_rad)
abs_39 = Absolute(Value=disp2d_2.RotationsXX_rad)
abs_40 = Absolute(Value=disp2d_2.TranslationsZ_mm)
abs_41 = Absolute(Value=disp2d_2.TranslationsXYZ_mm)
abs_42 = Absolute(Value=disp2d_2.RotationsYY_rad)
abs_43 = Absolute(Value=disp2d_2.TranslationsX_mm)
abs_44 = Absolute(Value=disp2d_2.TranslationsY_mm)
sort = SortList(Keys=flatten(abs))  # -> Keys, ValuesA
sort_2 = SortList(Keys=flatten(abs_2))  # -> Keys, ValuesA
sort_3 = SortList(Keys=flatten(abs_3))  # -> Keys, ValuesA
sort_4 = SortList(Keys=flatten(abs_4))  # -> Keys, ValuesA
sort_5 = SortList(Keys=flatten(abs_5))  # -> Keys, ValuesA
sort_6 = SortList(Keys=flatten(abs_6))  # -> Keys, ValuesA
sort_7 = SortList(Keys=flatten(abs_7))  # -> Keys, ValuesA
sort_8 = SortList(Keys=flatten(abs_8))  # -> Keys, ValuesA
sort_9 = SortList(Keys=flatten(abs_9))  # -> Keys, ValuesA
sort_10 = SortList(Keys=flatten(abs_10))  # -> Keys, ValuesA
sort_11 = SortList(Keys=flatten(abs_11))  # -> Keys, ValuesA
sort_12 = SortList(Keys=flatten(abs_12))  # -> Keys, ValuesA
sort_13 = SortList(Keys=flatten(abs_13))  # -> Keys, ValuesA
sort_14 = SortList(Keys=flatten(abs_14))  # -> Keys, ValuesA
sort_15 = SortList(Keys=flatten(abs_15))  # -> Keys, ValuesA
sort_16 = SortList(Keys=flatten(abs_16))  # -> Keys, ValuesA
sort_17 = SortList(Keys=flatten(abs_17))  # -> Keys, ValuesA
sort_18 = SortList(Keys=flatten(abs_18))  # -> Keys, ValuesA
sort_19 = SortList(Keys=flatten(abs_19))  # -> Keys, ValuesA
sort_20 = SortList(Keys=flatten(abs_20))  # -> Keys, ValuesA
sort_21 = SortList(Keys=flatten(abs_21))  # -> Keys, ValuesA
sort_22 = SortList(Keys=flatten(abs_22))  # -> Keys, ValuesA
sort_23 = SortList(Keys=flatten(abs_23))  # -> Keys, ValuesA
sort_24 = SortList(Keys=flatten(abs_24))  # -> Keys, ValuesA
sort_25 = SortList(Keys=flatten(abs_25))  # -> Keys, ValuesA
sort_26 = SortList(Keys=flatten(abs_26))  # -> Keys, ValuesA
sort_27 = SortList(Keys=flatten(abs_27))  # -> Keys, ValuesA
sort_28 = SortList(Keys=flatten(abs_28))  # -> Keys, ValuesA
sort_29 = SortList(Keys=flatten(abs_29))  # -> Keys, ValuesA
sort_30 = SortList(Keys=flatten(abs_30))  # -> Keys, ValuesA
sort_31 = SortList(Keys=flatten(abs_31))  # -> Keys, ValuesA
sort_32 = SortList(Keys=flatten(abs_32))  # -> Keys, ValuesA
sort_33 = SortList(Keys=flatten(abs_33))  # -> Keys, ValuesA
sort_34 = SortList(Keys=flatten(abs_34))  # -> Keys, ValuesA
sort_35 = SortList(Keys=flatten(abs_35))  # -> Keys, ValuesA
sort_36 = SortList(Keys=flatten(abs_36))  # -> Keys, ValuesA
sort_37 = SortList(Keys=flatten(abs_37))  # -> Keys, ValuesA
sort_38 = SortList(Keys=flatten(abs_38))  # -> Keys, ValuesA
sort_39 = SortList(Keys=flatten(abs_39))  # -> Keys, ValuesA
sort_40 = SortList(Keys=flatten(abs_40))  # -> Keys, ValuesA
sort_41 = SortList(Keys=flatten(abs_41))  # -> Keys, ValuesA
sort_42 = SortList(Keys=flatten(abs_42))  # -> Keys, ValuesA
sort_43 = SortList(Keys=flatten(abs_43))  # -> Keys, ValuesA
sort_44 = SortList(Keys=flatten(abs_44))  # -> Keys, ValuesA
item = ListItem(List=reverse(sort.Keys), Index=0, Wrap=True)
item_2 = ListItem(List=reverse(sort_2.Keys), Index=0, Wrap=True)
item_3 = ListItem(List=reverse(sort_3.Keys), Index=0, Wrap=True)
item_4 = ListItem(List=reverse(sort_5.Keys), Index=0, Wrap=True)
item_5 = ListItem(List=reverse(sort_6.Keys), Index=0, Wrap=True)
item_6 = ListItem(List=reverse(sort_4.Keys), Index=0, Wrap=True)
item_7 = ListItem(List=reverse(sort_7.Keys), Index=0, Wrap=True)
item_8 = ListItem(List=reverse(sort_8.Keys), Index=0, Wrap=True)
item_9 = ListItem(List=reverse(sort_9.Keys), Index=0, Wrap=True)
item_10 = ListItem(List=reverse(sort_10.Keys), Index=0, Wrap=True)
item_11 = ListItem(List=reverse(sort_11.Keys), Index=0, Wrap=True)
item_12 = ListItem(List=reverse(sort_12.Keys), Index=0, Wrap=True)
item_13 = ListItem(List=reverse(sort_13.Keys), Index=0, Wrap=True)
item_14 = ListItem(List=reverse(sort_14.Keys), Index=0, Wrap=True)
item_15 = ListItem(List=reverse(sort_15.Keys), Index=0, Wrap=True)
item_16 = ListItem(List=reverse(sort_16.Keys), Index=0, Wrap=True)
item_17 = ListItem(List=reverse(sort_17.Keys), Index=0, Wrap=True)
item_18 = ListItem(List=reverse(sort_18.Keys), Index=0, Wrap=True)
item_19 = ListItem(List=reverse(sort_19.Keys), Index=0, Wrap=True)
item_20 = ListItem(List=reverse(sort_20.Keys), Index=0, Wrap=True)
item_21 = ListItem(List=reverse(sort_21.Keys), Index=0, Wrap=True)
item_22 = ListItem(List=reverse(sort_22.Keys), Index=0, Wrap=True)
item_23 = ListItem(List=reverse(sort_23.Keys), Index=0, Wrap=True)
item_24 = ListItem(List=reverse(sort_24.Keys), Index=0, Wrap=True)
item_25 = ListItem(List=reverse(sort_25.Keys), Index=0, Wrap=True)
item_26 = ListItem(List=reverse(sort_27.Keys), Index=0, Wrap=True)
item_27 = ListItem(List=reverse(sort_28.Keys), Index=0, Wrap=True)
item_28 = ListItem(List=reverse(sort_26.Keys), Index=0, Wrap=True)
item_29 = ListItem(List=reverse(sort_29.Keys), Index=0, Wrap=True)
item_30 = ListItem(List=reverse(sort_30.Keys), Index=0, Wrap=True)
item_31 = ListItem(List=reverse(sort_31.Keys), Index=0, Wrap=True)
item_32 = ListItem(List=reverse(sort_33.Keys), Index=0, Wrap=True)
item_33 = ListItem(List=reverse(sort_34.Keys), Index=0, Wrap=True)
item_34 = ListItem(List=reverse(sort_35.Keys), Index=0, Wrap=True)
item_35 = ListItem(List=reverse(sort_36.Keys), Index=0, Wrap=True)
item_36 = ListItem(List=reverse(sort_37.Keys), Index=0, Wrap=True)
item_37 = ListItem(List=reverse(sort_38.Keys), Index=0, Wrap=True)
item_38 = ListItem(List=reverse(sort_39.Keys), Index=0, Wrap=True)
item_39 = ListItem(List=reverse(sort_40.Keys), Index=0, Wrap=True)
item_40 = ListItem(List=reverse(sort_41.Keys), Index=0, Wrap=True)
item_41 = ListItem(List=reverse(sort_42.Keys), Index=0, Wrap=True)
item_42 = ListItem(List=reverse(sort_43.Keys), Index=0, Wrap=True)
item_43 = ListItem(List=reverse(sort_44.Keys), Index=0, Wrap=True)
num = Number(item_5)
num_2 = Number(item_3)
num_3 = Number(item_4)
num_4 = Number(item)
num_5 = Number(item_2)
num_6 = Number(item_6)
num_7 = Number(item_11)
num_8 = Number(item_7)
num_9 = Number(item_8)
num_10 = Number(item_10)
num_11 = Number(item_14)
num_12 = Number(item_9)
num_13 = Number(item_15)
num_14 = Number(item_12)
num_15 = Number(item_13)
num_16 = Number(item_16)
num_17 = Number(item_17)
num_18 = Number(item_21)
num_19 = Number(item_20)
num_20 = Number(item_18)
num_21 = Number(item_19)
num_22 = Number(item_22)
num_23 = Number(item_26)
num_24 = Number(item_25)
num_25 = Number(item_23)
num_26 = Number(item_24)
num_27 = Number(item_28)
num_28 = Number(item_27)
num_29 = Number(item_33)
num_30 = Number(item_32)
num_31 = Number(item_29)
num_32 = Number(item_31)
num_33 = Number(item_35)
num_34 = Number(item_38)
num_35 = Number(item_34)
num_36 = Number(item_35)
num_37 = Number(item_30)
num_38 = Number(item_37)
num_39 = Number(item_36)
num_40 = Number(item_42)
num_41 = Number(item_39)
num_42 = Number(item_40)
num_43 = Number(item_41)
num_44 = Number(item_43)
max_my = Panel(num_2)
max_mxy = Panel(num_6)
max_mx = Panel(num_10)
max_nxy = Panel(num_4)
max_qx = Panel(num_5)
max_my_2 = Panel(num_8)
max_ny = Panel(num_12)
max_mxy_2 = Panel(num_9)
max_nxy_2 = Panel(num_14)
max_mx_2 = Panel(num_11)
max_qz = Panel(num)
max_qx_2 = Panel(num_15)
max_ny_2 = Panel(num_16)
max_nx = Panel(num_3)
max_qz_2 = Panel(num_7)
max_zz = Panel(num_20)
max_xy = Panel(num_21)
max_zx = Panel(num_19)
max_zz_2 = Panel(num_23)
max_xy_2 = Panel(num_28)
max_zx_2 = Panel(num_27)
max_nx_2 = Panel(num_13)
max_yy = Panel(num_22)
max_yy_2 = Panel(num_26)
max_yz = Panel(num_17)
max_yz_2 = Panel(num_24)
max_xx = Panel(num_18)
max_xx_2 = Panel(num_25)
max_u = Panel(num_37)
max_uy = Panel(num_39)
max_uz = Panel(num_31)
max_ux = Panel(num_30)
max_rzz = Panel(num_32)
max_r = Panel(num_33)
max_rzz_2 = Panel(num_35)
max_r_2 = Panel(num_36)
max_ryy = Panel(num_38)
max_uz_2 = Panel(num_41)
max_ryy_2 = Panel(num_43)
max_u_2 = Panel(num_42)
max_uy_2 = Panel(num_44)
max_rxx = Panel(num_29)
max_rxx_2 = Panel(num_34)
max_ux_2 = Panel(num_40)
subtraction = Subtraction(A=max_mx_2, B=max_mx)
subtraction_2 = Subtraction(A=max_mxy_2, B=max_mxy)
subtraction_3 = Subtraction(A=max_my_2, B=max_my)
subtraction_4 = Subtraction(A=max_nx_2, B=max_ny)
subtraction_5 = Subtraction(A=max_ny_2, B=max_nx)
subtraction_6 = Subtraction(A=max_qx_2, B=max_qz)
subtraction_7 = Subtraction(A=max_qz_2, B=max_qx)
subtraction_8 = Subtraction(A=max_zx, B=max_yz_2)
subtraction_9 = Subtraction(A=max_nxy_2, B=max_nxy)
subtraction_10 = Subtraction(A=max_xx, B=max_yy_2)
subtraction_11 = Subtraction(A=max_yy, B=max_xx_2)
subtraction_12 = Subtraction(A=max_xy, B=max_xy_2)
subtraction_13 = Subtraction(A=max_yz, B=max_zx_2)
subtraction_14 = Subtraction(A=max_zz, B=max_zz_2)
subtraction_15 = Subtraction(A=max_ryy_2, B=max_ryy)
subtraction_16 = Subtraction(A=max_r_2, B=max_r)
subtraction_17 = Subtraction(A=max_rzz_2, B=max_rxx)
subtraction_18 = Subtraction(A=max_ux_2, B=max_uz)
subtraction_19 = Subtraction(A=max_uy_2, B=max_uy)
subtraction_20 = Subtraction(A=max_u_2, B=max_u)
subtraction_21 = Subtraction(A=max_rxx_2, B=max_rzz)
subtraction_22 = Subtraction(A=max_uz_2, B=max_ux)

# ---- group: d25
num_45 = Number(subtraction_7)

# ---- group: d28
num_46 = Number(subtraction_2)

# ---- group: d27
num_47 = Number(subtraction_3)

# ---- group: d21
num_48 = Number(subtraction_4)

# ---- group: d24
num_49 = Number(subtraction_6)

# ---- group: d35
num_50 = Number(subtraction_13)

# ---- group: d36
num_51 = Number(subtraction_8)

# ---- group: d26
num_52 = Number(subtraction)

# ---- group: d22
num_53 = Number(subtraction_5)

# ---- group: d31
num_54 = Number(subtraction_10)

# ---- group: d34
num_55 = Number(subtraction_12)

# ---- group: d23
num_56 = Number(subtraction_9)

# ---- group: d32
num_57 = Number(subtraction_11)

# ---- group: d33
num_58 = Number(subtraction_14)

# ---- group: d15
num_59 = Number(subtraction_21)

# ---- group: d16
num_60 = Number(subtraction_15)

# ---- group: d18
num_61 = Number(subtraction_16)

# ---- group: d17
num_62 = Number(subtraction_17)

# ---- group: d11
num_63 = Number(subtraction_18)

# ---- group: d14
num_64 = Number(subtraction_20)

# ---- group: d12
num_65 = Number(subtraction_19)

# ---- group: d13
num_66 = Number(subtraction_22)

# ----
panel = Panel(num_47)
panel_2 = Panel(num_46)
panel_3 = Panel(num_45)
panel_4 = Panel(num_56)
panel_5 = Panel(num_49)
panel_6 = Panel(num_52)
panel_7 = Panel(num_48)
panel_8 = Panel(num_50)
panel_9 = Panel(num_53)
panel_10 = Panel(num_58)
panel_11 = Panel(num_55)
panel_12 = Panel(num_51)
panel_13 = Panel(num_54)
panel_14 = Panel(num_57)
panel_15 = Panel(num_62)
panel_16 = Panel(num_61)
panel_17 = Panel(num_59)
panel_18 = Panel(num_66)
panel_19 = Panel(num_64)
panel_20 = Panel(num_63)
panel_21 = Panel(num_60)
panel_22 = Panel(num_65)
