# Grasshopper definition ParametersCast.gh (Grasshopper 1.0.7)
# Copyright: Arup
# plug-ins: GSA

panel = Panel("https://samples.oasys-software.com/gsa/10.1/Steel/Steel_Design_Simple.gwb")
pt = ConstructPoint(XCoordinate=0, YCoordinate=0, ZCoordinate=0)
pt_2 = ConstructPoint(XCoordinate="4", YCoordinate="4", ZCoordinate="4")
pt_3 = ConstructPoint(XCoordinate=0, YCoordinate=0, ZCoordinate=0)
pt_4 = ConstructPoint(XCoordinate="4", YCoordinate=0, ZCoordinate=0)
pt_5 = ConstructPoint(XCoordinate="4", YCoordinate="4", ZCoordinate=0)
pt_6 = ConstructPoint(XCoordinate=0, YCoordinate="4", ZCoordinate=0)
beamload = CreateBeamLoad(LoadCase=1, ElementList="all", Axis=0, Direction="z", Projected=False, Value_kN_m="-5", Type="Uniform", Unit="kN/m")
box = Box2Pt(PointA=pt, PointB=pt_2, Plane=PlaneXY(0, 0, 0))
# A SelectResult component might have been inserted here.
# If you edit this file, then delete the SelectResult, lock the solver,
# connect the model output to the result input on the NodeContour
# component (red line) and save before enabling the solver again.
c_script = CSharpScript(x=panel)  # -> A; inputs x: String
# ---------- c_script: C# ----------
    string fileName = System.IO.Path.GetTempPath();

    //create webclient and download example file:
    System.Net.WebClient webClient = new System.Net.WebClient();
    webClient.DownloadFile(
      x,
      fileName + "Steel_Design_Simple.gwb");

    A = fileName + "Steel_Design_Simple.gwb";
# ---------- end c_script ----------
material = CreateMaterial(Material_type="Timber", Grade="EN 338 C14")
material_2 = CreateCustomMaterial(
    ElasticModulus_MPa="1",
    PoissonsRatio="1",
    Density_kg_m³="1",
    Material_Type="Timber",
    Stress_Unit="MPa",
    Density_Unit="kg/m³",
    Temperature_Unit="°C")
material_3 = CreateMaterial(Material_type="Concrete", Design_Code="EC2-1-1", Grade="C12/15")
pt_7 = ConstructPoint(XCoordinate=0, YCoordinate=0, ZCoordinate=0)
pt_8 = ConstructPoint(XCoordinate=0, YCoordinate="4", ZCoordinate=0)
srf4pt = _4PointSurface(CornerA=pt_3, CornerB=pt_4, CornerC=pt_5, CornerD=pt_6)
createlist = CreateList(Index=0, Definition="1 to 5", Type="Node")
faceload = CreateFaceLoad(LoadCase=1, ElementList="all", Axis=-1, Direction="z", Projected=False, Value_kN_m²="-5", Type="Uniform", Unit="kN/m²")
gridplane = CreateGridPlane(GridPlaneID=0, Type="General")
pt_9 = ConstructPoint(XCoordinate="2", YCoordinate="2", ZCoordinate=0)
pt_10 = ConstructPoint(XCoordinate=0, YCoordinate="4", ZCoordinate=0)
pt_11 = ConstructPoint(XCoordinate=0, YCoordinate=0, ZCoordinate=0)
areaload = CreateGridAreaLoad(
    LoadCase=1,
    Brep=srf4pt,
    Direction="z",
    Axis=0,
    Projected=False,
    Value_kN_m²="-5",
    ExpansionChanged=False,
    Mode=1,
    Unit="kN/m²")
mem3d = Create3DMember(Solid=box)
elemfrommem = ElementsFromMembers(_3DMembers_m=mem3d, Tolerance=0.01, Unit="m")  # -> Nodes, _1DElements, _2DElements, _3DElements, GSAModel
ln = Line(StartPoint=pt_7, EndPoint=pt_8)
prop2d = Create2DProperty(Thickness_cm="400 mm", Material=material, Type="Shell", Unit="cm")
elem3dedit = Edit3DElement(Element3D=elemfrommem._3DElements)  # -> Element3D, Number, flatten(AnalysisMesh), _3DProperty, Group, ElementType, Name, Colour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
mplane = MeshPlane(Boundary={Plane=PlaneXY(0, 0, 0), Size=Domain2(u=-10..10, v=-10..10)}, WidthCount=10, HeightCount=10)  # -> Mesh, Area
offset = CreateOffset(Measure="m")
open = OpenModel(FilenameAndPath=c_script)
spring = CreateSpringProperty(Stiffness_N_m="7", Type="Axial", Stiffness_Unit="N/m")
σa = CreateAnalysisCase(Name="name", Description="A1")
gridsurface = CreateGridSurface(GridSurfaceID=0, SpanDirection=0, Type="1D, One-way span")
pt_12 = ConstructPoint(XCoordinate=0, YCoordinate=0, ZCoordinate=0)
gravityload = CreateGravityLoad(LoadCase=null, GravityFactor=Vector(0, 0, -1))
b6 = CreateBool6(x=True, xx=False, y=True, yy=False, z=True, zz=False)
arc = Arc3Pt(PointA=pt_11, PointB=pt_9, PointC=pt_10)  # -> Arc, Plane, Radius
panel_2 = Panel("""A
1""")
crv = Curve(ln)
pl = PlaneNormal(Origin=pt_2, ZAxis=Vector(0, 0, 1))
lineload = CreateGridLineLoad(
    LoadCase=1,
    PolyLine=ln,
    Direction="z",
    Axis=0,
    Projected=False,
    ValueStart_kN_m="-5",
    ValueEnd_kN_m="-5",
    ExpansionChanged=False,
    Mode=1,
    Unit="kN/m")
mem2d = Create2DMember(Brep=srf4pt, InternalOffset=True, Preview3dSection=False, Mesh_mode="Quad dominant")
sectionmodifier = CreateSectionModifier(
    PrincipalBendingAxis=False,
    ReferencePointCentroid=False,
    Modify_type="Modify by",
    Density_unit="kg/m",
    Stress_calc="Don't calculate",
    toMode=False)
σt = CreateAnalysisTask(Solver="Static")
prop2dmodifier = Create2DPropertyModifier(Modify_type="Modify by", Density_unit="kg/m²", toMode=False)
createcombination = CreateCombinationCase(ID=0, Name="name", Description="A1")
elem1d = Create1DElement(Line=ln, Preview3dSection=False)
elem2d = Create2DElement(Mesh=mplane.Mesh, Preview3dSection=False)
elem2d_2 = Create2DElement(Mesh=mplane.Mesh, Prop2D=prop2d, Preview3dSection=False)
b6_2 = CreateBool6(x=True, xx=True, y=True, yy=True, z=True, zz=True)
nodeload = CreateNodeLoad(LoadCase=1, NodeList="all", Direction="z", Value_kN="-5", Type="NodeForce", Unit="kN")
support = CreateSupport(Point=pt_12, Plane=PlaneXY(0, 0, 0), x=False, xx=False, y=False, yy=False, z=False, zz=False)
creategridline = CreateGridLine(Curve=[crv, arc.Arc], Label=panel_2)
b6_3 = CreateBool6(x=True, xx=False, y=False, yy=True, z=True, zz=False)
section = CreateSection(Profile="STD I 1000 500 15 10", Material=material, Basic_Offset="Centroid")
elem1d_2 = Create1DElement(Line=ln, Property=section, Preview3dSection=False)
pointload = CreateGridPointLoad(LoadCase=1, Point=pt_2, Direction="z", Axis=0, Value_kN="-5", ExpansionChanged=False, Mode=1, Unit="kN")
bfs = CreateBucklingFactors()
crv_2 = Curve(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)
mem2d_2 = Create2DMember(Brep=srf4pt, Property2D=prop2d, InternalOffset=True, Preview3dSection=False, Mesh_mode="Quad dominant")
model = CreateModel(Properties=spring, ReMesh=True, Tolerance=0.01, Unit="m")
selres = SelectResult(GSAModel=open, Type="AnalysisCase", Case_ID="A1")
prop3d = Create3DProperty(Material=material)
mem3d_2 = Create3DMember(Solid=box, Prop3D=prop3d)
elem3dedit_2 = Edit3DElement(Element3D=elemfrommem._3DElements, _3DProperty=prop3d)  # -> Element3D, Number, AnalysisMesh, _3DProperty, Group, ElementType, Name, Colour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
getres = GetResults(GSAModel=open, T="C", Case="1")
mem1d = Create1DMember(
    Curve=crv_2,
    Preview3dSection=False,
    x1=False,
    x2=False,
    xx1=False,
    xx2=False,
    y1=False,
    y2=False,
    yy1=False,
    yy2=False,
    z1=False,
    z2=False,
    zz1=False,
    zz2=False)
ld = Load([areaload, lineload, pointload])
getprops = GetModelProperties(GSAModel=model)  # -> Sections, _2DProperties, _3DProperties, SpringProperties
mem1d_2 = Create1DMember(
    Curve=crv_2,
    Property=section,
    Preview3dSection=False,
    x1=False,
    x2=False,
    xx1=False,
    xx2=False,
    y1=False,
    y2=False,
    yy1=False,
    yy2=False,
    z1=False,
    z2=False,
    zz1=False,
    zz2=False)
b6_4 = Bool6([Toggle(False), Toggle(True), b6_3, b6, b6_2])
mat = Material([material_3, material_2, "1"])

# ---- group: BucklingLengthFactors
bfs_2 = BucklingFactors(bfs)

# ----
off = Offset(offset)
pb = Section([section, "STD I 1000 500 15 10", "1"])

# ---- group: Prop2d
pa = Prop2D(["400 mm", "1", prop2d])

# ---- group: Prop3d
pv = Prop3D([prop3d, material, "1"])

# ---- group: SectionModifier
pbm = SectionModifier([sectionmodifier, section])

# ----
ld_2 = Load([beamload, faceload, gravityload, nodeload])
L = List(createlist)

# ---- group: MaterialFromProp
mat_2 = Material([section, prop2d, prop3d])

# ---- group: AnalysisCase
σa_2 = AnalysisCase([σa, "name", "1"])

# ---- group: AnalysisTask
σt_2 = AnalysisTask(σt)

# ---- group: CombinationCase
σc = CombinationCase([createcombination, "name", "1"])

# ---- group: GridLine
gl = GridLine(creategridline)

# ---- group: Prop2dModifier
p2m = Property2DModifier([prop2dmodifier, prop2d])

# ----
gps = GridPlaneSurface([gridplane, gridsurface, pl])
ld_3 = Load([beamload, faceload, gravityload, nodeload, areaload, lineload, pointload])
res = Result(getres)

# ---- group: SrfFromGridLoad
srf = Surface(areaload)

# ---- group: BrepFromGridLoad
brep = Brep(areaload)

# ---- group: CrvFromGridLoad
crv_3 = Curve([areaload, lineload])

# ---- group: PtFromGridLoad
pt_13 = Point(pointload)

# ----
no = Node([pt_12, support])
model_2 = CreateModel(GSAGeometryIn_m=no, ReMesh=True, Tolerance=0.01, Unit="m")
gsa = Model(model_2)

# ---- group: Element1d
e1d = Element1D([ln, elem1d])

# ---- group: Element2d
e2d = Element2D([mplane.Mesh, elem2d])

# ---- group: Member1d
m1d = Member1D([crv_2, mem1d])

# ---- group: Member2d
m2d = Member2D([srf4pt, mem2d])

# ---- group: Member3d
m3d = Member3D([mem3d, box])

# ---- group: Element3d
e3d = Element3D(elemfrommem._3DElements)

# ----
nodecontour = ContourNodeResults(
    Result=selres,
    Scalar=10,
    Display=3,
    Mode=0,
    envelope="Absolute",
    force="kN",
    legend=True,
    legendScale=1,
    length="mm",
    moment="kN·m",
    noDec=0,
    Result_Type="Displacement",
    Component="Resolved |U|",
    slider=True,
    val=250,
    valMax=1000,
    valMin=0)  # -> P, Colours, Values_mm
stretch = Stretch(Geometry=gl, Axis=Line((0, 0, 0), (10, 10, 0)), Length=20, Rigid=False)
move = Move(Geometry=gl, Motion=Vector(0, 0, 10))  # -> Geometry, Transform

# ---- group: SpringPropertyId
int = Integer(getprops.SpringProperties)

# ---- group: GridLineTransform
gl_2 = GridLine(move.Geometry)

# ---- group: GridLineMorph
gl_3 = GridLine(stretch)

# ----
pa_2 = Prop2D(["400 mm", "1"])
pb_2 = Section(["STD I 1000 500 15 10", "1"])

# ---- group: Special List filters
getgeo = GetModelGeometry(GSAModel=gsa, NodeFilterList="1 to 5", ElementFilterList="1 to 5", MemberFilterList="1 to 5", Mode=1, Unit="m")  # -> NodesIn_m, _1DElementsIn_m, _2DElementsIn_m, _3DElementsIn_m, _1DMembersIn_m, _2DMembersIn_m, _3DMembersIn_m

# ---- group: GridPlaneSurfaceFromLoad
gps_2 = GridPlaneSurface(ld)

# ---- group: Member2dBrep
brep_2 = Brep(m2d)

# ---- group: Member3dMesh
mesh = Mesh(m3d)

# ----
pln = Plane([gps, ld])

# ---- group: ElementLine
line = Line(e1d)

# ---- group: ElementId
int_2 = Integer(e1d)

# ---- group: Elem3dMesh
mesh_2 = Mesh(elem3dedit.AnalysisMesh)

# ---- group: Mem1dCrv
crv_4 = Curve(m1d)

# ---- group: NodePoint
pt_14 = Point([no, getgeo.NodesIn_m])

# ---- group: NodeId
int_3 = Integer(no)

# ---- group: Elem2dMesh
mesh_3 = Mesh(e2d)

# ---- group: LoadCaseId
int_4 = Integer(ld_3)

# ---- group: CaseId
int_5 = Integer([σa_2, σc, res])

# ----
item = ListItem(List=gl_2, Index=0, Wrap=True)  # -> Item, Item1
item_2 = ListItem(List=gl_3, Index=0, Wrap=True)  # -> Item1, Item

# ---- group: PropId
int_6 = Integer([pb, pa, pv, mat])

# ----
move_2 = Move(Geometry=[gps, ld], Motion=Vector(0, 0, 10))  # -> Geometry, Transform
stretch_2 = Stretch(Geometry=[gps, ld], Axis=Line((0, 0, 0), (10, 10, 0)), Length=20, Rigid=False)
arc_2 = CircularArc(item.Item1)
line_2 = Line(item.Item)

# ---- group: MemberId
int_7 = Integer([m1d, m2d, m3d])

# ---- group: Prop2dFromGeo
pa_3 = Prop2D([elem2d_2, mem2d_2])

# ---- group: MaterialFromGeo
mat_3 = Material([elem1d_2, elem2d_2, elem3dedit_2.Element3D, mem1d_2, mem2d_2, mem3d_2])

# ---- group: SectionFromGeo
pb_3 = Section([elem1d_2, mem1d_2])

# ---- group: Prop3dFromGeo
pv_2 = Prop3D([elem3dedit_2.Element3D, mem3d_2])

# ----
stretch_3 = Stretch(Geometry=[no, e1d, e2d, e3d, m1d, m2d, m3d], Axis=Line((0, 0, 0), (10, 10, 0)), Length=20, Rigid=False)
move_3 = Move(Geometry=[no, e1d, e2d, e3d, m1d, m2d, m3d], Motion=Vector(0, 0, 10))  # -> Geometry, Transform

# ---- group: GridLineCrv
crv_5 = Curve([gl, line_2, arc_2])

# ---- group: LoadMorph
geo = Geometry(stretch_2)

# ---- group: LoadTransform
geo_2 = Geometry(move_2.Geometry)

# ---- group: GeoMorph
geo_3 = Geometry(stretch_3)

# ---- group: GeoTransform
geo_4 = Geometry(move_3.Geometry)

# ----
annotate_detailed = AnnotateDetailed(
    ElementMember=[elem1d_2, elem2d_2, elem3dedit_2.Element3D, mem1d_2, mem2d_2, mem3d_2],
    Colour=ColourSwatch(SwatchColor=RGB(255, 0, 0)),
    id=True,
    material=True,
    name=True,
    property=True,
    Type="TextTag 3D",
    text3d=True)  # -> Annotations, Position, Text
annotate_detailed_2 = AnnotateDetailed(
    ElementMember=[e1d, e2d, e3d, m1d, m2d, m3d],
    Size="4",
    id=True,
    material=True,
    name=True,
    property=True,
    Type="Regular Dot",
    text3d=False)  # -> Annotations, Position, Text

# ---- group: OffsetWarning
off_2 = Offset("0.25")

# ---- group: Prop2dWarning
pa_4 = Prop2D("0.25")

# ---- group: AnnoDotWithoutProps
txt = Text(annotate_detailed_2.Annotations)

# ---- group: Anno3dWithProps
txt_2 = Text(annotate_detailed.Annotations)

# ---- group: GridPlaneSurfaceError
gps_3 = GridPlaneSurface("asdf")

# ---- group: LoadError
ld_4 = Load("asdf")

# ---- group: AnalysisTaskError
σt_3 = AnalysisTask("asdf")

# ---- group: ResultError
res_2 = Result(["asdf", open])

# ---- group: GridPlaneSurfaceFromLoadError
gps_4 = GridPlaneSurface(ld_2)

# ---- group: GridLineLineError
line_3 = Line(item_2.Item1)

# ---- group: ListError
L_2 = List("456")

# ---- group: ModelError
gsa_2 = Model("456")

# ---- group: GridLineArcError
arc_3 = CircularArc(item_2.Item)

# ---- group: Bool6Error
b6_5 = Bool6("asdf")

# ---- group: MaterialError
mat_4 = Material(["asdf", pb_2, pa_2, e1d, e2d, e3d, m1d, m2d, m3d])

# ---- group: BucklingLengthFactorsError
bfs_3 = BucklingFactors("asdf")

# ---- group: OffsetError
off_3 = Offset("asdf")

# ---- group: SectionError
pb_4 = Section(["asdf", e1d, m1d])

# ---- group: Prop2dError
pa_5 = Prop2D(["asdf", e2d, m2d])

# ---- group: Prop3dError
pv_3 = Prop3D(["asdf", e3d, m3d])

# ---- group: SectionModifierError
pbm_2 = SectionModifier("asdf")

# ---- group: NodeError
no_2 = Node("asdf")

# ---- group: Element1dError
e1d_2 = Element1D("asdf")

# ---- group: Element2dError
e2d_2 = Element2D("asdf")

# ---- group: Element3dError
e3d_2 = Element3D("asdf")

# ---- group: Member1dError
m1d_2 = Member1D("asdf")

# ---- group: Member2dError
m2d_2 = Member2D("asdf")

# ---- group: Member3dError
m3d_2 = Member3D("asdf")

# ---- group: GridLineError
gl_4 = GridLine([crv, arc.Arc])

# ---- group: Prop2dModifierError
p2m_2 = Property2DModifier("asdf")
